# Grasshopper definition Alpaca4d_simply_supported_beam_example.gh (Grasshopper 1.0.7)
# plug-ins: Alpaca4d

# ----
# Material
number_slider = Slider(7830, range=0..100000)
num = Number("2.07e11")
num_2 = Number("8.076e10")
uniaxial_material_elastic = UniaxialMaterialElasticAlpaca4d(MaterialName="Steel", E=num, Eneg=num, Eta=Slider(0, range=0..1), G=num_2, V=Slider(0.3, range=0..1), Rho=number_slider)

# ----
# Alpaca4d example file
# Cantilever beam
# Input
beam_length_m = Slider(5, range=0..100)
line_load_kn_m = Slider(6, range=0..1000)
segments = Slider(50, range=0..100)

# ----
# Section
# Example: HEB600
flange_thickness_m = Slider(0.03, range=0..0.1)
web_thickness_m = Slider(0.0155, range=0..0.1)
flange_width_m = Slider(0.3, range=0..1)
height_m = Slider(0.6, range=0..1)
bottomflange_m = Slider(0.02, range=0..0.1)
topflange_m = Slider(0.02, range=0..0.1)
height_m_2 = Slider(0.5, range=0..1)
width_m = Slider(0.3, range=0..1)
diameter_m = Slider(0.3, range=0..1)
thickness_m = Slider(0.01, range=0..1)
web_m = Slider(0.02, range=0..0.1)
height_m_3 = Slider(0.3, range=0..1)
width_m_2 = Slider(0.3, range=0..1)
section = ValueList({"Rectangular": 0, "Circular": 1, "Hollow Rectangle": 2, "I profile": 3}, selected="Rectangular")
i_section = ISectionAlpaca4d(
    SectionName="I profile",
    Height=height_m,
    TopFlangeWidth=flange_width_m,
    TopFlangeThickness=flange_thickness_m,
    BottomFlangeWidth=flange_width_m,
    BottomFlangeThickness=flange_thickness_m,
    Web=web_thickness_m,
    Material=uniaxial_material_elastic)
rectanglehollowcs = RectangleHollowAlpaca4d(
    SectionName="Hollow Rectangle",
    Width=width_m,
    Height=height_m_2,
    Web=web_m,
    TopFlange=topflange_m,
    BottomFlange=bottomflange_m,
    Material=uniaxial_material_elastic)
circlecs = CircleCSAlpaca4d(SectionName="Circular section", Diameter=diameter_m, Thickness=thickness_m, Material=uniaxial_material_elastic)
rectanglecs = RectangleCSAlpaca4d(SectionName="Rectangular section", Width=width_m_2, Height=height_m_3, Material=uniaxial_material_elastic)

# ----
# Create beam
panel = Panel("{0,0,0}")
X = UnitX(Factor=beam_length_m)
pt = Point(panel)
move = Move(Geometry=pt, Motion=X)  # -> Geometry, Transform
ln = Line(StartPoint=pt, EndPoint=move.Geometry)

# ----
# Dimensions
xz = XZPlane(Origin=Point(0, 0, 0))
end = EndPoints(Curve=ln)  # -> Start, End
aligndim = AlignedDimension(
    Plane=xz,
    PointA=end.Start,
    PointB=end.End,
    Offset=expr("x", Slider(1, range=0..10)),
    Text="{0:0.0}",
    Size=Slider(0.4, range=0..10))
filter = StreamFilter(Gate=section, Stream0=rectanglecs, Stream1=circlecs, Stream2=rectanglehollowcs, Stream3=i_section)

# ----
# Mesh line
line = Line(ln)
int = Integer(segments)
data = Data(filter)
divide = DivideCurve(Curve=line, Count=int, Kinks=False)  # -> Points, Tangents, Parameters
shatter = Shatter(Curve=line, Parameters=divide.Parameters)
Y = UnitY(Factor="1")
force_beam_column = ForceBeamColumnAlpaca4d(Line=shatter, Section=data, ZAxis=Y)

# ----
# Supports
end_2 = EndPoints(Curve=ln)  # -> Start, End
pt_2 = Point([end_2.Start, end_2.End])
tx = BooleanToggle(True)
ty = BooleanToggle(True)
tz = BooleanToggle(True)
rx = BooleanToggle(True)
ry = BooleanToggle(False)
rz = BooleanToggle(True)
support = SupportAlpaca4d(Point=pt_2, Tx=tx, Ty=ty, Tz=tz, Rx=rx, Ry=ry, RZ=rz)

# ----
# Load
num_3 = Number(line_load_kn_m)
multiplication = Multiplication(A=num_3, _1e3=1000)
Z = UnitZ(Factor=expr("-x", multiplication))
linearload = LinearLoadAlpaca4d(BeamElement=force_beam_column, Force=Z)

# ----
# Assemble
assemble_model = AssembleModelAlpaca4d(Element=force_beam_column, Support=support, Load=linearload, Tolerance=0.01)  # -> AlpacaModel, Mass
# Settings
analysissettings = AnalysisSettingsAlpaca4d()
# Analysis
ra = RunAnalysisAlpaca4d(AlpacaModel=assemble_model.AlpacaModel, Settings=analysissettings)  # -> Log, AlpacaModel

# ----
# Beam Forces
toggle = BooleanToggle(False)
bf = BeamForcesAlpaca4d(AlpacaModel=ra.AlpacaModel, History=toggle, Step="0")  # -> N, Vy, Vz, Mx, My, Mz
avr = Average(Input=bf.Vy)  # -> flatten(ArithmeticMean)
avr_2 = Average(Input=bf.Mz)  # -> flatten(ArithmeticMean)

# ----
# Nodal Displacements
toggle_2 = BooleanToggle(False)
nd = NodalDisplacementsAlpaca4d(AlpacaModel=ra.AlpacaModel, History=toggle_2, Step="0")  # -> Displacement, Rotation, port, Velocity, Acceleration
devec = DeconstructVector(Vector=nd.Displacement)  # -> XComponent, YComponent, ZComponent

# ----
# Deformed model
deformed_model_view = DeformedModelViewAlpaca4d(AlpacaModel=ra.AlpacaModel, Step=0, Scale=Slider(1000, range=0..1000))  # -> Line, Mesh, Brick
int_2 = Integer(avr_2)
int_3 = Integer(avr)
# Moment diagram
graph = QuickGraph(int_2, SortOrder=0)
# Displacement diagram
graph_2 = QuickGraph(devec.ZComponent, SortOrder=0)
# Shear diagram
graph_3 = QuickGraph(int_3, SortOrder=0)

# ----
# Displacement comparison
expression = Expression(w=width_m_2, h=height_m_3, Expression="1/12*w*h^3")
load_kn_m = Panel(line_load_kn_m)
length_m = Panel(beam_length_m)
e_mod_kn_m_2 = Panel(num)
i_m_4 = Panel(expression)
multiplication_2 = Multiplication(KN=load_kn_m, _1e3=1000)
# For now only rectangular section validation
sort = SortList(Keys=devec.ZComponent)  # -> Keys, ValuesA
expression_2 = Expression(q=multiplication_2, l=length_m, E=e_mod_kn_m_2, I=i_m_4, Expression="(5*q*l^4)/(384*E*I)")
item = ListItem(List=sort.Keys, Index=0, Wrap=True)
abs = Absolute(Value=item)
num_4 = Number(expr("round(x*1000,3)", expression_2))
num_5 = Number(expr("round(x*1000,3)", abs))
fea_displacement_mm = Panel(num_5)
sbe_displacement_mm = Panel(num_4)
expression_3 = Expression(x=sbe_displacement_mm, y=fea_displacement_mm, Expression="abs(((x-y)/y)*100)")
deviation = Panel(expression_3)

# ----
# Bending moment comparison
load_kn_m_2 = Panel(line_load_kn_m)
length_m_2 = Panel(beam_length_m)
expression_4 = Expression(q=load_kn_m_2, l=length_m_2, Expression="(1/8) * q * l^2 ")
sort_2 = SortList(Keys=avr_2)  # -> Keys, ValuesA
item_2 = ListItem(List=sort_2.Keys, Index=0, Wrap=True)
num_6 = Number(expr("round(x,4)", expression_4))
num_7 = Number(expr("round(-x/1000,2)", item_2))
sbe_moment_knm = Panel(num_6)
fea_moment_knm = Panel(num_7)
expression_5 = Expression(x=sbe_moment_knm, y=fea_moment_knm, Expression="abs(((x-y)/y)*100)")
deviation_2 = Panel(expression_5)

# ----
# Shear force comparison
load_kn_m_3 = Panel(line_load_kn_m)
length_m_3 = Panel(beam_length_m)
sort_3 = SortList(Keys=avr)  # -> Keys, ValuesA
multiplication_3 = Multiplication(KN=load_kn_m_3, _1e3=1000)
item_3 = ListItem(List=sort_3.Keys, Index=0, Wrap=True)
expression_6 = Expression(q=multiplication_3, l=length_m_3, Expression="0.5 * q * l")
num_8 = Number(expr("round(-x/1000,4)", item_3))
num_9 = Number(expr("round(x/1000,4)", expression_6))
sbe_moment_kn = Panel(num_9)
fea_moment_kn = Panel(num_8)
expression_7 = Expression(x=sbe_moment_kn, y=fea_moment_kn, Expression="abs(((x-y)/y)*100)")
deviation_3 = Panel(expression_7)
