# Grasshopper definition deconstruct.gh (Grasshopper 1.0.7)
# plug-ins: Alpaca4d

n_mm2 = Panel("210000")
uniaxial_material_elastic = UniaxialMaterialElasticAlpaca4d(E=n_mm2, V="0.30", Rho="0.00000785")
mm = Panel("300")
mm_2 = Panel("4")
pt = Point(Point(0, 0, 0))
circlecs = CircleCSAlpaca4d(Diameter=mm, Thickness=mm_2, Material=uniaxial_material_elastic)
line = LineSDL(Start=pt, Direction=Vector(0, 0, 1), Length=1)
force_beam_column = ForceBeamColumnAlpaca4d(Line=line, Section=circlecs)
deconstruct = DeconstructAlpaca4d(Object=force_beam_column)  # -> Object_Class, Curve, Section, GeomTransf, BeamIntegration, LocalZAxis, Type, Id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
deconstruct_2 = DeconstructAlpaca4d(Object=deconstruct.Section)  # -> Object_Class, Id, Material, SectionName, Diameter, Thickness, Area, AlphaY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
deconstruct_3 = DeconstructAlpaca4d(Object=deconstruct_2.Material)  # -> Object_Class, Id, MatName, E, Eneg, Eta, G, Nu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
