# Grasshopper definition 211130-PA-Crystallon-demo-pressure.gh (Grasshopper 1.0.7)
# plug-ins: Weaverbird

pressure = FilePath("C:\Users\porte\Desktop\200715\pressure-example.csv")

# ---- group: TIME
number_slider = Slider(49, range=0..99)

# ----
panel = Panel(pressure)
mesh = Mesh(<mesh referenced from the Rhino model>)
pt = Point([<point referenced from the Rhino model> x99])
demesh = DeconstructMesh(Mesh=mesh)  # -> Vertices, Faces, Colours, Normals
meshcp = MeshClosestPoint(Point=pt, Mesh=mesh)  # -> Point, Index, Parameter
file = ReadFile(File="C:\Users\porte\Desktop\200715\pressure-example.csv", PerLineParse=True)
shift = ShiftList(List=file, Shift=1, Wrap=Toggle(False))
split = TextSplit(Text=shift, Separators=",")  # -> simplify(Result)
flip = FlipMatrix(Data=split)
bnd = Bounds(Numbers=flatten(flip))
remap = RemapNumbers(Value=flip, Source=bnd, Target=Domain(0, 1))  # -> Mapped, Clipped
gradient = Gradient(LowerLimit=0, UpperLimit=1, Parameter=remap.Mapped, stops=[0: RGB(0, 128, 0), 0.5: RGB(255, 255, 0), 1: RGB(255, 0, 0)])
cp = ClosestPoint(Point=demesh.Vertices, Cloud=meshcp.Point)  # -> ClosestPoint, CPIndex, Distance
item = ListItem(List=gradient, Index=number_slider, Wrap=True)  # -> flatten(Item)
item_2 = ListItem(List=item, Index=cp.CPIndex, Wrap=True)
conmesh = ConstructMesh(Vertices=demesh.Vertices, Faces=demesh.Faces, Colours=item_2)
preview = CustomPreview(Geometry=meshcp.Point, Material=item)
wbsplitquads = WeaverbirdsConstantQuadsSplitSubdivision(MeshCurves=conmesh, Level="3", SmoothNakedEdges=1)
