# Grasshopper definition Multi_Storey_Building.gh (Grasshopper 1.0.7)
# plug-ins: Kangaroo2 Components, MeshEdit Components

number_floor = Slider(5, range=2..15)
series = Series(Start=0, Step="5", Count=number_floor)
rectangle = Rectangle(Plane=PlaneXY(0, 0, 0), XSize="40", YSize="20", Radius=0)  # -> Rectangle, Length
Z = UnitZ(Factor=series)
srf = Surface(simplify(rectangle.Rectangle))
span_v = Slider(5, range=1..6)
span_u = Slider(5, range=1..6)

# ---- group: Element
data = Data(0)
data_2 = Data(0)

# ---- group: Load
# instagram:    Alpaca4d
# facebook:     Alpaca4d
# mail:             alpaca4d@gmail.com
# Example Developed by Marco Pellegrino
data_3 = Data(0)
data_4 = Data(0)

# ----
num = Number("40")
num_2 = Number("20")

# ---- group: Cross-Section
data_5 = Data(0)
data_6 = Data(0)

# ---- group: Support
data_7 = Data(0)
data_8 = Data(0)

# ----
division = Division(A=num, B=span_u)
division_2 = Division(A=num_2, B=span_v)

# ---- group: Material
data_9 = Data(0)
data_10 = Data(0)

# ---- group: Constraint
data_11 = Data(0)
data_12 = Data(0)

# ----
mplane = MeshPlane(Boundary=rectangle.Rectangle, WidthCount=division, HeightCount=division_2)  # -> Mesh, Area
medges = MeshEdges(Mesh=mplane.Mesh)  # -> NakedEdges, InteriorEdges, NonManifoldEdges
nv = NakedVertices(Mesh=mplane.Mesh)  # -> ClothedIndex, NakedIndex, ClothedPts, NakedPts
join = JoinCurves(Curves=medges.NakedEdges, Preserve=False)
explode = Explode(Curve=join, Recursive=True)  # -> Segments, Vertices
graft = GraftTree(Tree=nv.ClothedPts, IncludeEmptyLists=True, IncludeNullItems=True)
graft_2 = GraftTree(Tree=nv.NakedPts, IncludeEmptyLists=True, IncludeNullItems=True)
graft_3 = GraftTree(Tree=explode.Segments, IncludeEmptyLists=True, IncludeNullItems=True)
graft_4 = GraftTree(Tree=medges.InteriorEdges, IncludeEmptyLists=True, IncludeNullItems=True)
vec = Vector(Z)
vec_2 = Vector(Z)
vec_3 = Vector(Z)
vec_4 = Vector(Z)

panel = Panel("""10
22""")
faceb = FaceBoundaries(Mesh=mplane.Mesh)
item = ListItem(List=faceb, Index=panel, Wrap=True)
graft_5 = GraftTree(Tree=item, IncludeEmptyLists=True, IncludeNullItems=True)
vec_5 = Vector(Z)
move = Move(Geometry=graft_5, Motion=vec_5)  # -> Geometry, Transform
shift = ShiftList(List=move.Geometry, Shift=1, Wrap=invert(True))
merge = Merge(Data1=simplify(graft(move.Geometry)), Data2=simplify(graft(shift)))
loft = Loft(Curves=merge, Options={Adjust=False, Closed=False, LoftEnds=0, LoftSimp=0, LoftType=0, Rebuild=10, Refit=0.01})
clean = CleanTree(RemoveNulls=True, RemoveInvalid=True, RemoveEmpty=invert(False), Tree=loft)
debrep = DeconstructBrep(Brep=clean)  # -> simplify(Faces), Edges, Vertices

move_2 = Move(Geometry=graft, Motion=vec_2)  # -> Geometry, Transform
move_3 = Move(Geometry=graft_2, Motion=vec_3)  # -> Geometry, Transform
move_4 = Move(Geometry=graft_3, Motion=vec_4)  # -> Geometry, Transform
move_5 = Move(Geometry=graft_4, Motion=vec)  # -> Geometry, Transform
crv = Curve(simplify(move_4.Geometry))
pline = PolyLine(Vertices=move_2.Geometry, Closed=False)
pline_2 = PolyLine(Vertices=move_3.Geometry, Closed=False)
crv_2 = Curve(simplify(move_5.Geometry))
flip = FlipMatrix(Data=crv)
flip_2 = FlipMatrix(Data=crv_2)
join_2 = JoinCurves(Curves=flip_2, Preserve=invert(False))
join_3 = JoinCurves(Curves=flip, Preserve=False)
split = SplitTree(Data=simplify(join_3), Masks=flatten("{>0}"))  # -> Positive, Negative
split_2 = SplitTree(Data=simplify(join_2), Masks=flatten("{>0}"))  # -> Positive, Negative
external_colum = Curve(pline_2)
internal_colum = Curve(pline)
internal_beam = Curve(split_2.Positive)
outer_beam = Curve(split.Positive)

branch = TreeBranch(Tree=crv, Path=[Slider(0, range=0..17), Slider(17, range=0..17)], MaintainPaths=True)
crv_3 = Curve(branch)
shift_2 = ShiftList(List=crv_3, Shift=1, Wrap=invert(True))
merge_2 = Merge(Data1=simplify(graft(crv_3)), Data2=simplify(graft(shift_2)))
loft_2 = Loft(Curves=merge_2, Options={Adjust=False, Closed=False, LoftEnds=0, LoftSimp=0, LoftType=0, Rebuild=10, Refit=0.01})
clean_2 = CleanTree(RemoveNulls=True, RemoveInvalid=True, RemoveEmpty=invert(False), Tree=loft_2)
debrep_2 = DeconstructBrep(Brep=clean_2)  # -> simplify(Faces), Edges, Vertices
item_2 = ListItem(List=debrep_2.Vertices, Index=0, Wrap=True)  # -> Item, Item1, Item2, Item3
ln = Line(StartPoint=item_2.Item, EndPoint=item_2.Item2)
ln_2 = Line(StartPoint=item_2.Item1, EndPoint=item_2.Item3)

graft_6 = GraftTree(Tree=debrep.Faces, IncludeEmptyLists=True, IncludeNullItems=True)
dim = Dimensions(Surface=graft_6)  # -> UDimension, VDimension
num_3 = Number(dim.UDimension)
num_4 = Number(dim.VDimension)
division_3 = Division(A=num_3, B=Slider(1, range=0.1..1))
division_4 = Division(A=num_4, B=Slider(1, range=0.1..1))
divide = DivideDomain²(Domain=graft_6, UCount=division_3, VCount=division_4)
subsrf = Isotrim(Surface=graft_6, Domain=divide)  # -> simplify(Surface)
smesh = SimpleMesh(Brep=subsrf)  # -> simplify(Mesh)

mjoin = MeshJoin(Meshes=flatten(smesh))
weldvertices = MeshWeldVertices(Mesh=mjoin, Tolerance=0.01)  # -> RuntimeMessage, Mesh
