# Grasshopper definition connection design.gh (Grasshopper 1.0.7)
# plug-ins: Karamba3D, ONLMapGraph, Kangaroo2 Components, Weaverbird, EleFront, treesloth01, Human

box = DomainBox(Base=PlaneXY(0, 0, 0), X=Slider(11, range=1..20), Y=Slider(3, range=1..20), Z=Slider(3, range=1..20))
# Geometric Steps: - Draw two points
# - Draw a line
# Mechanical Steps: - Line to Beam
# - Boundary Conditions (supports)
# - Loads
# - Assemble Model
# - Run Analyses
# - Read Results
pop3d = Populate3D(Region=box, Count=100, Seed=1)
voronoi³ = Voronoi3D(Points=pop3d, Box=box)  # -> Cells, Boundary
edges = BrepEdges(Brep=voronoi³.Cells)  # -> Naked, flatten(Interior), NonManifold
rdlines = RemoveDuplicateLinesKaramba3D(Line=edges.Interior, LimitDistance=0.005)  # -> OutLine, Info, Indexes
debrep = DeconstructBrep(Brep=box)  # -> Faces, Edges, Vertices
explode = Explode(Curve=rdlines.OutLine, Recursive=True)  # -> Segments, flatten(Vertices)
rdpoints = RemoveDuplicatePointsKaramba3D(Point=explode.Vertices, LimitDistance=0.005)  # -> OutPoint, Info, Indexes
item = ListItem(List=debrep.Faces, Index=Slider(1, range=0..5), Wrap=True)
midpt = CurveMiddle(Curve=rdlines.OutLine)
pull = PullPoint(Point=rdpoints.OutPoint, Geometry=item, ClosestOnly=True)  # -> ClosestPoint, Distance
pull_2 = PullPoint(Point=midpt, Geometry=item, ClosestOnly=True)  # -> ClosestPoint, Distance
smaller = SmallerThan(FirstNumber=pull.Distance, SecondNumber="0.01")  # -> SmallerThan, OrEqualTo
smaller_2 = SmallerThan(FirstNumber=pull_2.Distance, SecondNumber="0.01")  # -> SmallerThan, OrEqualTo
cull = CullPattern(List=rdpoints.OutPoint, CullPattern=smaller.SmallerThan)
cull_2 = CullPattern(List=rdlines.OutLine, CullPattern=invert(smaller_2.SmallerThan))

# ---- group: create family
matselect = MaterialSelectionKaramba3D(menu=[dropdown(5), dropdown(1)])
dedomain = DeconstructDomain(Domain="20 to 100")  # -> Start, End
subtraction = Subtraction(A=dedomain.End, B=dedomain.Start)
division = Division(A=subtraction, B="10")
range = Range(Domain="20 to 100", Steps=division)
cross_section = CrossSectionKaramba3D(
    FamilyNameOfCrossSection="DefaultCroSec",
    Material=matselect,
    Height_cm=range,
    UpperFlangeWidth_cm="5",
    LowerFlangeWidth_cm="5",
    mode="Trapezoid")

# ----
dedomain_2 = DeconstructDomain(Domain="2 to 20")  # -> Start, End
subtraction_2 = Subtraction(A=dedomain_2.End, B=dedomain_2.Start)
division_2 = Division(A=subtraction_2, B="2")
range_2 = Range(Domain="2 to 20", Steps=division_2)
number_slider = Slider(1, range=1..20)
cross_section_2 = CrossSectionKaramba3D(
    FamilyNameOfCrossSection="DefaultCroSec",
    Material=matselect,
    Diameter_cm=range_2,
    WallThickness_cm="1",
    mode="Circular Hollow")
support_points = Point(cull)
neg = Negative(Value=Slider(0.18, range=0.01..1))
item_2 = ListItem(List=cross_section_2, Index=0, Wrap=True)
vec = VectorXYZ(XComponent=0, YComponent=0, ZComponent=neg)  # -> Vector, Length

crv = Curve(cull_2)
crosec = CrossSectionKaramba3D(item_2)
linetobeam = LineToBeamKaramba3D(
    Line=crv,
    Identifier="Cell Beam",
    CrossSection=crosec,
    New=True,
    Remove=True,
    LimitDistance_m=0.005,
    Bending=True,
    SetBucklingLength=True,
    ToPolylineMaxAngle=0.03,
    ToPolylineTolerance=0.01,
    ToPolylineMinEdgeLength=0.25)  # -> Element, Points, Info

data = Data("Cell Beam")
supp = SupportKaramba3D(PosInd=support_points, menu=[buttons(on, on, on, on, on, on)])
loads = LoadsKaramba3D(Vector=Vector(0, 0, -1), LCase="0", mode="Gravity")
beam_loads = BeamLoadsKaramba3D(BeamIdentifier=data, LoadCase="1", ForceVector=vec.Vector, TStart=0, TEnd=1, mode="Block", menu=[buttons(off, on, off)])
panel_2 = Panel("1 kN = 100 kg")
panel_3 = Panel("F = m * a")
element = ElementKaramba3D(flatten(linetobeam.Element))
support = SupportKaramba3D(flatten(supp))
load = LoadKaramba3D(flatten([loads, beam_loads]))
panel_4 = Panel("0.1")
assemble = AssembleModelKaramba3D(Elem=element, Support=support, Load=load, LimitDistance_m=0.005)  # -> Model, Info, Mass_kg, CenterOfGravity, LoadCaseNames
crosec_2 = CrossSectionKaramba3D(cross_section_2)
opticrosec = OptimizeCrossSectionKaramba3D(
    Model=assemble.Model,
    CrossSections=crosec_2,
    MaximumUtilization=1,
    UltimateLimitStateIterations=5,
    DisplacementIterations=5,
    NumberOfSamplePoints=3,
    ElasticDesign=True,
    GammaM0=1,
    GammaM1=1.1,
    SwayFrame=True)  # -> ModelWithOptimizedCrossSections, Info, Mass_kg, MaximumDisplacement_cm, ElasticEnergyChange_kNm
panel_5 = Panel(opticrosec.MaximumDisplacement_cm)
clr = ColorsAlpaca4d(gradIndex=Slider(11, range=0..12))  # -> colors; inputs gradIndex: Int32
#   port colors: A series of colors to be plugged into the "Ladybug_Legend Parameters" component.
# ---------- clr: Python ----------
"""
Preset of gradient colors perfect for Data Visualisation
    Inputs:
        gradIndex: An index refering to one of the following possible gradients:
            0 - Orignal Ladybug
            1 - Nuanced Ladybug
            2 - Multi-colored Ladybug
            3 - Ecotect
            4 - Thermal Comfort Percentage
            5 - Thermal Comfort Colors
            6 - Shade Benefit/Harm
            7 - Shade Harm
            8 - Shade Benefit
            9 - CFD Colors 1
            10 - Radiation Benefit
            11 - Gsa10 Colour
            12 - Gsa9 Colour
    Returns:
        customColors: A series of colors.
"""

ghenv.Component.Name = "Colors (Alpaca4d)"
ghenv.Component.NickName = 'CLR'
ghenv.Component.Message = 'Colors (Alpaca4d)'

import scriptcontext as sc
import Grasshopper.Kernel as gh
import System

gradientLibrary = {
        0: [System.Drawing.Color.FromArgb(75, 107, 169), System.Drawing.Color.FromArgb(115, 147, 202), System.Drawing.Color.FromArgb(170, 200, 247), System.Drawing.Color.FromArgb(193, 213, 208), System.Drawing.Color.FromArgb(245, 239, 103), System.Drawing.Color.FromArgb(252, 230, 74), System.Drawing.Color.FromArgb(239, 156, 21), System.Drawing.Color.FromArgb(234, 123, 0), System.Drawing.Color.FromArgb(234, 74, 0), System.Drawing.Color.FromArgb(234, 38, 0)],
        1: [System.Drawing.Color.FromArgb(49,54,149), System.Drawing.Color.FromArgb(69,117,180), System.Drawing.Color.FromArgb(116,173,209), System.Drawing.Color.FromArgb(171,217,233), System.Drawing.Color.FromArgb(224,243,248), System.Drawing.Color.FromArgb(255,255,191), System.Drawing.Color.FromArgb(254,224,144), System.Drawing.Color.FromArgb(253,174,97), System.Drawing.Color.FromArgb(244,109,67), System.Drawing.Color.FromArgb(215,48,39), System.Drawing.Color.FromArgb(165,0,38)],
        2: [System.Drawing.Color.FromArgb(4,25,145), System.Drawing.Color.FromArgb(7,48,224), System.Drawing.Color.FromArgb(7,88,255), System.Drawing.Color.FromArgb(1,232,255), System.Drawing.Color.FromArgb(97,246,156), System.Drawing.Color.FromArgb(166,249,86), System.Drawing.Color.FromArgb(254,244,1), System.Drawing.Color.FromArgb(255,121,0), System.Drawing.Color.FromArgb(239,39,0), System.Drawing.Color.FromArgb(138,17,0)],
        3: [System.Drawing.Color.FromArgb(0,0,255), System.Drawing.Color.FromArgb(53,0,202), System.Drawing.Color.FromArgb(107,0,148), System.Drawing.Color.FromArgb(160,0,95), System.Drawing.Color.FromArgb(214,0,41), System.Drawing.Color.FromArgb(255,12,0), System.Drawing.Color.FromArgb(255,66,0), System.Drawing.Color.FromArgb(255,119,0), System.Drawing.Color.FromArgb(255,173,0), System.Drawing.Color.FromArgb(255,226,0), System.Drawing.Color.FromArgb(255,255,0)],
        4: [System.Drawing.Color.FromArgb(0,0,0), System.Drawing.Color.FromArgb(110,0,153), System.Drawing.Color.FromArgb(255,0,0), System.Drawing.Color.FromArgb(255,255,102), System.Drawing.Color.FromArgb(255,255,255)],
        5: [System.Drawing.Color.FromArgb(0,136,255), System.Drawing.Color.FromArgb(200,225,255), System.Drawing.Color.FromArgb(255,255,255), System.Drawing.Color.FromArgb(255,230,230), System.Drawing.Color.FromArgb(255,0,0)],
        6: [System.Drawing.Color.FromArgb(5,48,97), System.Drawing.Color.FromArgb(33,102,172), System.Drawing.Color.FromArgb(67,147,195), System.Drawing.Color.FromArgb(146,197,222), System.Drawing.Color.FromArgb(209,229,240), System.Drawing.Color.FromArgb(255,255,255), System.Drawing.Color.FromArgb(253,219,199), System.Drawing.Color.FromArgb(244,165,130), System.Drawing.Color.FromArgb(214,96,77), System.Drawing.Color.FromArgb(178,24,43), System.Drawing.Color.FromArgb(103,0,31)],
        7: [System.Drawing.Color.FromArgb(255,255,255), System.Drawing.Color.FromArgb(253,219,199), System.Drawing.Color.FromArgb(244,165,130), System.Drawing.Color.FromArgb(214,96,77), System.Drawing.Color.FromArgb(178,24,43), System.Drawing.Color.FromArgb(103,0,31)],
        8: [System.Drawing.Color.FromArgb(255,255,255), System.Drawing.Color.FromArgb(209,229,240), System.Drawing.Color.FromArgb(146,197,222), System.Drawing.Color.FromArgb(67,147,195), System.Drawing.Color.FromArgb(33,102,172), System.Drawing.Color.FromArgb(5,48,97)],
        9: [System.Drawing.Color.FromArgb(0,16,120), System.Drawing.Color.FromArgb(38,70,160), System.Drawing.Color.FromArgb(5,180,222), System.Drawing.Color.FromArgb(16,180,109), System.Drawing.Color.FromArgb(59,183,35), System.Drawing.Color.FromArgb(143,209,19), System.Drawing.Color.FromArgb(228,215,29), System.Drawing.Color.FromArgb(246,147,17), System.Drawing.Color.FromArgb(243,74,0), System.Drawing.Color.FromArgb(255,0,0)],
        10: [System.Drawing.Color.FromArgb(0,191,48), System.Drawing.Color.FromArgb(255,238,184), System.Drawing.Color.FromArgb(255,0,0)],
        11: [System.Drawing.Color.FromArgb(204,0,71), System.Drawing.Color.FromArgb(255,182,71), System.Drawing.Color.FromArgb(206,255,115), System.Drawing.Color.FromArgb(26,180, 214),System.Drawing.Color.FromArgb(0,0,207)],
        12: [System.Drawing.Color.FromArgb(255, 51, 51), System.Drawing.Color.FromArgb(255, 170, 51), System.Drawing.Color.FromArgb(255, 255, 51), System.Drawing.Color.FromArgb(170, 255, 125), System.Drawing.Color.FromArgb(51, 255, 231), System.Drawing.Color.FromArgb(51, 170, 255), System.Drawing.Color.FromArgb(51,51, 255)]}
colors = gradientLibrary[gradIndex]
# ---------- end clr ----------
merge = Merge(
    Data1=ColourSwatch(SwatchColor=RGB(0, 255, 255)),
    Data2=ColourSwatch(SwatchColor=RGB(255, 0, 0)),
    Data3=ColourSwatch(SwatchColor=RGB(255, 255, 255)),
    Data4=ColourSwatch(SwatchColor=RGB(4, 0, 255)))
modelview = ModelViewKaramba3D(Model=opticrosec.ModelWithOptimizedCrossSections, ResultFactors=1, ResultCase=-1, Colors=clr)  # -> Model, DeformedMesh, DeformedAxes, DeformedModel
panel_6 = Panel("""Local Axis
RGB = XYZ""")
model = ModelKaramba3D(modelview.Model)
disassemble = DisassembleModelKaramba3D(Model=model)  # -> Model, Point, Beam, Shell, Support, Load, Line, Mesh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
lng = ListLength(List=disassemble.Point)
crv_2 = Curve(disassemble.Line)
series = Series(Start=0, Step=1, Count=lng)
textdot = DefineTextDot(Text=series, Location=disassemble.Point, Font="Arial", Size=14)
beamview = BeamViewKaramba3D(Model=modelview.Model)  # -> Model, MeshesOfRenderedBeams, DeformedBeamAxes, LegendColors, LegendTags
panel_7 = Panel("""40
41
44
42
43
45
46
48""")
utilization = UtilizationOfElementsKaramba3D(
    AnalyzedModel=modelview.Model,
    NumberOfSamplePoints=3,
    ElasticDesign=True,
    GammaM0=1,
    GammaM1=1.1,
    SwayFrame=True,
    WithDetails=False,
    mode="Beams")  # -> AnalyzedModel, Utilization, SigMax_kN_cm2, SigMin_kN_cm2, TauMax_kN_cm2, UtilN, UtilVy, UtilVz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
# Point where to extract
# the forces
panel_8 = Panel("44")
item_3 = ListItem(List=disassemble.Point, Index=panel_8, Wrap=True)
legend = Legend(Colour=beamview.LegendColors, Tags=beamview.LegendTags, LegendType=1)
custgraph = CustomGraph(Cs=disassemble.Line)  # -> G, As, Ns
bnd = Bounds(Numbers=utilization.Utilization)
pt = Point(item_3)
panel_9 = Panel(bnd)
findnode = FindNode(MarshallingSignalParameter=custgraph.G, Ps=pt)

data_2 = Data(utilization.Utilization)
data_3 = Data(clr)
lgnd = LegendAlpaca4d(Title="Utilisation", Data=data_2, Colors=data_3, Pos=Slider(2, range=0..2))  # inputs Data: list, Colors: list, Pos: Int32
# ---------- lgnd: Python ----------
"""Visualise a legend on screen
    Inputs:
        Title:
        Data:
        Colors:
        Pos:
        Scale:
    Output:
        """





from ghpythonlib.componentbase import executingcomponent as component
import Rhino as rc
import System


ghenv.Component.Name = "Legend (Alpaca4d)"
ghenv.Component.NickName = 'LGND'
ghenv.Component.Message = 'Legend (Alpaca4d)'

class MyComponent(component):

    def RunScript(self,Title,Data,Colors,Pos,Scale):
        # Assign input variables
        
        self.title = Title
        self.col = Colors
        self.scale = Scale
        self.data = Data
        
        
        self.pos = 2 if Pos is None else Pos
        
        RhinoDocument = rc.RhinoDoc.ActiveDoc
        self.active_view = RhinoDocument.Views.ActiveView

        self.black = System.Drawing.Color.Black
        
        if not self.scale:
            self.scale = 1.5
        
        if self.data:
            self.min_number = float(min(self.data))
            self.max_number = float(max(self.data))
        else:
            self.min_number = -1.0
            self.max_number = 1.0
        
        if not self.col:
            self.col = [System.Drawing.Color.FromArgb(255, 51, 51), System.Drawing.Color.FromArgb(255, 170, 51), System.Drawing.Color.FromArgb(255, 255, 51), System.Drawing.Color.FromArgb(170, 255, 125), System.Drawing.Color.FromArgb(51, 255, 231), System.Drawing.Color.FromArgb(51, 170, 255), System.Drawing.Color.FromArgb(51,51, 255)]
        
        
        self.diff = self.max_number - self.min_number
        
        self.range = len(self.col) + 1



    def DrawViewportWires(self,arg):
        
        
        width = self.active_view.Size.Width
        height = self.active_view.Size.Height
        
        anchor_y = height * 0.075
        
        
        if self.pos == 0:
            anchor_x = width * 0.025
        elif self.pos == 1:
            anchor_x = width * (1- 0.125)
        elif self.pos == 2:
            anchor_x = width * 0.5
            anchor_y = height * (1 - 0.125)
        
        
        
        
        
        rect_x = 20 * self.scale
        rect_y = 20 * self.scale
        
        txt_height = rect_y * 0.6
        title_height = rect_y * 0.9
        
        
        
        # Vertical Gradient
        if self.pos == 0 or self.pos == 1:
        
        # Title
            pt = rc.Geometry.Point2d(anchor_x, anchor_y - 3/(1.6) * txt_height)
            arg.Display.Draw2dText(self.title ,self.black,pt,False,title_height,"Arial")
        
            for i,col in enumerate(self.col):
                
                
                # Rectangle is drawn in front of mesh
                rec2d = System.Drawing.Rectangle(anchor_x,anchor_y + i * rect_y, rect_x,rect_y)
                arg.Display.Draw2dRectangle(rec2d,self.black,3,col)


                value = self.diff * i/self.range + self.min_number
                value = "{:.1f}".format(value)
                
                # Text is drawn in front of mesh
                pt = rc.Geometry.Point2d(anchor_x + 1.5 * rect_x, anchor_y - 1/(1.6*2) * txt_height + i * rect_y)
                
                arg.Display.Draw2dText(value,self.black,pt,False,txt_height,"Arial")
            
            i += 1
            pt = rc.Geometry.Point2d(anchor_x + 1.5 * rect_x, anchor_y - 1/(1.6*2) * txt_height + i * rect_y)
            value = "{:.1f}".format(self.max_number)
            arg.Display.Draw2dText(value,self.black,pt,False,txt_height,"Arial")

        # Horizontal Gradient
        if self.pos == 2:
        
        # Title
            pt = rc.Geometry.Point2d(anchor_x, anchor_y - 3/(1.6) * txt_height)
            arg.Display.Draw2dText(self.title,self.black,pt,False,title_height,"Arial")
            
            
            for i,col in enumerate(self.col):
                
                # Rectangle is drawn in front of mesh
                rec2d = System.Drawing.Rectangle(anchor_x + i * rect_x, anchor_y, rect_x,rect_y)
                arg.Display.Draw2dRectangle(rec2d,self.black,3,col)


                value = self.diff * i/self.range + self.min_number
                value = "{:.1f}".format(value)
                
                # Text is drawn in front of mesh
                #pt = rc.Geometry.Point2d(anchor_x + 1.5 * rect_x, anchor_y - 1/(1.6*2) * txt_height + i * rect_y)
                pt = rc.Geometry.Point2d(anchor_x - 1/(1.6) * txt_height + i * rect_x, anchor_y + 3/(1.2) * txt_height)
                arg.Display.Draw2dText(value,self.black,pt,False,txt_height/1.4,"Arial")
            
            i += 1
            pt = rc.Geometry.Point2d(anchor_x - 1/(1.2) * txt_height + i * rect_x, anchor_y + 3/(1.2) * txt_height)
            value = "{:.1f}".format(self.max_number)
            arg.Display.Draw2dText(value,self.black,pt,False,txt_height/1.4,"Arial")
# ---------- end lgnd ----------

adjac = NodeAdjacent(G=custgraph.G, N=findnode)  # -> As, Ns, Dir, Deg
# a = x.Id - 1
python = GhPythonScript(x=adjac.As)  # -> out, a
# ---------- python: Python ----------
a = x.Id - 1
# ---------- end python ----------
panel_10 = Panel(python.a)
selectelems = SelectElementsKaramba3D(Model=disassemble.Model, ElementIdentifiers=panel_10)  # -> Model, Elements
disassemble_2 = DisassembleElementKaramba3D(Element=selectelems.Elements)  # -> Element, ElementIdentifier, AxisOfElement, CrossSection, Joint, Material, LocalCoordinateSystem, ElementIsActive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
crv_3 = Curve(disassemble_2.AxisOfElement)
explode_2 = Explode(Curve=crv_3, Recursive=True)  # -> Segments, Vertices
shift = ShiftPaths(Data=explode_2.Vertices, Offset=-1)
rdpoints_2 = RemoveDuplicatePointsKaramba3D(Point=shift, LimitDistance=0.005)  # -> OutPoint, Info, Indexes
item_4 = ListItem(List=rdpoints_2.Indexes, Index=0, Wrap=True)
item_5 = ListItem(List=shift, Index=item_4, Wrap=True)
python_2 = GhPythonScript(iCurve=simplify(crv_3), iPoint=simplify(item_5))  # -> out, a
# ---------- python_2: Python ----------
import Rhino.Geometry as rg


start_point = iCurve.PointAtStart

distance = start_point.DistanceTo(iPoint)

if not(distance <= 0.01):
    iCurve.Reverse()
else:
    iCurve = iCurve

a = iCurve
# ---------- end python_2 ----------
line = LineSDL(Start=item_5, Direction=python_2.a, Length="0.25")
mp = MultiPipe(Curves=line, NodeSize="0.05", EndOffset=1, StrutSize=1, Segment=0, KinkAngle=0.6, CubeFit=0, Caps=0)
data_4 = Data(mp)
meshsubd = MeshFromSubD(SubD=data_4, Density="3")
wbnaked = WeaverbirdsNakedBoundary(MeshClosedPolylines=meshsubd)
split = SplitList(List=wbnaked, Index="1")  # -> ListA, ListB
explode_3 = Explode(Curve=split.ListB, Recursive=True)  # -> Segments, Vertices
explode_4 = Explode(Curve=split.ListA, Recursive=True)  # -> Segments, Vertices
cullpt = CullDuplicates(Points=explode_3.Vertices, Tolerance="0.001", CullMode=3)  # -> Points, Indices, Valence
cullpt_2 = CullDuplicates(Points=explode_4.Vertices, Tolerance="0.001", CullMode=3)  # -> Points, Indices, Valence
fcircle = CircleFit(Points=cullpt.Points)  # -> Circle, Radius, Deviation
darc = DeconstructArc(Arc=fcircle.Circle)  # -> BasePlane, Radius, Angle
deplane = DeconstructPlane(Plane=darc.BasePlane)  # -> Origin, XAxis, YAxis, ZAxis
vdisex = VectorDisplayEx(Point=deplane.Origin, Vector=deplane.YAxis, Colour=RGB(0, 0, 0), Width=2)
eim = ElasticIsotropicMaterialAlpaca4d(E="2.1e9", v="0.3", rho="7850")  # -> out, nDMaterial
# ---------- eim: Python ----------
"""
Create a nD Elastic Isotropic Material
-
    Args:
        name:
        E:
        G:
        v:
        rho:
    Returns:
        nDMaterial:
"""

ghenv.Component.Name = "Elastic Isotropic Material (Alpaca4d)"
ghenv.Component.NickName = 'EIM'
ghenv.Component.Message = "Elastic Isotropic (Alpaca4d)"


import sys
import Rhino.Geometry as rg
import Grasshopper as gh
import copy


## add alpaca install directory to system path

ghcompfolder = gh.Folders.DefaultAssemblyFolder
if ghcompfolder not in sys.path:
    sys.path.append(ghcompfolder)

try:
    from Alpaca4d import alpaca4d as alpaca
except:
    msg = "Cannot import Alpaca4d. Is the Alpaca4d folder available in " + ghcompfolder + "?"
    ghenv.Component.AddRuntimeMessage(gh.Kernel.GH_RuntimeMessageLevel.Error, msg)


checkData = True

if not E:
    checkData = False
    msg = "Input parameter E failed to collect data"
    ghenv.Component.AddRuntimeMessage(gh.Kernel.GH_RuntimeMessageLevel.Warning, msg)

if not G and not v:
    checkData = False
    msg = "Input parameter G or v failed to collect data"
    ghenv.Component.AddRuntimeMessage(gh.Kernel.GH_RuntimeMessageLevel.Warning, msg)

if not rho:
    checkData = False
    msg = "Input parameter rho failed to collect data"
    ghenv.Component.AddRuntimeMessage(gh.Kernel.GH_RuntimeMessageLevel.Warning, msg)

if checkData:
    nDMaterial = alpaca.ElasticIsotropic(name, E, G, rho, v)
# ---------- end eim ----------
cts = ConstantTimeSeriesAlpaca4d()  # -> TimeSeries, Graph
# ---------- cts: Python ----------
"""
Create a Constant Time Series
-
    Args:
        tStart:
        tEnd:
        period:
        factor:
        shift:
    Returns:
        TimeSeries:
        Graph:
"""

ghenv.Component.Name = "Constant Time Series (Alpaca4d)"
ghenv.Component.NickName = 'CTS'
ghenv.Component.Message = "Constant Time Series (Alpaca4d)"


import sys
import Rhino.Geometry as rg
import Grasshopper as gh
import copy
import math


## add alpaca install directory to system path

ghcompfolder = gh.Folders.DefaultAssemblyFolder
if ghcompfolder not in sys.path:
    sys.path.append(ghcompfolder)

try:
    from Alpaca4d import alpaca4d as alpaca
except:
    msg = "Cannot import Alpaca4d. Is the Alpaca4d folder available in " + ghcompfolder + "?"
    ghenv.Component.AddRuntimeMessage(gh.Kernel.GH_RuntimeMessageLevel.Error, msg)

def ConstantSeries(x):
    return x



checkData = True

if not constantFactor:
    constantFactor = 1


if checkData:
    TimeSeries = alpaca.TimeSeriesConstant(constantFactor)
    
    Graph = []
    
    for x in range(10):
        Graph.append(ConstantSeries(constantFactor))
# ---------- end cts ----------
toggle = BooleanToggle(True)
toggle_2 = BooleanToggle(False)
pfs = PlateFiberAlpaca4d(thickness="0.004", nDMaterial=eim.nDMaterial)  # -> out, Section
# ---------- pfs: Python ----------
"""
Create a Plate Fiber Section
-
    Args:
        secName:
        thickness:
        nDMaterial:
    Returns:
        Section:
"""


import sys
import Rhino.Geometry as rg
import Grasshopper as gh
import copy

ghenv.Component.Name = "Plate Fiber (Alpaca4d)"
ghenv.Component.NickName = 'PFS'
ghenv.Component.Message = "Plate Fiber (Alpaca4d)"


## add alpaca install directory to system path

ghcompfolder = gh.Folders.DefaultAssemblyFolder
if ghcompfolder not in sys.path:
    sys.path.append(ghcompfolder)

try:
    from Alpaca4d import alpaca4d as alpaca
except:
    msg = "Cannot import Alpaca4d. Is the Alpaca4d folder available in " + ghcompfolder + "?"
    ghenv.Component.AddRuntimeMessage(gh.Kernel.GH_RuntimeMessageLevel.Error, msg)


checkData = True

if not thickness:
    checkData = False
    msg = "Input parameter thickness failed to collect data"
    ghenv.Component.AddRuntimeMessage(gh.Kernel.GH_RuntimeMessageLevel.Warning, msg)

if not nDMaterial:
    checkData = False
    msg = "Input parameter nDMaterial failed to collect data"
    ghenv.Component.AddRuntimeMessage(gh.Kernel.GH_RuntimeMessageLevel.Warning, msg)

if checkData:
    Section = alpaca.PlateFiberSection(secName, thickness, nDMaterial)
# ---------- end pfs ----------
pt_2 = Point(cullpt_2.Points)
multiplication = Multiplication(A=deplane.YAxis, B="2000")
pl = PointLoadAlpaca4d(Pos=cullpt.Points, Force=multiplication, TimeSeries=cts.TimeSeries)  # -> out, flatten(Load); inputs Pos: Point3d, Force: Vector3d, Moment: Vector3d
# ---------- pl: Python ----------
"""
Create a Point Load
-
    Args:
        Pos:
        Force:
        Moment:
        TimeSeries:
    Returns:
        PointLoad:
"""

ghenv.Component.Name = "Point Load (Alpaca4d)"
ghenv.Component.NickName = 'PL'
ghenv.Component.Message = "Point Load (Alpaca4d)"



import sys
import Rhino.Geometry as rg
import Grasshopper as gh
import copy


## add alpaca install directory to system path

ghcompfolder = gh.Folders.DefaultAssemblyFolder
if ghcompfolder not in sys.path:
    sys.path.append(ghcompfolder)

try:
    from Alpaca4d import alpaca4d as alpaca
except:
    msg = "Cannot import Alpaca4d. Is the Alpaca4d folder available in " + ghcompfolder + "?"
    ghenv.Component.AddRuntimeMessage(gh.Kernel.GH_RuntimeMessageLevel.Error, msg)


checkData = True

if not Pos:
    checkData = False
    msg = "Input parameter Pos failed to collect data"
    ghenv.Component.AddRuntimeMessage(gh.Kernel.GH_RuntimeMessageLevel.Warning, msg)

if not Force:
    Force = rg.Vector3d(0,0,0)

if not Moment:
    Moment = rg.Vector3d(0,0,0)

if not TimeSeries:
    checkData = False
    msg = "Input parameter TimeSeries failed to collect data"
    ghenv.Component.AddRuntimeMessage(gh.Kernel.GH_RuntimeMessageLevel.Warning, msg)


if checkData:
    Load = alpaca.PointLoad(Pos, Force, Moment, TimeSeries)
# ---------- end pl ----------
mitc4 = ShellMITC4Alpaca4d(Mesh=meshsubd, Section=pfs.Section)  # -> out, flatten(Element); inputs Mesh: Mesh, Colour: Color
# ---------- mitc4: Python ----------
"""
Create a ShellMITC4 element
-
    Args:
        Mesh:
        Section:
        Colour:
    Returns:
        Element:
"""

ghenv.Component.Name = "Shell MITC4 (Alpaca4d)"
ghenv.Component.NickName = 'MITC4'
ghenv.Component.Message = "ShellMITC4 (Alpaca4d)"
ghenv.Component.IconDisplayMode = ghenv.Component.IconDisplayMode.application
ghenv.Component.Category = "Alpaca4d"
ghenv.Component.SubCategory = "2_Element"



import sys
import Rhino.Geometry as rg
import Grasshopper as gh
from System.Drawing import Color


## add alpaca install directory to system path

ghcompfolder = gh.Folders.DefaultAssemblyFolder
if ghcompfolder not in sys.path:
    sys.path.append(ghcompfolder)

try:
    from Alpaca4d import alpaca4d as alpaca
except:
    msg = "Cannot import Alpaca4d. Is the Alpaca4d folder available in " + ghcompfolder + "?"
    ghenv.Component.AddRuntimeMessage(gh.Kernel.GH_RuntimeMessageLevel.Error, msg)


checkData = True

if not Mesh:
    checkData = False
    msg = "Input parameter Mesh failed to collect data"
    ghenv.Component.AddRuntimeMessage(gh.Kernel.GH_RuntimeMessageLevel.Warning, msg)

if not Section:
    checkData = False
    msg = "Input parameter Section failed to collect data"
    ghenv.Component.AddRuntimeMessage(gh.Kernel.GH_RuntimeMessageLevel.Warning, msg)

if not Colour:
    Colour = Color.Blue


if checkData:
    
    Mesh.Unweld(0,True)
    explodedMesh = Mesh.ExplodeAtUnweldedEdges()
    if explodedMesh.Length > 0:
        Element = []
        for mesh in explodedMesh:
            if mesh.Vertices.Count == 4:
                Element.append(alpaca.ShellMITC4(mesh, Section, Colour))
            elif mesh.Vertices.Count == 3:
                Element.append(alpaca.ShellNLDKGT(mesh, Section, Colour))
    elif explodedMesh.Length == 0:
        if Mesh.Vertices.Count == 4:
                Element = alpaca.ShellMITC4(Mesh, Section, Colour)
        elif Mesh.Vertices.Count == 3:
            Element = alpaca.ShellNLDKGT(Mesh, Section, Colour)
# ---------- end mitc4 ----------
support_2 = SupportAlpaca4d(Pos=pt_2, Tx=toggle, Ty=toggle, Tz=toggle, Rx=toggle_2, Ry=toggle_2, Rz=toggle_2)  # -> Support; inputs Pos: Point3d, Tx: Boolean, Ty: Boolean, Tz: Boolean, Rx: Boolean, Ry: Boolean, Rz: Boolean
# ---------- support_2: Python ----------
"""
Create a support
-
    Args:
        Pos:
        Tx:
        Ty:
        Tz:
        Rx:
        Ry:
    Returns:
        Support:
"""

ghenv.Component.Name = "Support (Alpaca4d)"
ghenv.Component.NickName = 'Support'
ghenv.Component.Message = "Support (Alpaca4d)"


import sys
import Rhino.Geometry as rg
import Grasshopper as gh


## add alpaca install directory to system path

ghcompfolder = gh.Folders.DefaultAssemblyFolder
if ghcompfolder not in sys.path:
    sys.path.append(ghcompfolder)

try:
    from Alpaca4d import alpaca4d as alpaca
except:
    msg = "Cannot import Alpaca4d. Is the Alpaca4d folder available in " + ghcompfolder + "?"
    ghenv.Component.AddRuntimeMessage(gh.Kernel.GH_RuntimeMessageLevel.Error, msg)

checkData = True


if not Pos:
    checkData = False
    msg = "Input parameter Pos failed to collect data"
    ghenv.Component.AddRuntimeMessage(gh.Kernel.GH_RuntimeMessageLevel.Warning, msg)

if checkData:
    Support = alpaca.Support(Pos, Tx, Ty, Tz, Rx, Ry, Rz)
# ---------- end support_2 ----------
am = AssembleModelAlpaca4d(Element=mitc4.Element, Support=flatten(support_2), Load=pl.Load)  # -> out, AlpacaModel; inputs Element: list, Support: list, Load: list, Constraint: list
# ---------- am: Python ----------
"""
Create a FEA Model
-
    Args:
        Element:
        Support:
        Load:
        Constraint:
    Returns:
        AlpacaModel:
"""


import os
import sys
import ghpythonlib.treehelpers as th
import Rhino.Geometry as rg
import Rhino.Collections as rc
import rhinoscriptsyntax as rs
from collections import defaultdict, OrderedDict, deque
import copy
import time
import Grasshopper as gh



ghenv.Component.Name = "Assemble Model (Alpaca4d)"
ghenv.Component.NickName = 'AM'
ghenv.Component.Message = "Assemble Model (Alpaca4d)"


## add alpaca install directory to system path

ghcompfolder = gh.Folders.DefaultAssemblyFolder
if ghcompfolder not in sys.path:
    sys.path.append(ghcompfolder)

try:
    from Alpaca4d import alpaca4d as alpaca
    from Alpaca4d import alpaca4dUtil as alpacaUtil
except:
    msg = "Cannot import Alpaca4d. Is the Alpaca4d folder available in " + ghcompfolder + "?"
    ghenv.Component.AddRuntimeMessage(gh.Kernel.GH_RuntimeMessageLevel.Error, msg)


checkData = True

if not Element:
    checkData = False
    msg = "Input parameter Element failed to collect data"
    ghenv.Component.AddRuntimeMessage(gh.Kernel.GH_RuntimeMessageLevel.Warning, msg)

if not Support:
    checkData = False
    msg = "Input parameter Support failed to collect data"
    ghenv.Component.AddRuntimeMessage(gh.Kernel.GH_RuntimeMessageLevel.Warning, msg)


if checkData:
    
    FolderPath = rs.DocumentPath()
    os.chdir(FolderPath)
    
    # create the object model
    AlpacaModel = alpaca.Model()
    
    
    start = time.clock()
    #subdivide element per type
    
    for element in Element:
        if element.type == "Beam":
            AlpacaModel.beams.append(element)
        elif element.type == "Shell":
            AlpacaModel.shells.append(element)
        elif element.type == "Brick":
            AlpacaModel.bricks.append(element)
    
    
    end = time.clock() - start
    print("time to subdivide element {}".format(end))
    start = time.clock()
    
    # create a list of unique point
    # need to add the rigid constraint
    
    AlpacaModel.getuniquePoints(AlpacaModel.beams, AlpacaModel.shells, AlpacaModel.bricks, Constraint)
    
    
    end = time.clock() - start
    print("time to get uniquepoints {}".format(end))
    start = time.clock()
    
    
    #############
    # create node and assign to object
    #############
    
    if AlpacaModel.uniquePointsThreeNDF:
        AlpacaModel.py.append(alpaca.Model.write3ndf_tcl())
        for point in AlpacaModel.uniquePointsThreeNDF:
            node = alpaca.Node(point)
            node.ndf = 3
            node.setNodeTag(AlpacaModel)
            AlpacaModel.nodes.append( node )
        
            AlpacaModel.py.append(node.write_tcl())
    
    
    if AlpacaModel.uniquePointsSixNDF:
        AlpacaModel.py.append(alpaca.Model.write6ndf_tcl())
        for point in AlpacaModel.uniquePointsSixNDF:
            node = alpaca.Node(point)
            node.ndf = 6
            node.setNodeTag(AlpacaModel)
            AlpacaModel.nodes.append( node )
         
            AlpacaModel.py.append(node.write_tcl())
    
    
    
    end = time.clock() - start
    print("time to create node and assign tag {}".format(end))
    start = time.clock()
    
    
    #################
    # create supports
    #################
    
    for supportNode in Support:
        
        # if the list is empty, skip this operation
        if AlpacaModel.uniquePointsThreeNDF:
            closestPointInThreeNDF = rc.Point3dList.ClosestPointInList(AlpacaModel.uniquePointsThreeNDF, supportNode.Pos)
            if supportNode.Pos.DistanceTo(closestPointInThreeNDF) < 0.001:
                #print("I am in 3ndf")
                supportNode.ndf = 3
                AlpacaModel.threeNDFModel.append(supportNode)
                supportNode.setNodeTag(AlpacaModel)
        
        if AlpacaModel.uniquePointsSixNDF:
            closestPointInSixNDF = rc.Point3dList.ClosestPointInList(AlpacaModel.uniquePointsSixNDF, supportNode.Pos)
            if supportNode.Pos.DistanceTo(closestPointInSixNDF) < 0.001:
                supportNode.ndf = 6
                AlpacaModel.sixNDFModel.append(supportNode)
                supportNode.setNodeTag(AlpacaModel)
        
        
        AlpacaModel.supports.append(supportNode)
        AlpacaModel.py.append(supportNode.write_tcl())
    
    
    end = time.clock() - start
    print("time to create support and assign tag {}".format(end))
    start = time.clock()
    
    
    ####################
    # create constraints
    ####################
    
    
    for constraint in Constraint:
        constraint.setNodeTag(AlpacaModel)
        AlpacaModel.constraints.append(constraint)
    
    ####################
    # create equalDOF when the model has 3df and 6df together
    ####################
    
    
    end = time.clock() - start
    print("time to create constraint and assign tag {}".format(end))
    start = time.clock()
    
    
    Id = []
    IdB = []
    
    def SearchCallback(sender, e):
        Id.Add(e.Id)
        IdB.Add(e.IdB)
    
    
    
    lenThreeNDF = len(AlpacaModel.uniquePointsThreeNDF)
    lenSixNDF = len(AlpacaModel.uniquePointsSixNDF)
    
    
    if not(lenThreeNDF == 0 or lenSixNDF == 0):
        print("brick and beam together")
        rg.RTree.SearchOverlaps(AlpacaModel.RTreeCloudPointThreeNDF, AlpacaModel.RTreeCloudPointSixNDF, 0.001, SearchCallback)
        
        for i,j in zip(Id, IdB):
            print(i,j)
            node_i = AlpacaModel.uniquePointsThreeNDF[i]
            node_j = AlpacaModel.uniquePointsSixNDF[j]
            
            #index_i = AlpacaModel.cloudPoint.ClosestPoint(node_i) + 1
            #index_j = AlpacaModel.cloudPoint.ClosestPoint(node_j) + 1
            
            equalConstraint = alpaca.EqualDOF(node_i, node_j, True, True, True, False, False, False)
            equalConstraint.masterNodeTag = AlpacaModel.cloudPointThreeNDF.ClosestPoint(node_i) + 1
            equalConstraint.slaveNodesTag = AlpacaModel.cloudPointSixNDF.ClosestPoint(node_j) + 1 + len(AlpacaModel.uniquePointsThreeNDF)
            AlpacaModel.py.append(equalConstraint.write_tcl())
    
    
    
    end = time.clock() - start
    print("time to find common points between 3ndf and 6ndf {}".format(end))
    start = time.clock()
    
    ##########################
    ##########################
    ##########################
    
    crossSection = []
    material = []
    
    for item in Element:
        if item.type != "Brick":
            crossSection.append(item.CrossSection)
            material.append(item.CrossSection.material)
        else:
            material.extend(item.material)
        
    
    uniqueCS = list(set(crossSection))
    
    
    flatten_material = alpacaUtil.flatten_list(material)
    
    
    uniqueMaterial = list(set(flatten_material))
    
    for index, material in enumerate(uniqueMaterial,1):
        material.matTag = index
        AlpacaModel.py.append(material.write_tcl())
    
    
    for index, section in enumerate(uniqueCS,1):
        section.sectionTag = index
        AlpacaModel.py.append(section.write_tcl())
        
    
    
    
    
    
    # write py file
    
    
    # assign tag and node Index to element and shell
    for index, element in enumerate(Element,1):
        element.setTopologyRTree(AlpacaModel)
        element.eleTag = index
        element.setTags()
    
    
    
    end = time.clock() - start
    print("time to assign tags for the elements {}".format(end))
    start = time.clock()
    
    
    
    
    
    
    Mass = 0
    IsGravity = False
    g_factor = 10.00
    
    for item in Load:
        if item.type == "Gravity Load":
            IsGravity = True
            GravityLoad = item
        if item.type == "PointLoad":
            AlpacaModel.loads.append(item)
        if item.type == "Mass":
            AlpacaModel.masses.append(item)
    
    
    for item in Element:
        if item.type == "Beam":
            length = item.Crv.GetLength()
            Mass += (item.massDens * length)
            if IsGravity:
                gravityPointLoad_1 = alpaca.PointLoad(item.Crv.PointAtStart, g_factor * rg.Vector3d(0,0, -(item.massDens * length / 2)) * GravityLoad.GravityFactor, rg.Vector3d(0,0,0), GravityLoad.TimeSeries)
                gravityPointLoad_2 = alpaca.PointLoad(item.Crv.PointAtEnd, g_factor * rg.Vector3d(0,0, -(item.massDens * length / 2)) * GravityLoad.GravityFactor, rg.Vector3d(0,0,0), GravityLoad.TimeSeries)
                ##print( -(item.massDens * length / 2))
                AlpacaModel.loads.append(gravityPointLoad_1)
                AlpacaModel.loads.append(gravityPointLoad_2)
        if item.type == "Shell":
            meshArea = rg.AreaMassProperties.Compute(item.Mesh).Area
            if item.CrossSection.__class__.__name__ != "LayeredShell":
                areaDensity = item.CrossSection.thickness * item.CrossSection.material.rho
                Mass += areaDensity * meshArea
                if IsGravity:
                    for vertex in item.Mesh.Vertices.ToPoint3dArray():
                        gravityPointLoad = alpaca.PointLoad(vertex, g_factor * rg.Vector3d(0,0, -(areaDensity * meshArea/ len(item.Mesh.Vertices))) * GravityLoad.GravityFactor, rg.Vector3d(0,0,0), GravityLoad.TimeSeries)
                        AlpacaModel.loads.append(gravityPointLoad)
            else:
                for thickness, material in zip(item.CrossSection.thickness, item.CrossSection.material):
                    areaDensity = thickness * material.rho
                    Mass += areaDensity * meshArea
                    if IsGravity:
                        for vertex in item.Mesh.Vertices.ToPoint3dArray():
                            gravityPointLoad = alpaca.PointLoad(vertex, g_factor * rg.Vector3d(0,0, -(areaDensity * meshArea/ len(item.Mesh.Vertices))) * GravityLoad.GravityFactor, rg.Vector3d(0,0,0), GravityLoad.TimeSeries)
                            AlpacaModel.loads.append(gravityPointLoad)


        if item.type == "Brick":
            #print(type(item.Mesh))
            meshVolume = rg.VolumeMassProperties.Compute(item.Mesh).Volume
            density = item.material.rho 
            Mass += density * meshVolume
            if IsGravity:
                for vertex in item.Mesh.Vertices.ToPoint3dArray():
                    gravityPointLoad = alpaca.PointLoad(vertex, g_factor * rg.Vector3d(0,0, -(density * meshVolume / len(item.Mesh.Vertices))) * GravityLoad.GravityFactor, rg.Vector3d(0,0,0), GravityLoad.TimeSeries)
                    #print(len(item.Mesh.Vertices))
                    #print(density)
                    # volume can be zero if mesh faces are not properly rotated
                    #print(meshVolume)
                    #print(-(density * meshVolume / len(item.Mesh.Vertices)))
                    AlpacaModel.loads.append(gravityPointLoad)
    
    #print(AlpacaModel.loads)
    ## load
    
    
    for item in AlpacaModel.loads:
        item.setNodeTag(AlpacaModel)
    
    #print(AlpacaModel.loads)
    
    for item in AlpacaModel.beams:
        AlpacaModel.py.append(item.write_tcl())
    
    for item in AlpacaModel.shells:
        AlpacaModel.py.append(item.write_tcl())
    
    for item in AlpacaModel.bricks:
        AlpacaModel.py.append(item.write_tcl())
    
    
    for item in Constraint:
        AlpacaModel.py.append(item.write_tcl())
    
    
    for item in AlpacaModel.masses:
        item.setNodeTag(AlpacaModel)
        AlpacaModel.py.append(item.write_tcl())
    
    
    timeSeriesDict = alpaca.TimeSeries.getTimeSeries(AlpacaModel.loads)[1]
    AlpacaModel.py.append(alpaca.PointLoad.write_tcl(timeSeriesDict,AlpacaModel))
    
    
    text = AlpacaModel.py
# ---------- end am ----------
as = AnalysesStepsAlpaca4d(numIncr="1")  # -> AnalysisSteps; inputs numIncr: Int32
# ---------- as: Python ----------
"""
Define the Analysis Step
-
    Inputs:
        numIncr:
        dt:
        dtMin:
        dtMAx:
        Jd:
    Output:
        AnalysisSteps:
"""



ghenv.Component.Name = "Analyses Steps (Alpaca4d)"
ghenv.Component.NickName = 'AS'
ghenv.Component.Message = "Analyses Steps (Alpaca4d)"
ghenv.Component.IconDisplayMode = ghenv.Component.IconDisplayMode.application
ghenv.Component.Category = "Alpaca4d"
ghenv.Component.SubCategory = "7_Analysis"



import sys
import Rhino.Geometry as rg
import Grasshopper as gh
import ghpythonlib.components as ghcomp
from System.Drawing import Color

## add alpaca install directory to system path

ghcompfolder = gh.Folders.DefaultAssemblyFolder
if ghcompfolder not in sys.path:
    sys.path.append(ghcompfolder)

try:
    from Alpaca4d import alpaca4d as alpaca
except:
    msg = "Cannot import Alpaca4d. Is the Alpaca4d folder available in " + ghcompfolder + "?"
    ghenv.Component.AddRuntimeMessage(gh.Kernel.GH_RuntimeMessageLevel.Error, msg)

dt = "" if dt is None else dt
dtMin = "" if dtMin is None else dtMin
dtMax = "" if dtMax is None else dtMax
Jd = "" if Jd is None else Jd

checkData = True

if not numIncr:
    checkData = False
    msg = "Input parameter numIncr failed to collect data"
    ghenv.Component.AddRuntimeMessage(gh.Kernel.GH_RuntimeMessageLevel.Warning, msg)

if checkData:
    AnalysisSteps = alpaca.AnalysisSteps(numIncr, dt, dtMin, dtMax, Jd)
# ---------- end as ----------
as_2 = AnalysisSettingsAlpaca4d(AnalysisSteps=as)  # -> out, Settings
# ---------- as_2: Python ----------
"""
Create Analysis settings
-
    Args:
        Damping: 
        Constraint: 'Plain', 'Transformation'. Default is 'Transformation'.
        Numberer: 'RCM', 'AMD', 'Plain'. Default is 'RCM'.
        System: 'BandGen', 'BandSPD', 'ProfileSPD', 'SuperLU', 'UmfPack', 'FullGeneral', 'SparseSYM'. Default is 'BandSPD'.
        Test: Feature not implemented. Please contact alpaca4d@gmail.com 
        Algorithm: 'Linear', 'Newton', 'NewtonLineSearch', 'ModifiedNewton', 'KrylovNewton', 'SecantNewton', 'BFGS', 'Broyden'. Default is 'Linear'.
        Integrator: Default is LoadControl.
        AnalysisType: 'Static', 'Transient'. Default is 'Static'.
        AnalyesSteps:
    Returns:
        Analysis:
"""

import sys
import os


import clr
import clrtype
import Rhino.Geometry as rg
import rhinoscriptsyntax as rs
import Grasshopper as gh
import copy
import ghpythonlib.treehelpers as th


ghenv.Component.Name = "Analysis settings (Alpaca4d)"
ghenv.Component.NickName = 'AS'
ghenv.Component.Message = "Analysis settings \n(Alpaca4d)"



from Alpaca4d import alpaca4d as alpaca

checkData = True



Damping = None if Damping is None else Damping


# default Value
Constraint = 'Transformation' if Constraint is None else Constraint
ConstraintList = ['Plain', 'Transformation']

for item in ConstraintList:
    if Constraint.lower() == item.lower():
        Constraint = item


# default Value
Numberer = 'RCM' if Numberer is None else Numberer
NumbererList = ['RCM', 'AMD', 'Plain', 'ParallelPlain', 'ParallelRCM']

for i,item in enumerate(NumbererList):
    if Numberer.lower() == item.lower():
        Numberer = item



# default Value
System = 'BandSPD' if System is None else System
SystemList = ['BandGen', 'BandSPD', 'ProfileSPD', 'SuperLU', 'UmfPack', 'FullGeneral', 'SparseSYM']

for i,item in enumerate(SystemList):
    if System.lower() == item.lower():
        System = item


# default Test
Test = 'NormDispIncr 1.0e-6 12 5' if Test is None else Test




# default Value
Algorithm = 'Linear' if Algorithm is None else Algorithm
AlgorithmList = ['Linear', 'Newton', 'NewtonLineSearch', 'ModifiedNewton', 'KrylovNewton', 'SecantNewton', 'BFGS', 'Broyden']

for i,item in enumerate(AlgorithmList):
    if Algorithm.lower() == item.lower():
        Algorithm = item


# default Value
AnalysisType = 'Static' if AnalysisType is None else AnalysisType
AnalysisTypeList = ['Static', 'Transient']

for item in AnalysisTypeList:
    if AnalysisType.lower() == item.lower():
        AnalysisType = item



## Define Integrator
if AnalysisType == "Static":
    Integrator = "LoadControl 1.0" if Integrator is None else Integrator
elif AnalysisType == "Transient":
    Integrator = "Newmark 0.5 0.25" if Integrator is None else Integrator


if AnalysisType == 'Transient':
    if not Damping:
        checkData = False
        msg = "Input parameter Damping failed to collect data"
        ghenv.Component.AddRuntimeMessage(gh.Kernel.GH_RuntimeMessageLevel.Warning, msg)


if not AnalysisSteps:
    checkData = False
    msg = "Input parameter AnalysisSteps failed to collect data"
    ghenv.Component.AddRuntimeMessage(gh.Kernel.GH_RuntimeMessageLevel.Warning, msg)




if checkData:
    Settings = alpaca.Analysis(Constraint, Numberer, System, Test, Algorithm, Integrator, AnalysisType, AnalysisSteps, Damping)
    print(Settings.write_tcl())
# ---------- end as_2 ----------
ra = RunAnalysisAlpaca4d(AlpacaModel=am.AlpacaModel, Settings=as_2.Settings)  # -> log, AlpacaSolvedModel
# ---------- ra: Python ----------
"""
Run an OpenSees Analysis
-
    Args:
        AlpacaModel:
        Settings:
    Returns:
        AlpacaSolvedModel:
"""



import Rhino.RhinoDoc
import Grasshopper as gh
import copy
import rhinoscriptsyntax as rs
import os
import time
import sys



ghenv.Component.Name = "Run Analysis (Alpaca4d)"
ghenv.Component.NickName = 'RA'
ghenv.Component.Message = "Run Analysis (Alpaca4d)"

ghcompfolder = gh.Folders.DefaultAssemblyFolder
if ghcompfolder not in sys.path:
    sys.path.append(ghcompfolder)

try:
    from Alpaca4d import alpaca4d as alpaca
except:
    msg = "Cannot import Alpaca4d. Is the Alpaca4d folder available in " + ghcompfolder + "?"
    ghenv.Component.AddRuntimeMessage(gh.Kernel.GH_RuntimeMessageLevel.Error, msg)


checkData = True



if not AlpacaModel:
    checkData = False
    msg = "Input parameter AlpacaModel failed to collect data"
    ghenv.Component.AddRuntimeMessage(gh.Kernel.GH_RuntimeMessageLevel.Warning, msg)


if not Settings:
    checkData = False
    msg = "Input parameter Settings failed to collect data"
    ghenv.Component.AddRuntimeMessage(gh.Kernel.GH_RuntimeMessageLevel.Warning, msg)


if checkData:
    FolderPath = rs.DocumentPath()
    os.chdir(FolderPath)
    
    outputFileName = 'openSeesModel'
    recorderFileName = 'recorder.mpco'
    
    for dirpath, dirnames, filenames in os.walk(FolderPath):
        for filename in filenames:
            if filename == outputFileName:
                file = os.path.join(dirpath,outputFileName)
                os.remove(file)
            elif filename == recorderFileName:
                file = os.path.join(dirpath,recorderFileName)
                os.remove(file)
    
    
    # create a copy
    
    AnalysisModel = copy.copy(AlpacaModel)
    AnalysisModel.py = list(AnalysisModel.py)
    
    # generate Recorder and assign name
    AnalysisModel.recorderName = "recorder" + ".mpco"
    
    if Settings.AnalysisType == "Static":
        recorder = alpaca.TCLRecorder.mpco(AnalysisModel.recorderName, True,True,False,False,True,True,False,False,True,True,True,True)
    elif Settings.AnalysisType == "Transient":
        recorder = alpaca.TCLRecorder.mpco(AnalysisModel.recorderName, True,True,True,True,True,True,False,False,True,True,True,True)
    
    AnalysisModel.py.append(recorder)
    
    
    AnalysisModel.analysis = Settings
    AnalysisModel.py.append(Settings.write_tcl())
    AnalysisModel.py.append("wipe")
    
    
    #textFile = AnalysisModel.py
    
    time_start = time.clock()
    
    AnalysisModel.writeFile(outputFileName)
    
    time_elapsed = (time.clock() - time_start)
    print("Writing Time {}".format(time_elapsed))
    
    
    
    time_start = time.clock()
    
    executable = os.path.join(ghcompfolder,'Alpaca4d\OpenSees-Solvers\opensees.bat')
    a, log = AnalysisModel.runOpensees(executable)
    
    
    time_elapsed = (time.clock() - time_start)
    print("Analyses Time {}".format(time_elapsed))
    
    AlpacaSolvedModel = copy.copy(AnalysisModel)
    AlpacaSolvedModel.isAnalysed = True
# ---------- end ra ----------
clr_2 = ColorsAlpaca4d(gradIndex=Slider(11, range=0..12))  # -> reverse(colors); inputs gradIndex: Int32; same code as clr
clr_3 = ColorsAlpaca4d(gradIndex=Slider(12, range=0..12))  # -> reverse(colors); inputs gradIndex: Int32; same code as clr
dm = DeformedModelAlpaca4d(AlpacaSolvedModel=ra.AlpacaSolvedModel, scale=Slider(0, range=0..1), listColor=clr_2)  # -> DefModel, bounds; inputs step: Int32, extrudeModel: Boolean, typeColor: Int32, listColor: list of Color
# ---------- dm: Python ----------
"""View Deformed model
    Args:
        AlpacaSolvedModel: Output of Analyses solver
        step:
        scale: Multiplication factor for displacement
        extrudeModel:  
True : view extruded model
else : view stick model
        typeColor:  View relative color of the traslation
<=0 : view traslation X 
1 : view traslation Y
2 : view traslation Z
>= 3 : view resulting displacement.
        listColor : one list of color 

    Output:
       DefModel: view deformed model
       bounds: max end min of displacement of the structure 
"""

ghenv.Component.Name = "Deformed Model (Alpaca4d)"
ghenv.Component.NickName = 'DM'
ghenv.Component.Message = "Deformed Model (Alpaca4d)"

from ghpythonlib.componentbase import executingcomponent as component
import System
import rhinoscriptsyntax as rs

import sys
import os
import clr
import clrtype
import Rhino.Geometry as rg
import Rhino as rc
import math as mt
import Grasshopper as gh
import ghpythonlib.treehelpers as th
from ghpythonlib.components import ConstructDomain

ghcompfolder = gh.Folders.DefaultAssemblyFolder
if ghcompfolder not in sys.path:
    sys.path.append(ghcompfolder)
try:
    from Alpaca4d import alpaca4dView as alpacaView
except:
    msg = "Cannot import Alpaca4d. Is the Alpaca4d folder available in " + ghcompfolder + "?"
    ghenv.Component.AddRuntimeMessage(gh.Kernel.GH_RuntimeMessageLevel.Error, msg)
    
FolderPath = rs.DocumentPath()
os.chdir(FolderPath)

ghcompfolder = gh.Folders.DefaultAssemblyFolder
my_module_name = "Alpaca_StepReader"
my_module = sys.modules.setdefault(my_module_name, type(sys)(my_module_name))


try:
    Steps_dm = my_module.Steps_dm
    Modes = my_module.Modes
except AttributeError:
    type_2d = type(System.Array.CreateInstance(float, 1, 1))

    class Steps_dm(object):
        __metaclass__ = clrtype.ClrClass
        _clrfields = {"STEP_{}".format(i): type_2d for i in range(1000)} # it will work for model with less than 1000 steps

    class Modes(object):
        __metaclass__ = clrtype.ClrClass
        _clrfields = {"MODE_{}".format(i): type_2d for i in range(1000)} # it will work for model with less than 1000 steps

    my_module.Steps_dm = Steps_dm
    my_module.Modes = Modes


hdfFilePath = os.path.join(ghcompfolder, "Alpaca4d\HDF5CSharp.dll")
clr.AddReferenceToFileAndPath(hdfFilePath)

from HDF5CSharp import Hdf5

class MyComponent(component):
    
    def RunScript(self, AlpacaSolvedModel, step = None, scale = None , extrudeModel = None, typeColor = None, listColor = [] ):
        import sys
        
        self.extrudeModel = extrudeModel
        
        self.defModel1 = []
        self.defModel2 = []
        self.defModel3 = []
        
        self.beamColor = []
        

        if step == None:
            step = 0
        if extrudeModel == None:
            extrudeModel = False
        if typeColor == None:
            typeColor = 3
        
        if not listColor: listColor = [ System.Drawing.Color.DarkViolet, 
                                        System.Drawing.Color.BlueViolet, 
                                        System.Drawing.Color.RoyalBlue, 
                                        System.Drawing.Color.CornflowerBlue,
                                        System.Drawing.Color.LightSkyBlue, 
                                        System.Drawing.Color.LightBlue,
                                        System.Drawing.Color.CadetBlue,
                                        System.Drawing.Color.LightGreen,
                                        System.Drawing.Color.GreenYellow,
                                        System.Drawing.Color.Yellow,
                                        System.Drawing.Color.Orange,
                                        System.Drawing.Color.Red,
                                        System.Drawing.Color.DarkRed]
            
        checkData = True
        
        if not AlpacaSolvedModel:
            checkData = False
            msg = "Input parameter AlpacaSolvedModel failed to collect data"
            ghenv.Component.AddRuntimeMessage(gh.Kernel.GH_RuntimeMessageLevel.Warning, msg)
        else:
            try:
                fileId = Hdf5.OpenFile(AlpacaSolvedModel.recorderName, True)
                print( AlpacaSolvedModel.recorderName)
                numberOfPoints = len(AlpacaSolvedModel.uniquePoints) #
                
                displacement = []
                rotation = []
                dispNodeList = []
                
                if AlpacaSolvedModel.isModal == True:
                    print( AlpacaSolvedModel.isModal == True )
                    outputData = "MODEL_STAGE[1]/RESULTS/ON_NODES/MODES_OF_VIBRATION(U)/DATA/STEP_0"
                    print( outputData )
                    displacementResult = Hdf5.ReadObject[Modes](fileId, outputData)
                    for i in range(numberOfPoints):
                        tag = i + 1
                        vx = getattr(displacementResult, 'MODE_{}'.format(step))[i,0]
                        vy = getattr(displacementResult, 'MODE_{}'.format(step))[i,1]
                        vz = getattr(displacementResult, 'MODE_{}'.format(step))[i,2]
                        trasl = rg.Vector3d(vx,vy,vz)
                        displacement.append(trasl)
                        dispNodeList.append( [tag, trasl] )
                        
                    Hdf5.CloseFile(fileId)
                    print("I have closed the file")
                else: 
                    outputData = "/MODEL_STAGE[1]/RESULTS/ON_NODES/DISPLACEMENT/DATA"
                    print( outputData )
                    displacementResult = Hdf5.ReadObject[Steps_dm](fileId, outputData)
                    for i in range(numberOfPoints):
                        tag = i + 1
                        vx = getattr(displacementResult, 'STEP_{}'.format(step))[i,0]
                        vy = getattr(displacementResult, 'STEP_{}'.format(step))[i,1]
                        vz = getattr(displacementResult, 'STEP_{}'.format(step))[i,2]
                        trasl = rg.Vector3d(vx,vy,vz)
                        displacement.append(trasl)
                        dispNodeList.append( [tag, trasl] )
                        
                    Hdf5.CloseFile(fileId)
                    print("I have closed the file")
            
                dispNodeDict = dict( dispNodeList )
                #---------------------------------------------------#
                defEleVector1 = alpacaView.BeamVectorDef(AlpacaSolvedModel,dispNodeDict) #beam
                defEleVector2 = alpacaView.ShellVectorDef(AlpacaSolvedModel,dispNodeDict) #shell
                defEleVector3 = alpacaView.BrickVectorDef(AlpacaSolvedModel,dispNodeDict) #shell
                bound = alpacaView.boundsDef(displacement, typeColor)
                if scale == None: scale = 1/bound[1]
                if self.extrudeModel == None or self.extrudeModel == False:
                    #BEAM
                    defModel1 = alpacaView.BeamDef(AlpacaSolvedModel, dispNodeDict,scale)
                    self.defModel1, self.beamColor = alpacaView.ColorBeamDef( defModel1, defEleVector1, bound, listColor, typeColor)
                    #SHELL
                    defModel2 = alpacaView.ShellDef(AlpacaSolvedModel,dispNodeDict,scale)
                    #BRICK
                    defModel3 = alpacaView.BrickDef(AlpacaSolvedModel,dispNodeDict,scale)
                else:
                    #BEAM
                    defModel1 = alpacaView.BeamDefExtrude(AlpacaSolvedModel, dispNodeDict,scale)
                    self.defModel1 = alpacaView.ColorBeamDefExtrude( defModel1, defEleVector1, bound, listColor, typeColor)
                    #SHELL
                    defModel2 = alpacaView.ShellDefExtrude(AlpacaSolvedModel,dispNodeDict,scale)
                    #BRICK
                    defModel3 = alpacaView.BrickDef(AlpacaSolvedModel,dispNodeDict,scale)
                    
                #SHELL COLOR
                self.defModel2 = alpacaView.ColorShellDef( defModel2, defEleVector2 , bound, listColor, typeColor, extrudeModel )
                #BRICK COLOR
                self.defModel3 = alpacaView.ColorBrickDef( defModel3, defEleVector3 , bound, listColor, typeColor)
                DefModel = th.list_to_tree(self.defModel1 + defModel2 + defModel3)
                bounds = ConstructDomain(bound[0], bound[1])
                return (DefModel, bounds)
            except:
                Hdf5.CloseFile(fileId)
                print("I have closed the file due to exception")
            # return outputs if you have them; here I try it for you:
        
        
    def DrawViewportWires(self,arg):
        for iMesh in self.defModel2 :
            colorWirframe = System.Drawing.Color.Black
            arg.Display.DrawMeshWires(iMesh, colorWirframe)
            
        for iMesh in self.defModel3 :
            colorWirframe = System.Drawing.Color.Black
            arg.Display.DrawMeshWires(iMesh, colorWirframe)
        if self.extrudeModel is None or self.extrudeModel is False:
            thickness =2
            for iBeam, iColor in zip(self.defModel1, self.beamColor) :
                for jBeam, jColor in zip(iBeam, iColor):
                    arg.Display.DrawCurve(jBeam, jColor, thickness)
        else:
            for iBeam in self.defModel1 :
                colorWirframe = System.Drawing.Color.Black
                arg.Display.DrawMeshWires(iBeam, colorWirframe)
# ---------- end dm ----------
vm = ViewModelAlpaca4d(
    AlpacaModel=ra.AlpacaSolvedModel,
    support=Toggle(False),
    scale_Support=Slider(0.05, range=0..1),
    load=Toggle(False),
    scale_load=Slider(0.1, range=0..1))  # inputs type: Int32, nodeTag: Boolean, eleTag: Boolean, localAxis: Boolean, support: Boolean, load: Boolean
# ---------- vm: Python ----------
"""View structural Model
    Inputs:
        AlpacaModel: Output of Assemble Model.
        type: Style of visualize Model 
Default: Visualize the stick Model
True: Visualize the extrude Model
        nodeTag: 
True: Visualize tag nodes
        eleTag: 
True: Visualize tag elements 
        LocalAxes:
True: Visualize local Axis of elements 
        Support: 
True: Visualize support type
        Load: 
True: Visualize load
"""


from ghpythonlib.componentbase import executingcomponent as component
import Grasshopper, GhPython
import System
import ghpythonlib.components as ghcomp

import Rhino as rc
import rhinoscriptsyntax as rs
import sys
import Rhino.Geometry as rg
import Grasshopper as gh
import copy

ghenv.Component.Name = "View Model (Alpaca4d)"
ghenv.Component.NickName = 'VM'
ghenv.Component.Message = "View Model (Alpaca4d)"

ghcompfolder = gh.Folders.DefaultAssemblyFolder
if ghcompfolder not in sys.path:
    sys.path.append(ghcompfolder)
try:
    from Alpaca4d import alpaca4dView as alpacaView
except:
    msg = "Cannot import Alpaca4d. Is the Alpaca4d folder available in " + ghcompfolder + "?"
    ghenv.Component.AddRuntimeMessage(gh.Kernel.GH_RuntimeMessageLevel.Error, msg)

checkData = True

class MyComponent(component):
    
    def RunScript(self, AlpacaModel, type, nodeTag, eleTag, scale_Tag, __________, localAxis, scale_Axis, ____________ , support, scale_Support,___________, load, scale_load):
        
        
        self.ModelBeam = []
        self.ModelShell = []
        self.ModelBrick = []
        self.Nodes = []
        self.TagEle = []
        self.localAxis = []
        self.solidSupport = []
        self.viewLoad = []
        
        if not AlpacaModel:
            checkData = False
            msg = "Input parameter AlpacaModel failed to collect data"
            ghenv.Component.AddRuntimeMessage(gh.Kernel.GH_RuntimeMessageLevel.Warning, msg)
        else:
            
            
            self.type = 0 if type is None else type
            
            if self.type == 1 or self.type == 0:
                self.ModelBeam = alpacaView.ViewBeam( AlpacaModel, type)
                self.ModelShell = alpacaView.ViewShell( AlpacaModel, type )
                self.ModelBrick = alpacaView.ViewBrick( AlpacaModel)

            #NODE TAG VIEW
            
            self.scale_Tag = 50 if scale_Tag is None else scale_Tag
            
            if nodeTag is True:
                self.Nodes = [ [inode.nodeTag, inode.Pos] for inode in AlpacaModel.nodes]
            else:
                self.Nodes = []
            #ELE TAG VIEW
            if eleTag is True:
                TagBeam = [ [item.eleTag, item.getPerpFrame().Origin] for item in AlpacaModel.beams]
                TagShell = [ [item.eleTag, rg.AreaMassProperties.Compute( item.Mesh, False, True, False, False ).Centroid] for item in AlpacaModel.shells]
                TagBrick = [ [item.eleTag, rg.AreaMassProperties.Compute( item.Mesh, False, True, False, False ).Centroid] for item in AlpacaModel.bricks]
                self.TagEle = TagBeam + TagShell + TagBrick
            else:
                self.TagEle = []
            #LOCAL AXIS
            self.scale_Axis = 0.25 if scale_Axis is None else scale_Axis
            
            if localAxis is True:
                self.localAxis = [ [item.getPerpFrame().Origin, item.getPerpFrame().XAxis, item.getPerpFrame().YAxis, item.getPerpFrame().ZAxis]   for item in AlpacaModel.beams]
    
                for item in AlpacaModel.shells:
                    item.Mesh.Normals.ComputeNormals()
                    i = item.Mesh.Vertices[0]
                    j = item.Mesh.Vertices[1]
                    curve = rg.LineCurve( i, j )
                    midPoint = rg.AreaMassProperties.Compute( item.Mesh, False, True, False, False ).Centroid
                    vector3 = item.Mesh.Normals.Item[0]
                    vector1 = rg.Curve.PerpendicularFrameAt( curve, 0 )[1].ZAxis
                    vector2 = rg.Vector3d.CrossProduct( vector3, vector1)
                    self.localAxis.append( [midPoint, ghcomp.UnitVector(vector1), ghcomp.UnitVector(vector2), ghcomp.UnitVector(vector3)] )
                
                for item in AlpacaModel.bricks:
                    FaceNormals = ghcomp.FaceNormals(item.Mesh)
                    midPoint = FaceNormals[0]
                    normals = FaceNormals[1]
                    face = item.Mesh.Faces
                    curve = []
                    for iFace in face:
                        i = item.Mesh.Vertices[iFace[0]]
                        j = item.Mesh.Vertices[iFace[1]]
                        curve.append( rg.LineCurve( i, j ) )
                    for iM, iN, iC in zip(midPoint, normals, curve):
                        vector3 = iN
                        vector1 = rg.Curve.PerpendicularFrameAt( iC, 0 )[1].ZAxis
                        vector2 = rg.Vector3d.CrossProduct( vector3, vector1)
                        self.localAxis.append( [iM, ghcomp.UnitVector(vector1), ghcomp.UnitVector(vector2), ghcomp.UnitVector(vector3)] )
                
            else:
                self.localAxis = []
            #SUPPORT
            if support is True:
                scale_Support = 0.5 if scale_Support is None else scale_Support
                self.solidSupport = [ alpacaView.Support( iSupport, scale_Support ) for iSupport in AlpacaModel.supports ]
            else:
                self.solidSupport = []
            # LOAD
            if load is True:
                scale_load = 1.0 if scale_load is None else scale_load
                self.viewLoad =[[item.Pos, item.Force, item.Moment] for item in AlpacaModel.loads]
            else:
                self.viewLoad = []
            self.forceBounds = ghcomp.Bounds([ item[1] for item in self.viewLoad])
            self.momentBounds = ghcomp.Bounds([ item[2] for item in self.viewLoad])
            self.scale_load = scale_load

    def DrawViewportWires(self,arg):
        # Beam
        for iBeam in self.ModelBeam:
            color = iBeam[1]
            colorMaterial = rc.Display.DisplayMaterial(color, 0.3)
            if self.type == 1:
                colorWirframe = System.Drawing.Color.Gray
                #System.Drawing.Color.LightGray
                arg.Display.DrawBrepShaded(iBeam[0], colorMaterial)
                arg.Display.DrawBrepWires(iBeam[0], colorWirframe)
            elif self.type == 0 :
                thickness = 2
                arg.Display.DrawCurve(iBeam[0], color, thickness)
        # Mesh
        for iShell in self.ModelShell:
            color = iShell[1]
            #color = System.Drawing.Color.Blue
            colorMaterial = rc.Display.DisplayMaterial(color,color,color,color,1,0.30)
            colorMaterial.IsTwoSided = False
            arg.Display.DrawMeshShaded(iShell[0], colorMaterial)
            colorWirframe = System.Drawing.Color.Black
            arg.Display.DrawMeshWires(iShell[0], colorWirframe)
        #Brick 
        for iBrick in self.ModelBrick:
            color = iBrick[1]
            #color = System.Drawing.Color.Blue
            colorMaterial = rc.Display.DisplayMaterial(color,color,color,color,1,0.30)
            colorMaterial.IsTwoSided = False
            arg.Display.DrawMeshShaded(iBrick[0], colorMaterial)
            colorWirframe = System.Drawing.Color.Black
            arg.Display.DrawMeshWires(iBrick[0], colorWirframe)
            
        # node Tag view
        for inode in self.Nodes:
            arg.Display.Draw2dText( str(inode[0]), System.Drawing.Color.DarkSlateBlue, inode[1], True, self.scale_Tag)
        # ele Tag view
        for iEle in self.TagEle:
            arg.Display.Draw2dText( str(iEle[0]), System.Drawing.Color.BlanchedAlmond, iEle[1], True, self.scale_Tag)
        # local Axis
        for iLocalAxis in self.localAxis:
            c = self.scale_Axis
            arg.Display.DrawArrow( rg.Line(iLocalAxis[0], rg.Vector3d.Multiply(c,iLocalAxis[1])), System.Drawing.Color.Red)
            arg.Display.DrawArrow( rg.Line(iLocalAxis[0], rg.Vector3d.Multiply(c,iLocalAxis[2])), System.Drawing.Color.Green)
            arg.Display.DrawArrow( rg.Line(iLocalAxis[0], rg.Vector3d.Multiply(c,iLocalAxis[3])), System.Drawing.Color.Blue)
            
            
        color = System.Drawing.Color.Azure
        colorWirframe = System.Drawing.Color.Black
        colorMaterial = rc.Display.DisplayMaterial(color, 0.0)
        for iSupport in self.solidSupport :
            arg.Display.DrawBrepShaded( iSupport, colorMaterial)
            arg.Display.DrawBrepWires( iSupport, colorWirframe)
            
        for iLoad in self.viewLoad:
            arg.Display.DrawArrow( rg.Line(iLoad[0], iLoad[1]/self.forceBounds[1] * self.scale_load) ,  System.Drawing.Color.DarkRed)
            arg.Display.DrawArrow( rg.Line(iLoad[0], iLoad[2]/self.momentBounds[1] * self.scale_load) ,  System.Drawing.Color.DarkBlue)
# ---------- end vm ----------
vss = ViewShellStressesAlpaca4d(AlpacaSolvedModel=ra.AlpacaSolvedModel, step="0", listColor=clr_3)  # -> Shell; inputs step: Int32, stressType: Int32, listColor: list of Color
# ---------- vss: Python ----------
"""
Read Shell Stresses
-
    Args:
        AlpacaSolvedModel:
        step:
        stressType: 0-p11, 1-p22, 2-p12, 3-m11, 4-m22, 5-m12, 6-q1, 7-q2
        listColor:
    Returns:
        Shell
"""

ghenv.Component.Name = "View Shell Stresses (Alpaca4d)"
ghenv.Component.NickName = 'VSS'
ghenv.Component.Message = "View Shell Stresses (Alpaca4d)"

import sys
import os
import System
from System.Drawing import Color


import clr
import clrtype
import Rhino.Geometry as rg
import rhinoscriptsyntax as rs
import Grasshopper as gh
import copy
import ghpythonlib.treehelpers as th
from ghpythonlib.components import Bounds
import math as mt


## add alpaca install directory to system path

ghcompfolder = gh.Folders.DefaultAssemblyFolder
if ghcompfolder not in sys.path:
    sys.path.append(ghcompfolder)

try:
    from Alpaca4d import alpaca4d as alpaca
    from Alpaca4d import alpaca4dView as alpacaView
except:
    msg = "Cannot import Alpaca4d. Is the Alpaca4d folder available in " + ghcompfolder + "?"
    ghenv.Component.AddRuntimeMessage(gh.Kernel.GH_RuntimeMessageLevel.Error, msg)



FolderPath = rs.DocumentPath()
os.chdir(FolderPath)


# import costum modules to read the hdf5 file

my_module_name = "Alpaca_StepReader"
my_module = sys.modules.setdefault(my_module_name, type(sys)(my_module_name))

hdfFilePath = os.path.join(ghcompfolder, "Alpaca4d\HDF5CSharp.dll")
clr.AddReferenceToFileAndPath(hdfFilePath)

from HDF5CSharp import Hdf5

try:
    Steps = my_module.Steps
except AttributeError:
    type_2d = type(System.Array.CreateInstance(float, 1, 1))

    class Steps(object):
        __metaclass__ = clrtype.ClrClass
        _clrfields = {"STEP_{}".format(i): type_2d for i in range(1000)} # it will work for model with less than 1000 steps

    my_module.Steps = Steps


checkData = True

if not AlpacaSolvedModel:
    checkData = False
    msg = "Input parameter AlpacaModel failed to collect data"
    ghenv.Component.AddRuntimeMessage(gh.Kernel.GH_RuntimeMessageLevel.Warning, msg)

if stressType is None:
    stressType = 0

if not listColor: listColor = [ System.Drawing.Color.DarkBlue, 
                                System.Drawing.Color.RoyalBlue, 
                                System.Drawing.Color.CornflowerBlue,
                                System.Drawing.Color.LightSkyBlue, 
                                System.Drawing.Color.LightBlue,
                                System.Drawing.Color.CadetBlue,
                                System.Drawing.Color.White,
                                System.Drawing.Color.Yellow,
                                System.Drawing.Color.Orange,
                                System.Drawing.Color.Red,
                                System.Drawing.Color.DarkRed]

if checkData:
    
    try:
        step = (int(AlpacaSolvedModel.analysis.NumberOfSteps) - 1) if step is None else step
        fileId = Hdf5.OpenFile(AlpacaSolvedModel.recorderName, True)
        
        shellSortedByeleTag = sorted(AlpacaSolvedModel.shells, key=lambda x: x.eleTag)
        
        ShellDKGT = []
        ShellMITC4 = []
        ASDShellQ4 = []
        
        
        for item in shellSortedByeleTag:
            if item.elementType == "ShellDKGT":
                ShellDKGT.append(item)
            elif item.elementType == "ShellMITC4":
                ShellMITC4.append(item)
            elif item.elementType == "ASDShellQ4":
                ASDShellQ4.append(item)
        
        shellElements = [ShellDKGT, ShellMITC4, ASDShellQ4]
        
        #shellMITC4
        stressResultMITC4 = Hdf5.ReadObject[Steps](fileId, "/MODEL_STAGE[1]/RESULTS/ON_ELEMENTS/stresses/53-UnknownMovableObject[201:0:0]/DATA")
        #ShellNLDKGT
        stressResultNLDKGT = Hdf5.ReadObject[Steps](fileId, "/MODEL_STAGE[1]/RESULTS/ON_ELEMENTS/stresses/167-UnknownMovableObject[103:0:0]/DATA")
        #asdea shell
        stressResultASDShellQ4 = Hdf5.ReadObject[Steps](fileId, "/MODEL_STAGE[1]/RESULTS/ON_ELEMENTS/stresses/203-UnknownMovableObject[201:0:0]/DATA")
        
        stress = []
        
        for j,stressResult in enumerate([stressResultNLDKGT, stressResultMITC4, stressResultASDShellQ4]):
            for i in range(len(shellElements[j])):
                p11_0 = getattr(stressResult, 'STEP_{}'.format(step))[i,0]
                p11_1 = getattr(stressResult, 'STEP_{}'.format(step))[i,8]
                p11_2 = getattr(stressResult, 'STEP_{}'.format(step))[i,16]
                p11_3 = getattr(stressResult, 'STEP_{}'.format(step))[i,24]
                
                p11 = [p11_0,p11_1,p11_2,p11_3]
                
                
                p22_0 = getattr(stressResult, 'STEP_{}'.format(step))[i,1]
                p22_1 = getattr(stressResult, 'STEP_{}'.format(step))[i,9]
                p22_2 = getattr(stressResult, 'STEP_{}'.format(step))[i,17]
                p22_3 = getattr(stressResult, 'STEP_{}'.format(step))[i,25]
                
                p22 = [p22_0,p22_1,p22_2,p22_3]
                
                
                p12_0 = getattr(stressResult, 'STEP_{}'.format(step))[i,2]
                p12_1 = getattr(stressResult, 'STEP_{}'.format(step))[i,10]
                p12_2 = getattr(stressResult, 'STEP_{}'.format(step))[i,18]
                p12_3 = getattr(stressResult, 'STEP_{}'.format(step))[i,26]
                
                p12 = [p12_0,p12_1,p12_2,p12_3]
                
                
                m11_0 = getattr(stressResult, 'STEP_{}'.format(step))[i,3]
                m11_1 = getattr(stressResult, 'STEP_{}'.format(step))[i,11]
                m11_2 = getattr(stressResult, 'STEP_{}'.format(step))[i,19]
                m11_3 = getattr(stressResult, 'STEP_{}'.format(step))[i,27]
                
                m11 = [m11_0,m11_1,m11_2,m11_3]
                
                
                m22_0 = getattr(stressResult, 'STEP_{}'.format(step))[i,4]
                m22_1 = getattr(stressResult, 'STEP_{}'.format(step))[i,12]
                m22_2 = getattr(stressResult, 'STEP_{}'.format(step))[i,20]
                m22_3 = getattr(stressResult, 'STEP_{}'.format(step))[i,28]
                
                m22 = [m22_0,m22_1,m22_2,m22_3]
                
                
                m12_0 = getattr(stressResult, 'STEP_{}'.format(step))[i,5]
                m12_1 = getattr(stressResult, 'STEP_{}'.format(step))[i,13]
                m12_2 = getattr(stressResult, 'STEP_{}'.format(step))[i,21]
                m12_3 = getattr(stressResult, 'STEP_{}'.format(step))[i,29]
                
                m12 = [m12_0,m12_1,m12_2,m12_3]
                
                
                q1_0 = getattr(stressResult, 'STEP_{}'.format(step))[i,6]
                q1_1 = getattr(stressResult, 'STEP_{}'.format(step))[i,14]
                q1_2 = getattr(stressResult, 'STEP_{}'.format(step))[i,22]
                q1_3 = getattr(stressResult, 'STEP_{}'.format(step))[i,30]
                
                q1 = [q1_0,q1_1,q1_2,q1_3]
                
                
                q2_0 = getattr(stressResult, 'STEP_{}'.format(step))[i,7]
                q2_1 = getattr(stressResult, 'STEP_{}'.format(step))[i,15]
                q2_2 = getattr(stressResult, 'STEP_{}'.format(step))[i,23]
                q2_3 = getattr(stressResult, 'STEP_{}'.format(step))[i,31]
                
                q2 = [q2_0,q2_1,q2_2,q2_3]
                
                stress.append([ p11, p22, p12, m11, m22, m12, q1, q2 ]) 
                
        Hdf5.CloseFile(fileId)
        print("I have close the file")
    except:
        Hdf5.CloseFile(fileId)
        print("I have close the file")


    ListValor = [ row[stressType] for row in stress ]
    ListFlatten = []
    for i in ListValor:
        for j in i:
            ListFlatten.append(j)
            
    bounds = Bounds(ListFlatten)
    shellElement = ShellDKGT + ShellMITC4 + ASDShellQ4
    Shell = alpacaView.ColorShellStress( shellElement, ListValor, bounds, listColor)
# ---------- end vss ----------
mjoin = MeshJoin(Meshes=vss)
medges = MeshEdges(Mesh=mjoin)  # -> NakedEdges, InteriorEdges, NonManifoldEdges
previewlw = CustomPreviewLineweights(Geometry=medges.InteriorEdges, Shader=ColourSwatch(SwatchColor=RGB(0, 0, 0)), Absolute=False)
previewlw_2 = CustomPreviewLineweights(
    Geometry=medges.NakedEdges,
    Shader=ColourSwatch(SwatchColor=RGB(0, 0, 0)),
    Thickness=Slider(3, range=0..10),
    Absolute=False)
