# Grasshopper definition VaseGeometry.gh (Grasshopper 1.0.7)
# plug-ins: Chromodoris, Human, Weaverbird, Alpaca4d, MeshEdit Components

# Format Engineers CAD Information Issue Disclaimer
# 
# Project: PROJECT NAME
# 
# You should use this model for reference purposes only to assist in co-ordinating your work and is supplementary to formally issued drawings. Once the data is introduced into your own CAD or other system Format Engineers Ltd. can take no responsibility for its accuracy.
# 
# The last set of formally issued paper drawings are the contractual documents which represent the current stage of design development. If you have any queries, please contact the project CAD co-ordinator or the CAD Development Team.
# 
# Changes:
# 
# YYYY-MM-DD: Summary of changes
# 
# Usage notes:
# 
# This definition includes a basic implementation of Merbarki's Farthest Point Seeding algorithm (2005), adapted for tracing lines of principal curvature on NURBS surfaces. Requires modified Triangle.NET, if this isn't attached then... good luck! There are currently two main limitations: (a) this implementation measures density in parameter space, and (b) it doesn't include the dynamic refinement of density that Mebarki suggests.
panel = Panel("0.25")
pt = ConstructPoint(XCoordinate=panel, YCoordinate=0, ZCoordinate=panel)
diameter = Slider(0.5, range=0.1..1)
pt_2 = Point(pt)
num = Number(expr("x/2", diameter))
circle = CircleCNR(Center=pt_2, Normal=Vector(0, 0, 1), Radius=num)
len = Length(Curve=circle)
phi = GoldenRatio(Factor=1)
division = Division(A=len, B="0.02")
multiplication = Multiplication(A=diameter, B=phi)
divide = DivideCurve(Curve=circle, Count=division, Kinks=False)  # -> Points, Tangents, Parameters
pline = PolyLine(Vertices=divide.Points, Closed=invert(False))
division_2 = Division(A=multiplication, B="0.08")
range = Range(Domain=multiplication, Steps=division_2)
Z = UnitZ(Factor=range)
move = Move(Geometry=pline, Motion=Z)  # -> Geometry, Transform
mloft = MeshLoft(Polylines=move.Geometry, Cap=False)
ml = MeshLoftAlpaca4d(Polylines=move.Geometry)
wbnaked = WeaverbirdsNakedBoundary(MeshClosedPolylines=ml)
item = ListItem(List=wbnaked, Index=0, Wrap=True)  # -> Item, Item1
explode = Explode(Curve=item.Item1, Recursive=True)  # -> Segments, Vertices
explode_2 = Explode(Curve=item.Item, Recursive=True)  # -> Segments, Vertices
cullpt = CullDuplicates(Points=explode.Vertices, Tolerance="0.01", CullMode=3)  # -> Points, Indices, Valence
eim = ElasticIsotropicMaterialAlpaca4d(E="2e9", V="0.3", Rho="1250")
cullpt_2 = CullDuplicates(Points=explode_2.Vertices, Tolerance="0.01", CullMode=3)  # -> Points, Indices, Valence
toggle = BooleanToggle(True)
mesh = Mesh(ml)
pfs = PlateFiberSectionAlpaca4d(Thickness="0.05", Material=eim)
pt_3 = Point(cullpt_2.Points)
pt_4 = Point(cullpt.Points)
explode_3 = MeshExplode(Mesh=mesh, Interpolate=False)
asdq4 = ASDShellQ4Alpaca4d(Mesh=explode_3, Section=pfs)
support = SupportAlpaca4d(Point=pt_3, Tx=toggle, Ty=toggle, Tz=toggle, Rx=toggle, Ry=toggle, RZ=toggle)
support_2 = SupportAlpaca4d(Point=pt_4, Tx=True, Ty=True, Tz=Toggle(True), Rx=True, Ry=True, RZ=True)
assemble_model = AssembleModelAlpaca4d(Element=asdq4, Support=[support, support_2], Tollerance=0.01)  # -> AlpacaModel, MassForce
panel_2 = Panel(assemble_model.MassForce)
list = ValueList({"-genBandArpack", "-symmBandLapack", "-fullGenLapack"}, selected="-genBandArpack")
nv = NaturalVibrationAnalysisAlpaca4d(AlpacaModel=assemble_model.AlpacaModel, VibrationModes="25", Solver=list)  # -> Log, AlpacaModel, Eigenvalues, Period, Frequencies
series = Series(Start=0, Step=1, Count="25")
clr = ColorsAlpaca4d(gradIndex=11)  # -> colors; inputs gradIndex: Int32
#   port colors: A series of colors to be plugged into the "Ladybug_Legend Parameters" component.
# ---------- clr: Python ----------
"""
Preset of gradient colors perfect for Data Visualisation
    Inputs:
        gradIndex: An index refering to one of the following possible gradients:
            0 - Orignal Ladybug
            1 - Nuanced Ladybug
            2 - Multi-colored Ladybug
            3 - Ecotect
            4 - Thermal Comfort Percentage
            5 - Thermal Comfort Colors
            6 - Shade Benefit/Harm
            7 - Shade Harm
            8 - Shade Benefit
            9 - CFD Colors 1
            10 - Radiation Benefit
            11 - Gsa10 Colour
            12 - Gsa9 Colour
    Returns:
        customColors: A series of colors.
"""

ghenv.Component.Name = "Colors (Alpaca4d)"
ghenv.Component.NickName = 'CLR'
ghenv.Component.Message = 'Colors (Alpaca4d)'

import scriptcontext as sc
import Grasshopper.Kernel as gh
import System

gradientLibrary = {
        0: [System.Drawing.Color.FromArgb(75, 107, 169), System.Drawing.Color.FromArgb(115, 147, 202), System.Drawing.Color.FromArgb(170, 200, 247), System.Drawing.Color.FromArgb(193, 213, 208), System.Drawing.Color.FromArgb(245, 239, 103), System.Drawing.Color.FromArgb(252, 230, 74), System.Drawing.Color.FromArgb(239, 156, 21), System.Drawing.Color.FromArgb(234, 123, 0), System.Drawing.Color.FromArgb(234, 74, 0), System.Drawing.Color.FromArgb(234, 38, 0)],
        1: [System.Drawing.Color.FromArgb(49,54,149), System.Drawing.Color.FromArgb(69,117,180), System.Drawing.Color.FromArgb(116,173,209), System.Drawing.Color.FromArgb(171,217,233), System.Drawing.Color.FromArgb(224,243,248), System.Drawing.Color.FromArgb(255,255,191), System.Drawing.Color.FromArgb(254,224,144), System.Drawing.Color.FromArgb(253,174,97), System.Drawing.Color.FromArgb(244,109,67), System.Drawing.Color.FromArgb(215,48,39), System.Drawing.Color.FromArgb(165,0,38)],
        2: [System.Drawing.Color.FromArgb(4,25,145), System.Drawing.Color.FromArgb(7,48,224), System.Drawing.Color.FromArgb(7,88,255), System.Drawing.Color.FromArgb(1,232,255), System.Drawing.Color.FromArgb(97,246,156), System.Drawing.Color.FromArgb(166,249,86), System.Drawing.Color.FromArgb(254,244,1), System.Drawing.Color.FromArgb(255,121,0), System.Drawing.Color.FromArgb(239,39,0), System.Drawing.Color.FromArgb(138,17,0)],
        3: [System.Drawing.Color.FromArgb(0,0,255), System.Drawing.Color.FromArgb(53,0,202), System.Drawing.Color.FromArgb(107,0,148), System.Drawing.Color.FromArgb(160,0,95), System.Drawing.Color.FromArgb(214,0,41), System.Drawing.Color.FromArgb(255,12,0), System.Drawing.Color.FromArgb(255,66,0), System.Drawing.Color.FromArgb(255,119,0), System.Drawing.Color.FromArgb(255,173,0), System.Drawing.Color.FromArgb(255,226,0), System.Drawing.Color.FromArgb(255,255,0)],
        4: [System.Drawing.Color.FromArgb(0,0,0), System.Drawing.Color.FromArgb(110,0,153), System.Drawing.Color.FromArgb(255,0,0), System.Drawing.Color.FromArgb(255,255,102), System.Drawing.Color.FromArgb(255,255,255)],
        5: [System.Drawing.Color.FromArgb(0,136,255), System.Drawing.Color.FromArgb(200,225,255), System.Drawing.Color.FromArgb(255,255,255), System.Drawing.Color.FromArgb(255,230,230), System.Drawing.Color.FromArgb(255,0,0)],
        6: [System.Drawing.Color.FromArgb(5,48,97), System.Drawing.Color.FromArgb(33,102,172), System.Drawing.Color.FromArgb(67,147,195), System.Drawing.Color.FromArgb(146,197,222), System.Drawing.Color.FromArgb(209,229,240), System.Drawing.Color.FromArgb(255,255,255), System.Drawing.Color.FromArgb(253,219,199), System.Drawing.Color.FromArgb(244,165,130), System.Drawing.Color.FromArgb(214,96,77), System.Drawing.Color.FromArgb(178,24,43), System.Drawing.Color.FromArgb(103,0,31)],
        7: [System.Drawing.Color.FromArgb(255,255,255), System.Drawing.Color.FromArgb(253,219,199), System.Drawing.Color.FromArgb(244,165,130), System.Drawing.Color.FromArgb(214,96,77), System.Drawing.Color.FromArgb(178,24,43), System.Drawing.Color.FromArgb(103,0,31)],
        8: [System.Drawing.Color.FromArgb(255,255,255), System.Drawing.Color.FromArgb(209,229,240), System.Drawing.Color.FromArgb(146,197,222), System.Drawing.Color.FromArgb(67,147,195), System.Drawing.Color.FromArgb(33,102,172), System.Drawing.Color.FromArgb(5,48,97)],
        9: [System.Drawing.Color.FromArgb(0,16,120), System.Drawing.Color.FromArgb(38,70,160), System.Drawing.Color.FromArgb(5,180,222), System.Drawing.Color.FromArgb(16,180,109), System.Drawing.Color.FromArgb(59,183,35), System.Drawing.Color.FromArgb(143,209,19), System.Drawing.Color.FromArgb(228,215,29), System.Drawing.Color.FromArgb(246,147,17), System.Drawing.Color.FromArgb(243,74,0), System.Drawing.Color.FromArgb(255,0,0)],
        10: [System.Drawing.Color.FromArgb(0,191,48), System.Drawing.Color.FromArgb(255,238,184), System.Drawing.Color.FromArgb(255,0,0)],
        11: [System.Drawing.Color.FromArgb(204,0,71), System.Drawing.Color.FromArgb(255,182,71), System.Drawing.Color.FromArgb(206,255,115), System.Drawing.Color.FromArgb(26,180, 214),System.Drawing.Color.FromArgb(0,0,207)],
        12: [System.Drawing.Color.FromArgb(255, 51, 51), System.Drawing.Color.FromArgb(255, 170, 51), System.Drawing.Color.FromArgb(255, 255, 51), System.Drawing.Color.FromArgb(170, 255, 125), System.Drawing.Color.FromArgb(51, 255, 231), System.Drawing.Color.FromArgb(51, 170, 255), System.Drawing.Color.FromArgb(51,51, 255)]}
colors = gradientLibrary[gradIndex]
# ---------- end clr ----------
graft = GraftTree(Tree=series, IncludeEmptyLists=True, IncludeNullItems=True)
deformed_model_view = DeformedModelViewAlpaca4d(AlpacaModel=nv.AlpacaModel, Step=graft, Scale=Slider(0.146, range=0..1), Colors=clr)  # -> Line, Mesh, Brick
python = GhPythonScript(x=nv.AlpacaModel)  # -> out, a
# ---------- python: Python ----------
__author__ = "Marco"
__version__ = "2022.11.08"

import rhinoscriptsyntax as rs

a = x.Shells
# ---------- end python ----------
lng = ListLength(List=python.a)
geo = Geometry(deformed_model_view.Mesh)
partition = PartitionList(List=geo, Size=lng)
mjoin = MeshJoin(Meshes=partition)  # -> flatten(Mesh)
lng_2 = ListLength(List=mjoin)
sqrt = SquareRoot(Value=lng_2)
sqgrid = Square(Plane=PlaneXY(0, 0, 0), Size=1, ExtentX=sqrt, ExtentY=sqrt)  # -> Cells, Points
flip = FlipMatrix(Data=sqgrid.Cells)
pcen = PolygonCenter(Polyline=flip)  # -> flatten(CenterV), CenterE, CenterA
pt_5 = ConstructPoint(XCoordinate=0, YCoordinate=0, ZCoordinate=0)
orient = Orient(Geometry=mjoin, Source=pt_2, Target=pcen.CenterV)  # -> Geometry, Transform
xy = XYPlane(Origin=Point(0, 0, 0))
transform = Transform(Geometry=pt_5, Transform=orient.Transform)
mirror = Mirror(Geometry=orient.Geometry, Plane=xy)  # -> Geometry, Transform

geo_2 = Geometry(transform)
lng_3 = ListLength(List=geo_2)
series_2 = Series(Start=0, Step=1, Count=lng_3)
python_2 = GhPythonScript(x="shape mode:", y=series_2)  # -> out, a
# ---------- python_2: Python ----------
a = "{1}\n{0}".format(int(y),x)
# ---------- end python_2 ----------
panel_3 = Panel(python_2.a)
tag = TextTag3D(Location=geo_2, Text=python_2.a, Size="0.05", Justification=1)

mesh_2 = Mesh(mirror.Geometry)
Z_2 = UnitZ(Factor=multiplication)
move_2 = Move(Geometry=mesh_2, Motion=Z_2)  # -> Geometry, Transform
item_2 = ListItem(List=move_2.Geometry, Index="117", Wrap=True)
item_3 = ListItem(List=move_2.Geometry, Index=Slider(49, range=0..63), Wrap=True)
medges = MeshEdges(Mesh=move_2.Geometry)  # -> NakedEdges, InteriorEdges, NonManifoldEdges
mcol = MeshColours(Mesh=item_2, Colours=ColourSwatch(SwatchColor=RGB(255, 255, 255)))
crv = Curve(medges.NakedEdges)
crv_2 = Curve(medges.InteriorEdges)
mcol_2 = MeshColours(Mesh=move_2.Geometry, Colours=ColourSwatch(SwatchColor=RGB(255, 255, 255)))
previewlw = CustomPreviewLineweights(Geometry=crv, Shader=ColourSwatch(SwatchColor=RGB(0, 0, 0)), Thickness="3", Absolute=False)
previewlw_2 = CustomPreviewLineweights(Geometry=crv_2, Shader=ColourSwatch(SwatchColor=RGB(0, 0, 0)), Thickness="1", Absolute=False)
