# Grasshopper definition Serpentine Pavillon 2016_shared.gh (Grasshopper 1.0.7)
# plug-ins: Pufferfish, Alpaca4d, MeshEdit Components

# ---- group: Element
data = Data(0)
data_2 = Data(0)

# ---- group: Load
# Shell Elements
# Units
# N, mm
data_3 = Data(0)
data_4 = Data(0)

# ---- group: Cross_Section
data_5 = Data(0)
data_6 = Data(0)

# ---- group: Support
data_7 = Data(0)
data_8 = Data(0)

# ---- group: Material
data_9 = Data(0)
data_10 = Data(0)

# ---- group: Constraint
data_11 = Data(0)
data_12 = Data(0)

# ----
mesh = Mesh([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])
mjoin = MeshJoin(Meshes=mesh)
demesh = DeconstructMesh(Mesh=mjoin)  # -> Vertices, Faces, Colours, Normals
pdecon = Deconstruct(Point=demesh.Vertices)  # -> XComponent, YComponent, ZComponent

# ---- group: Visualization
data_13 = Data(0)
data_14 = Data(0)

# ---- group: Output
data_15 = Data(0)
data_16 = Data(0)

# ----
bnd = Bounds(Numbers=flatten(pdecon.ZComponent))
dedomain = DeconstructDomain(Domain=bnd)  # -> Start, End

panel = Panel("2.1e9")
panel_2 = Panel("2500")  # "kg/m3"
eim = ElasticIsotropicMaterialAlpaca4d(E=panel, V="0.20", Rho=panel_2)

addition = Addition(A=dedomain.Start, B="0.1")
smaller = SmallerThan(FirstNumber=pdecon.ZComponent, SecondNumber=addition)  # -> SmallerThan, OrEqualTo
cull = CullPattern(List=demesh.Vertices, CullPattern=smaller.SmallerThan)
pt = Point(demesh.Vertices)

meter = Panel("0.005")
pfs = PlateFiberSectionAlpaca4d(Thickness=meter, Material=eim)

cullpt = CullDuplicates(Points=cull, Tolerance="0.01", CullMode=3)  # -> Points, Indices, Valence

cullpt_2 = CullDuplicates(Points=pt, Tolerance=0.1, CullMode=1)  # -> Points, Indices, Valence
constant_time_series = ConstantTimeSeriesAlpaca4d(LoadFactor=1)  # -> TimeSeries, Graph
vec = VectorXYZ(XComponent=0, YComponent=0, ZComponent="-10")  # -> Vector, Length
point_load = PointLoadAlpaca4d(Point=cullpt_2.Points, Force=vec.Vector, Moment=Vector(0, 0, 0), TimeSeries=constant_time_series.TimeSeries)

toggle = BooleanToggle(True)
pt_2 = Point(cullpt.Points)
support = SupportAlpaca4d(Point=pt_2, Tx=toggle, Ty=toggle, Tz=toggle, Rx=toggle, Ry=toggle, RZ=toggle)

explode = MeshExplode(Mesh=mjoin, Interpolate=False)
asdq4 = ASDShellQ4Alpaca4d(Mesh=explode, Section=pfs, Colour=ColourSwatch(SwatchColor=RGB(60, 0, 255)))

assemble_model = AssembleModelAlpaca4d(Element=flatten(asdq4), Support=flatten(support), Load=flatten(point_load), Tollerance=0.01)  # -> AlpacaModel, MassForce
analysisstep = AnalysisStepAlpaca4d(NumIncr="1")
analysissettings = AnalysisSettingsAlpaca4d(AnalysisSteps=analysisstep)

# ---- group: Run Analysis (Alpaca4d)
ra = RunAnalysisAlpaca4d(AlpacaModel=assemble_model.AlpacaModel, Settings=analysissettings)  # -> Log, AlpacaModel

# ----
nd = NodalDisplacementsAlpaca4d(AlpacaModel=ra.AlpacaModel, History=False, Step=0)  # -> Displacement, Rotation, port, Velocity, Acceleration; disabled
ds = DisassembleModelAlpaca4d(AlpacaModel=ra.AlpacaModel)  # -> Points; disabled
# ---------- ds: Python ----------
"""
Disassemble a Model
-
    Args:
        AlpacaModel:
    Returns:
        Points:
        threeNdfPoints:
        sixNdfPoints:
        
        Beam:
        Shell:
        Brick:
        Support:
        Constraint:
        TimeSeries:
        Load:
        Material:
"""

ghenv.Component.Name = "Disassemble Model (Alpaca4d)"
ghenv.Component.NickName = 'DS'
ghenv.Component.Message = "Disassemble Model (Alpaca4d)"


checkData = True




if checkData:
    Points = AlpacaModel.UniquePoints
# ---------- end ds ----------
clr = ColorsAlpaca4d(GradientIndex=Slider(9, range=1..12))
dom = ConstructDomain(DomainStart="0", DomainEnd="0.005")
deformed_model_view = DeformedModelViewAlpaca4d(AlpacaModel=ra.AlpacaModel, Step=0, Scale="0", Colors=clr, Range=dom)  # -> Line, Mesh, Brick
vlen = VectorLength(Vector=nd.Displacement)  # disabled
mjoin_2 = MeshJoin(Meshes=deformed_model_view.Mesh)
points = Geometry(ds)  # disabled
values = Number(vlen)  # disabled

num = Data(values)  # disabled
bnd_2 = Bounds(Numbers=num)  # disabled
remap = RemapNumbers(Value=num, Source=bnd_2, Target=Domain(0, 1))  # -> Mapped, Clipped; disabled
twnthrucols = TweenThroughColors(
    Colors=clr,
    Factor=remap.Mapped,
    Normalized=True,
    Equalized=False,
    Weighted=False,
    Loopback=False,
    Degree=3,
    InterpolationType=0,
    Alpha=True)  # disabled
col = Colour(twnthrucols)  # disabled
col_2 = Data(col)  # disabled

num_2 = Data(values)  # disabled
bnd_3 = Bounds(Numbers=num_2)  # disabled

geo = Geometry(points)  # disabled
number_slider = Slider(0.1, range=0.1..4)  # disabled
number_slider_2 = Slider(0.25, range=0.1..4)  # disabled
dom_2 = ConstructDomain(DomainStart=number_slider, DomainEnd=number_slider_2)  # disabled
remap_2 = RemapNumbers(Value=num_2, Source=bnd_3, Target=dom_2)  # -> Mapped, Clipped; disabled
dots = DotDisplay(Point=geo, Colour=col_2, Size=remap_2.Mapped)  # disabled
