# Grasshopper definition timeHistoryTest.gh (Grasshopper 1.0.7)

path = FilePath("C:\Users\Marco\Documents\GitHub\Alpaca4d\Examples\Time History\time_history.csv")
rth = ReadTimeHistoryAlpaca4d(FilePath=path, separator=",")  # -> time, values
# ---------- rth: Python ----------
"""
Parse a text file formatted in column
-
    Args:
        FilePath:
        TimeLapse:
        separator:
    Returns:
        time:
        values:
"""

import Grasshopper as gh

ghenv.Component.Name = "Read Time History (Alpaca4d)"
ghenv.Component.NickName = 'RTH'
ghenv.Component.Message = "Read Time History (Alpaca4d)"



checkData = True

if not FilePath:
    checkData = False
    msg = "Input parameter FilePath failed to collect data"
    ghenv.Component.AddRuntimeMessage(gh.Kernel.GH_RuntimeMessageLevel.Warning, msg)

separator = "," if not separator else separator


if checkData:
    
    with open(FilePath) as f:
        text_file = f.readlines()
        
        text = []
        for item in text_file:
            text.append( item.strip().split(separator))
    
    
    time = []
    values = []
    
    for line in text:
        time_track = float(line[0])
        if time_track <= TimeLapse or not TimeLapse:
            time.append(float(line[0]))
            values.append(float(line[1]))
        else:
            break
# ---------- end rth ----------
length = Slider(21, range=0..100)
time = Number([0, 0.01, 0.02, 0.03, 0.04, 0.05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])
values = Number([0, 0.22, 0.42, 0.61, 0.77, 0.89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])

# ---- group: Load applied at same frequency as mode 1
panel = Panel(rth.values)
panel_2 = Panel(rth.time)
pts = PathTimeSeriesAlpaca4d(time=panel_2, values=panel)  # -> out, TimeSeries, Graph; inputs time: list, values: list
# ---------- pts: Python ----------
"""
Create a Time Series Path
-
    Args:
        time:
        values:
        factor:
    Returns:
        TimeSeries:
        Graph:
"""

ghenv.Component.Name = "Path Time Series (Alpaca4d)"
ghenv.Component.NickName = 'PTS'
ghenv.Component.Message = "Path Time Series (Alpaca4d)"


import sys
import Rhino.Geometry as rg
import Grasshopper as gh
import copy


## add alpaca install directory to system path

ghcompfolder = gh.Folders.DefaultAssemblyFolder
if ghcompfolder not in sys.path:
    sys.path.append(ghcompfolder)

try:
    from Alpaca4d import alpaca4d as alpaca
except:
    msg = "Cannot import Alpaca4d. Is the Alpaca4d folder available in " + ghcompfolder + "?"
    ghenv.Component.AddRuntimeMessage(gh.Kernel.GH_RuntimeMessageLevel.Error, msg)


checkData = True

if not time:
    checkData = False
    msg = "Input parameter time failed to collect data"
    ghenv.Component.AddRuntimeMessage(gh.Kernel.GH_RuntimeMessageLevel.Warning, msg)

if not values:
    checkData = False
    msg = "Input parameter values failed to collect data"
    ghenv.Component.AddRuntimeMessage(gh.Kernel.GH_RuntimeMessageLevel.Warning, msg)

if not factor:
    factor = 1


if checkData:
    TimeSeries = alpaca.TimeSeriesPath(values, time, factor)
    Graph = [value * factor for value in values]
# ---------- end pts ----------
graph = QuickGraph(pts.Graph, SortOrder=0)

# ----
X = UnitX(Factor=length)
xy = XYPlane(Origin=Point(0, 0, 0))
move = Move(Geometry=xy, Motion=X)  # -> Geometry, Transform
ln = Line(StartPoint=xy, EndPoint=move.Geometry)
panel_3 = Panel(length)

# ---- group: NB. units corrected I think
panel_4 = Panel("205e9")

# ----
range = Range(Domain=Domain(0, 1), Steps=panel_3)
graft = GraftTree(Tree=ln, IncludeEmptyLists=True, IncludeNullItems=True)
uem = UniaxialElasticMaterialAlpaca4d(E=panel_4, v="0.3", rho="7850")  # -> out, uniAxialMaterial
# ---------- uem: Python ----------
"""
Create a uniaxial Elastic Material
-
    Args:
        E:
        Eneg:
        eta:
        G:
        v:
        rho:
    Returns:
        uniAxialMaterial:
"""

ghenv.Component.Name = "uniaxial Elastic Material (Alpaca4d)"
ghenv.Component.NickName = 'UEM'
ghenv.Component.Message = "uniaxial Elastic (Alpaca4d)"

import sys
import Rhino.Geometry as rg
import Grasshopper as gh
import copy


## add alpaca install directory to system path

ghcompfolder = gh.Folders.DefaultAssemblyFolder
if ghcompfolder not in sys.path:
    sys.path.append(ghcompfolder)

try:
    from Alpaca4d import alpaca4d as alpaca
except:
    msg = "Cannot import Alpaca4d. Is the Alpaca4d folder available in " + ghcompfolder + "?"
    ghenv.Component.AddRuntimeMessage(gh.Kernel.GH_RuntimeMessageLevel.Error, msg)


checkData = True

if not E:
    checkData = False
    msg = "Input parameter E failed to collect data"
    ghenv.Component.AddRuntimeMessage(gh.Kernel.GH_RuntimeMessageLevel.Warning, msg)

if not G and not v:
    checkData = False
    msg = "Input parameter G or v failed to collect data"
    ghenv.Component.AddRuntimeMessage(gh.Kernel.GH_RuntimeMessageLevel.Warning, msg)

if not rho:
    checkData = False
    msg = "Input parameter rho failed to collect data"
    ghenv.Component.AddRuntimeMessage(gh.Kernel.GH_RuntimeMessageLevel.Warning, msg)



if checkData:
    uniAxialMaterial = alpaca.uniAxialMaterialElastic(name, E, Eneg, eta, G, v, rho)
# ---------- end uem ----------
toggle = BooleanToggle(False)
toggle_2 = BooleanToggle(True)
pt = Point(xy)
pt_2 = Point(move.Geometry)
shatter = Shatter(Curve=graft, Parameters=range)
end = EndPoints(Curve=shatter)  # -> Start, End
pt_3 = Point([end.Start, end.End])
cullpt = CullDuplicates(Points=pt_3, Tolerance=0.1, CullMode=3)  # -> Points, Indices, Valence

# ---- group: distibuted load as defined in national annex for a jogging crowd
na_2_44_5 = Panel("-4.79")
Z = UnitZ(Factor=na_2_44_5)
pl = PointLoadAlpaca4d(Pos=cullpt.Points, Force=Z, TimeSeries=pts.TimeSeries)  # -> out, Load; inputs Pos: Point3d, Force: Vector3d, Moment: Vector3d
# ---------- pl: Python ----------
"""
Create a Point Load
-
    Args:
        Pos:
        Force:
        Moment:
        TimeSeries:
    Returns:
        PointLoad:
"""

ghenv.Component.Name = "Point Load (Alpaca4d)"
ghenv.Component.NickName = 'PL'
ghenv.Component.Message = "Point Load (Alpaca4d)"



import sys
import Rhino.Geometry as rg
import Grasshopper as gh
import copy


## add alpaca install directory to system path

ghcompfolder = gh.Folders.DefaultAssemblyFolder
if ghcompfolder not in sys.path:
    sys.path.append(ghcompfolder)

try:
    from Alpaca4d import alpaca4d as alpaca
except:
    msg = "Cannot import Alpaca4d. Is the Alpaca4d folder available in " + ghcompfolder + "?"
    ghenv.Component.AddRuntimeMessage(gh.Kernel.GH_RuntimeMessageLevel.Error, msg)


checkData = True

if not Pos:
    checkData = False
    msg = "Input parameter Pos failed to collect data"
    ghenv.Component.AddRuntimeMessage(gh.Kernel.GH_RuntimeMessageLevel.Warning, msg)

if not Force:
    Force = rg.Vector3d(0,0,0)

if not Moment:
    Moment = rg.Vector3d(0,0,0)

if not TimeSeries:
    checkData = False
    msg = "Input parameter TimeSeries failed to collect data"
    ghenv.Component.AddRuntimeMessage(gh.Kernel.GH_RuntimeMessageLevel.Warning, msg)


if checkData:
    Load = alpaca.PointLoad(Pos, Force, Moment, TimeSeries)
# ---------- end pl ----------

# ----
pt_4 = Point(cullpt.Points)
support = SupportAlpaca4d(Pos=pt, Tx=toggle_2, Ty=toggle, Tz=toggle_2, Rx=toggle_2, Ry=toggle, Rz=toggle)  # -> Support; inputs Pos: Point3d, Tx: Boolean, Ty: Boolean, Tz: Boolean, Rx: Boolean, Ry: Boolean, Rz: Boolean
# ---------- support: Python ----------
"""
Create a support
-
    Args:
        Pos:
        Tx:
        Ty:
        Tz:
        Rx:
        Ry:
    Returns:
        Support:
"""

ghenv.Component.Name = "Support (Alpaca4d)"
ghenv.Component.NickName = 'Support'
ghenv.Component.Message = "Support (Alpaca4d)"


import sys
import Rhino.Geometry as rg
import Grasshopper as gh


## add alpaca install directory to system path

ghcompfolder = gh.Folders.DefaultAssemblyFolder
if ghcompfolder not in sys.path:
    sys.path.append(ghcompfolder)

try:
    from Alpaca4d import alpaca4d as alpaca
except:
    msg = "Cannot import Alpaca4d. Is the Alpaca4d folder available in " + ghcompfolder + "?"
    ghenv.Component.AddRuntimeMessage(gh.Kernel.GH_RuntimeMessageLevel.Error, msg)

checkData = True


if not Pos:
    checkData = False
    msg = "Input parameter Pos failed to collect data"
    ghenv.Component.AddRuntimeMessage(gh.Kernel.GH_RuntimeMessageLevel.Warning, msg)

if checkData:
    Support = alpaca.Support(Pos, Tx, Ty, Tz, Rx, Ry, Rz)
# ---------- end support ----------
support_2 = SupportAlpaca4d(Pos=pt_2, Tx=toggle, Ty=toggle, Tz=toggle_2, Rx=toggle, Ry=toggle, Rz=toggle)  # -> Support; inputs Pos: Point3d, Tx: Boolean, Ty: Boolean, Tz: Boolean, Rx: Boolean, Ry: Boolean, Rz: Boolean; same code as support
support_3 = SupportAlpaca4d(Pos=pt_4, Tx=toggle, Ty=toggle_2, Tz=toggle, Rx=toggle_2, Ry=toggle, Rz=toggle)  # -> Support; inputs Pos: Point3d, Tx: Boolean, Ty: Boolean, Tz: Boolean, Rx: Boolean, Ry: Boolean, Rz: Boolean; same code as support
is = ISectionAlpaca4d(Bsup=".2276", tsup="0.0148", Binf=".2276", tinf="0.0148", H="0.6026", tw="0.0105", material=uem.uniAxialMaterial)  # -> Section
# ---------- is: Python ----------
"""
Create a double T Cross Section
-
    Args:
        secName:
        Bsup:
        tsup:
        Binf:
        tinf:
        H:
        tw:
        material:
    Returns:
        Section:
"""
ghenv.Component.Name = "I Section (Alpaca4d)"
ghenv.Component.NickName = 'IS'
ghenv.Component.Message = "I Section (Alpaca4d)"

import sys
import Rhino.Geometry as rg
import Grasshopper as gh
import copy



## add alpaca install directory to system path

ghcompfolder = gh.Folders.DefaultAssemblyFolder
if ghcompfolder not in sys.path:
    sys.path.append(ghcompfolder)

try:
    from Alpaca4d import alpaca4d as alpaca
except:
    msg = "Cannot import Alpaca4d. Is the Alpaca4d folder available in " + ghcompfolder + "?"
    ghenv.Component.AddRuntimeMessage(gh.Kernel.GH_RuntimeMessageLevel.Error, msg)


checkData = True

if not Bsup:
    checkData = False
    msg = "Input parameter Bsup failed to collect data"
    ghenv.Component.AddRuntimeMessage(gh.Kernel.GH_RuntimeMessageLevel.Warning, msg)

if not tsup:
    checkData = False
    msg = "Input parameter tsup failed to collect data"
    ghenv.Component.AddRuntimeMessage(gh.Kernel.GH_RuntimeMessageLevel.Warning, msg)

if not Binf:
    checkData = False
    msg = "Input parameter Binf failed to collect data"
    ghenv.Component.AddRuntimeMessage(gh.Kernel.GH_RuntimeMessageLevel.Warning, msg)

if not tinf:
    checkData = False
    msg = "Input parameter tinf failed to collect data"
    ghenv.Component.AddRuntimeMessage(gh.Kernel.GH_RuntimeMessageLevel.Warning, msg)

if not H:
    checkData = False
    msg = "Input parameter H failed to collect data"
    ghenv.Component.AddRuntimeMessage(gh.Kernel.GH_RuntimeMessageLevel.Warning, msg)

if not tw:
    checkData = False
    msg = "Input parameter tw failed to collect data"
    ghenv.Component.AddRuntimeMessage(gh.Kernel.GH_RuntimeMessageLevel.Warning, msg)

if not material:
    checkData = False
    msg = "Input parameter material failed to collect data"
    ghenv.Component.AddRuntimeMessage(gh.Kernel.GH_RuntimeMessageLevel.Warning, msg)



if checkData:
    Section = alpaca.I_Section(secName, Bsup, tsup, Binf, tinf, H, tw, material)
# ---------- end is ----------
relay = Relay([support_3, support, support_2])
fbc = ForceBeamColumnAlpaca4d(Line=shatter, Section=is)  # -> out, Element; inputs Line: Curve, Colour: Color, Z_Axis: Vector3d
# ---------- fbc: Python ----------
"""
Create a Force Beam Column
-
    Args:
        Line:
        Section:
        Colour:
        Z_Axis:
    Returns:
        Element:
"""

ghenv.Component.Name = "Force Beam Column (Alpaca4d)"
ghenv.Component.NickName = 'FBC'
ghenv.Component.Message = "Force Beam Column (Alpaca4d)"


import sys
import Rhino.Geometry as rg
import Grasshopper as gh
import ghpythonlib.components as ghcomp
from System.Drawing import Color

## add alpaca install directory to system path

ghcompfolder = gh.Folders.DefaultAssemblyFolder
if ghcompfolder not in sys.path:
    sys.path.append(ghcompfolder)

try:
    from Alpaca4d import alpaca4d as alpaca
except:
    msg = "Cannot import Alpaca4d. Is the Alpaca4d folder available in " + ghcompfolder + "?"
    ghenv.Component.AddRuntimeMessage(gh.Kernel.GH_RuntimeMessageLevel.Error, msg)


checkData = True

if not Line:
    checkData = False
    msg = "Input parameter Line failed to collect data"
    ghenv.Component.AddRuntimeMessage(gh.Kernel.GH_RuntimeMessageLevel.Warning, msg)


if not Section:
    checkData = False
    msg = "Input parameter Section failed to collect data"
    ghenv.Component.AddRuntimeMessage(gh.Kernel.GH_RuntimeMessageLevel.Warning, msg)

if not Colour:
    Colour = Color.Red


if not GeomTransf:
    GeomTransf = "Linear"

if checkData:
    
    if not Z_Axis:
        midPoint =  Line.PointAtNormalizedLength(0.5)
        parameter = Line.ClosestPoint(midPoint, 0.01)[1]
        Z_Axis = ghcomp.PerpFrame( Line, parameter )
    Element = alpaca.ForceBeamColumn(Line, Section, GeomTransf, Colour, Z_Axis)
# ---------- end fbc ----------

# ---- group: picking mode 2 for damping
list = ValueList({"0", "1", "2", "3"}, selected="0")

# ----
list_2 = ValueList({"0", "1", "2"}, selected="0")
time_to_analyse = Panel("20")
division = Division(A=time_to_analyse, B="0.01")
as = AnalysesStepsAlpaca4d(numIncr=division, dt="0.01")  # -> AnalysisSteps; inputs numIncr: Int32
# ---------- as: Python ----------
"""
Define the Analysis Step
-
    Inputs:
        numIncr:
        dt:
        dtMin:
        dtMAx:
        Jd:
    Output:
        AnalysisSteps:
"""



ghenv.Component.Name = "Analyses Steps (Alpaca4d)"
ghenv.Component.NickName = 'AS'
ghenv.Component.Message = "Analyses Steps (Alpaca4d)"
ghenv.Component.IconDisplayMode = ghenv.Component.IconDisplayMode.application
ghenv.Component.Category = "Alpaca4d"
ghenv.Component.SubCategory = "7_Analysis"



import sys
import Rhino.Geometry as rg
import Grasshopper as gh
import ghpythonlib.components as ghcomp
from System.Drawing import Color

## add alpaca install directory to system path

ghcompfolder = gh.Folders.DefaultAssemblyFolder
if ghcompfolder not in sys.path:
    sys.path.append(ghcompfolder)

try:
    from Alpaca4d import alpaca4d as alpaca
except:
    msg = "Cannot import Alpaca4d. Is the Alpaca4d folder available in " + ghcompfolder + "?"
    ghenv.Component.AddRuntimeMessage(gh.Kernel.GH_RuntimeMessageLevel.Error, msg)

dt = "" if dt is None else dt
dtMin = "" if dtMin is None else dtMin
dtMax = "" if dtMax is None else dtMax
Jd = "" if Jd is None else Jd

checkData = True

if not numIncr:
    checkData = False
    msg = "Input parameter numIncr failed to collect data"
    ghenv.Component.AddRuntimeMessage(gh.Kernel.GH_RuntimeMessageLevel.Warning, msg)

if checkData:
    AnalysisSteps = alpaca.AnalysisSteps(numIncr, dt, dtMin, dtMax, Jd)
# ---------- end as ----------
as_2 = AnalysesStepsAlpaca4d(numIncr="10")  # -> AnalysisSteps; inputs numIncr: Int32; same code as as
as_3 = AnalysisSettingsAlpaca4d(AnalysisSteps=as_2)  # -> out, Settings
# ---------- as_3: Python ----------
"""
Create Analysis settings
-
    Args:
        Damping: 
        Constraint: 'Plain', 'Transformation'. Default is 'Transformation'.
        Numberer: 'RCM', 'AMD', 'Plain'. Default is 'RCM'.
        System: 'BandGen', 'BandSPD', 'ProfileSPD', 'SuperLU', 'UmfPack', 'FullGeneral', 'SparseSYM'. Default is 'BandSPD'.
        Test: Feature not implemented. Please contact alpaca4d@gmail.com 
        Algorithm: 'Linear', 'Newton', 'NewtonLineSearch', 'ModifiedNewton', 'KrylovNewton', 'SecantNewton', 'BFGS', 'Broyden'. Default is 'Linear'.
        Integrator: Default is LoadControl.
        AnalysisType: 'Static', 'Transient'. Default is 'Static'.
        AnalyesSteps:
    Returns:
        Analysis:
"""

import sys
import os


import clr
import clrtype
import Rhino.Geometry as rg
import rhinoscriptsyntax as rs
import Grasshopper as gh
import copy
import ghpythonlib.treehelpers as th


ghenv.Component.Name = "Analysis settings (Alpaca4d)"
ghenv.Component.NickName = 'AS'
ghenv.Component.Message = "Analysis settings \n(Alpaca4d)"



from Alpaca4d import alpaca4d as alpaca

checkData = True



Damping = None if Damping is None else Damping


# default Value
Constraint = 'Transformation' if Constraint is None else Constraint
ConstraintList = ['Plain', 'Transformation']

for item in ConstraintList:
    if Constraint.lower() == item.lower():
        Constraint = item


# default Value
Numberer = 'RCM' if Numberer is None else Numberer
NumbererList = ['RCM', 'AMD', 'Plain', 'ParallelPlain', 'ParallelRCM']

for i,item in enumerate(NumbererList):
    if Numberer.lower() == item.lower():
        Numberer = item



# default Value
System = 'BandSPD' if System is None else System
SystemList = ['BandGen', 'BandSPD', 'ProfileSPD', 'SuperLU', 'UmfPack', 'FullGeneral', 'SparseSYM']

for i,item in enumerate(SystemList):
    if System.lower() == item.lower():
        System = item


# default Test
Test = 'NormDispIncr 1.0e-6 12 5' if Test is None else Test




# default Value
Algorithm = 'Linear' if Algorithm is None else Algorithm
AlgorithmList = ['Linear', 'Newton', 'NewtonLineSearch', 'ModifiedNewton', 'KrylovNewton', 'SecantNewton', 'BFGS', 'Broyden']

for i,item in enumerate(AlgorithmList):
    if Algorithm.lower() == item.lower():
        Algorithm = item


# default Value
AnalysisType = 'Static' if AnalysisType is None else AnalysisType
AnalysisTypeList = ['Static', 'Transient']

for item in AnalysisTypeList:
    if AnalysisType.lower() == item.lower():
        AnalysisType = item



## Define Integrator
if AnalysisType == "Static":
    Integrator = "LoadControl 1.0" if Integrator is None else Integrator
elif AnalysisType == "Transient":
    Integrator = "Newmark 0.5 0.25" if Integrator is None else Integrator


if AnalysisType == 'Transient':
    if not Damping:
        checkData = False
        msg = "Input parameter Damping failed to collect data"
        ghenv.Component.AddRuntimeMessage(gh.Kernel.GH_RuntimeMessageLevel.Warning, msg)


if not AnalysisSteps:
    checkData = False
    msg = "Input parameter AnalysisSteps failed to collect data"
    ghenv.Component.AddRuntimeMessage(gh.Kernel.GH_RuntimeMessageLevel.Warning, msg)




if checkData:
    Settings = alpaca.Analysis(Constraint, Numberer, System, Test, Algorithm, Integrator, AnalysisType, AnalysisSteps, Damping)
    print(Settings.write_tcl())
# ---------- end as_3 ----------
list_3 = ValueList({"Static": 1, "Dynamic": 0}, selected="Dynamic")
number_slider = Slider(100, range=0..100)

# ---- group: time step
number_slider_2 = Slider(0, range=0..2000)

# ----
number_slider_3 = Slider(1000, range=0..1000)
clr = ColorsAlpaca4d(gradIndex=Slider(12, range=0..12))  # -> reverse(colors); inputs gradIndex: Int32
#   port colors: A series of colors to be plugged into the "Ladybug_Legend Parameters" component.
# ---------- clr: Python ----------
"""
Preset of gradient colors perfect for Data Visualisation
    Inputs:
        gradIndex: An index refering to one of the following possible gradients:
            0 - Orignal Ladybug
            1 - Nuanced Ladybug
            2 - Multi-colored Ladybug
            3 - Ecotect
            4 - Thermal Comfort Percentage
            5 - Thermal Comfort Colors
            6 - Shade Benefit/Harm
            7 - Shade Harm
            8 - Shade Benefit
            9 - CFD Colors 1
            10 - Radiation Benefit
            11 - Gsa10 Colour
            12 - Gsa9 Colour
    Returns:
        customColors: A series of colors.
"""

ghenv.Component.Name = "Colors (Alpaca4d)"
ghenv.Component.NickName = 'CLR'
ghenv.Component.Message = 'Colors (Alpaca4d)'

import scriptcontext as sc
import Grasshopper.Kernel as gh
import System

gradientLibrary = {
        0: [System.Drawing.Color.FromArgb(75, 107, 169), System.Drawing.Color.FromArgb(115, 147, 202), System.Drawing.Color.FromArgb(170, 200, 247), System.Drawing.Color.FromArgb(193, 213, 208), System.Drawing.Color.FromArgb(245, 239, 103), System.Drawing.Color.FromArgb(252, 230, 74), System.Drawing.Color.FromArgb(239, 156, 21), System.Drawing.Color.FromArgb(234, 123, 0), System.Drawing.Color.FromArgb(234, 74, 0), System.Drawing.Color.FromArgb(234, 38, 0)],
        1: [System.Drawing.Color.FromArgb(49,54,149), System.Drawing.Color.FromArgb(69,117,180), System.Drawing.Color.FromArgb(116,173,209), System.Drawing.Color.FromArgb(171,217,233), System.Drawing.Color.FromArgb(224,243,248), System.Drawing.Color.FromArgb(255,255,191), System.Drawing.Color.FromArgb(254,224,144), System.Drawing.Color.FromArgb(253,174,97), System.Drawing.Color.FromArgb(244,109,67), System.Drawing.Color.FromArgb(215,48,39), System.Drawing.Color.FromArgb(165,0,38)],
        2: [System.Drawing.Color.FromArgb(4,25,145), System.Drawing.Color.FromArgb(7,48,224), System.Drawing.Color.FromArgb(7,88,255), System.Drawing.Color.FromArgb(1,232,255), System.Drawing.Color.FromArgb(97,246,156), System.Drawing.Color.FromArgb(166,249,86), System.Drawing.Color.FromArgb(254,244,1), System.Drawing.Color.FromArgb(255,121,0), System.Drawing.Color.FromArgb(239,39,0), System.Drawing.Color.FromArgb(138,17,0)],
        3: [System.Drawing.Color.FromArgb(0,0,255), System.Drawing.Color.FromArgb(53,0,202), System.Drawing.Color.FromArgb(107,0,148), System.Drawing.Color.FromArgb(160,0,95), System.Drawing.Color.FromArgb(214,0,41), System.Drawing.Color.FromArgb(255,12,0), System.Drawing.Color.FromArgb(255,66,0), System.Drawing.Color.FromArgb(255,119,0), System.Drawing.Color.FromArgb(255,173,0), System.Drawing.Color.FromArgb(255,226,0), System.Drawing.Color.FromArgb(255,255,0)],
        4: [System.Drawing.Color.FromArgb(0,0,0), System.Drawing.Color.FromArgb(110,0,153), System.Drawing.Color.FromArgb(255,0,0), System.Drawing.Color.FromArgb(255,255,102), System.Drawing.Color.FromArgb(255,255,255)],
        5: [System.Drawing.Color.FromArgb(0,136,255), System.Drawing.Color.FromArgb(200,225,255), System.Drawing.Color.FromArgb(255,255,255), System.Drawing.Color.FromArgb(255,230,230), System.Drawing.Color.FromArgb(255,0,0)],
        6: [System.Drawing.Color.FromArgb(5,48,97), System.Drawing.Color.FromArgb(33,102,172), System.Drawing.Color.FromArgb(67,147,195), System.Drawing.Color.FromArgb(146,197,222), System.Drawing.Color.FromArgb(209,229,240), System.Drawing.Color.FromArgb(255,255,255), System.Drawing.Color.FromArgb(253,219,199), System.Drawing.Color.FromArgb(244,165,130), System.Drawing.Color.FromArgb(214,96,77), System.Drawing.Color.FromArgb(178,24,43), System.Drawing.Color.FromArgb(103,0,31)],
        7: [System.Drawing.Color.FromArgb(255,255,255), System.Drawing.Color.FromArgb(253,219,199), System.Drawing.Color.FromArgb(244,165,130), System.Drawing.Color.FromArgb(214,96,77), System.Drawing.Color.FromArgb(178,24,43), System.Drawing.Color.FromArgb(103,0,31)],
        8: [System.Drawing.Color.FromArgb(255,255,255), System.Drawing.Color.FromArgb(209,229,240), System.Drawing.Color.FromArgb(146,197,222), System.Drawing.Color.FromArgb(67,147,195), System.Drawing.Color.FromArgb(33,102,172), System.Drawing.Color.FromArgb(5,48,97)],
        9: [System.Drawing.Color.FromArgb(0,16,120), System.Drawing.Color.FromArgb(38,70,160), System.Drawing.Color.FromArgb(5,180,222), System.Drawing.Color.FromArgb(16,180,109), System.Drawing.Color.FromArgb(59,183,35), System.Drawing.Color.FromArgb(143,209,19), System.Drawing.Color.FromArgb(228,215,29), System.Drawing.Color.FromArgb(246,147,17), System.Drawing.Color.FromArgb(243,74,0), System.Drawing.Color.FromArgb(255,0,0)],
        10: [System.Drawing.Color.FromArgb(0,191,48), System.Drawing.Color.FromArgb(255,238,184), System.Drawing.Color.FromArgb(255,0,0)],
        11: [System.Drawing.Color.FromArgb(204,0,71), System.Drawing.Color.FromArgb(255,182,71), System.Drawing.Color.FromArgb(206,255,115), System.Drawing.Color.FromArgb(26,180, 214),System.Drawing.Color.FromArgb(0,0,207)],
        12: [System.Drawing.Color.FromArgb(255, 51, 51), System.Drawing.Color.FromArgb(255, 170, 51), System.Drawing.Color.FromArgb(255, 255, 51), System.Drawing.Color.FromArgb(170, 255, 125), System.Drawing.Color.FromArgb(51, 255, 231), System.Drawing.Color.FromArgb(51, 170, 255), System.Drawing.Color.FromArgb(51,51, 255)]}
colors = gradientLibrary[gradIndex]
# ---------- end clr ----------
addition = Addition()
num = Number("0.01")

# ---- group: mass (half model) distributed to nodes
total_mass_kg = Panel("7820/2-102*21")

# ----
num_2 = Number(total_mass_kg)

# ---- group: mass (half model) distributed to nodes (continued)
division_2 = Division(A=num_2, B=length)

# ----
weight_m_kg_m = Panel(division_2)
Z_2 = UnitZ(Factor=weight_m_kg_m)
mp = MassPointAlpaca4d(Pos=cullpt.Points, TransMass=Z_2)  # -> Load; inputs Pos: Point3d, TransMass: Vector3d, RotMass: Vector3d
# ---------- mp: Python ----------
"""
Create a Concentrated Mas
-
    Args:
        Pos:
        TransMass:
        RotMass:
    Returns:
        Load:
"""

ghenv.Component.Name = "Mass Point (Alpaca4d)"
ghenv.Component.NickName = 'MP'
ghenv.Component.Message = "Mass Point (Alpaca4d)"



import sys
import Rhino.Geometry as rg
import Grasshopper as gh
import copy


## add alpaca install directory to system path

ghcompfolder = gh.Folders.DefaultAssemblyFolder
if ghcompfolder not in sys.path:
    sys.path.append(ghcompfolder)

try:
    from Alpaca4d import alpaca4d as alpaca
except:
    msg = "Cannot import Alpaca4d. Is the Alpaca4d folder available in " + ghcompfolder + "?"
    ghenv.Component.AddRuntimeMessage(gh.Kernel.GH_RuntimeMessageLevel.Error, msg)


checkData = True

if not Pos:
    checkData = False
    msg = "Input parameter Pos failed to collect data"
    ghenv.Component.AddRuntimeMessage(gh.Kernel.GH_RuntimeMessageLevel.Warning, msg)

if not TransMass:
    checkData = False
    msg = "Input parameter TransMass failed to collect data"
    ghenv.Component.AddRuntimeMessage(gh.Kernel.GH_RuntimeMessageLevel.Warning, msg)

if not RotMass:
    RotMass = rg.Vector3d(0,0,0)


if checkData:
    Load = alpaca.MassPoint(Pos, TransMass, RotMass)
# ---------- end mp ----------
relay_2 = Relay([pl.Load, mp])
am = AssembleModelAlpaca4d(Element=flatten(fbc.Element), Support=flatten(relay), Load=flatten(relay_2))  # -> out, AlpacaModel, Mass; inputs Element: list, Support: list, Load: list, Constraint: list
# ---------- am: Python ----------
"""
Create a FEA Model
-
    Args:
        Element:
        Support:
        Load:
        Constraint:
    Returns:
        AlpacaModel:
"""


import os
import sys
import ghpythonlib.treehelpers as th
import Rhino.Geometry as rg
import Rhino.Collections as rc
import rhinoscriptsyntax as rs
from collections import defaultdict, OrderedDict, deque
import copy
import time
import Grasshopper as gh



ghenv.Component.Name = "Assemble Model (Alpaca4d)"
ghenv.Component.NickName = 'AM'
ghenv.Component.Message = "Assemble Model (Alpaca4d)"


## add alpaca install directory to system path

ghcompfolder = gh.Folders.DefaultAssemblyFolder
if ghcompfolder not in sys.path:
    sys.path.append(ghcompfolder)

try:
    from Alpaca4d import alpaca4d as alpaca
    from Alpaca4d import alpaca4dUtil as alpacaUtil
except:
    msg = "Cannot import Alpaca4d. Is the Alpaca4d folder available in " + ghcompfolder + "?"
    ghenv.Component.AddRuntimeMessage(gh.Kernel.GH_RuntimeMessageLevel.Error, msg)


checkData = True

if not Element:
    checkData = False
    msg = "Input parameter Element failed to collect data"
    ghenv.Component.AddRuntimeMessage(gh.Kernel.GH_RuntimeMessageLevel.Warning, msg)

if not Support:
    checkData = False
    msg = "Input parameter Support failed to collect data"
    ghenv.Component.AddRuntimeMessage(gh.Kernel.GH_RuntimeMessageLevel.Warning, msg)


if checkData:
    
    FolderPath = rs.DocumentPath()
    os.chdir(FolderPath)
    
    # create the object model
    AlpacaModel = alpaca.Model()
    
    
    start = time.clock()
    #subdivide element per type
    
    for element in Element:
        if element.type == "Beam":
            AlpacaModel.beams.append(element)
        elif element.type == "Shell":
            AlpacaModel.shells.append(element)
        elif element.type == "Brick":
            AlpacaModel.bricks.append(element)
    
    
    end = time.clock() - start
    print("time to subdivide element {}".format(end))
    start = time.clock()
    
    # create a list of unique point
    # need to add the rigid constraint
    
    AlpacaModel.getuniquePoints(AlpacaModel.beams, AlpacaModel.shells, AlpacaModel.bricks, Constraint)
    
    
    end = time.clock() - start
    print("time to get uniquepoints {}".format(end))
    start = time.clock()
    
    
    #############
    # create node and assign to object
    #############
    
    if AlpacaModel.uniquePointsThreeNDF:
        AlpacaModel.py.append(alpaca.Model.write3ndf_tcl())
        for point in AlpacaModel.uniquePointsThreeNDF:
            node = alpaca.Node(point)
            node.ndf = 3
            node.setNodeTag(AlpacaModel)
            AlpacaModel.nodes.append( node )
        
            AlpacaModel.py.append(node.write_tcl())
    
    
    if AlpacaModel.uniquePointsSixNDF:
        AlpacaModel.py.append(alpaca.Model.write6ndf_tcl())
        for point in AlpacaModel.uniquePointsSixNDF:
            node = alpaca.Node(point)
            node.ndf = 6
            node.setNodeTag(AlpacaModel)
            AlpacaModel.nodes.append( node )
         
            AlpacaModel.py.append(node.write_tcl())
    
    
    
    end = time.clock() - start
    print("time to create node and assign tag {}".format(end))
    start = time.clock()
    
    
    #################
    # create supports
    #################
    
    for supportNode in Support:
        
        # if the list is empty, skip this operation
        if AlpacaModel.uniquePointsThreeNDF:
            closestPointInThreeNDF = rc.Point3dList.ClosestPointInList(AlpacaModel.uniquePointsThreeNDF, supportNode.Pos)
            if supportNode.Pos.DistanceTo(closestPointInThreeNDF) < 0.001:
                #print("I am in 3ndf")
                supportNode.ndf = 3
                AlpacaModel.threeNDFModel.append(supportNode)
                supportNode.setNodeTag(AlpacaModel)
        
        if AlpacaModel.uniquePointsSixNDF:
            closestPointInSixNDF = rc.Point3dList.ClosestPointInList(AlpacaModel.uniquePointsSixNDF, supportNode.Pos)
            if supportNode.Pos.DistanceTo(closestPointInSixNDF) < 0.001:
                supportNode.ndf = 6
                AlpacaModel.sixNDFModel.append(supportNode)
                supportNode.setNodeTag(AlpacaModel)
        
        
        AlpacaModel.supports.append(supportNode)
        AlpacaModel.py.append(supportNode.write_tcl())
    
    
    end = time.clock() - start
    print("time to create support and assign tag {}".format(end))
    start = time.clock()
    
    
    ####################
    # create constraints
    ####################
    
    
    for constraint in Constraint:
        constraint.setNodeTag(AlpacaModel)
        AlpacaModel.constraints.append(constraint)
    
    ####################
    # create equalDOF when the model has 3df and 6df together
    ####################
    
    
    end = time.clock() - start
    print("time to create constraint and assign tag {}".format(end))
    start = time.clock()
    
    
    Id = []
    IdB = []
    
    def SearchCallback(sender, e):
        Id.Add(e.Id)
        IdB.Add(e.IdB)
    
    
    
    lenThreeNDF = len(AlpacaModel.uniquePointsThreeNDF)
    lenSixNDF = len(AlpacaModel.uniquePointsSixNDF)
    
    
    if not(lenThreeNDF == 0 or lenSixNDF == 0):
        print("brick and beam together")
        rg.RTree.SearchOverlaps(AlpacaModel.RTreeCloudPointThreeNDF, AlpacaModel.RTreeCloudPointSixNDF, 0.001, SearchCallback)
        
        for i,j in zip(Id, IdB):
            print(i,j)
            node_i = AlpacaModel.uniquePointsThreeNDF[i]
            node_j = AlpacaModel.uniquePointsSixNDF[j]
            
            #index_i = AlpacaModel.cloudPoint.ClosestPoint(node_i) + 1
            #index_j = AlpacaModel.cloudPoint.ClosestPoint(node_j) + 1
            
            equalConstraint = alpaca.EqualDOF(node_i, node_j, True, True, True, False, False, False)
            equalConstraint.masterNodeTag = AlpacaModel.cloudPointThreeNDF.ClosestPoint(node_i) + 1
            equalConstraint.slaveNodesTag = AlpacaModel.cloudPointSixNDF.ClosestPoint(node_j) + 1 + len(AlpacaModel.uniquePointsThreeNDF)
            AlpacaModel.py.append(equalConstraint.write_tcl())
    
    
    
    end = time.clock() - start
    print("time to find common points between 3ndf and 6ndf {}".format(end))
    start = time.clock()
    
    ##########################
    ##########################
    ##########################
    
    crossSection = []
    material = []
    
    for item in Element:
        if item.type != "Brick":
            crossSection.append(item.CrossSection)
            material.append(item.CrossSection.material)
        else:
            material.extend(item.material)
        
    
    uniqueCS = list(set(crossSection))
    
    
    flatten_material = alpacaUtil.flatten_list(material)
    
    
    uniqueMaterial = list(set(flatten_material))
    
    for index, material in enumerate(uniqueMaterial,1):
        material.matTag = index
        AlpacaModel.py.append(material.write_tcl())
    
    
    for index, section in enumerate(uniqueCS,1):
        section.sectionTag = index
        AlpacaModel.py.append(section.write_tcl())
        
    
    
    
    
    
    # write py file
    
    
    # assign tag and node Index to element and shell
    for index, element in enumerate(Element,1):
        element.setTopologyRTree(AlpacaModel)
        element.eleTag = index
        element.setTags()
    
    
    
    end = time.clock() - start
    print("time to assign tags for the elements {}".format(end))
    start = time.clock()
    
    
    
    
    
    
    Mass = 0
    IsGravity = False
    g_factor = 10.00
    
    for item in Load:
        if item.type == "Gravity Load":
            IsGravity = True
            GravityLoad = item
        if item.type == "PointLoad":
            AlpacaModel.loads.append(item)
        if item.type == "Mass":
            AlpacaModel.masses.append(item)
    
    
    for item in Element:
        if item.type == "Beam":
            length = item.Crv.GetLength()
            Mass += (item.massDens * length)
            if IsGravity:
                gravityPointLoad_1 = alpaca.PointLoad(item.Crv.PointAtStart, g_factor * rg.Vector3d(0,0, -(item.massDens * length / 2)) * GravityLoad.GravityFactor, rg.Vector3d(0,0,0), GravityLoad.TimeSeries)
                gravityPointLoad_2 = alpaca.PointLoad(item.Crv.PointAtEnd, g_factor * rg.Vector3d(0,0, -(item.massDens * length / 2)) * GravityLoad.GravityFactor, rg.Vector3d(0,0,0), GravityLoad.TimeSeries)
                ##print( -(item.massDens * length / 2))
                AlpacaModel.loads.append(gravityPointLoad_1)
                AlpacaModel.loads.append(gravityPointLoad_2)
        if item.type == "Shell":
            meshArea = rg.AreaMassProperties.Compute(item.Mesh).Area
            if item.CrossSection.__class__.__name__ != "LayeredShell":
                areaDensity = item.CrossSection.thickness * item.CrossSection.material.rho
                Mass += areaDensity * meshArea
                if IsGravity:
                    for vertex in item.Mesh.Vertices.ToPoint3dArray():
                        gravityPointLoad = alpaca.PointLoad(vertex, g_factor * rg.Vector3d(0,0, -(areaDensity * meshArea/ len(item.Mesh.Vertices))) * GravityLoad.GravityFactor, rg.Vector3d(0,0,0), GravityLoad.TimeSeries)
                        AlpacaModel.loads.append(gravityPointLoad)
            else:
                for thickness, material in zip(item.CrossSection.thickness, item.CrossSection.material):
                    areaDensity = thickness * material.rho
                    Mass += areaDensity * meshArea
                    if IsGravity:
                        for vertex in item.Mesh.Vertices.ToPoint3dArray():
                            gravityPointLoad = alpaca.PointLoad(vertex, g_factor * rg.Vector3d(0,0, -(areaDensity * meshArea/ len(item.Mesh.Vertices))) * GravityLoad.GravityFactor, rg.Vector3d(0,0,0), GravityLoad.TimeSeries)
                            AlpacaModel.loads.append(gravityPointLoad)


        if item.type == "Brick":
            #print(type(item.Mesh))
            meshVolume = rg.VolumeMassProperties.Compute(item.Mesh).Volume
            density = item.material.rho 
            Mass += density * meshVolume
            if IsGravity:
                for vertex in item.Mesh.Vertices.ToPoint3dArray():
                    gravityPointLoad = alpaca.PointLoad(vertex, g_factor * rg.Vector3d(0,0, -(density * meshVolume / len(item.Mesh.Vertices))) * GravityLoad.GravityFactor, rg.Vector3d(0,0,0), GravityLoad.TimeSeries)
                    #print(len(item.Mesh.Vertices))
                    #print(density)
                    # volume can be zero if mesh faces are not properly rotated
                    #print(meshVolume)
                    #print(-(density * meshVolume / len(item.Mesh.Vertices)))
                    AlpacaModel.loads.append(gravityPointLoad)
    
    #print(AlpacaModel.loads)
    ## load
    
    
    for item in AlpacaModel.loads:
        item.setNodeTag(AlpacaModel)
    
    #print(AlpacaModel.loads)
    
    for item in AlpacaModel.beams:
        AlpacaModel.py.append(item.write_tcl())
    
    for item in AlpacaModel.shells:
        AlpacaModel.py.append(item.write_tcl())
    
    for item in AlpacaModel.bricks:
        AlpacaModel.py.append(item.write_tcl())
    
    
    for item in Constraint:
        AlpacaModel.py.append(item.write_tcl())
    
    
    for item in AlpacaModel.masses:
        item.setNodeTag(AlpacaModel)
        AlpacaModel.py.append(item.write_tcl())
    
    
    timeSeriesDict = alpaca.TimeSeries.getTimeSeries(AlpacaModel.loads)[1]
    AlpacaModel.py.append(alpaca.PointLoad.write_tcl(timeSeriesDict,AlpacaModel))
    
    
    text = AlpacaModel.py
# ---------- end am ----------
nv = RunNaturalVibrationAnalysisAlpaca4d(AlpacaModel=am.AlpacaModel, numberModes="3")  # -> AlpacaSolvedModel, EigenValues, Period, NaturalFrequencies; inputs numberModes: Int32
# ---------- nv: Python ----------
"""
Run an Natural Vibration Analysis
-
    Args:
        AlpacaModel:
        numberModes:
    Returns:
        AlpacaSolvedModel:
        EigenValues:
        Period:
        NaturalFrequencies:
"""



import Rhino.RhinoDoc
import Grasshopper as gh
import copy
import rhinoscriptsyntax as rs
import os
import time
import sys
import math


ghenv.Component.Name = "Run Natural Vibration Analysis (Alpaca4d)"
ghenv.Component.NickName = 'NV'
ghenv.Component.Message = "Natural Vibration Analysis (Alpaca4d)"

ghcompfolder = gh.Folders.DefaultAssemblyFolder
if ghcompfolder not in sys.path:
    sys.path.append(ghcompfolder)

try:
    from Alpaca4d import alpaca4d as alpaca
except:
    msg = "Cannot import Alpaca4d. Is the Alpaca4d folder available in " + ghcompfolder + "?"
    ghenv.Component.AddRuntimeMessage(gh.Kernel.GH_RuntimeMessageLevel.Error, msg)


checkData = True



if not AlpacaModel:
    checkData = False
    msg = "Input parameter AlpacaModel failed to collect data"
    ghenv.Component.AddRuntimeMessage(gh.Kernel.GH_RuntimeMessageLevel.Warning, msg)


if not numberModes:
    checkData = False
    msg = "Input parameter numberModes failed to collect data"
    ghenv.Component.AddRuntimeMessage(gh.Kernel.GH_RuntimeMessageLevel.Warning, msg)


if checkData:
    FolderPath = rs.DocumentPath()
    os.chdir(FolderPath)
    
    outputFileName = 'openSeesModel'
    recorderFileName = 'recorder_modes.mpco'
    
    for dirpath, dirnames, filenames in os.walk(FolderPath):
        for filename in filenames:
            if filename == outputFileName:
                file = os.path.join(dirpath,outputFileName)
                os.remove(file)
            elif filename == recorderFileName:
                file = os.path.join(dirpath,recorderFileName)
                os.remove(file)
    
    
    # create a copy
    
    AnalysisModel = copy.copy(AlpacaModel)
    AnalysisModel.py = list(AnalysisModel.py)
    
    # generate Recorder and assign name
    AnalysisModel.recorderName = "recorder_modes" + ".mpco"
    AnalysisModel.modalAnalysisReportFile = "ModalReport.txt"
    
    AnalysisModel.py.append(alpaca.TCLRecorder.mpco(AnalysisModel.recorderName, False,False,False,False,False,False,True,True,False,False,False,False))
    
    AnalysisModel.numberModes = numberModes
    
    eigen_tcl = "set lambdaN [eigen {}]".format(numberModes)
    AnalysisModel.py.append(eigen_tcl)
    
    
    AnalysisModel.py.append('puts "$lambdaN"')
    
    AnalysisModel.py.append(('modalProperties -file "{0}"  -unorm').format(AnalysisModel.modalAnalysisReportFile))
    
    AnalysisModel.py.append('record\nwipe')
    
    
    
    #textFile = AnalysisModel.py
    
    time_start = time.clock()
    
    AnalysisModel.writeFile(outputFileName)
    
    time_elapsed = (time.clock() - time_start)
    print("Writing Time {}".format(time_elapsed))
    
    
    
    time_start = time.clock()
    
    executable = os.path.join(ghcompfolder,'Alpaca4d\OpenSees-Solvers\opensees.bat')
    log, eigen = AnalysisModel.runEigen(executable)
    
    

    eigen = eigen[0].strip().split()[0:numberModes]
    
    
    EigenValues = [float(eigenValue) for eigenValue in eigen] 
    
    NaturalFrequencies = [math.sqrt(eigenValue) / (2 * math.pi) for eigenValue in EigenValues]
    Period = [1/naturalFrequency for naturalFrequency in NaturalFrequencies]
    
    AlpacaSolvedModel = copy.copy(AnalysisModel)
    AlpacaSolvedModel.isAnalysed = True
    AlpacaSolvedModel.isModal = True
# ---------- end nv ----------

# ---- group: assumed this should be taking in NF not eigen value?
item = ListItem(List=nv.EigenValues, Index=list, Wrap=True)

# ----
panel_5 = Panel(nv.NaturalFrequencies)

# ----
# Numerical Check
dcs = DisassembleCrossSectionAlpaca4d(CrossSection=is)  # -> Name, SectionCurve, Material, port, Area, Area_Y, Area_Z, alpha_Y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
# ---------- dcs: Python ----------
"""
Disassemble a Cross Section
-
    Args:
        CrossSection:
    Returns:
        Points:
        threeNdfPoints:
        sixNdfPoints:
"""

ghenv.Component.Name = "Disassemble CrossSection (Alpaca4d)"
ghenv.Component.NickName = 'DCS'
ghenv.Component.Message = "Disassemble CrossSection\n(Alpaca4d)"


import sys
import Rhino.Geometry as rg
import Grasshopper as gh


## add alpaca install directory to system path

ghcompfolder = gh.Folders.DefaultAssemblyFolder
if ghcompfolder not in sys.path:
    sys.path.append(ghcompfolder)

try:
    from Alpaca4d import alpaca4d as alpaca
except:
    msg = "Cannot import Alpaca4d. Is the Alpaca4d folder available in " + ghcompfolder + "?"
    ghenv.Component.AddRuntimeMessage(gh.Kernel.GH_RuntimeMessageLevel.Error, msg)

checkData = True


if not CrossSection:
    checkData = False
    msg = "Input parameter CrossSection failed to collect data"
    ghenv.Component.AddRuntimeMessage(gh.Kernel.GH_RuntimeMessageLevel.Warning, msg)



if checkData:
    print(CrossSection.__dict__)
    Name = CrossSection.secName
    SectionCurve = CrossSection.crv
    Material = CrossSection.material
    Area = CrossSection.Area()
    Area_Y = CrossSection.AreaY()
    Area_Z = CrossSection.AreaZ()
    alpha_Y = CrossSection.alphaY()
    alpha_Z = CrossSection.alphaZ()
    Iyy = CrossSection.Iyy()
    Izz = CrossSection.Izz()
    J = CrossSection.J()
# ---------- end dcs ----------
sdl_mass = Number(num_2)
mass_structure = Number(am.Mass)
length_2 = Number(length)
addition_2 = Addition(A=sdl_mass, B=mass_structure)
division_3 = Division(A=addition_2, B=length_2)
dm = DisassembleMaterialAlpaca4d(Material=dcs.Material)  # -> Name, E, G, V, rho, MaterialClass
# ---------- dm: Python ----------
"""
Disassemble Material
-
    Args:
        Material:
    Returns:
        Name:
        E:
        G:
        v:
        rho:
        MaterialClass:
"""

ghenv.Component.Name = "Disassemble Material (Alpaca4d)"
ghenv.Component.NickName = 'DM'
ghenv.Component.Message = "Disassemble Material(Alpaca4d)"


import sys
import Rhino.Geometry as rg
import Grasshopper as gh


## add alpaca install directory to system path

ghcompfolder = gh.Folders.DefaultAssemblyFolder
if ghcompfolder not in sys.path:
    sys.path.append(ghcompfolder)

try:
    from Alpaca4d import alpaca4d as alpaca
except:
    msg = "Cannot import Alpaca4d. Is the Alpaca4d folder available in " + ghcompfolder + "?"
    ghenv.Component.AddRuntimeMessage(gh.Kernel.GH_RuntimeMessageLevel.Error, msg)

checkData = True


if not Material:
    checkData = False
    msg = "Input parameter Material failed to collect data"
    ghenv.Component.AddRuntimeMessage(gh.Kernel.GH_RuntimeMessageLevel.Warning, msg)



if checkData:
    Name = Material.matName
    E = Material.E
    G = Material.G
    v = Material.v
    rho = Material.rho
    MaterialClass = Material.materialDimension
# ---------- end dm ----------
panel_6 = Panel(division_3)  # "kg/ml"
num_3 = Number(dm.E)
panel_7 = Panel("""9.87
39.5
88.8""")
python = GhPythonScript(k_n=panel_7, E=num_3, I=dcs.Iyy, w=panel_6, length=length_2)  # -> out, frequency
# ---------- python: Python ----------
import math

frequency = (k_n/(2*math.pi))*((E*I)/(w*length**4))**0.5
# ---------- end python ----------
panel_8 = Panel(python.frequency)
alpaca_result = Panel(nv.NaturalFrequencies)
python_2 = GhPythonScript(f_numeric=alpaca_result, f_theoretic=panel_8)  # -> out, error
# ---------- python_2: Python ----------
error = (f_theoretic - f_numeric)/f_theoretic

error = "{:.2%}".format(error)
# ---------- end python_2 ----------
panel_9 = Panel(python_2.error)

# ----
# Method to use one Vibration Mode
lambda = Number(item)
sqrt = SquareRoot(Value=lambda)
omega = Number(sqrt)
python_3 = GhPythonScript(omega=omega, xDamp="0.01")  # -> out, betaK
# ---------- python_3: Python ----------
betaK = 2 * xDamp / omega
# ---------- end python_3 ----------
rd = RayleighDampingAlpaca4d(betaKcomm=python_3.betaK)  # -> RayleighDamping
# ---------- rd: Python ----------
"""
This command is used to assign damping to all previously-defined elements and nodes. When using rayleigh damping in OpenSees, the damping matrix for an element or node, D is specified as a combination of stiffness and mass-proportional damping matrices:
D = alphaM * M + [betaKcurrent * Kcurrent] + [betaKinit * Kinit] + [betaKcomm * KlastCommit] 


xDamp = 0.05;                       # 5% damping ratio
alphaM = 0.00;                      # M-prop damping;                               alphaM*M
betaKcurrent = 0.00;                # K-proportional damping;                       beatKcurr*KCurrent
betaKinit = 0.00;                   # initial-stiffness proportional damping;       beatKinit*Kinit
betaKcomm = 2.*xDamp/omega;         # K-prop. damping parameter;                    betaKcomm*KlastCommitt


    Args:
        alphaM: factor applied to elements or nodes mass matrix
        betaKcurrent: factor applied to elements current stiffness matrix.
        betaKinit: factor applied to elements initial stiffness matrix.
        betaKcomm: factor applied to elements committed stiffness matrix. 
    Returns:
        RayleighDamping:
"""

ghenv.Component.Name = "Rayleigh Damping (Alpaca4d)"
ghenv.Component.NickName = 'RD'
ghenv.Component.Message = "Rayleigh Damping (Alpaca4d)"


import sys
import Rhino.Geometry as rg
import Grasshopper as gh
import ghpythonlib.components as ghcomp
from System.Drawing import Color

## add alpaca install directory to system path

ghcompfolder = gh.Folders.DefaultAssemblyFolder
if ghcompfolder not in sys.path:
    sys.path.append(ghcompfolder)

try:
    from Alpaca4d import alpaca4d as alpaca
except:
    msg = "Cannot import Alpaca4d. Is the Alpaca4d folder available in " + ghcompfolder + "?"
    ghenv.Component.AddRuntimeMessage(gh.Kernel.GH_RuntimeMessageLevel.Error, msg)


checkData = True

if not betaKcomm:
    checkData = False
    msg = "Input parameter betaKcomm failed to collect data"
    ghenv.Component.AddRuntimeMessage(gh.Kernel.GH_RuntimeMessageLevel.Warning, msg)


alphaM = 0.0 if alphaM is None else alphaM
betaKcurrent = 0.0 if betaKcurrent is None else betaKcurrent
betaKinit = 0.0 if betaKinit is None else betaKinit


if checkData:
    RayleighDamping = alpaca.Rayleigh_Damping(alphaM, betaKcurrent, betaKinit, betaKcomm)
# ---------- end rd ----------

dm_2 = DeformedModelAlpaca4d(AlpacaSolvedModel=nv.AlpacaSolvedModel, step=list_2, extrudeModel=Toggle(True))  # -> DefModel, bounds; inputs step: Int32, extrudeModel: Boolean, typeColor: Int32, listColor: list of Color
# ---------- dm_2: Python ----------
"""View Deformed model
    Args:
        AlpacaSolvedModel: Output of Analyses solver
        step:
        scale: Multiplication factor for displacement
        extrudeModel:  
True : view extruded model
else : view stick model
        typeColor:  View relative color of the traslation
<=0 : view traslation X 
1 : view traslation Y
2 : view traslation Z
>= 3 : view resulting displacement.
        listColor : one list of color 

    Output:
       DefModel: view deformed model
       bounds: max end min of displacement of the structure 
"""

ghenv.Component.Name = "Deformed Model (Alpaca4d)"
ghenv.Component.NickName = 'DM'
ghenv.Component.Message = "Deformed Model (Alpaca4d)"

from ghpythonlib.componentbase import executingcomponent as component
import System
import rhinoscriptsyntax as rs

import sys
import os
import clr
import clrtype
import Rhino.Geometry as rg
import Rhino as rc
import math as mt
import Grasshopper as gh
import ghpythonlib.treehelpers as th
from ghpythonlib.components import ConstructDomain

ghcompfolder = gh.Folders.DefaultAssemblyFolder
if ghcompfolder not in sys.path:
    sys.path.append(ghcompfolder)
try:
    from Alpaca4d import alpaca4dView as alpacaView
except:
    msg = "Cannot import Alpaca4d. Is the Alpaca4d folder available in " + ghcompfolder + "?"
    ghenv.Component.AddRuntimeMessage(gh.Kernel.GH_RuntimeMessageLevel.Error, msg)
    
FolderPath = rs.DocumentPath()
os.chdir(FolderPath)

ghcompfolder = gh.Folders.DefaultAssemblyFolder
my_module_name = "Alpaca_StepReader"
my_module = sys.modules.setdefault(my_module_name, type(sys)(my_module_name))


try:
    Steps_dm = my_module.Steps_dm
    Modes = my_module.Modes
except AttributeError:
    type_2d = type(System.Array.CreateInstance(float, 1, 1))

    class Steps_dm(object):
        __metaclass__ = clrtype.ClrClass
        _clrfields = {"STEP_{}".format(i): type_2d for i in range(1000)} # it will work for model with less than 1000 steps

    class Modes(object):
        __metaclass__ = clrtype.ClrClass
        _clrfields = {"MODE_{}".format(i): type_2d for i in range(1000)} # it will work for model with less than 1000 steps

    my_module.Steps_dm = Steps_dm
    my_module.Modes = Modes


hdfFilePath = os.path.join(ghcompfolder, "Alpaca4d\HDF5CSharp.dll")
clr.AddReferenceToFileAndPath(hdfFilePath)

from HDF5CSharp import Hdf5

class MyComponent(component):
    
    def RunScript(self, AlpacaSolvedModel, step = None, scale = None , extrudeModel = None, typeColor = None, listColor = [] ):
        import sys
        
        self.extrudeModel = extrudeModel
        
        self.defModel1 = []
        self.defModel2 = []
        self.defModel3 = []
        
        self.beamColor = []
        

        if step == None:
            step = 0
        if extrudeModel == None:
            extrudeModel = False
        if typeColor == None:
            typeColor = 3
        
        if not listColor: listColor = [ System.Drawing.Color.DarkViolet, 
                                        System.Drawing.Color.BlueViolet, 
                                        System.Drawing.Color.RoyalBlue, 
                                        System.Drawing.Color.CornflowerBlue,
                                        System.Drawing.Color.LightSkyBlue, 
                                        System.Drawing.Color.LightBlue,
                                        System.Drawing.Color.CadetBlue,
                                        System.Drawing.Color.LightGreen,
                                        System.Drawing.Color.GreenYellow,
                                        System.Drawing.Color.Yellow,
                                        System.Drawing.Color.Orange,
                                        System.Drawing.Color.Red,
                                        System.Drawing.Color.DarkRed]
            
        checkData = True
        
        if not AlpacaSolvedModel:
            checkData = False
            msg = "Input parameter AlpacaSolvedModel failed to collect data"
            ghenv.Component.AddRuntimeMessage(gh.Kernel.GH_RuntimeMessageLevel.Warning, msg)
        else:
            try:
                fileId = Hdf5.OpenFile(AlpacaSolvedModel.recorderName, True)
                print( AlpacaSolvedModel.recorderName)
                numberOfPoints = len(AlpacaSolvedModel.uniquePoints) #
                
                displacement = []
                rotation = []
                dispNodeList = []
                
                if AlpacaSolvedModel.isModal == True:
                    print( AlpacaSolvedModel.isModal == True )
                    outputData = "MODEL_STAGE[1]/RESULTS/ON_NODES/MODES_OF_VIBRATION(U)/DATA/STEP_0"
                    print( outputData )
                    displacementResult = Hdf5.ReadObject[Modes](fileId, outputData)
                    for i in range(numberOfPoints):
                        tag = i + 1
                        vx = getattr(displacementResult, 'MODE_{}'.format(step))[i,0]
                        vy = getattr(displacementResult, 'MODE_{}'.format(step))[i,1]
                        vz = getattr(displacementResult, 'MODE_{}'.format(step))[i,2]
                        trasl = rg.Vector3d(vx,vy,vz)
                        displacement.append(trasl)
                        dispNodeList.append( [tag, trasl] )
                        
                    Hdf5.CloseFile(fileId)
                    print("I have closed the file")
                else: 
                    outputData = "/MODEL_STAGE[1]/RESULTS/ON_NODES/DISPLACEMENT/DATA"
                    print( outputData )
                    displacementResult = Hdf5.ReadObject[Steps_dm](fileId, outputData)
                    for i in range(numberOfPoints):
                        tag = i + 1
                        vx = getattr(displacementResult, 'STEP_{}'.format(step))[i,0]
                        vy = getattr(displacementResult, 'STEP_{}'.format(step))[i,1]
                        vz = getattr(displacementResult, 'STEP_{}'.format(step))[i,2]
                        trasl = rg.Vector3d(vx,vy,vz)
                        displacement.append(trasl)
                        dispNodeList.append( [tag, trasl] )
                        
                    Hdf5.CloseFile(fileId)
                    print("I have closed the file")
            
                dispNodeDict = dict( dispNodeList )
                #---------------------------------------------------#
                defEleVector1 = alpacaView.BeamVectorDef(AlpacaSolvedModel,dispNodeDict) #beam
                defEleVector2 = alpacaView.ShellVectorDef(AlpacaSolvedModel,dispNodeDict) #shell
                defEleVector3 = alpacaView.BrickVectorDef(AlpacaSolvedModel,dispNodeDict) #shell
                bound = alpacaView.boundsDef(displacement, typeColor)
                if scale == None: scale = 1/bound[1]
                if self.extrudeModel == None or self.extrudeModel == False:
                    #BEAM
                    defModel1 = alpacaView.BeamDef(AlpacaSolvedModel, dispNodeDict,scale)
                    self.defModel1, self.beamColor = alpacaView.ColorBeamDef( defModel1, defEleVector1, bound, listColor, typeColor)
                    #SHELL
                    defModel2 = alpacaView.ShellDef(AlpacaSolvedModel,dispNodeDict,scale)
                    #BRICK
                    defModel3 = alpacaView.BrickDef(AlpacaSolvedModel,dispNodeDict,scale)
                else:
                    #BEAM
                    defModel1 = alpacaView.BeamDefExtrude(AlpacaSolvedModel, dispNodeDict,scale)
                    self.defModel1 = alpacaView.ColorBeamDefExtrude( defModel1, defEleVector1, bound, listColor, typeColor)
                    #SHELL
                    defModel2 = alpacaView.ShellDefExtrude(AlpacaSolvedModel,dispNodeDict,scale)
                    #BRICK
                    defModel3 = alpacaView.BrickDef(AlpacaSolvedModel,dispNodeDict,scale)
                    
                #SHELL COLOR
                self.defModel2 = alpacaView.ColorShellDef( defModel2, defEleVector2 , bound, listColor, typeColor, extrudeModel )
                #BRICK COLOR
                self.defModel3 = alpacaView.ColorBrickDef( defModel3, defEleVector3 , bound, listColor, typeColor)
                DefModel = th.list_to_tree(self.defModel1 + defModel2 + defModel3)
                bounds = ConstructDomain(bound[0], bound[1])
                return (DefModel, bounds)
            except:
                Hdf5.CloseFile(fileId)
                print("I have closed the file due to exception")
            # return outputs if you have them; here I try it for you:
        
        
    def DrawViewportWires(self,arg):
        for iMesh in self.defModel2 :
            colorWirframe = System.Drawing.Color.Black
            arg.Display.DrawMeshWires(iMesh, colorWirframe)
            
        for iMesh in self.defModel3 :
            colorWirframe = System.Drawing.Color.Black
            arg.Display.DrawMeshWires(iMesh, colorWirframe)
        if self.extrudeModel is None or self.extrudeModel is False:
            thickness =2
            for iBeam, iColor in zip(self.defModel1, self.beamColor) :
                for jBeam, jColor in zip(iBeam, iColor):
                    arg.Display.DrawCurve(jBeam, jColor, thickness)
        else:
            for iBeam in self.defModel1 :
                colorWirframe = System.Drawing.Color.Black
                arg.Display.DrawMeshWires(iBeam, colorWirframe)
# ---------- end dm_2 ----------
as_4 = AnalysisSettingsAlpaca4d(Damping=rd, AnalysisType="Transient", AnalysisSteps=as)  # -> out, Settings; same code as as_3
filter = StreamFilter(Gate=list_3, Stream0=as_4.Settings, Stream1=as_3.Settings)
ra = RunAnalysisAlpaca4d(AlpacaModel=am.AlpacaModel, Settings=filter)  # -> log, AlpacaSolvedModel
# ---------- ra: Python ----------
"""
Run an OpenSees Analysis
-
    Args:
        AlpacaModel:
        Settings:
    Returns:
        AlpacaSolvedModel:
"""



import Rhino.RhinoDoc
import Grasshopper as gh
import copy
import rhinoscriptsyntax as rs
import os
import time
import sys



ghenv.Component.Name = "Run Analysis (Alpaca4d)"
ghenv.Component.NickName = 'RA'
ghenv.Component.Message = "Run Analysis (Alpaca4d)"

ghcompfolder = gh.Folders.DefaultAssemblyFolder
if ghcompfolder not in sys.path:
    sys.path.append(ghcompfolder)

try:
    from Alpaca4d import alpaca4d as alpaca
except:
    msg = "Cannot import Alpaca4d. Is the Alpaca4d folder available in " + ghcompfolder + "?"
    ghenv.Component.AddRuntimeMessage(gh.Kernel.GH_RuntimeMessageLevel.Error, msg)


checkData = True



if not AlpacaModel:
    checkData = False
    msg = "Input parameter AlpacaModel failed to collect data"
    ghenv.Component.AddRuntimeMessage(gh.Kernel.GH_RuntimeMessageLevel.Warning, msg)


if not Settings:
    checkData = False
    msg = "Input parameter Settings failed to collect data"
    ghenv.Component.AddRuntimeMessage(gh.Kernel.GH_RuntimeMessageLevel.Warning, msg)


if checkData:
    FolderPath = rs.DocumentPath()
    os.chdir(FolderPath)
    
    outputFileName = 'openSeesModel'
    recorderFileName = 'recorder.mpco'
    
    for dirpath, dirnames, filenames in os.walk(FolderPath):
        for filename in filenames:
            if filename == outputFileName:
                file = os.path.join(dirpath,outputFileName)
                os.remove(file)
            elif filename == recorderFileName:
                file = os.path.join(dirpath,recorderFileName)
                os.remove(file)
    
    
    # create a copy
    
    AnalysisModel = copy.copy(AlpacaModel)
    AnalysisModel.py = list(AnalysisModel.py)
    
    # generate Recorder and assign name
    AnalysisModel.recorderName = "recorder" + ".mpco"
    
    if Settings.AnalysisType == "Static":
        recorder = alpaca.TCLRecorder.mpco(AnalysisModel.recorderName, True,True,False,False,True,True,False,False,True,True,True,True)
    elif Settings.AnalysisType == "Transient":
        recorder = alpaca.TCLRecorder.mpco(AnalysisModel.recorderName, True,True,True,True,True,True,False,False,True,True,True,True)
    
    AnalysisModel.py.append(recorder)
    
    
    AnalysisModel.analysis = Settings
    AnalysisModel.py.append(Settings.write_tcl())
    AnalysisModel.py.append("wipe")
    
    
    #textFile = AnalysisModel.py
    
    time_start = time.clock()
    
    AnalysisModel.writeFile(outputFileName)
    
    time_elapsed = (time.clock() - time_start)
    print("Writing Time {}".format(time_elapsed))
    
    
    
    time_start = time.clock()
    
    executable = os.path.join(ghcompfolder,'Alpaca4d\OpenSees-Solvers\opensees.bat')
    a, log = AnalysisModel.runOpensees(executable)
    
    
    time_elapsed = (time.clock() - time_start)
    print("Analyses Time {}".format(time_elapsed))
    
    AlpacaSolvedModel = copy.copy(AnalysisModel)
    AlpacaSolvedModel.isAnalysed = True
# ---------- end ra ----------
dm_3 = DeformedModelAlpaca4d(AlpacaSolvedModel=ra.AlpacaSolvedModel, step=number_slider_2, scale="1000", extrudeModel=Toggle(True), listColor=clr)  # -> DefModel, bounds; inputs step: Int32, extrudeModel: Boolean, typeColor: Int32, listColor: list of Color
# ---------- dm_3: Python ----------
"""View Deformed model
    Args:
        AlpacaSolvedModel: Output of Analyses solver
        step:
        scale: Multiplication factor for displacement
        extrudeModel:  
True : view extruded model
else : view stick model
        typeColor:  View relative color of the traslation
<=0 : view traslation X 
1 : view traslation Y
2 : view traslation Z
>= 3 : view resulting displacement.
        listColor : one list of color 

    Output:
       DefModel: view deformed model
       bounds: max end min of displacement of the structure 
"""

ghenv.Component.Name = "Deformed Model (Alpaca4d)"
ghenv.Component.NickName = 'DM'
ghenv.Component.Message = "Deformed Model (Alpaca4d)"

from ghpythonlib.componentbase import executingcomponent as component
import System
import rhinoscriptsyntax as rs

import sys
import os
import clr
import clrtype
import Rhino.Geometry as rg
import Rhino as rc
import math as mt
import Grasshopper as gh
import ghpythonlib.treehelpers as th
from ghpythonlib.components import ConstructDomain

ghcompfolder = gh.Folders.DefaultAssemblyFolder
if ghcompfolder not in sys.path:
    sys.path.append(ghcompfolder)
try:
    from Alpaca4d import alpaca4dView as alpacaView
except:
    msg = "Cannot import Alpaca4d. Is the Alpaca4d folder available in " + ghcompfolder + "?"
    ghenv.Component.AddRuntimeMessage(gh.Kernel.GH_RuntimeMessageLevel.Error, msg)
    
FolderPath = rs.DocumentPath()
os.chdir(FolderPath)

ghcompfolder = gh.Folders.DefaultAssemblyFolder
my_module_name = "Alpaca_StepReader"
my_module = sys.modules.setdefault(my_module_name, type(sys)(my_module_name))


try:
    Steps_dm = my_module.Steps_dm
    Modes = my_module.Modes
except AttributeError:
    type_2d = type(System.Array.CreateInstance(float, 1, 1))

    class Steps_dm(object):
        __metaclass__ = clrtype.ClrClass
        _clrfields = {"STEP_{}".format(i): type_2d for i in range(2000)} # it will work for model with less than 1000 steps

    class Modes(object):
        __metaclass__ = clrtype.ClrClass
        _clrfields = {"MODE_{}".format(i): type_2d for i in range(2000)} # it will work for model with less than 1000 steps

    my_module.Steps_dm = Steps_dm
    my_module.Modes = Modes


hdfFilePath = os.path.join(ghcompfolder, "Alpaca4d\HDF5CSharp.dll")
clr.AddReferenceToFileAndPath(hdfFilePath)

from HDF5CSharp import Hdf5

class MyComponent(component):
    
    def RunScript(self, AlpacaSolvedModel, step = None, scale = None , extrudeModel = None, typeColor = None, listColor = [] ):
        import sys
        
        self.extrudeModel = extrudeModel
        
        self.defModel1 = []
        self.defModel2 = []
        self.defModel3 = []
        
        self.beamColor = []
        

        if step == None:
            step = 0
        if extrudeModel == None:
            extrudeModel = False
        if typeColor == None:
            typeColor = 3
        
        if not listColor: listColor = [ System.Drawing.Color.DarkViolet, 
                                        System.Drawing.Color.BlueViolet, 
                                        System.Drawing.Color.RoyalBlue, 
                                        System.Drawing.Color.CornflowerBlue,
                                        System.Drawing.Color.LightSkyBlue, 
                                        System.Drawing.Color.LightBlue,
                                        System.Drawing.Color.CadetBlue,
                                        System.Drawing.Color.LightGreen,
                                        System.Drawing.Color.GreenYellow,
                                        System.Drawing.Color.Yellow,
                                        System.Drawing.Color.Orange,
                                        System.Drawing.Color.Red,
                                        System.Drawing.Color.DarkRed]
            
        checkData = True
        
        if not AlpacaSolvedModel:
            checkData = False
            msg = "Input parameter AlpacaSolvedModel failed to collect data"
            ghenv.Component.AddRuntimeMessage(gh.Kernel.GH_RuntimeMessageLevel.Warning, msg)
        else:
            try:
                fileId = Hdf5.OpenFile(AlpacaSolvedModel.recorderName, True)
                print( AlpacaSolvedModel.recorderName)
                numberOfPoints = len(AlpacaSolvedModel.uniquePoints) #
                
                displacement = []
                rotation = []
                dispNodeList = []
                
                if AlpacaSolvedModel.isModal == True:
                    print( AlpacaSolvedModel.isModal == True )
                    outputData = "MODEL_STAGE[1]/RESULTS/ON_NODES/MODES_OF_VIBRATION(U)/DATA/STEP_0"
                    print( outputData )
                    displacementResult = Hdf5.ReadObject[Modes](fileId, outputData)
                    for i in range(numberOfPoints):
                        tag = i + 1
                        vx = getattr(displacementResult, 'MODE_{}'.format(step))[i,0]
                        vy = getattr(displacementResult, 'MODE_{}'.format(step))[i,1]
                        vz = getattr(displacementResult, 'MODE_{}'.format(step))[i,2]
                        trasl = rg.Vector3d(vx,vy,vz)
                        displacement.append(trasl)
                        dispNodeList.append( [tag, trasl] )
                        
                    Hdf5.CloseFile(fileId)
                    print("I have closed the file")
                else: 
                    outputData = "/MODEL_STAGE[1]/RESULTS/ON_NODES/DISPLACEMENT/DATA"
                    print( outputData )
                    displacementResult = Hdf5.ReadObject[Steps_dm](fileId, outputData)
                    for i in range(numberOfPoints):
                        tag = i + 1
                        vx = getattr(displacementResult, 'STEP_{}'.format(step))[i,0]
                        vy = getattr(displacementResult, 'STEP_{}'.format(step))[i,1]
                        vz = getattr(displacementResult, 'STEP_{}'.format(step))[i,2]
                        trasl = rg.Vector3d(vx,vy,vz)
                        displacement.append(trasl)
                        dispNodeList.append( [tag, trasl] )
                        
                    Hdf5.CloseFile(fileId)
                    print("I have closed the file")
            
                dispNodeDict = dict( dispNodeList )
                #---------------------------------------------------#
                defEleVector1 = alpacaView.BeamVectorDef(AlpacaSolvedModel,dispNodeDict) #beam
                defEleVector2 = alpacaView.ShellVectorDef(AlpacaSolvedModel,dispNodeDict) #shell
                defEleVector3 = alpacaView.BrickVectorDef(AlpacaSolvedModel,dispNodeDict) #shell
                bound = alpacaView.boundsDef(displacement, typeColor)
                if scale == None: scale = 1/bound[1]
                if self.extrudeModel == None or self.extrudeModel == False:
                    #BEAM
                    defModel1 = alpacaView.BeamDef(AlpacaSolvedModel, dispNodeDict,scale)
                    self.defModel1, self.beamColor = alpacaView.ColorBeamDef( defModel1, defEleVector1, bound, listColor, typeColor)
                    #SHELL
                    defModel2 = alpacaView.ShellDef(AlpacaSolvedModel,dispNodeDict,scale)
                    #BRICK
                    defModel3 = alpacaView.BrickDef(AlpacaSolvedModel,dispNodeDict,scale)
                else:
                    #BEAM
                    defModel1 = alpacaView.BeamDefExtrude(AlpacaSolvedModel, dispNodeDict,scale)
                    self.defModel1 = alpacaView.ColorBeamDefExtrude( defModel1, defEleVector1, bound, listColor, typeColor)
                    #SHELL
                    defModel2 = alpacaView.ShellDefExtrude(AlpacaSolvedModel,dispNodeDict,scale)
                    #BRICK
                    defModel3 = alpacaView.BrickDef(AlpacaSolvedModel,dispNodeDict,scale)
                    
                #SHELL COLOR
                self.defModel2 = alpacaView.ColorShellDef( defModel2, defEleVector2 , bound, listColor, typeColor, extrudeModel )
                #BRICK COLOR
                self.defModel3 = alpacaView.ColorBrickDef( defModel3, defEleVector3 , bound, listColor, typeColor)
                DefModel = th.list_to_tree(self.defModel1 + defModel2 + defModel3)
                bounds = ConstructDomain(bound[0], bound[1])
                return (DefModel, bounds)
            except:
                Hdf5.CloseFile(fileId)
                print("I have closed the file due to exception")
            # return outputs if you have them; here I try it for you:
        
        
    def DrawViewportWires(self,arg):
        for iMesh in self.defModel2 :
            colorWirframe = System.Drawing.Color.Black
            arg.Display.DrawMeshWires(iMesh, colorWirframe)
            
        for iMesh in self.defModel3 :
            colorWirframe = System.Drawing.Color.Black
            arg.Display.DrawMeshWires(iMesh, colorWirframe)
        if self.extrudeModel is None or self.extrudeModel is False:
            thickness =2
            for iBeam, iColor in zip(self.defModel1, self.beamColor) :
                for jBeam, jColor in zip(iBeam, iColor):
                    arg.Display.DrawCurve(jBeam, jColor, thickness)
        else:
            for iBeam in self.defModel1 :
                colorWirframe = System.Drawing.Color.Black
                arg.Display.DrawMeshWires(iBeam, colorWirframe)
# ---------- end dm_3 ----------
nd = NodalDisplacementsAlpaca4d(AlpacaModel=ra.AlpacaSolvedModel, History=Toggle(True))  # -> out, displacement, rotation, a, velocity, acceleration; inputs History: Boolean, step: Int32
# ---------- nd: Python ----------
"""
Read displacement results
-
    Args:
        AlpacaModel:
        History: True to visualise the displacement and rotation history of the points
        step:
    Returns:
        displacement:
        rotation:
        displacement_History:
        rotation_History:
"""

ghenv.Component.Name = "Nodal Displacements (Alpaca4d)"
ghenv.Component.NickName = 'ND'
ghenv.Component.Message = "Displacements (Alpaca4d)"

import sys
import os
import System
from System.Drawing import Color


import clr
import clrtype
import Rhino.Geometry as rg
import rhinoscriptsyntax as rs
import Grasshopper as gh
import copy
import ghpythonlib.treehelpers as th



## add alpaca install directory to system path

ghcompfolder = gh.Folders.DefaultAssemblyFolder
if ghcompfolder not in sys.path:
    sys.path.append(ghcompfolder)

try:
    from Alpaca4d import alpaca4d as alpaca
except:
    msg = "Cannot import Alpaca4d. Is the Alpaca4d folder available in " + ghcompfolder + "?"
    ghenv.Component.AddRuntimeMessage(gh.Kernel.GH_RuntimeMessageLevel.Error, msg)



FolderPath = rs.DocumentPath()
os.chdir(FolderPath)

my_module_name = "Alpaca_StepReader" # replace this with something unique that doesn't collide with a real module!
my_module = sys.modules.setdefault(my_module_name, type(sys)(my_module_name))

hdfFilePath = os.path.join(ghcompfolder, "Alpaca4d\HDF5CSharp.dll")
clr.AddReferenceToFileAndPath(hdfFilePath)


from HDF5CSharp import Hdf5

try:
    Steps = my_module.Steps
except AttributeError:
    type_2d = type(System.Array.CreateInstance(float, 1, 1))

    class Steps(object):
        __metaclass__ = clrtype.ClrClass
        _clrfields = {"STEP_{}".format(i): type_2d for i in range(3000)} # it will work for model with less than 1000 steps

    my_module.Steps = Steps



checkData = True

if not AlpacaModel:
    checkData = False
    msg = "Input parameter AlpacaModel failed to collect data"
    ghenv.Component.AddRuntimeMessage(gh.Kernel.GH_RuntimeMessageLevel.Warning, msg)



History = False if History is None else History


if checkData:
    step = (int(AlpacaModel.analysis.AnalysisSteps.numIncr) - 1) if step is None else step
    numberOfPoints = len(AlpacaModel.uniquePoints) #
    
    if not History:
        try:
            fileId = Hdf5.OpenFile(AlpacaModel.recorderName, True)
            
            
            displacementResult = Hdf5.ReadObject[Steps](fileId, "/MODEL_STAGE[1]/RESULTS/ON_NODES/DISPLACEMENT/DATA")
            displacement = []
            for i in range(numberOfPoints):
                x = getattr(displacementResult, 'STEP_{}'.format(step))[i,0]
                y = getattr(displacementResult, 'STEP_{}'.format(step))[i,1]
                z = getattr(displacementResult, 'STEP_{}'.format(step))[i,2]
                displacement.append(rg.Vector3d(x,y,z))
            
            
            rotationResult = Hdf5.ReadObject[Steps](fileId, "/MODEL_STAGE[1]/RESULTS/ON_NODES/ROTATION/DATA")
            rotation = []
            for i in range(numberOfPoints):
                x = getattr(rotationResult, 'STEP_{}'.format(step))[i,0]
                y = getattr(rotationResult, 'STEP_{}'.format(step))[i,1]
                z = getattr(rotationResult, 'STEP_{}'.format(step))[i,2]
                rotation.append(rg.Vector3d(x,y,z))
            
            
            
            if AlpacaModel.analysis.AnalysisType == "Transient":
                velocityResult = Hdf5.ReadObject[Steps](fileId, "/MODEL_STAGE[1]/RESULTS/ON_NODES/VELOCITY/DATA")
                velocity = []
                for i in range(numberOfPoints):
                    x = getattr(velocityResult, 'STEP_{}'.format(step))[i,0]
                    y = getattr(velocityResult, 'STEP_{}'.format(step))[i,1]
                    z = getattr(velocityResult, 'STEP_{}'.format(step))[i,2]
                    velocity.append(rg.Vector3d(x,y,z))
    
    
    
                accelerationResult = Hdf5.ReadObject[Steps](fileId, "/MODEL_STAGE[1]/RESULTS/ON_NODES/ACCELERATION/DATA")
                acceleration = []
                for i in range(numberOfPoints):
                    x = getattr(accelerationResult, 'STEP_{}'.format(step))[i,0]
                    y = getattr(accelerationResult, 'STEP_{}'.format(step))[i,1]
                    z = getattr(accelerationResult, 'STEP_{}'.format(step))[i,2]
                    acceleration.append(rg.Vector3d(x,y,z))

                
                
            Hdf5.CloseFile(fileId)
            print("I have closed the file")
        except:
            if fileId >0:
                Hdf5.CloseFile(fileId)
                print("I have closed the file because of exception")
    
    
    
    if History:
        try:
            fileId = Hdf5.OpenFile(AlpacaModel.recorderName, True)
            
            displacementResult = Hdf5.ReadObject[Steps](fileId, "/MODEL_STAGE[1]/RESULTS/ON_NODES/DISPLACEMENT/DATA")
            displacement = []
            
            for i in range(numberOfPoints):
                dispTemp = []
                maxNumberStep = int(AlpacaModel.analysis.AnalysisSteps.numIncr)
                for n_step in range(maxNumberStep):
                    x = getattr(displacementResult, 'STEP_{}'.format(n_step))[i,0]
                    y = getattr(displacementResult, 'STEP_{}'.format(n_step))[i,1]
                    z = getattr(displacementResult, 'STEP_{}'.format(n_step))[i,2]
                    dispTemp.append(rg.Vector3d(x,y,z))
                    
                
                displacement.append(dispTemp)
    
    
    
            rotationResult = Hdf5.ReadObject[Steps](fileId, "/MODEL_STAGE[1]/RESULTS/ON_NODES/ROTATION/DATA")
            
            rotation = []
            
            for i in range(numberOfPoints):
                rotationTemp = []
                for n_step in range(maxNumberStep):
                    x = getattr(rotationResult, 'STEP_{}'.format(n_step))[i,0]
                    y = getattr(rotationResult, 'STEP_{}'.format(n_step))[i,1]
                    z = getattr(rotationResult, 'STEP_{}'.format(n_step))[i,2]
                    rotationTemp.append(rg.Vector3d(x,y,z))
                
                rotation.append(rotationTemp)
    
    
            if AlpacaModel.analysis.AnalysisType == "Transient":
                velocityResult = Hdf5.ReadObject[Steps](fileId, "/MODEL_STAGE[1]/RESULTS/ON_NODES/VELOCITY/DATA")
                
                velocity = []
                
                for i in range(numberOfPoints):
                    velocityTemp = []
                    for n_step in range(maxNumberStep):
                        x = getattr(velocityResult, 'STEP_{}'.format(n_step))[i,0]
                        y = getattr(velocityResult, 'STEP_{}'.format(n_step))[i,1]
                        z = getattr(velocityResult, 'STEP_{}'.format(n_step))[i,2]
                        velocityTemp.append(rg.Vector3d(x,y,z))
                    
                    velocity.append(velocityTemp)
    
    
    
                accelerationResult = Hdf5.ReadObject[Steps](fileId, "/MODEL_STAGE[1]/RESULTS/ON_NODES/ACCELERATION/DATA")
                
                acceleration = []
                
                for i in range(numberOfPoints):
                    accelerationTemp = []
                    for n_step in range(maxNumberStep):
                        x = getattr(accelerationResult, 'STEP_{}'.format(n_step))[i,0]
                        y = getattr(accelerationResult, 'STEP_{}'.format(n_step))[i,1]
                        z = getattr(accelerationResult, 'STEP_{}'.format(n_step))[i,2]
                        accelerationTemp.append(rg.Vector3d(x,y,z))
                    
                    acceleration.append(accelerationTemp)




            Hdf5.CloseFile(fileId)
        except:
            Hdf5.CloseFile(fileId)
            print("I have closed the file because an exception")
    
    
    displacement = th.list_to_tree(displacement)
    rotation = th.list_to_tree(rotation)
    
    if AlpacaModel.analysis.AnalysisType == "Transient":
        velocity = th.list_to_tree(velocity)
        acceleration = th.list_to_tree(acceleration)
    else:
        velocity = []
        acceleration = []
# ---------- end nd ----------
devec = DeconstructVector(Vector=nd.displacement)  # -> XComponent, YComponent, ZComponent
devec_2 = DeconstructVector(Vector=nd.velocity)  # -> XComponent, YComponent, ZComponent
panel_10 = Panel(nd.out)
python_4 = GhPythonScript(displacement=devec.ZComponent, time_step=num)  # -> out, displacement, velocity, acceleration; inputs displacement: list
# ---------- python_4: Python ----------
velocity = []
acceleration = []

for i,value in enumerate(displacement):
    try:
        v_0 = displacement[i+0]
        v_1 = displacement[i+1]
        velocity.append( (v_1 - v_0)/time_step )
    except:
        pass


for i,value in enumerate(velocity):
    try:
        a_0 = velocity[i+0]
        a_1 = velocity[i+1]
        acceleration.append( (a_1 - a_0)/time_step )
    except:
        pass
# ---------- end python_4 ----------
devec_3 = DeconstructVector(Vector=nd.acceleration)  # -> XComponent, YComponent, ZComponent

# ---- group: displacement
graph_2 = QuickGraph(python_4.displacement, SortOrder=0)

# ---- group: velocity
graph_3 = QuickGraph(python_4.velocity, SortOrder=0)

# ----
graph_4 = QuickGraph(devec_2.ZComponent, SortOrder=0)

# ---- group: acceleration
graph_5 = QuickGraph(python_4.acceleration, SortOrder=0)

# ----
graph_6 = QuickGraph(devec_3.ZComponent, SortOrder=0)
