# Grasshopper definition topological optimisation.gh (Grasshopper 1.0.7)
# Copyright: Sebastian Białkowski
# plug-ins: tOpos, Kangaroo Components, Pufferfish, TetgenGH, Human, Karamba3D, MeshEdit Components, DendroGH, IguanaMesh, Weaverbird, NGon

box = DomainBox(Base=PlaneXY(0, 0, 0), X="30", Y="150", Z="50")
geo = Geometry(box)
debrep = DeconstructBrep(Brep=geo)  # -> Faces, Edges, Vertices
item = ListItem(List=debrep.Faces, Index=0, Wrap=True)  # -> Item, Item1, Item2
geo_2 = Geometry(item.Item)
geo_3 = Geometry(item.Item2)
geo_4 = Geometry(geo_3)
md_slider = MDSlider(
    SliderMode=0,
    slider_value=Point(0.5347299576, 0.1219053268, 0.5),
    x_domain=Domain(0, 1),
    y_domain=Domain(0, 1),
    z_domain=Domain(0, 1))
iso = IsoCurve(Surface=reparameterize(geo_4), UVPoint=md_slider)  # -> UIsocurve, VIsocurve
neg = Negative(Value="3")
neg_2 = Negative(Value="10")
panel = Panel("""0.00
1.00""")
crv = Curve(iso.UIsocurve)
edges = BrepEdges(Brep=geo_2)  # -> Naked, Interior, NonManifold
dom = ConstructDomain(DomainStart=neg, DomainEnd="3")
dom_2 = ConstructDomain(DomainStart=neg_2, DomainEnd="10")
srfsplit = SurfaceSplit(Surface=geo_4, Curves=crv)
item_2 = ListItem(List=edges.Naked, Index=0, Wrap=True)  # -> Item3, Item2, Item1, Item
pframe = PerpFrame(Curve=reparameterize(item_2.Item3), Parameter=panel)
rectangle = Rectangle(Plane=PlaneXY(0, 0, 0), XSize=dom_2, YSize=dom, Radius=0)  # -> Rectangle, Length
item_3 = ListItem(List=srfsplit, Index=0, Wrap=True)  # -> Item, Item1
Z = UnitZ(Factor="-15")
orient = Orient(Geometry=rectangle.Rectangle, Source=PlaneXY(0, 0, 0), Target=pframe)  # -> Geometry, Transform
neg_3 = Negative(Value="2")
move = Move(Geometry=item_2.Item3, Motion=Z)  # -> Geometry, Transform
loft = Loft(Curves=orient.Geometry, Options={Adjust=False, Closed=False, LoftEnds=0, LoftSimp=0, LoftType=0, Rebuild=10, Refit=0.01})
offsrf = OffsetSurface(Surface=item_3.Item1, Distance="2", BothSides=neg_3, CreateSolid=True)
capex = CapHolesEx(Brep=loft)  # -> Brep, Caps, Solid
neg_4 = Negative(Value="1")
Z_2 = UnitZ(Factor="45")
geo_5 = Geometry(geo)
vec = VectorXYZ(XComponent=0, YComponent=0, ZComponent=neg_4)  # -> Vector, Length
move_2 = Move(Geometry=offsrf, Motion=Z_2)  # -> Geometry, Transform
ll = LinearLoad(LoadLine=item_2.Item3, LoadVector=vec.Vector)

# ---- group: ingredients
boundary_support = Mesh([offsrf, move_2.Geometry])
number_slider = Slider(40, range=0..100)
geometry = Mesh(geo_5)

# ----
panel_2 = Panel("20")
young_ingpa = Slider(70, range=0..1000)
poisson = Slider(0.3, range=0..1)
targetdens = Slider(0.1, range=0..1)
volume = Volume(Geometry=boundary_support)  # -> Volume, Centroid

# ---- group: CUDA
reset_cuda = Button()
cudacontext = CudaCtx(Reset=reset_cuda)  # -> Performance, FreeMemory, KernelStatistics

# ----
scale = Scale(Geometry=boundary_support, Center=volume.Centroid, Factor="1.05")  # -> Geometry, Transform
bprop = BoundaryProperties(FixedMesh=scale.Geometry, DensityPattern="1")
res = Resolution(ResolutionX=number_slider, sizeModeToggle=False)
bdomain = BoundaryDomain(DomainMesh=geometry, DensityValue=targetdens, YoungModul=young_ingpa, PoissonNumber=poisson)
bcond = BoundaryConditions(Load=ll, Support=boundary_support)
model = Model(BoundaryDomain=bdomain, BoundaryCondition=bcond, BoundaryProperties=bprop, ModelResolution=res, gpuModeToggle=True)  # -> Model, Performance
mstat = ModelStatistics(Model=model.Model)  # -> ModelResolution, ElementCount, ElementSize, NodeCount, DoFs; disabled
panel_3 = Panel([mstat.ModelResolution, mstat.ElementCount, mstat.ElementSize, mstat.NodeCount, mstat.DoFs])  # disabled

# ---- group: Good Setups. In penalisation I'm using continuation idea described by Bendsoe and Sigmund
oparam = OptimiusParameters(
    OptimisationIteration=Slider(100, range=0..100),
    VolumeFraction="0.05",
    Penalty=Domain(2, 3),
    Change="0.1",
    SensitivityFilterRadius=Domain(1.5, 1.5),
    DensityFilterType=0,
    GrayScaleFilter=False,
    HeavisideProjection=0,
    SensitivityFilterType=1)

# ----
clean = CombineClean(Meshes=<missing>)  # disabled

# ---- group: General Setup
aparam = AnalyserParameters(Iterations=5000, Tolerance=0.001)

# ----
reset = Button()
run = BooleanToggle(False)
optimus = Optimus(
    Model=model.Model,
    AnalyserParameters=aparam,
    OptimusParameters=oparam,
    SubdivisionThreshold=0.5,
    Reset=reset,
    Run=run,
    optimisationPreviewMode=False,
    solverType=0)  # -> Model, Compliance, Performance

mesh = Mesh(<mesh referenced from the Rhino model>)

# ---- group: Optimisation process
graph = QuickGraph(optimus.Compliance, SortOrder=0)

# ----
wbnaked = WeaverbirdsNakedBoundary(MeshClosedPolylines=mesh)
clsmsh = CloseMesh(Mesh=mesh, Quadrangulate=True)  # -> Closed, Amount, Openings, R
denspre = DensPreview(model=optimus.Model, iso=Slider(0.055, range=0.01..1))
iso_2 = IsoMesh(Deflection=0)
vox = VoxelMesh(Model=optimus.Model, Threshold="0.1", asOneMeshMode=True, densityPreviewMode=False)
pstress = PrincipalStress(Model=optimus.Model, Tolerance=0)  # -> PStressValues, PStressPlane, PStressCrosses, PStressCrossesColours, PStressMinMax, VonMiesesValues, VonMiesesCrossesColours, Performance
mesh_2 = Mesh(vox)
element = ElementData(Model=optimus.Model, densityMode=False)  # -> Location, Density, Compliance, Sensitivity, Size
meshskeleton = MeshSkeleton()
bbox = BoundingBox(Content=element.Location, Plane=PlaneXY(0, 0, 0), UnionBox=True)  # -> Box, Box_2
number_slider_2 = Slider(0.42, range=0.01..1)  # disabled
isosurface = IsoSurface(
    Box=box,
    XResolution=number_slider,
    YResolution=number_slider,
    ZResolution=number_slider,
    IsoValue=0.15,
    MergeVertices=False)
panel_4 = Panel("0.5")  # disabled
panel_5 = Panel("30")  # disabled
element_2 = ElementData(Model=optimus.Model, densityMode=False)  # -> Location, Density, Compliance, Sensitivity, Size; disabled
panel_6 = Panel("0.2")  # disabled
vox_2 = VoxelMesh(Model=optimus.Model, Threshold=number_slider_2, asOneMeshMode=True, densityPreviewMode=False)  # disabled
iso_3 = Number(number_slider_2)  # disabled
elepre = ElementDataPreview(model=optimus.Model, iso=panel_4, move=panel_5)  # -> element_location, colours, colour_range; disabled
vsettings = CreateSettings(VoxelSize=panel_6, Bandwidth=panel_6, Isovalue=0, Adaptivity=0.1)  # disabled
larger = LargerThan(FirstNumber=element_2.Density, SecondNumber=iso_3)  # -> LargerThan, OrEqualTo; disabled
panel_7 = Panel("1.5")  # disabled
cull = CullPattern(List=element_2.Location, CullPattern=larger.LargerThan)  # disabled
vpoints = PointsToVolume(Points=cull, PointRadius=panel_7, Settings=vsettings)  # disabled
panel_8 = Panel("10000")  # disabled
mvolume = VolumeToMesh(Volume=vpoints, VolumeSettings=vsettings)  # disabled
qrsettings = QuadRemeshSettings(TargetCount=panel_8, AdaptiveSize=0, AdaptiveCount=False, HardEdges=False, SeamEdges=0, Symmetry=0, GuideCurves=0)  # disabled
qrmesh = QuadRemesh(Mesh=mvolume, Settings=qrsettings)  # disabled
subdmesh = SubDFromMesh(Mesh=qrmesh, Creases=1, Corners=1, Interpolate=False)  # disabled
brep = Brep(subdmesh)  # disabled
panel_9 = Panel("0.1")  # disabled
panel_10 = Panel("0.5")  # disabled
ilineartetraprism = ILinearTetraPrism(
    MinimumSize=panel_9,
    MaximunSize=panel_10,
    CurvatureAdapt=False,
    MinimumElements=6,
    Optimization=0,
    QualityType=2,
    QualityThreshold=0.3,
    Massive_Refinement=False)  # disabled
ifillbrep = IFillBrep(Brep=brep)  # -> IMesh, Entities, Info; disabled
brep_2 = Brep([offsrf, move_2.Geometry])  # disabled

# ----
# if you modify the screen
update = Button()  # disabled

panel_11 = Panel("1")  # disabled
subd = SubD()  # disabled
meshsubd = MeshFromSubD(SubD=subd, Density=panel_11)  # disabled
panel_12 = Panel("0")  # disabled
tetgen = Tetrahedralize(Mesh=meshsubd, Flags=panel_12, MinRatio=2)  # -> Mesh, Indices, Points; disabled
demesh = DeconstructMesh(Mesh=tetgen.Mesh)  # -> flatten(Vertices), Faces, Colours, Normals; disabled
brep_3 = Brep(capex.Brep)  # disabled
rdpoints = RemoveDuplicatePointsKaramba3D(Point=demesh.Vertices, LimitDistance=0.005)  # -> OutPoint, Info, Indexes; disabled
panel_13 = Panel("2.1e+11")  # disabled
brepinc = PointInBrep(Brep=brep_3, Point=rdpoints.OutPoint, Strict=False)  # disabled
panel_14 = Panel("2500")  # disabled
panel_15 = Panel("0.3")  # disabled
cull_2 = CullPattern(List=rdpoints.OutPoint, CullPattern=brepinc)  # disabled
eim = ElasticIsotropicMaterialAlpaca4d(E=panel_13, v=panel_15, rho=panel_14)  # -> out, nDMaterial; disabled
# ---------- eim: Python ----------
"""
Create a nD Elastic Isotropic Material
-
    Args:
        name:
        E:
        G:
        v:
        rho:
    Returns:
        nDMaterial:
"""

ghenv.Component.Name = "Elastic Isotropic Material (Alpaca4d)"
ghenv.Component.NickName = 'EIM'
ghenv.Component.Message = "Elastic Isotropic (Alpaca4d)"


import sys
import Rhino.Geometry as rg
import Grasshopper as gh
import copy


## add alpaca install directory to system path

ghcompfolder = gh.Folders.DefaultAssemblyFolder
if ghcompfolder not in sys.path:
    sys.path.append(ghcompfolder)

try:
    from Alpaca4d import alpaca4d as alpaca
except:
    msg = "Cannot import Alpaca4d. Is the Alpaca4d folder available in " + ghcompfolder + "?"
    ghenv.Component.AddRuntimeMessage(gh.Kernel.GH_RuntimeMessageLevel.Error, msg)


checkData = True

if not E:
    checkData = False
    msg = "Input parameter E failed to collect data"
    ghenv.Component.AddRuntimeMessage(gh.Kernel.GH_RuntimeMessageLevel.Warning, msg)

if not G and not v:
    checkData = False
    msg = "Input parameter G or v failed to collect data"
    ghenv.Component.AddRuntimeMessage(gh.Kernel.GH_RuntimeMessageLevel.Warning, msg)

if not rho:
    checkData = False
    msg = "Input parameter rho failed to collect data"
    ghenv.Component.AddRuntimeMessage(gh.Kernel.GH_RuntimeMessageLevel.Warning, msg)

if checkData:
    nDMaterial = alpaca.ElasticIsotropic(name, E, G, rho, v)
# ---------- end eim ----------
mesh_3 = Mesh(tetgen.Mesh)  # disabled
panel_16 = Panel("-10000")  # disabled
lng = ListLength(List=cull_2)  # disabled
toggle = BooleanToggle(True)  # disabled
toggle_2 = BooleanToggle(False)  # disabled
cts = ConstantTimeSeriesAlpaca4d()  # -> TimeSeries, Graph; disabled
# ---------- cts: Python ----------
"""
Create a Constant Time Series
-
    Args:
        tStart:
        tEnd:
        period:
        factor:
        shift:
    Returns:
        TimeSeries:
        Graph:
"""

ghenv.Component.Name = "Constant Time Series (Alpaca4d)"
ghenv.Component.NickName = 'CTS'
ghenv.Component.Message = "Constant Time Series (Alpaca4d)"


import sys
import Rhino.Geometry as rg
import Grasshopper as gh
import copy
import math


## add alpaca install directory to system path

ghcompfolder = gh.Folders.DefaultAssemblyFolder
if ghcompfolder not in sys.path:
    sys.path.append(ghcompfolder)

try:
    from Alpaca4d import alpaca4d as alpaca
except:
    msg = "Cannot import Alpaca4d. Is the Alpaca4d folder available in " + ghcompfolder + "?"
    ghenv.Component.AddRuntimeMessage(gh.Kernel.GH_RuntimeMessageLevel.Error, msg)

def ConstantSeries(x):
    return x



checkData = True

if not constantFactor:
    constantFactor = 1


if checkData:
    TimeSeries = alpaca.TimeSeriesConstant(constantFactor)
    
    Graph = []
    
    for x in range(10):
        Graph.append(ConstantSeries(constantFactor))
# ---------- end cts ----------
division = Division(A=panel_16, B=lng)  # disabled
Z_3 = UnitZ(Factor=division)  # disabled
fnt = FourNodeTetrahedronAlpaca4d(Tetrahedron=mesh_3, nDMaterial=eim.nDMaterial)  # -> out, Element; inputs Tetrahedron: Mesh, Colour: Color; disabled
# ---------- fnt: Python ----------
"""
Create a Four Node Tetrahedron Element
-
    Args:
        Tetrahedron:
        nDMaterial:
        Colour:
    Returns:
        Element:
"""

ghenv.Component.Name = "Four Node Tetrahedron (Alpaca4d)"
ghenv.Component.NickName = 'FNT'
ghenv.Component.Message = "Tetrahedron (Alpaca4d)"


import sys
import Rhino.Geometry as rg
import Grasshopper as gh
from System.Drawing import Color


## add alpaca install directory to system path

ghcompfolder = gh.Folders.DefaultAssemblyFolder
if ghcompfolder not in sys.path:
    sys.path.append(ghcompfolder)

try:
    from Alpaca4d import alpaca4d as alpaca
    from Alpaca4d import alpaca4dUtil as alpacaUtil
except:
    msg = "Cannot import Alpaca4d. Is the Alpaca4d folder available in " + ghcompfolder + "?"
    ghenv.Component.AddRuntimeMessage(gh.Kernel.GH_RuntimeMessageLevel.Error, msg)


checkData = True

if not Tetrahedron:
    checkData = False
    msg = "Input parameter Tetrahedron failed to collect data"
    ghenv.Component.AddRuntimeMessage(gh.Kernel.GH_RuntimeMessageLevel.Warning, msg)

if not nDMaterial:
    checkData = False
    msg = "Input parameter nDMaterial failed to collect data"
    ghenv.Component.AddRuntimeMessage(gh.Kernel.GH_RuntimeMessageLevel.Warning, msg)

if not Colour:
    Colour = Color.PaleGoldenrod

if checkData:
    #Tetrahedron = alpacaUtil.cleanTetrahedron(Tetrahedron)
    Element = alpaca.FourNodeTetrahedron(Tetrahedron, nDMaterial, Colour)
# ---------- end fnt ----------
pl = PointLoadAlpaca4d(Pos=cull_2, Force=Z_3, TimeSeries=cts.TimeSeries)  # -> out, Load; inputs Pos: Point3d, Force: Vector3d, Moment: Vector3d; disabled
# ---------- pl: Python ----------
"""
Create a Point Load
-
    Args:
        Pos:
        Force:
        Moment:
        TimeSeries:
    Returns:
        PointLoad:
"""

ghenv.Component.Name = "Point Load (Alpaca4d)"
ghenv.Component.NickName = 'PL'
ghenv.Component.Message = "Point Load (Alpaca4d)"



import sys
import Rhino.Geometry as rg
import Grasshopper as gh
import copy


## add alpaca install directory to system path

ghcompfolder = gh.Folders.DefaultAssemblyFolder
if ghcompfolder not in sys.path:
    sys.path.append(ghcompfolder)

try:
    from Alpaca4d import alpaca4d as alpaca
except:
    msg = "Cannot import Alpaca4d. Is the Alpaca4d folder available in " + ghcompfolder + "?"
    ghenv.Component.AddRuntimeMessage(gh.Kernel.GH_RuntimeMessageLevel.Error, msg)


checkData = True

if not Pos:
    checkData = False
    msg = "Input parameter Pos failed to collect data"
    ghenv.Component.AddRuntimeMessage(gh.Kernel.GH_RuntimeMessageLevel.Warning, msg)

if not Force:
    Force = rg.Vector3d(0,0,0)

if not Moment:
    Moment = rg.Vector3d(0,0,0)

if not TimeSeries:
    checkData = False
    msg = "Input parameter TimeSeries failed to collect data"
    ghenv.Component.AddRuntimeMessage(gh.Kernel.GH_RuntimeMessageLevel.Warning, msg)


if checkData:
    Load = alpaca.PointLoad(Pos, Force, Moment, TimeSeries)
# ---------- end pl ----------
alpaca_element = Data(fnt.Element)  # disabled
alpaca_load = Data(pl.Load)  # disabled
panel_17 = Panel("1")  # disabled
as = AnalysesStepsAlpaca4d(numIncr=panel_17)  # -> AnalysisSteps; inputs numIncr: Int32; disabled
# ---------- as: Python ----------
"""
Define the Analysis Step
-
    Inputs:
        numIncr:
        dt:
        dtMin:
        dtMAx:
        Jd:
    Output:
        AnalysisSteps:
"""



ghenv.Component.Name = "Analyses Steps (Alpaca4d)"
ghenv.Component.NickName = 'AS'
ghenv.Component.Message = "Analyses Steps (Alpaca4d)"
ghenv.Component.IconDisplayMode = ghenv.Component.IconDisplayMode.application
ghenv.Component.Category = "Alpaca4d"
ghenv.Component.SubCategory = "7_Analysis"



import sys
import Rhino.Geometry as rg
import Grasshopper as gh
import ghpythonlib.components as ghcomp
from System.Drawing import Color

## add alpaca install directory to system path

ghcompfolder = gh.Folders.DefaultAssemblyFolder
if ghcompfolder not in sys.path:
    sys.path.append(ghcompfolder)

try:
    from Alpaca4d import alpaca4d as alpaca
except:
    msg = "Cannot import Alpaca4d. Is the Alpaca4d folder available in " + ghcompfolder + "?"
    ghenv.Component.AddRuntimeMessage(gh.Kernel.GH_RuntimeMessageLevel.Error, msg)

dt = "" if dt is None else dt
dtMin = "" if dtMin is None else dtMin
dtMax = "" if dtMax is None else dtMax
Jd = "" if Jd is None else Jd

checkData = True

if not numIncr:
    checkData = False
    msg = "Input parameter numIncr failed to collect data"
    ghenv.Component.AddRuntimeMessage(gh.Kernel.GH_RuntimeMessageLevel.Warning, msg)

if checkData:
    AnalysisSteps = alpaca.AnalysisSteps(numIncr, dt, dtMin, dtMax, Jd)
# ---------- end as ----------
panel_18 = Panel("BandGen")  # disabled
as_2 = AnalysisSettingsAlpaca4d(System=panel_18, AnalysisSteps=as)  # -> out, Settings; disabled
# ---------- as_2: Python ----------
"""
Create Analysis settings
-
    Args:
        Damping: 
        Constraint: 'Plain', 'Transformation'. Default is 'Transformation'.
        Numberer: 'RCM', 'AMD', 'Plain'. Default is 'RCM'.
        System: 'BandGen', 'BandSPD', 'ProfileSPD', 'SuperLU', 'UmfPack', 'FullGeneral', 'SparseSYM'. Default is 'BandSPD'.
        Test: Feature not implemented. Please contact alpaca4d@gmail.com 
        Algorithm: 'Linear', 'Newton', 'NewtonLineSearch', 'ModifiedNewton', 'KrylovNewton', 'SecantNewton', 'BFGS', 'Broyden'. Default is 'Linear'.
        Integrator: Default is LoadControl.
        AnalysisType: 'Static', 'Transient'. Default is 'Static'.
        AnalyesSteps:
    Returns:
        Analysis:
"""

import sys
import os


import clr
import clrtype
import Rhino.Geometry as rg
import rhinoscriptsyntax as rs
import Grasshopper as gh
import copy
import ghpythonlib.treehelpers as th


ghenv.Component.Name = "Analysis settings (Alpaca4d)"
ghenv.Component.NickName = 'AS'
ghenv.Component.Message = "Analysis settings \n(Alpaca4d)"



from Alpaca4d import alpaca4d as alpaca

checkData = True



Damping = None if Damping is None else Damping


# default Value
Constraint = 'Transformation' if Constraint is None else Constraint
ConstraintList = ['Plain', 'Transformation']

for item in ConstraintList:
    if Constraint.lower() == item.lower():
        Constraint = item


# default Value
Numberer = 'RCM' if Numberer is None else Numberer
NumbererList = ['RCM', 'AMD', 'Plain', 'ParallelPlain', 'ParallelRCM']

for i,item in enumerate(NumbererList):
    if Numberer.lower() == item.lower():
        Numberer = item



# default Value
System = 'BandSPD' if System is None else System
SystemList = ['BandGen', 'BandSPD', 'ProfileSPD', 'SuperLU', 'UmfPack', 'FullGeneral', 'SparseSYM']

for i,item in enumerate(SystemList):
    if System.lower() == item.lower():
        System = item


# default Test
Test = 'NormDispIncr 1.0e-6 12 5' if Test is None else Test




# default Value
Algorithm = 'Linear' if Algorithm is None else Algorithm
AlgorithmList = ['Linear', 'Newton', 'NewtonLineSearch', 'ModifiedNewton', 'KrylovNewton', 'SecantNewton', 'BFGS', 'Broyden']

for i,item in enumerate(AlgorithmList):
    if Algorithm.lower() == item.lower():
        Algorithm = item


# default Value
AnalysisType = 'Static' if AnalysisType is None else AnalysisType
AnalysisTypeList = ['Static', 'Transient']

for item in AnalysisTypeList:
    if AnalysisType.lower() == item.lower():
        AnalysisType = item



## Define Integrator
if AnalysisType == "Static":
    Integrator = "LoadControl 1.0" if Integrator is None else Integrator
elif AnalysisType == "Transient":
    Integrator = "Newmark 0.5 0.25" if Integrator is None else Integrator


if AnalysisType == 'Transient':
    if not Damping:
        checkData = False
        msg = "Input parameter Damping failed to collect data"
        ghenv.Component.AddRuntimeMessage(gh.Kernel.GH_RuntimeMessageLevel.Warning, msg)


if not AnalysisSteps:
    checkData = False
    msg = "Input parameter AnalysisSteps failed to collect data"
    ghenv.Component.AddRuntimeMessage(gh.Kernel.GH_RuntimeMessageLevel.Warning, msg)




if checkData:
    Settings = alpaca.Analysis(Constraint, Numberer, System, Test, Algorithm, Integrator, AnalysisType, AnalysisSteps, Damping)
    print(Settings.write_tcl())
# ---------- end as_2 ----------
number_slider_3 = Slider(2, range=0..2)  # disabled
number_slider_4 = Slider(0.1, range=0..1)  # disabled
number_slider_5 = Slider(0.36, range=0..1)  # disabled
panel_19 = Panel("106000 in 8 minutes")  # disabled
toggle_3 = BooleanToggle(True)  # disabled
toggle_4 = BooleanToggle(True)  # disabled
clr = ColorsAlpaca4d(gradIndex=11)  # -> reverse(colors); inputs gradIndex: Int32; disabled
#   port colors: A series of colors to be plugged into the "Ladybug_Legend Parameters" component.
# ---------- clr: Python ----------
"""
Preset of gradient colors perfect for Data Visualisation
    Inputs:
        gradIndex: An index refering to one of the following possible gradients:
            0 - Orignal Ladybug
            1 - Nuanced Ladybug
            2 - Multi-colored Ladybug
            3 - Ecotect
            4 - Thermal Comfort Percentage
            5 - Thermal Comfort Colors
            6 - Shade Benefit/Harm
            7 - Shade Harm
            8 - Shade Benefit
            9 - CFD Colors 1
            10 - Radiation Benefit
            11 - Gsa10 Colour
            12 - Gsa9 Colour
    Returns:
        customColors: A series of colors.
"""

ghenv.Component.Name = "Colors (Alpaca4d)"
ghenv.Component.NickName = 'CLR'
ghenv.Component.Message = 'Colors (Alpaca4d)'

import scriptcontext as sc
import Grasshopper.Kernel as gh
import System

gradientLibrary = {
        0: [System.Drawing.Color.FromArgb(75, 107, 169), System.Drawing.Color.FromArgb(115, 147, 202), System.Drawing.Color.FromArgb(170, 200, 247), System.Drawing.Color.FromArgb(193, 213, 208), System.Drawing.Color.FromArgb(245, 239, 103), System.Drawing.Color.FromArgb(252, 230, 74), System.Drawing.Color.FromArgb(239, 156, 21), System.Drawing.Color.FromArgb(234, 123, 0), System.Drawing.Color.FromArgb(234, 74, 0), System.Drawing.Color.FromArgb(234, 38, 0)],
        1: [System.Drawing.Color.FromArgb(49,54,149), System.Drawing.Color.FromArgb(69,117,180), System.Drawing.Color.FromArgb(116,173,209), System.Drawing.Color.FromArgb(171,217,233), System.Drawing.Color.FromArgb(224,243,248), System.Drawing.Color.FromArgb(255,255,191), System.Drawing.Color.FromArgb(254,224,144), System.Drawing.Color.FromArgb(253,174,97), System.Drawing.Color.FromArgb(244,109,67), System.Drawing.Color.FromArgb(215,48,39), System.Drawing.Color.FromArgb(165,0,38)],
        2: [System.Drawing.Color.FromArgb(4,25,145), System.Drawing.Color.FromArgb(7,48,224), System.Drawing.Color.FromArgb(7,88,255), System.Drawing.Color.FromArgb(1,232,255), System.Drawing.Color.FromArgb(97,246,156), System.Drawing.Color.FromArgb(166,249,86), System.Drawing.Color.FromArgb(254,244,1), System.Drawing.Color.FromArgb(255,121,0), System.Drawing.Color.FromArgb(239,39,0), System.Drawing.Color.FromArgb(138,17,0)],
        3: [System.Drawing.Color.FromArgb(0,0,255), System.Drawing.Color.FromArgb(53,0,202), System.Drawing.Color.FromArgb(107,0,148), System.Drawing.Color.FromArgb(160,0,95), System.Drawing.Color.FromArgb(214,0,41), System.Drawing.Color.FromArgb(255,12,0), System.Drawing.Color.FromArgb(255,66,0), System.Drawing.Color.FromArgb(255,119,0), System.Drawing.Color.FromArgb(255,173,0), System.Drawing.Color.FromArgb(255,226,0), System.Drawing.Color.FromArgb(255,255,0)],
        4: [System.Drawing.Color.FromArgb(0,0,0), System.Drawing.Color.FromArgb(110,0,153), System.Drawing.Color.FromArgb(255,0,0), System.Drawing.Color.FromArgb(255,255,102), System.Drawing.Color.FromArgb(255,255,255)],
        5: [System.Drawing.Color.FromArgb(0,136,255), System.Drawing.Color.FromArgb(200,225,255), System.Drawing.Color.FromArgb(255,255,255), System.Drawing.Color.FromArgb(255,230,230), System.Drawing.Color.FromArgb(255,0,0)],
        6: [System.Drawing.Color.FromArgb(5,48,97), System.Drawing.Color.FromArgb(33,102,172), System.Drawing.Color.FromArgb(67,147,195), System.Drawing.Color.FromArgb(146,197,222), System.Drawing.Color.FromArgb(209,229,240), System.Drawing.Color.FromArgb(255,255,255), System.Drawing.Color.FromArgb(253,219,199), System.Drawing.Color.FromArgb(244,165,130), System.Drawing.Color.FromArgb(214,96,77), System.Drawing.Color.FromArgb(178,24,43), System.Drawing.Color.FromArgb(103,0,31)],
        7: [System.Drawing.Color.FromArgb(255,255,255), System.Drawing.Color.FromArgb(253,219,199), System.Drawing.Color.FromArgb(244,165,130), System.Drawing.Color.FromArgb(214,96,77), System.Drawing.Color.FromArgb(178,24,43), System.Drawing.Color.FromArgb(103,0,31)],
        8: [System.Drawing.Color.FromArgb(255,255,255), System.Drawing.Color.FromArgb(209,229,240), System.Drawing.Color.FromArgb(146,197,222), System.Drawing.Color.FromArgb(67,147,195), System.Drawing.Color.FromArgb(33,102,172), System.Drawing.Color.FromArgb(5,48,97)],
        9: [System.Drawing.Color.FromArgb(0,16,120), System.Drawing.Color.FromArgb(38,70,160), System.Drawing.Color.FromArgb(5,180,222), System.Drawing.Color.FromArgb(16,180,109), System.Drawing.Color.FromArgb(59,183,35), System.Drawing.Color.FromArgb(143,209,19), System.Drawing.Color.FromArgb(228,215,29), System.Drawing.Color.FromArgb(246,147,17), System.Drawing.Color.FromArgb(243,74,0), System.Drawing.Color.FromArgb(255,0,0)],
        10: [System.Drawing.Color.FromArgb(0,191,48), System.Drawing.Color.FromArgb(255,238,184), System.Drawing.Color.FromArgb(255,0,0)],
        11: [System.Drawing.Color.FromArgb(204,0,71), System.Drawing.Color.FromArgb(255,182,71), System.Drawing.Color.FromArgb(206,255,115), System.Drawing.Color.FromArgb(26,180, 214),System.Drawing.Color.FromArgb(0,0,207)],
        12: [System.Drawing.Color.FromArgb(255, 51, 51), System.Drawing.Color.FromArgb(255, 170, 51), System.Drawing.Color.FromArgb(255, 255, 51), System.Drawing.Color.FromArgb(170, 255, 125), System.Drawing.Color.FromArgb(51, 255, 231), System.Drawing.Color.FromArgb(51, 170, 255), System.Drawing.Color.FromArgb(51,51, 255)]}
colors = gradientLibrary[gradIndex]
# ---------- end clr ----------
panel_20 = Panel("100000000")  # disabled
panel_21 = Panel("-2.5")  # disabled
X = UnitX(Factor=panel_21)  # disabled
move_3 = Move(Motion=X)  # -> Geometry, Transform; disabled
medges = MeshEdges(Mesh=move_3.Geometry)  # -> NakedEdges, InteriorEdges, NonManifoldEdges; disabled
swatch = ColourSwatch(SwatchColor=RGB(0, 0, 0))  # disabled
previewlw = CustomPreviewLineweights(Geometry=[medges.InteriorEdges, medges.NonManifoldEdges], Shader=swatch, Absolute=False)  # disabled
panel_22 = Panel("0.02")  # disabled
panel_23 = Panel("0.01")  # disabled
facen = FaceNormals(Mesh=mesh_3)  # -> Centers, Normals; disabled
sfit = SphereFit(Points=facen.Centers)  # -> Center, Radius, Sphere; disabled
panel_24 = Panel("4")  # disabled
msphereex = MeshSphereEx(Base=sfit.Center, Radius=sfit.Radius, Count=panel_24)  # -> flatten(Mesh); disabled
number_slider_6 = Slider(0, range=0..12)  # disabled
lng_2 = ListLength(List=flatten(msphereex))  # disabled
range = Range(Domain=Domain(0, 1), Steps=expr("x-1", lng_2))  # disabled
clr_2 = ColorsAlpaca4d(gradIndex=number_slider_6)  # -> colors; inputs gradIndex: Int32; disabled; same code as clr
twnthrucols = TweenThroughColors(
    Colors=clr_2,
    Factor=range,
    Normalized=True,
    Equalized=False,
    Weighted=False,
    Loopback=False,
    Degree=3,
    InterpolationType=0,
    Alpha=True)  # disabled
graft = GraftTree(Tree=msphereex, IncludeEmptyLists=True, IncludeNullItems=True)  # disabled
graft_2 = GraftTree(Tree=twnthrucols, IncludeEmptyLists=True, IncludeNullItems=True)  # disabled
mcol = MeshColours(Mesh=graft, Colours=graft_2)  # -> flatten(Mesh); disabled
mjoin = MeshJoin(Meshes=mcol)  # disabled
panel_25 = Panel("2.5")  # disabled
X_2 = UnitX(Factor=panel_25)  # disabled
move_4 = Move(Geometry=mjoin, Motion=X_2)  # -> Geometry, Transform; disabled

brepsinc = PointInBreps(Brep=brep_2, Point=rdpoints.OutPoint, Strict=False)  # -> Inside, Index; disabled

cull_3 = CullPattern(List=rdpoints.OutPoint, CullPattern=brepsinc.Inside)  # disabled
pt = Point(cull_3)  # disabled
support = SupportAlpaca4d(Pos=pt, Tx=toggle, Ty=toggle, Tz=toggle, Rx=toggle_2, Ry=toggle_2, Rz=toggle_2)  # -> Support; inputs Pos: Point3d, Tx: Boolean, Ty: Boolean, Tz: Boolean, Rx: Boolean, Ry: Boolean, Rz: Boolean; disabled
# ---------- support: Python ----------
"""
Create a support
-
    Args:
        Pos:
        Tx:
        Ty:
        Tz:
        Rx:
        Ry:
    Returns:
        Support:
"""

ghenv.Component.Name = "Support (Alpaca4d)"
ghenv.Component.NickName = 'Support'
ghenv.Component.Message = "Support (Alpaca4d)"


import sys
import Rhino.Geometry as rg
import Grasshopper as gh


## add alpaca install directory to system path

ghcompfolder = gh.Folders.DefaultAssemblyFolder
if ghcompfolder not in sys.path:
    sys.path.append(ghcompfolder)

try:
    from Alpaca4d import alpaca4d as alpaca
except:
    msg = "Cannot import Alpaca4d. Is the Alpaca4d folder available in " + ghcompfolder + "?"
    ghenv.Component.AddRuntimeMessage(gh.Kernel.GH_RuntimeMessageLevel.Error, msg)

checkData = True


if not Pos:
    checkData = False
    msg = "Input parameter Pos failed to collect data"
    ghenv.Component.AddRuntimeMessage(gh.Kernel.GH_RuntimeMessageLevel.Warning, msg)

if checkData:
    Support = alpaca.Support(Pos, Tx, Ty, Tz, Rx, Ry, Rz)
# ---------- end support ----------
alpaca_support = Data(support)  # disabled
am = AssembleModelAlpaca4d(Element=alpaca_element, Support=alpaca_support, Load=alpaca_load)  # -> out, AlpacaModel; inputs Element: list, Support: list, Load: list, Constraint: list; disabled
# ---------- am: Python ----------
"""
Create a FEA Model
-
    Args:
        Element:
        Support:
        Load:
        Constraint:
    Returns:
        AlpacaModel:
"""


import os
import sys
import ghpythonlib.treehelpers as th
import Rhino.Geometry as rg
import Rhino.Collections as rc
import rhinoscriptsyntax as rs
from collections import defaultdict, OrderedDict, deque
import copy
import time
import Grasshopper as gh



ghenv.Component.Name = "Assemble Model (Alpaca4d)"
ghenv.Component.NickName = 'AM'
ghenv.Component.Message = "Assemble Model (Alpaca4d)"


## add alpaca install directory to system path

ghcompfolder = gh.Folders.DefaultAssemblyFolder
if ghcompfolder not in sys.path:
    sys.path.append(ghcompfolder)

try:
    from Alpaca4d import alpaca4d as alpaca
    from Alpaca4d import alpaca4dUtil as alpacaUtil
except:
    msg = "Cannot import Alpaca4d. Is the Alpaca4d folder available in " + ghcompfolder + "?"
    ghenv.Component.AddRuntimeMessage(gh.Kernel.GH_RuntimeMessageLevel.Error, msg)


checkData = True

if not Element:
    checkData = False
    msg = "Input parameter Element failed to collect data"
    ghenv.Component.AddRuntimeMessage(gh.Kernel.GH_RuntimeMessageLevel.Warning, msg)

if not Support:
    checkData = False
    msg = "Input parameter Support failed to collect data"
    ghenv.Component.AddRuntimeMessage(gh.Kernel.GH_RuntimeMessageLevel.Warning, msg)


if checkData:
    
    FolderPath = rs.DocumentPath()
    os.chdir(FolderPath)
    
    # create the object model
    AlpacaModel = alpaca.Model()
    
    
    start = time.clock()
    #subdivide element per type
    
    for element in Element:
        if element.type == "Beam":
            AlpacaModel.beams.append(element)
        elif element.type == "Shell":
            AlpacaModel.shells.append(element)
        elif element.type == "Brick":
            AlpacaModel.bricks.append(element)
    
    
    end = time.clock() - start
    print("time to subdivide element {}".format(end))
    start = time.clock()
    
    # create a list of unique point
    # need to add the rigid constraint
    
    AlpacaModel.getuniquePoints(AlpacaModel.beams, AlpacaModel.shells, AlpacaModel.bricks, Constraint)
    
    
    end = time.clock() - start
    print("time to get uniquepoints {}".format(end))
    start = time.clock()
    
    
    #############
    # create node and assign to object
    #############
    
    if AlpacaModel.uniquePointsThreeNDF:
        AlpacaModel.py.append(alpaca.Model.write3ndf_tcl())
        for point in AlpacaModel.uniquePointsThreeNDF:
            node = alpaca.Node(point)
            node.ndf = 3
            node.setNodeTag(AlpacaModel)
            AlpacaModel.nodes.append( node )
        
            AlpacaModel.py.append(node.write_tcl())
    
    
    if AlpacaModel.uniquePointsSixNDF:
        AlpacaModel.py.append(alpaca.Model.write6ndf_tcl())
        for point in AlpacaModel.uniquePointsSixNDF:
            node = alpaca.Node(point)
            node.ndf = 6
            node.setNodeTag(AlpacaModel)
            AlpacaModel.nodes.append( node )
         
            AlpacaModel.py.append(node.write_tcl())
    
    
    
    end = time.clock() - start
    print("time to create node and assign tag {}".format(end))
    start = time.clock()
    
    
    #################
    # create supports
    #################
    
    for supportNode in Support:
        
        # if the list is empty, skip this operation
        if AlpacaModel.uniquePointsThreeNDF:
            closestPointInThreeNDF = rc.Point3dList.ClosestPointInList(AlpacaModel.uniquePointsThreeNDF, supportNode.Pos)
            if supportNode.Pos.DistanceTo(closestPointInThreeNDF) < 0.001:
                #print("I am in 3ndf")
                supportNode.ndf = 3
                AlpacaModel.threeNDFModel.append(supportNode)
                supportNode.setNodeTag(AlpacaModel)
        
        if AlpacaModel.uniquePointsSixNDF:
            closestPointInSixNDF = rc.Point3dList.ClosestPointInList(AlpacaModel.uniquePointsSixNDF, supportNode.Pos)
            if supportNode.Pos.DistanceTo(closestPointInSixNDF) < 0.001:
                supportNode.ndf = 6
                AlpacaModel.sixNDFModel.append(supportNode)
                supportNode.setNodeTag(AlpacaModel)
        
        
        AlpacaModel.supports.append(supportNode)
        AlpacaModel.py.append(supportNode.write_tcl())
    
    
    end = time.clock() - start
    print("time to create support and assign tag {}".format(end))
    start = time.clock()
    
    
    ####################
    # create constraints
    ####################
    
    
    for constraint in Constraint:
        constraint.setNodeTag(AlpacaModel)
        AlpacaModel.constraints.append(constraint)
    
    ####################
    # create equalDOF when the model has 3df and 6df together
    ####################
    
    
    end = time.clock() - start
    print("time to create constraint and assign tag {}".format(end))
    start = time.clock()
    
    
    Id = []
    IdB = []
    
    def SearchCallback(sender, e):
        Id.Add(e.Id)
        IdB.Add(e.IdB)
    
    
    
    lenThreeNDF = len(AlpacaModel.uniquePointsThreeNDF)
    lenSixNDF = len(AlpacaModel.uniquePointsSixNDF)
    
    
    if not(lenThreeNDF == 0 or lenSixNDF == 0):
        print("brick and beam together")
        rg.RTree.SearchOverlaps(AlpacaModel.RTreeCloudPointThreeNDF, AlpacaModel.RTreeCloudPointSixNDF, 0.001, SearchCallback)
        
        for i,j in zip(Id, IdB):
            print(i,j)
            node_i = AlpacaModel.uniquePointsThreeNDF[i]
            node_j = AlpacaModel.uniquePointsSixNDF[j]
            
            #index_i = AlpacaModel.cloudPoint.ClosestPoint(node_i) + 1
            #index_j = AlpacaModel.cloudPoint.ClosestPoint(node_j) + 1
            
            equalConstraint = alpaca.EqualDOF(node_i, node_j, True, True, True, False, False, False)
            equalConstraint.masterNodeTag = AlpacaModel.cloudPointThreeNDF.ClosestPoint(node_i) + 1
            equalConstraint.slaveNodesTag = AlpacaModel.cloudPointSixNDF.ClosestPoint(node_j) + 1 + len(AlpacaModel.uniquePointsThreeNDF)
            AlpacaModel.py.append(equalConstraint.write_tcl())
    
    
    
    end = time.clock() - start
    print("time to find common points between 3ndf and 6ndf {}".format(end))
    start = time.clock()
    
    ##########################
    ##########################
    ##########################
    
    crossSection = []
    material = []
    
    for item in Element:
        if item.type != "Brick":
            crossSection.append(item.CrossSection)
            material.append(item.CrossSection.material)
        else:
            material.append(item.material)
        
    
    uniqueCS = list(set(crossSection))
    
    
    flatten_material = alpacaUtil.flatten_list(material)
    
    
    uniqueMaterial = list(set(flatten_material))
    
    for index, material in enumerate(uniqueMaterial,1):
        material.matTag = index
        AlpacaModel.py.append(material.write_tcl())
    
    
    for index, section in enumerate(uniqueCS,1):
        section.sectionTag = index
        AlpacaModel.py.append(section.write_tcl())
        
    
    
    
    
    
    # write py file
    
    
    # assign tag and node Index to element and shell
    for index, element in enumerate(Element,1):
        element.setTopologyRTree(AlpacaModel)
        element.eleTag = index
        element.setTags()
    
    
    
    end = time.clock() - start
    print("time to assign tags for the elements {}".format(end))
    start = time.clock()
    
    
    
    
    
    
    Mass = 0
    IsGravity = False
    g_factor = 10.00
    
    for item in Load:
        if item.type == "Gravity Load":
            IsGravity = True
            GravityLoad = item
        if item.type == "PointLoad":
            AlpacaModel.loads.append(item)
        if item.type == "Mass":
            AlpacaModel.masses.append(item)
    
    
    for item in Element:
        if item.type == "Beam":
            length = item.Crv.GetLength()
            Mass += (item.massDens * length)
            if IsGravity:
                gravityPointLoad_1 = alpaca.PointLoad(item.Crv.PointAtStart, g_factor * rg.Vector3d(0,0, -(item.massDens * length / 2)) * GravityLoad.GravityFactor, rg.Vector3d(0,0,0), GravityLoad.TimeSeries)
                gravityPointLoad_2 = alpaca.PointLoad(item.Crv.PointAtEnd, g_factor * rg.Vector3d(0,0, -(item.massDens * length / 2)) * GravityLoad.GravityFactor, rg.Vector3d(0,0,0), GravityLoad.TimeSeries)
                ##print( -(item.massDens * length / 2))
                AlpacaModel.loads.append(gravityPointLoad_1)
                AlpacaModel.loads.append(gravityPointLoad_2)
        if item.type == "Shell":
            meshArea = rg.AreaMassProperties.Compute(item.Mesh).Area
            if item.CrossSection.__class__.__name__ != "LayeredShell":
                areaDensity = item.CrossSection.thickness * item.CrossSection.material.rho
                Mass += areaDensity * meshArea
                if IsGravity:
                    for vertex in item.Mesh.Vertices.ToPoint3dArray():
                        gravityPointLoad = alpaca.PointLoad(vertex, g_factor * rg.Vector3d(0,0, -(areaDensity * meshArea/ len(item.Mesh.Vertices))) * GravityLoad.GravityFactor, rg.Vector3d(0,0,0), GravityLoad.TimeSeries)
                        AlpacaModel.loads.append(gravityPointLoad)
            else:
                for thickness, material in zip(item.CrossSection.thickness, item.CrossSection.material):
                    areaDensity = thickness * material.rho
                    Mass += areaDensity * meshArea
                    if IsGravity:
                        for vertex in item.Mesh.Vertices.ToPoint3dArray():
                            gravityPointLoad = alpaca.PointLoad(vertex, g_factor * rg.Vector3d(0,0, -(areaDensity * meshArea/ len(item.Mesh.Vertices))) * GravityLoad.GravityFactor, rg.Vector3d(0,0,0), GravityLoad.TimeSeries)
                            AlpacaModel.loads.append(gravityPointLoad)


        if item.type == "Brick":
            #print(type(item.Mesh))
            meshVolume = rg.VolumeMassProperties.Compute(item.Mesh).Volume
            density = item.material.rho 
            Mass += density * meshVolume
            if IsGravity:
                for vertex in item.Mesh.Vertices.ToPoint3dArray():
                    gravityPointLoad = alpaca.PointLoad(vertex, g_factor * rg.Vector3d(0,0, -(density * meshVolume / len(item.Mesh.Vertices))) * GravityLoad.GravityFactor, rg.Vector3d(0,0,0), GravityLoad.TimeSeries)
                    #print(len(item.Mesh.Vertices))
                    #print(density)
                    # volume can be zero if mesh faces are not properly rotated
                    #print(meshVolume)
                    #print(-(density * meshVolume / len(item.Mesh.Vertices)))
                    AlpacaModel.loads.append(gravityPointLoad)
    
    #print(AlpacaModel.loads)
    ## load
    
    
    for item in AlpacaModel.loads:
        item.setNodeTag(AlpacaModel)
    
    #print(AlpacaModel.loads)
    
    for item in AlpacaModel.beams:
        AlpacaModel.py.append(item.write_tcl())
    
    for item in AlpacaModel.shells:
        AlpacaModel.py.append(item.write_tcl())
    
    for item in AlpacaModel.bricks:
        AlpacaModel.py.append(item.write_tcl())
    
    
    for item in Constraint:
        AlpacaModel.py.append(item.write_tcl())
    
    
    for item in AlpacaModel.masses:
        item.setNodeTag(AlpacaModel)
        AlpacaModel.py.append(item.write_tcl())
    
    
    timeSeriesDict = alpaca.TimeSeries.getTimeSeries(AlpacaModel.loads)[1]
    AlpacaModel.py.append(alpaca.PointLoad.write_tcl(timeSeriesDict,AlpacaModel))
    
    
    text = AlpacaModel.py
# ---------- end am ----------
alpaca_model = Data(am.AlpacaModel)  # disabled
ra = RunAnalysisAlpaca4d(AlpacaModel=am.AlpacaModel, Settings=as_2.Settings)  # -> log, AlpacaSolvedModel; disabled
# ---------- ra: Python ----------
"""
Run an OpenSees Analysis
-
    Args:
        AlpacaModel:
        Settings:
    Returns:
        AlpacaSolvedModel:
"""



import Rhino.RhinoDoc
import Grasshopper as gh
import copy
import rhinoscriptsyntax as rs
import os
import time
import sys



ghenv.Component.Name = "Run Analysis (Alpaca4d)"
ghenv.Component.NickName = 'RA'
ghenv.Component.Message = "Run Analysis (Alpaca4d)"

ghcompfolder = gh.Folders.DefaultAssemblyFolder
if ghcompfolder not in sys.path:
    sys.path.append(ghcompfolder)

try:
    from Alpaca4d import alpaca4d as alpaca
except:
    msg = "Cannot import Alpaca4d. Is the Alpaca4d folder available in " + ghcompfolder + "?"
    ghenv.Component.AddRuntimeMessage(gh.Kernel.GH_RuntimeMessageLevel.Error, msg)


checkData = True



if not AlpacaModel:
    checkData = False
    msg = "Input parameter AlpacaModel failed to collect data"
    ghenv.Component.AddRuntimeMessage(gh.Kernel.GH_RuntimeMessageLevel.Warning, msg)


if not Settings:
    checkData = False
    msg = "Input parameter Settings failed to collect data"
    ghenv.Component.AddRuntimeMessage(gh.Kernel.GH_RuntimeMessageLevel.Warning, msg)


if checkData:
    FolderPath = rs.DocumentPath()
    os.chdir(FolderPath)
    
    outputFileName = 'openSeesModel'
    recorderFileName = 'recorder.mpco'
    
    for dirpath, dirnames, filenames in os.walk(FolderPath):
        for filename in filenames:
            if filename == outputFileName:
                file = os.path.join(dirpath,outputFileName)
                os.remove(file)
            elif filename == recorderFileName:
                file = os.path.join(dirpath,recorderFileName)
                os.remove(file)
    
    
    # create a copy
    
    AnalysisModel = copy.copy(AlpacaModel)
    AnalysisModel.py = list(AnalysisModel.py)
    
    # generate Recorder and assign name
    AnalysisModel.recorderName = "recorder" + ".mpco"
    
    if Settings.AnalysisType == "Static":
        recorder = alpaca.TCLRecorder.mpco(AnalysisModel.recorderName, True,True,False,False,True,True,False,False,True,True,True,True)
    elif Settings.AnalysisType == "Transient":
        recorder = alpaca.TCLRecorder.mpco(AnalysisModel.recorderName, True,True,True,True,True,True,False,False,True,True,True,True)
    
    AnalysisModel.py.append(recorder)
    
    
    AnalysisModel.analysis = Settings
    AnalysisModel.py.append(Settings.write_tcl())
    AnalysisModel.py.append("wipe")
    
    
    #textFile = AnalysisModel.py
    
    time_start = time.clock()
    
    AnalysisModel.writeFile(outputFileName)
    
    time_elapsed = (time.clock() - time_start)
    print("Writing Time {}".format(time_elapsed))
    
    
    
    time_start = time.clock()
    
    executable = os.path.join(ghcompfolder,'Alpaca4d\OpenSees-Solvers\opensees.bat')
    a, log = AnalysisModel.runOpensees(executable)
    
    
    time_elapsed = (time.clock() - time_start)
    print("Analyses Time {}".format(time_elapsed))
    
    AlpacaSolvedModel = copy.copy(AnalysisModel)
    AlpacaSolvedModel.isAnalysed = True
# ---------- end ra ----------
vm = ViewModelAlpaca4d(
    AlpacaModel=alpaca_model,
    type=number_slider_3,
    support=toggle_3,
    scale_Support=number_slider_4,
    load=toggle_4,
    scale_load=number_slider_5)  # inputs type: Int32, nodeTag: Boolean, eleTag: Boolean, localAxis: Boolean, support: Boolean, load: Boolean; disabled
# ---------- vm: Python ----------
"""View structural Model
    Inputs:
        AlpacaModel: Output of Assemble Model.
        type: Style of visualize Model 
Default: Visualize the stick Model
True: Visualize the extrude Model
        nodeTag: 
True: Visualize tag nodes
        eleTag: 
True: Visualize tag elements 
        LocalAxes:
True: Visualize local Axis of elements 
        Support: 
True: Visualize support type
        Load: 
True: Visualize load
"""


from ghpythonlib.componentbase import executingcomponent as component
import Grasshopper, GhPython
import System
import ghpythonlib.components as ghcomp

import Rhino as rc
import rhinoscriptsyntax as rs
import sys
import Rhino.Geometry as rg
import Grasshopper as gh
import copy

ghenv.Component.Name = "View Model (Alpaca4d)"
ghenv.Component.NickName = 'VM'
ghenv.Component.Message = "View Model (Alpaca4d)"

ghcompfolder = gh.Folders.DefaultAssemblyFolder
if ghcompfolder not in sys.path:
    sys.path.append(ghcompfolder)
try:
    from Alpaca4d import alpaca4dView as alpacaView
except:
    msg = "Cannot import Alpaca4d. Is the Alpaca4d folder available in " + ghcompfolder + "?"
    ghenv.Component.AddRuntimeMessage(gh.Kernel.GH_RuntimeMessageLevel.Error, msg)

checkData = True

class MyComponent(component):
    
    def RunScript(self, AlpacaModel, type, nodeTag, eleTag, scale_Tag, __________, localAxis, scale_Axis, ____________ , support, scale_Support,___________, load, scale_load):
        
        
        self.ModelBeam = []
        self.ModelShell = []
        self.ModelBrick = []
        self.Nodes = []
        self.TagEle = []
        self.localAxis = []
        self.solidSupport = []
        self.viewLoad = []
        
        if not AlpacaModel:
            checkData = False
            msg = "Input parameter AlpacaModel failed to collect data"
            ghenv.Component.AddRuntimeMessage(gh.Kernel.GH_RuntimeMessageLevel.Warning, msg)
        else:
            
            
            self.type = 0 if type is None else type
            
            if self.type == 1 or self.type == 0:
                self.ModelBeam = alpacaView.ViewBeam( AlpacaModel, type)
                self.ModelShell = alpacaView.ViewShell( AlpacaModel, type )
                self.ModelBrick = alpacaView.ViewBrick( AlpacaModel)

            #NODE TAG VIEW
            
            self.scale_Tag = 50 if scale_Tag is None else scale_Tag
            
            if nodeTag is True:
                self.Nodes = [ [inode.nodeTag, inode.Pos] for inode in AlpacaModel.nodes]
            else:
                self.Nodes = []
            #ELE TAG VIEW
            if eleTag is True:
                TagBeam = [ [item.eleTag, item.getPerpFrame().Origin] for item in AlpacaModel.beams]
                TagShell = [ [item.eleTag, rg.AreaMassProperties.Compute( item.Mesh, False, True, False, False ).Centroid] for item in AlpacaModel.shells]
                TagBrick = [ [item.eleTag, rg.AreaMassProperties.Compute( item.Mesh, False, True, False, False ).Centroid] for item in AlpacaModel.bricks]
                self.TagEle = TagBeam + TagShell + TagBrick
            else:
                self.TagEle = []
            #LOCAL AXIS
            self.scale_Axis = 0.25 if scale_Axis is None else scale_Axis
            
            if localAxis is True:
                self.localAxis = [ [item.getPerpFrame().Origin, item.getPerpFrame().XAxis, item.getPerpFrame().YAxis, item.getPerpFrame().ZAxis]   for item in AlpacaModel.beams]
    
                for item in AlpacaModel.shells:
                    item.Mesh.Normals.ComputeNormals()
                    i = item.Mesh.Vertices[0]
                    j = item.Mesh.Vertices[1]
                    curve = rg.LineCurve( i, j )
                    midPoint = rg.AreaMassProperties.Compute( item.Mesh, False, True, False, False ).Centroid
                    vector3 = item.Mesh.Normals.Item[0]
                    vector1 = rg.Curve.PerpendicularFrameAt( curve, 0 )[1].ZAxis
                    vector2 = rg.Vector3d.CrossProduct( vector3, vector1)
                    self.localAxis.append( [midPoint, ghcomp.UnitVector(vector1), ghcomp.UnitVector(vector2), ghcomp.UnitVector(vector3)] )
                
                for item in AlpacaModel.bricks:
                    FaceNormals = ghcomp.FaceNormals(item.Mesh)
                    midPoint = FaceNormals[0]
                    normals = FaceNormals[1]
                    face = item.Mesh.Faces
                    curve = []
                    for iFace in face:
                        i = item.Mesh.Vertices[iFace[0]]
                        j = item.Mesh.Vertices[iFace[1]]
                        curve.append( rg.LineCurve( i, j ) )
                    for iM, iN, iC in zip(midPoint, normals, curve):
                        vector3 = iN
                        vector1 = rg.Curve.PerpendicularFrameAt( iC, 0 )[1].ZAxis
                        vector2 = rg.Vector3d.CrossProduct( vector3, vector1)
                        self.localAxis.append( [iM, ghcomp.UnitVector(vector1), ghcomp.UnitVector(vector2), ghcomp.UnitVector(vector3)] )
                
            else:
                self.localAxis = []
            #SUPPORT
            if support is True:
                scale_Support = 0.5 if scale_Support is None else scale_Support
                self.solidSupport = [ alpacaView.Support( iSupport, scale_Support ) for iSupport in AlpacaModel.supports ]
            else:
                self.solidSupport = []
            # LOAD
            if load is True:
                scale_load = 1.0 if scale_load is None else scale_load
                self.viewLoad =[[item.Pos, item.Force, item.Moment] for item in AlpacaModel.loads]
            else:
                self.viewLoad = []
            self.forceBounds = ghcomp.Bounds([ item[1] for item in self.viewLoad])
            self.momentBounds = ghcomp.Bounds([ item[2] for item in self.viewLoad])
            self.scale_load = scale_load

    def DrawViewportWires(self,arg):
        # Beam
        for iBeam in self.ModelBeam:
            color = iBeam[1]
            colorMaterial = rc.Display.DisplayMaterial(color, 0.3)
            if self.type == 1:
                colorWirframe = System.Drawing.Color.Gray
                #System.Drawing.Color.LightGray
                arg.Display.DrawBrepShaded(iBeam[0], colorMaterial)
                arg.Display.DrawBrepWires(iBeam[0], colorWirframe)
            elif self.type == 0 :
                thickness = 2
                arg.Display.DrawCurve(iBeam[0], color, thickness)
        # Mesh
        for iShell in self.ModelShell:
            color = iShell[1]
            #color = System.Drawing.Color.Blue
            colorMaterial = rc.Display.DisplayMaterial(color,color,color,color,1,0.30)
            colorMaterial.IsTwoSided = False
            arg.Display.DrawMeshShaded(iShell[0], colorMaterial)
            colorWirframe = System.Drawing.Color.Black
            arg.Display.DrawMeshWires(iShell[0], colorWirframe)
        #Brick 
        for iBrick in self.ModelBrick:
            color = iBrick[1]
            #color = System.Drawing.Color.Blue
            colorMaterial = rc.Display.DisplayMaterial(color,color,color,color,1,0.30)
            colorMaterial.IsTwoSided = False
            arg.Display.DrawMeshShaded(iBrick[0], colorMaterial)
            colorWirframe = System.Drawing.Color.Black
            arg.Display.DrawMeshWires(iBrick[0], colorWirframe)
            
        # node Tag view
        for inode in self.Nodes:
            arg.Display.Draw2dText( str(inode[0]), System.Drawing.Color.DarkSlateBlue, inode[1], True, self.scale_Tag)
        # ele Tag view
        for iEle in self.TagEle:
            arg.Display.Draw2dText( str(iEle[0]), System.Drawing.Color.BlanchedAlmond, iEle[1], True, self.scale_Tag)
        # local Axis
        for iLocalAxis in self.localAxis:
            c = self.scale_Axis
            arg.Display.DrawArrow( rg.Line(iLocalAxis[0], rg.Vector3d.Multiply(c,iLocalAxis[1])), System.Drawing.Color.Red)
            arg.Display.DrawArrow( rg.Line(iLocalAxis[0], rg.Vector3d.Multiply(c,iLocalAxis[2])), System.Drawing.Color.Green)
            arg.Display.DrawArrow( rg.Line(iLocalAxis[0], rg.Vector3d.Multiply(c,iLocalAxis[3])), System.Drawing.Color.Blue)
            
            
        color = System.Drawing.Color.Azure
        colorWirframe = System.Drawing.Color.Black
        colorMaterial = rc.Display.DisplayMaterial(color, 0.0)
        for iSupport in self.solidSupport :
            arg.Display.DrawBrepShaded( iSupport, colorMaterial)
            arg.Display.DrawBrepWires( iSupport, colorWirframe)
            
        for iLoad in self.viewLoad:
            arg.Display.DrawArrow( rg.Line(iLoad[0], iLoad[1]/self.forceBounds[1] * self.scale_load) ,  System.Drawing.Color.DarkRed)
            arg.Display.DrawArrow( rg.Line(iLoad[0], iLoad[2]/self.momentBounds[1] * self.scale_load) ,  System.Drawing.Color.DarkBlue)
# ---------- end vm ----------
dm = DeformedModelAlpaca4d(AlpacaSolvedModel=ra.AlpacaSolvedModel, scale=panel_20, listColor=clr)  # -> DefModel, bounds; inputs step: Int32, extrudeModel: Boolean, typeColor: Int32, listColor: list of Color; disabled
# ---------- dm: Python ----------
"""View Deformed model
    Args:
        AlpacaSolvedModel: Output of Analyses solver
        step:
        scale: Multiplication factor for displacement
        extrudeModel:  
True : view extruded model
else : view stick model
        typeColor:  View relative color of the traslation
<=0 : view traslation X 
1 : view traslation Y
2 : view traslation Z
>= 3 : view resulting displacement.
        listColor : one list of color 

    Output:
       DefModel: view deformed model
       bounds: max end min of displacement of the structure 
"""

ghenv.Component.Name = "Deformed Model (Alpaca4d)"
ghenv.Component.NickName = 'DM'
ghenv.Component.Message = "Deformed Model (Alpaca4d)"

from ghpythonlib.componentbase import executingcomponent as component
import System
import rhinoscriptsyntax as rs

import sys
import os
import clr
import clrtype
import Rhino.Geometry as rg
import Rhino as rc
import math as mt
import Grasshopper as gh
import ghpythonlib.treehelpers as th
from ghpythonlib.components import ConstructDomain

ghcompfolder = gh.Folders.DefaultAssemblyFolder
if ghcompfolder not in sys.path:
    sys.path.append(ghcompfolder)
try:
    from Alpaca4d import alpaca4dView as alpacaView
except:
    msg = "Cannot import Alpaca4d. Is the Alpaca4d folder available in " + ghcompfolder + "?"
    ghenv.Component.AddRuntimeMessage(gh.Kernel.GH_RuntimeMessageLevel.Error, msg)
    
FolderPath = rs.DocumentPath()
os.chdir(FolderPath)

ghcompfolder = gh.Folders.DefaultAssemblyFolder
my_module_name = "Alpaca_StepReader"
my_module = sys.modules.setdefault(my_module_name, type(sys)(my_module_name))


try:
    Steps_dm = my_module.Steps_dm
    Modes = my_module.Modes
except AttributeError:
    type_2d = type(System.Array.CreateInstance(float, 1, 1))

    class Steps_dm(object):
        __metaclass__ = clrtype.ClrClass
        _clrfields = {"STEP_{}".format(i): type_2d for i in range(1000)} # it will work for model with less than 1000 steps

    class Modes(object):
        __metaclass__ = clrtype.ClrClass
        _clrfields = {"MODE_{}".format(i): type_2d for i in range(1000)} # it will work for model with less than 1000 steps

    my_module.Steps_dm = Steps_dm
    my_module.Modes = Modes


hdfFilePath = os.path.join(ghcompfolder, "Alpaca4d\HDF5CSharp.dll")
clr.AddReferenceToFileAndPath(hdfFilePath)

from HDF5CSharp import Hdf5

class MyComponent(component):
    
    def RunScript(self, AlpacaSolvedModel, step = None, scale = None , extrudeModel = None, typeColor = None, listColor = [] ):
        import sys
        
        self.extrudeModel = extrudeModel
        
        self.defModel1 = []
        self.defModel2 = []
        self.defModel3 = []
        
        self.beamColor = []
        

        if step == None:
            step = 0
        if extrudeModel == None:
            extrudeModel = False
        if typeColor == None:
            typeColor = 3
        
        if not listColor: listColor = [ System.Drawing.Color.DarkViolet, 
                                        System.Drawing.Color.BlueViolet, 
                                        System.Drawing.Color.RoyalBlue, 
                                        System.Drawing.Color.CornflowerBlue,
                                        System.Drawing.Color.LightSkyBlue, 
                                        System.Drawing.Color.LightBlue,
                                        System.Drawing.Color.CadetBlue,
                                        System.Drawing.Color.LightGreen,
                                        System.Drawing.Color.GreenYellow,
                                        System.Drawing.Color.Yellow,
                                        System.Drawing.Color.Orange,
                                        System.Drawing.Color.Red,
                                        System.Drawing.Color.DarkRed]
            
        checkData = True
        
        if not AlpacaSolvedModel:
            checkData = False
            msg = "Input parameter AlpacaSolvedModel failed to collect data"
            ghenv.Component.AddRuntimeMessage(gh.Kernel.GH_RuntimeMessageLevel.Warning, msg)
        else:
            try:
                fileId = Hdf5.OpenFile(AlpacaSolvedModel.recorderName, True)
                print( AlpacaSolvedModel.recorderName)
                numberOfPoints = len(AlpacaSolvedModel.uniquePoints) #
                
                displacement = []
                rotation = []
                dispNodeList = []
                
                if AlpacaSolvedModel.isModal == True:
                    print( AlpacaSolvedModel.isModal == True )
                    outputData = "MODEL_STAGE[1]/RESULTS/ON_NODES/MODES_OF_VIBRATION(U)/DATA/STEP_0"
                    print( outputData )
                    displacementResult = Hdf5.ReadObject[Modes](fileId, outputData)
                    for i in range(numberOfPoints):
                        tag = i + 1
                        vx = getattr(displacementResult, 'MODE_{}'.format(step))[i,0]
                        vy = getattr(displacementResult, 'MODE_{}'.format(step))[i,1]
                        vz = getattr(displacementResult, 'MODE_{}'.format(step))[i,2]
                        trasl = rg.Vector3d(vx,vy,vz)
                        displacement.append(trasl)
                        dispNodeList.append( [tag, trasl] )
                        
                    Hdf5.CloseFile(fileId)
                    print("I have closed the file")
                else: 
                    outputData = "/MODEL_STAGE[1]/RESULTS/ON_NODES/DISPLACEMENT/DATA"
                    print( outputData )
                    displacementResult = Hdf5.ReadObject[Steps_dm](fileId, outputData)
                    for i in range(numberOfPoints):
                        tag = i + 1
                        vx = getattr(displacementResult, 'STEP_{}'.format(step))[i,0]
                        vy = getattr(displacementResult, 'STEP_{}'.format(step))[i,1]
                        vz = getattr(displacementResult, 'STEP_{}'.format(step))[i,2]
                        trasl = rg.Vector3d(vx,vy,vz)
                        displacement.append(trasl)
                        dispNodeList.append( [tag, trasl] )
                        
                    Hdf5.CloseFile(fileId)
                    print("I have closed the file")
            
                dispNodeDict = dict( dispNodeList )
                #---------------------------------------------------#
                defEleVector1 = alpacaView.BeamVectorDef(AlpacaSolvedModel,dispNodeDict) #beam
                defEleVector2 = alpacaView.ShellVectorDef(AlpacaSolvedModel,dispNodeDict) #shell
                defEleVector3 = alpacaView.BrickVectorDef(AlpacaSolvedModel,dispNodeDict) #shell
                bound = alpacaView.boundsDef(displacement, typeColor)
                if scale == None: scale = 1/bound[1]
                if self.extrudeModel == None or self.extrudeModel == False:
                    #BEAM
                    defModel1 = alpacaView.BeamDef(AlpacaSolvedModel, dispNodeDict,scale)
                    self.defModel1, self.beamColor = alpacaView.ColorBeamDef( defModel1, defEleVector1, bound, listColor, typeColor)
                    #SHELL
                    defModel2 = alpacaView.ShellDef(AlpacaSolvedModel,dispNodeDict,scale)
                    #BRICK
                    defModel3 = alpacaView.BrickDef(AlpacaSolvedModel,dispNodeDict,scale)
                else:
                    #BEAM
                    defModel1 = alpacaView.BeamDefExtrude(AlpacaSolvedModel, dispNodeDict,scale)
                    self.defModel1 = alpacaView.ColorBeamDefExtrude( defModel1, defEleVector1, bound, listColor, typeColor)
                    #SHELL
                    defModel2 = alpacaView.ShellDefExtrude(AlpacaSolvedModel,dispNodeDict,scale)
                    #BRICK
                    defModel3 = alpacaView.BrickDef(AlpacaSolvedModel,dispNodeDict,scale)
                    
                #SHELL COLOR
                self.defModel2 = alpacaView.ColorShellDef( defModel2, defEleVector2 , bound, listColor, typeColor, extrudeModel )
                #BRICK COLOR
                self.defModel3 = alpacaView.ColorBrickDef( defModel3, defEleVector3 , bound, listColor, typeColor)
                DefModel = th.list_to_tree(self.defModel1 + defModel2 + defModel3)
                bounds = ConstructDomain(bound[0], bound[1])
                return (DefModel, bounds)
            except:
                Hdf5.CloseFile(fileId)
                print("I have closed the file due to exception")
            # return outputs if you have them; here I try it for you:
        
        
    def DrawViewportWires(self,arg):
        for iMesh in self.defModel2 :
            colorWirframe = System.Drawing.Color.Black
            arg.Display.DrawMeshWires(iMesh, colorWirframe)
            
        for iMesh in self.defModel3 :
            colorWirframe = System.Drawing.Color.Black
            arg.Display.DrawMeshWires(iMesh, colorWirframe)
        if self.extrudeModel is None or self.extrudeModel is False:
            thickness =2
            for iBeam, iColor in zip(self.defModel1, self.beamColor) :
                for jBeam, jColor in zip(iBeam, iColor):
                    arg.Display.DrawCurve(jBeam, jColor, thickness)
        else:
            for iBeam in self.defModel1 :
                colorWirframe = System.Drawing.Color.Black
                arg.Display.DrawMeshWires(iBeam, colorWirframe)
# ---------- end dm ----------
ds = DisassembleModelAlpaca4d(AlpacaModel=ra.AlpacaSolvedModel)  # -> out, Points, threeNdfPoints, sixNdfPoints, Beam, Shell, Brick, Support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; disabled
# ---------- ds: Python ----------
"""
Disassemble a Model
-
    Args:
        AlpacaModel:
    Returns:
        Points:
        threeNdfPoints:
        sixNdfPoints:
        
        Beam:
        Shell:
        Brick:
        Support:
        Constraint:
        TimeSeries:
        Load:
        Material:
"""

ghenv.Component.Name = "Disassemble Model (Alpaca4d)"
ghenv.Component.NickName = 'DS'
ghenv.Component.Message = "Disassemble Model (Alpaca4d)"


import sys
import Rhino.Geometry as rg
import Grasshopper as gh


## add alpaca install directory to system path

ghcompfolder = gh.Folders.DefaultAssemblyFolder
if ghcompfolder not in sys.path:
    sys.path.append(ghcompfolder)

try:
    from Alpaca4d import alpaca4d as alpaca
except:
    msg = "Cannot import Alpaca4d. Is the Alpaca4d folder available in " + ghcompfolder + "?"
    ghenv.Component.AddRuntimeMessage(gh.Kernel.GH_RuntimeMessageLevel.Error, msg)

checkData = True


if not AlpacaModel:
    checkData = False
    msg = "Input parameter AlpacaModel failed to collect data"
    ghenv.Component.AddRuntimeMessage(gh.Kernel.GH_RuntimeMessageLevel.Warning, msg)

if checkData:
    Points = AlpacaModel.uniquePoints
    threeNdfPoints = AlpacaModel.uniquePointsThreeNDF
    sixNdfPoints = AlpacaModel.uniquePointsSixNDF
    
    Beam = AlpacaModel.beams
    Shell  = AlpacaModel.shells
    Brick = AlpacaModel.bricks
    Support = AlpacaModel.supports
    Constraint = AlpacaModel.constraints
    TimeSeries = AlpacaModel.timeSeries
    Load = AlpacaModel.loads
    Material = AlpacaModel.materials
# ---------- end ds ----------
nd = NodalDisplacementsAlpaca4d(AlpacaModel=ra.AlpacaSolvedModel)  # -> out, displacement, rotation, port, velocity, acceleration; inputs History: Boolean, step: Int32; disabled
# ---------- nd: Python ----------
"""
Read displacement results
-
    Args:
        AlpacaModel:
        History: True to visualise the displacement and rotation history of the points
        step:
    Returns:
        displacement:
        rotation:
        displacement_History:
        rotation_History:
"""

ghenv.Component.Name = "Nodal Displacements (Alpaca4d)"
ghenv.Component.NickName = 'ND'
ghenv.Component.Message = "Displacements (Alpaca4d)"

import sys
import os
import System
from System.Drawing import Color


import clr
import clrtype
import Rhino.Geometry as rg
import rhinoscriptsyntax as rs
import Grasshopper as gh
import copy
import ghpythonlib.treehelpers as th



## add alpaca install directory to system path

ghcompfolder = gh.Folders.DefaultAssemblyFolder
if ghcompfolder not in sys.path:
    sys.path.append(ghcompfolder)

try:
    from Alpaca4d import alpaca4d as alpaca
except:
    msg = "Cannot import Alpaca4d. Is the Alpaca4d folder available in " + ghcompfolder + "?"
    ghenv.Component.AddRuntimeMessage(gh.Kernel.GH_RuntimeMessageLevel.Error, msg)



FolderPath = rs.DocumentPath()
os.chdir(FolderPath)

my_module_name = "Alpaca_StepReader" # replace this with something unique that doesn't collide with a real module!
my_module = sys.modules.setdefault(my_module_name, type(sys)(my_module_name))

hdfFilePath = os.path.join(ghcompfolder, "Alpaca4d\HDF5CSharp.dll")
clr.AddReferenceToFileAndPath(hdfFilePath)


from HDF5CSharp import Hdf5

try:
    Steps = my_module.Steps
except AttributeError:
    type_2d = type(System.Array.CreateInstance(float, 1, 1))

    class Steps(object):
        __metaclass__ = clrtype.ClrClass
        _clrfields = {"STEP_{}".format(i): type_2d for i in range(3000)} # it will work for model with less than 1000 steps

    my_module.Steps = Steps



checkData = True

if not AlpacaModel:
    checkData = False
    msg = "Input parameter AlpacaModel failed to collect data"
    ghenv.Component.AddRuntimeMessage(gh.Kernel.GH_RuntimeMessageLevel.Warning, msg)



History = False if History is None else History


if checkData:
    step = (int(AlpacaModel.analysis.AnalysisSteps.numIncr) - 1) if step is None else step
    numberOfPoints = len(AlpacaModel.uniquePoints) #
    
    if not History:
        try:
            fileId = Hdf5.OpenFile(AlpacaModel.recorderName, True)
            
            
            displacementResult = Hdf5.ReadObject[Steps](fileId, "/MODEL_STAGE[1]/RESULTS/ON_NODES/DISPLACEMENT/DATA")
            displacement = []
            for i in range(numberOfPoints):
                x = getattr(displacementResult, 'STEP_{}'.format(step))[i,0]
                y = getattr(displacementResult, 'STEP_{}'.format(step))[i,1]
                z = getattr(displacementResult, 'STEP_{}'.format(step))[i,2]
                displacement.append(rg.Vector3d(x,y,z))
            
            
            rotationResult = Hdf5.ReadObject[Steps](fileId, "/MODEL_STAGE[1]/RESULTS/ON_NODES/ROTATION/DATA")
            rotation = []
            for i in range(numberOfPoints):
                x = getattr(rotationResult, 'STEP_{}'.format(step))[i,0]
                y = getattr(rotationResult, 'STEP_{}'.format(step))[i,1]
                z = getattr(rotationResult, 'STEP_{}'.format(step))[i,2]
                rotation.append(rg.Vector3d(x,y,z))
            
            
            
            if AlpacaModel.analysis.AnalysisType == "Transient":
                velocityResult = Hdf5.ReadObject[Steps](fileId, "/MODEL_STAGE[1]/RESULTS/ON_NODES/VELOCITY/DATA")
                velocity = []
                for i in range(numberOfPoints):
                    x = getattr(velocityResult, 'STEP_{}'.format(step))[i,0]
                    y = getattr(velocityResult, 'STEP_{}'.format(step))[i,1]
                    z = getattr(velocityResult, 'STEP_{}'.format(step))[i,2]
                    velocity.append(rg.Vector3d(x,y,z))
    
    
    
                accelerationResult = Hdf5.ReadObject[Steps](fileId, "/MODEL_STAGE[1]/RESULTS/ON_NODES/ACCELERATION/DATA")
                acceleration = []
                for i in range(numberOfPoints):
                    x = getattr(accelerationResult, 'STEP_{}'.format(step))[i,0]
                    y = getattr(accelerationResult, 'STEP_{}'.format(step))[i,1]
                    z = getattr(accelerationResult, 'STEP_{}'.format(step))[i,2]
                    acceleration.append(rg.Vector3d(x,y,z))

                
                
            Hdf5.CloseFile(fileId)
            print("I have closed the file")
        except:
            if fileId >0:
                Hdf5.CloseFile(fileId)
                print("I have closed the file because of exception")
    
    
    
    if History:
        try:
            fileId = Hdf5.OpenFile(AlpacaModel.recorderName, True)
            
            displacementResult = Hdf5.ReadObject[Steps](fileId, "/MODEL_STAGE[1]/RESULTS/ON_NODES/DISPLACEMENT/DATA")
            displacement = []
            
            for i in range(numberOfPoints):
                dispTemp = []
                maxNumberStep = int(AlpacaModel.analysis.AnalysisSteps.numIncr)
                for n_step in range(maxNumberStep):
                    x = getattr(displacementResult, 'STEP_{}'.format(n_step))[i,0]
                    y = getattr(displacementResult, 'STEP_{}'.format(n_step))[i,1]
                    z = getattr(displacementResult, 'STEP_{}'.format(n_step))[i,2]
                    dispTemp.append(rg.Vector3d(x,y,z))
                    
                
                displacement.append(dispTemp)
    
    
    
            rotationResult = Hdf5.ReadObject[Steps](fileId, "/MODEL_STAGE[1]/RESULTS/ON_NODES/ROTATION/DATA")
            
            rotation = []
            
            for i in range(numberOfPoints):
                rotationTemp = []
                for n_step in range(maxNumberStep):
                    x = getattr(rotationResult, 'STEP_{}'.format(n_step))[i,0]
                    y = getattr(rotationResult, 'STEP_{}'.format(n_step))[i,1]
                    z = getattr(rotationResult, 'STEP_{}'.format(n_step))[i,2]
                    rotationTemp.append(rg.Vector3d(x,y,z))
                
                rotation.append(rotationTemp)
    
    
            if AlpacaModel.analysis.AnalysisType == "Transient":
                velocityResult = Hdf5.ReadObject[Steps](fileId, "/MODEL_STAGE[1]/RESULTS/ON_NODES/VELOCITY/DATA")
                
                velocity = []
                
                for i in range(numberOfPoints):
                    velocityTemp = []
                    for n_step in range(maxNumberStep):
                        x = getattr(velocityResult, 'STEP_{}'.format(n_step))[i,0]
                        y = getattr(velocityResult, 'STEP_{}'.format(n_step))[i,1]
                        z = getattr(velocityResult, 'STEP_{}'.format(n_step))[i,2]
                        velocityTemp.append(rg.Vector3d(x,y,z))
                    
                    velocity.append(velocityTemp)
    
    
    
                accelerationResult = Hdf5.ReadObject[Steps](fileId, "/MODEL_STAGE[1]/RESULTS/ON_NODES/ACCELERATION/DATA")
                
                acceleration = []
                
                for i in range(numberOfPoints):
                    accelerationTemp = []
                    for n_step in range(maxNumberStep):
                        x = getattr(accelerationResult, 'STEP_{}'.format(n_step))[i,0]
                        y = getattr(accelerationResult, 'STEP_{}'.format(n_step))[i,1]
                        z = getattr(accelerationResult, 'STEP_{}'.format(n_step))[i,2]
                        accelerationTemp.append(rg.Vector3d(x,y,z))
                    
                    acceleration.append(accelerationTemp)




            Hdf5.CloseFile(fileId)
        except:
            Hdf5.CloseFile(fileId)
            print("I have closed the file because an exception")
    
    
    displacement = th.list_to_tree(displacement)
    rotation = th.list_to_tree(rotation)
    
    if AlpacaModel.analysis.AnalysisType == "Transient":
        velocity = th.list_to_tree(velocity)
        acceleration = th.list_to_tree(acceleration)
    else:
        velocity = []
        acceleration = []
# ---------- end nd ----------
mjoin_2 = MeshJoin(Meshes=dm.DefModel)  # disabled
move_5 = Move(Geometry=ds.Points, Motion=Vector(0, 0, 10))  # -> Geometry, Transform; disabled
vlen = VectorLength(Vector=nd.displacement)  # disabled
points = Geometry(ds.Points)  # disabled
values = Number(vlen)  # disabled
num = Data(values)  # disabled
bnd = Bounds(Numbers=num)  # disabled

num_2 = Data(values)  # disabled
number_slider_7 = Slider(9, range=1..12)  # disabled
bnd_2 = Bounds(Numbers=num_2)  # disabled
remap = RemapNumbers(Value=num_2, Source=bnd_2, Target=Domain(0, 1))  # -> Mapped, Clipped; disabled
clr_3 = ColorsAlpaca4d(gradIndex=number_slider_7)  # -> colors; inputs gradIndex: Int32; disabled; same code as clr
twnthrucols_2 = TweenThroughColors(
    Colors=clr_3,
    Factor=remap.Mapped,
    Normalized=True,
    Equalized=False,
    Weighted=False,
    Loopback=False,
    Degree=3,
    InterpolationType=0,
    Alpha=True)  # disabled
col = Colour(twnthrucols_2)  # disabled
col_2 = Data(col)  # disabled

geo_6 = Geometry(points)  # disabled
number_slider_8 = Slider(0.1, range=0.1..4)  # disabled
number_slider_9 = Slider(0.89, range=0.1..4)  # disabled
dom_3 = ConstructDomain(DomainStart=panel_23, DomainEnd=panel_22)  # disabled
remap_2 = RemapNumbers(Value=num, Source=bnd, Target=dom_3)  # -> Mapped, Clipped; disabled
dots = DotDisplay(Point=geo_6, Colour=col_2, Size=remap_2.Mapped)  # disabled

save_picture = BooleanToggle(True)  # disabled
select_palette = Slider(3, range=0..7)  # disabled
picture_name = Panel("test")  # disabled
panel_26 = Panel("""2
4
6
4
3
3
6""")  # disabled
swatch_2 = ColourSwatch(SwatchColor=RGB(255, 255, 255))  # disabled
swatch_3 = ColourSwatch(SwatchColor=RGB(0, 0, 0))  # disabled
item_4 = ListItem(List=panel_26, Index=select_palette, Wrap=True)  # disabled
swatch_4 = ColourSwatch(SwatchColor=RGB(148, 0, 181))  # disabled
swatch_5 = ColourSwatch(SwatchColor=RGB(48, 159, 255))  # disabled
swatch_6 = ColourSwatch(SwatchColor=RGB(0, 0, 0))  # disabled
swatch_7 = ColourSwatch(SwatchColor=RGB(255, 170, 0))  # disabled
swatch_8 = ColourSwatch(SwatchColor=RGB(194, 194, 14))  # disabled
swatch_9 = ColourSwatch(SwatchColor=RGB(34, 58, 212))  # disabled
swatch_10 = ColourSwatch(SwatchColor=RGB(237, 12, 42))  # disabled
swatch_11 = ColourSwatch(SwatchColor=RGB(227, 227, 227))  # disabled
merge = Merge(Data1=swatch_2, Data2=swatch_3, Data3=swatch_2, Data4=swatch_3, Data5=swatch_2, Data6=swatch_2, Data7=swatch_2)  # disabled
merge_2 = Merge(
    Data1=swatch_6,
    Data2=swatch_4,
    Data3=swatch_7,
    Data4=swatch_8,
    Data5=swatch_9,
    Data6=swatch_5,
    Data7=swatch_10,
    Data8=swatch_11)  # disabled
gradientlibrary = GradientLibrary(gradIndex=item_4)  # -> colors; inputs gradIndex: Int32; disabled
#   port colors: A series of colors to be plugged into the "Ladybug_Legend Parameters" component.
# ---------- gradientlibrary: Python ----------
"""
Preset of gradient colors perfect for Data Visualisation
    Inputs:
        gradIndex: An index refering to one of the following possible gradients:
            0 - Orignal Ladybug
            1 - Nuanced Ladybug
            2 - Multi-colored Ladybug
            3 - Ecotect
            4 - Thermal Comfort Percentage
            5 - Thermal Comfort Colors
            6 - Shade Benefit/Harm
            7 - Shade Harm
            8 - Shade Benefit
            9 - CFD Colors 1
            10 - Radiation Benefit
            11 - Gsa10 Colour
            12 - Gsa9 Colour
    Returns:
        customColors: A series of colors.
"""

ghenv.Component.Name = "Gradient Library"
ghenv.Component.NickName = 'GradientLibrary'
#ghenv.Component.Message = 'GradientLibrary\nWIP'

import scriptcontext as sc
import Grasshopper.Kernel as gh
import System

gradientLibrary = {
        0: [System.Drawing.Color.FromArgb(75, 107, 169), System.Drawing.Color.FromArgb(115, 147, 202), System.Drawing.Color.FromArgb(170, 200, 247), System.Drawing.Color.FromArgb(193, 213, 208), System.Drawing.Color.FromArgb(245, 239, 103), System.Drawing.Color.FromArgb(252, 230, 74), System.Drawing.Color.FromArgb(239, 156, 21), System.Drawing.Color.FromArgb(234, 123, 0), System.Drawing.Color.FromArgb(234, 74, 0), System.Drawing.Color.FromArgb(234, 38, 0)],
        1: [System.Drawing.Color.FromArgb(49,54,149), System.Drawing.Color.FromArgb(69,117,180), System.Drawing.Color.FromArgb(116,173,209), System.Drawing.Color.FromArgb(171,217,233), System.Drawing.Color.FromArgb(224,243,248), System.Drawing.Color.FromArgb(255,255,191), System.Drawing.Color.FromArgb(254,224,144), System.Drawing.Color.FromArgb(253,174,97), System.Drawing.Color.FromArgb(244,109,67), System.Drawing.Color.FromArgb(215,48,39), System.Drawing.Color.FromArgb(165,0,38)],
        2: [System.Drawing.Color.FromArgb(4,25,145), System.Drawing.Color.FromArgb(7,48,224), System.Drawing.Color.FromArgb(7,88,255), System.Drawing.Color.FromArgb(1,232,255), System.Drawing.Color.FromArgb(97,246,156), System.Drawing.Color.FromArgb(166,249,86), System.Drawing.Color.FromArgb(254,244,1), System.Drawing.Color.FromArgb(255,121,0), System.Drawing.Color.FromArgb(239,39,0), System.Drawing.Color.FromArgb(138,17,0)],
        3: [System.Drawing.Color.FromArgb(0,0,255), System.Drawing.Color.FromArgb(53,0,202), System.Drawing.Color.FromArgb(107,0,148), System.Drawing.Color.FromArgb(160,0,95), System.Drawing.Color.FromArgb(214,0,41), System.Drawing.Color.FromArgb(255,12,0), System.Drawing.Color.FromArgb(255,66,0), System.Drawing.Color.FromArgb(255,119,0), System.Drawing.Color.FromArgb(255,173,0), System.Drawing.Color.FromArgb(255,226,0), System.Drawing.Color.FromArgb(255,255,0)],
        4: [System.Drawing.Color.FromArgb(0,0,0), System.Drawing.Color.FromArgb(110,0,153), System.Drawing.Color.FromArgb(255,0,0), System.Drawing.Color.FromArgb(255,255,102), System.Drawing.Color.FromArgb(255,255,255)],
        5: [System.Drawing.Color.FromArgb(0,136,255), System.Drawing.Color.FromArgb(200,225,255), System.Drawing.Color.FromArgb(255,255,255), System.Drawing.Color.FromArgb(255,230,230), System.Drawing.Color.FromArgb(255,0,0)],
        6: [System.Drawing.Color.FromArgb(5,48,97), System.Drawing.Color.FromArgb(33,102,172), System.Drawing.Color.FromArgb(67,147,195), System.Drawing.Color.FromArgb(146,197,222), System.Drawing.Color.FromArgb(209,229,240), System.Drawing.Color.FromArgb(255,255,255), System.Drawing.Color.FromArgb(253,219,199), System.Drawing.Color.FromArgb(244,165,130), System.Drawing.Color.FromArgb(214,96,77), System.Drawing.Color.FromArgb(178,24,43), System.Drawing.Color.FromArgb(103,0,31)],
        7: [System.Drawing.Color.FromArgb(255,255,255), System.Drawing.Color.FromArgb(253,219,199), System.Drawing.Color.FromArgb(244,165,130), System.Drawing.Color.FromArgb(214,96,77), System.Drawing.Color.FromArgb(178,24,43), System.Drawing.Color.FromArgb(103,0,31)],
        8: [System.Drawing.Color.FromArgb(255,255,255), System.Drawing.Color.FromArgb(209,229,240), System.Drawing.Color.FromArgb(146,197,222), System.Drawing.Color.FromArgb(67,147,195), System.Drawing.Color.FromArgb(33,102,172), System.Drawing.Color.FromArgb(5,48,97)],
        9: [System.Drawing.Color.FromArgb(0,16,120), System.Drawing.Color.FromArgb(38,70,160), System.Drawing.Color.FromArgb(5,180,222), System.Drawing.Color.FromArgb(16,180,109), System.Drawing.Color.FromArgb(59,183,35), System.Drawing.Color.FromArgb(143,209,19), System.Drawing.Color.FromArgb(228,215,29), System.Drawing.Color.FromArgb(246,147,17), System.Drawing.Color.FromArgb(243,74,0), System.Drawing.Color.FromArgb(255,0,0)],
        10: [System.Drawing.Color.FromArgb(0,191,48), System.Drawing.Color.FromArgb(255,238,184), System.Drawing.Color.FromArgb(255,0,0)],
        11: [System.Drawing.Color.FromArgb(204,0,71), System.Drawing.Color.FromArgb(255,182,71), System.Drawing.Color.FromArgb(206,255,115), System.Drawing.Color.FromArgb(26,180, 214),System.Drawing.Color.FromArgb(0,0,207)],
        12: [System.Drawing.Color.FromArgb(255, 51, 51), System.Drawing.Color.FromArgb(255, 170, 51), System.Drawing.Color.FromArgb(255, 255, 51), System.Drawing.Color.FromArgb(170, 255, 125), System.Drawing.Color.FromArgb(51, 255, 231), System.Drawing.Color.FromArgb(51, 170, 255), System.Drawing.Color.FromArgb(51,51, 255)]}
colors = gradientLibrary[gradIndex]
# ---------- end gradientlibrary ----------
item_5 = ListItem(List=merge_2, Index=select_palette, Wrap=True)  # disabled
col_3 = Colour(gradientlibrary)  # disabled
item_6 = ListItem(List=merge, Index=select_palette, Wrap=True)  # disabled
python = GhPythonScript(color=item_5)  # -> out; inputs color: Color; disabled
# ---------- python: Python ----------
import Rhino.ApplicationSettings.AppearanceSettings
import System
import scriptcontext

settings = Rhino.ApplicationSettings.AppearanceSettings
settings.ViewportBackgroundColor = color

scriptcontext.doc.Views.Redraw()
# ---------- end python ----------
viewports = ViewportProperties(Update=update, AutoUpdate=False)  # -> ViewportNames, ActiveViewportIndex, ViewportBounds, ViewportDisplayMode, CameraLocation, CameraTarget, CameraPlane, CameraLensLength, CameraProjection, CameraUp; disabled
item_7 = ListItem(List=viewports.ViewportBounds, Index=viewports.ActiveViewportIndex, Wrap=True)  # disabled
drec = DeconstuctRectangle(Rectangle=item_7)  # -> BasePlane, XInterval, YInterval; disabled
number_slider_10 = Slider(35, range=1..70)  # disabled
int = Integer(expr("x/2", drec.XInterval))  # disabled
int_2 = Integer(expr("x*0.9", drec.YInterval))  # disabled
panel_27 = Panel("2")  # disabled
panel_28 = Panel("0 to 20")  # disabled
number_slider_11 = Slider(16, range=1..50)  # disabled
panel_29 = Panel("200")  # disabled
random = Random(Range=panel_28, Number=panel_29, Seed=2)  # disabled
multiplication = Multiplication(A=number_slider_11, B=0.5)  # disabled
num_3 = Number(expr("Round(x,0)", random))  # disabled
bnd_3 = Bounds(Numbers=num_3)  # disabled
dedomain = DeconstructDomain(Domain=bnd_3)  # -> Start, End; disabled
merge_3 = Merge(Data1=dedomain.Start, Data2=dedomain.End)  # disabled
panel_30 = Panel("Iosevka")  # disabled
int_3 = Integer(drec.YInterval)  # disabled
int_4 = Integer(drec.XInterval)  # disabled
captureview = Ladybug_CaptureView(fileName=picture_name, imageWidth=int_4, imageHeight=int_3, capture=save_picture)  # -> Output; disabled; plug-in component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
panel_31 = Panel(captureview)  # disabled
python_2 = GhPythonScript(imagePath=captureview)  # -> out, a; disabled
# ---------- python_2: Python ----------
import System


fileName =r'C:\Dev\WorkWithImage\cutImage.py'
pythonInterpreter = 'python.exe'

wrapperFile = '"' + imagePath + '"'
fileName = '"' + fileName + '"'

p = System.Diagnostics.Process()
p.StartInfo.RedirectStandardOutput = True
p.StartInfo.RedirectStandardError = True

p.StartInfo.UseShellExecute = False
p.StartInfo.CreateNoWindow = True

p.StartInfo.FileName = pythonInterpreter
p.StartInfo.Arguments = fileName + " " + wrapperFile + " " 
p.Start()
p.WaitForExit()

a = p.StandardOutput.ReadLine()
# ---------- end python_2 ----------
panel_32 = Panel(python_2.a)  # disabled

# ----
# CHOOSE
# YOUR COLOUR
panel_33 = Panel("9")  # disabled
range_2 = Range(Domain=Domain(0, 1), Steps=panel_33)  # disabled
twnthrucols_3 = TweenThroughColors(
    Colors=col_3,
    Factor=range_2,
    Normalized=True,
    Equalized=False,
    Weighted=False,
    Degree=3,
    InterpolationType=0,
    Alpha=True)  # disabled

# ----
# Legend Panel
panel_34 = Panel("10")  # disabled
panel_35 = Panel("0.5")  # disabled
rectangle_2 = Rectangle(Plane=PlaneXY(0, 0, 0), XSize=panel_35, YSize=panel_34, Radius=0)  # -> Rectangle, Length; disabled
rectangle_3 = Rectangle(Plane=PlaneXY(0, 0, 0), XSize=panel_34, YSize=panel_35, Radius=0)  # -> Rectangle, Length; disabled
panel_36 = Panel("1")  # disabled
boundary = BoundarySurfaces(Edges=rectangle_3.Rectangle)  # disabled
divide = DivideDomain(Domain=boundary, UCount=panel_36, VCount=10)  # disabled
divide_2 = DivideDomain(Domain=boundary, UCount=10, VCount=panel_36)  # disabled
subsrf = Isotrim(Surface=boundary, Domain=divide_2)  # disabled
explode = MeshExplode(Mesh=subsrf, Interpolate=False)  # disabled
mcol_2 = MeshColours(Mesh=explode, Colours=graft(twnthrucols_3))  # -> flatten(Mesh); disabled
mjoin_3 = MeshJoin(Meshes=mcol_2)  # disabled
weldvertices = MeshWeldVertices(Mesh=mjoin_3, Tolerance=0.01)  # -> RuntimeMessage, Mesh; disabled
pt_2 = ConstructPoint(XCoordinate=int, YCoordinate=int_2, ZCoordinate=0)  # disabled

multiplication_2 = Multiplication(A=number_slider_10, B=panel_34)  # disabled
division_2 = Division(A=multiplication_2, B=panel_27)  # disabled
X_3 = UnitX(Factor=division_2)  # disabled
rev = Reverse(Vector=X_3)  # disabled
move_6 = Move(Geometry=pt_2, Motion=rev)  # -> Geometry, Transform; disabled
multiplication_3 = Multiplication(A=number_slider_10, B=panel_34)  # disabled
multiplication_4 = Multiplication(A=panel_35, B=number_slider_10)  # disabled
X_4 = UnitX(Factor=multiplication_3)  # disabled
move_7 = Move(Geometry=move_6.Geometry, Motion=X_4)  # -> Geometry, Transform; disabled
addition = Addition(A=multiplication_4, B=multiplication)  # disabled
merge_4 = Merge(Data1=move_6.Geometry, Data2=move_7.Geometry)  # disabled
vec_2 = VectorXYZ(XComponent=0, YComponent=addition, ZComponent=0)  # -> Vector, Length; disabled
move_8 = Move(Geometry=merge_4, Motion=vec_2.Vector)  # -> Geometry, Transform; disabled
texttoscreen = RenderTextToScreen(Text=merge_3, Location=move_8.Geometry, Size=number_slider_11, Color=item_6, Font=panel_30, m_scWithvp=False)  # disabled

meshtoscreen = RenderMeshToScreen(Mesh=weldvertices.Mesh, Location=move_6.Geometry, ScaleFactor=number_slider_10, Depth=0.95, Fixed=True, m_scWithvp=False)  # disabled

# ==== cluster DensPreview: Preview densities as a Blured Point Cloud
model = ClusterInput()  # tOpos Model
iso = ClusterInput()  # Iso Threshold
element = ElementData(Model=model, densityMode=False)  # -> Location, Density, Compliance, Sensitivity, Size
iso_2 = Number(iso)
larger = LargerThan(FirstNumber=element.Density, SecondNumber=iso_2)  # -> LargerThan, OrEqualTo
cull = CullPattern(List=element.Density, CullPattern=larger.LargerThan)
cull_2 = CullPattern(List=element.Location, CullPattern=larger.LargerThan)
gradient = Gradient(LowerLimit=0, UpperLimit=1, Parameter=cull, stops=[0: RGBA(255, 255, 255, 0), 0.462: RGB(0, 0, 0)])
cloud = CloudDisplay(Points=cull_2, Colours=gradient, Size=expr("x/2", element.Size), SpriteType=1)

# ==== cluster ElementDataPreview: Dot style preview of tOpos Model data including element Density, Compliance and Sensitivity
model = ClusterInput()  # tOpos Model to generate preview
iso = ClusterInput()  # Iso Threshold
move = ClusterInput()  # Space between particular data sets
M = Data(model)
iso_2 = Number(iso)
num = Number(move)
dom = ConstructDomain(DomainStart=0, DomainEnd=1)

element = ElementResult(Model=M, densityMode=False)  # -> Location, Density, Compliance, Sensitivity, Size
larger = LargerThan(FirstNumber=element.Density, SecondNumber=iso_2)  # -> LargerThan, OrEqualTo
dotsize = Slider(0.6, range=0..1)
cull = CullPattern(List=element.Location, CullPattern=larger.LargerThan)
multiplication = Multiplication(A=element.Size, B=dotsize)
bbox = BoundingBox(Content=cull, Plane=PlaneXY(0, 0, 0), UnionBox=True)  # -> Box, Box_2
boxprop = BoxProperties(Box=bbox.Box)  # -> Center, Diagonal, Area, Volume, Degeneracy
devec = DeconstructVector(Vector=boxprop.Diagonal)  # -> XComponent, YComponent, ZComponent
addition = Addition(A=num, B=devec.XComponent)
series = Series(Start=0, Step=addition, Count=3)
X = UnitX(Factor=series)
move_2 = Move(Geometry=cull, Motion=graft(X))  # -> simplify(Geometry), Transform

cull_2 = CullPattern(List=element.Density, CullPattern=larger.LargerThan)
gradient = Gradient(LowerLimit=0, UpperLimit=1, Parameter=cull_2, stops=[0: RGBA(255, 255, 255, 0), 1: RGB(0, 0, 0)])

bnd = Bounds(Numbers=element.Compliance)
cull_3 = CullPattern(List=element.Compliance, CullPattern=larger.LargerThan)
dedomain = DeconstructDomain(Domain=bnd)  # -> Start, End
gradient_2 = Gradient(
    LowerLimit=dedomain.Start,
    UpperLimit=dedomain.End,
    Parameter=cull_3,
    stops=[0.00371: RGBA(176, 53, 53, 0), 0.102: RGB(255, 250, 98), 0.5: RGB(46, 144, 208)])

bnd_2 = Bounds(Numbers=element.Sensitivity)
cull_4 = CullPattern(List=element.Sensitivity, CullPattern=larger.LargerThan)
dedomain_2 = DeconstructDomain(Domain=bnd_2)  # -> Start, End
gradient_3 = Gradient(
    LowerLimit=dedomain_2.Start,
    UpperLimit=dedomain_2.End,
    Parameter=cull_4,
    stops=[0.502: RGB(175, 53, 52), 0.895: RGB(255, 250, 98), 1: RGBA(46, 144, 209, 0)])

entwine = Entwine(Branch00=gradient, Branch01=gradient_2, Branch02=gradient_3, FlattenInputs=True)  # -> simplify(Result)

cloud = CloudDisplay(Points=move_2.Geometry, Colours=entwine, Size=multiplication, SpriteType=1)

pt = Point(cull)
col = Colour(entwine)
merge = Merge(Data1=flatten(dom), Data2=flatten(bnd), Data3=flatten(bnd_2))  # -> graft(Result)
range = Domain(merge)
element_location = ClusterOutput(pt)  # Element location (center) after culling by Iso parameter.
colours = ClusterOutput(col)  # Colous for each element (after culling by Iso Threshold) of particular data sets (dens, colpiance, sensitivity)
colour_range = ClusterOutput(range)  # Colour range of particular data sets (dens, colpiance, sensitivity) for creating legend
