# Grasshopper definition Alpaca4d_Benchmark_BrickCantilever.gh (Grasshopper 1.0.8)
# plug-ins: Alpaca4d

section = Rectangle({Plane=PlaneYZ(0, 0, 0), Size=Domain2(u=-0.1..0.1, v=-0.1..0.1)})
p_per_node_kn = Vector([Vector(0, 0, -0.15625), Vector(0, 0, -0.3125), Vector(0, 0, -0.3125), Vector(0, 0, -0.3125), Vector(0, 0, -0.15625), Vector(0, 0, -0.3125), Vector(0, 0, -0.625), Vector(0, 0, -0.625), Vector(0, 0, -0.625), Vector(0, 0, -0.3125), Vector(0, 0, -0.3125), Vector(0, 0, -0.625), Vector(0, 0, -0.625), Vector(0, 0, -0.625), Vector(0, 0, -0.3125), Vector(0, 0, -0.3125), Vector(0, 0, -0.625), Vector(0, 0, -0.625), Vector(0, 0, -0.625), Vector(0, 0, -0.3125), Vector(0, 0, -0.15625), Vector(0, 0, -0.3125), Vector(0, 0, -0.3125), Vector(0, 0, -0.3125), Vector(0, 0, -0.15625)])
# Alpaca4d benchmark - cantilever of SSP bricks under an end load
# L = 2 m, 200 x 200 mm steel bar, E = 2.1e5 N/mm2, nu = 0.3, P = 10 kN, 20 x 4 x 4 SSP bricks
mplane = MeshPlane(Boundary=section, WidthCount=4, HeightCount=4)  # -> Mesh, Area
series = Series(Start=0, Step=0.1, Count=21)
X = UnitX(Factor=series)
move = Move(Geometry=mplane.Mesh, Motion=X)  # -> Geometry, Transform
mesh_series_to_brick = MeshSeriesToBrickAlpaca4d(Meshes=move.Geometry, Closed=False)
nd = ND(MaterialName="steel", E=210000000, G=80769230.77, Ν=0.3, Rho=7850, mode="ElasticIsotropic (Alpaca4d)")
ssp_brick = SSPBrickAlpaca4d(Mesh=mesh_series_to_brick, Material=nd)
item = ListItem(List=move.Geometry, Index=0, Wrap=True)
demesh = DeconstructMesh(Mesh=item)  # -> Vertices, Faces, Colours, Normals
support = SupportAlpaca4d(Position=demesh.Vertices, Tx=True, Ty=True, Tz=True, Rx=False, Ry=False, Rz=False)
item_2 = ListItem(List=move.Geometry, Index=20, Wrap=True)
demesh_2 = DeconstructMesh(Mesh=item_2)  # -> Vertices, Faces, Colours, Normals
point_load = PointLoadAlpaca4d(Point=demesh_2.Vertices, Force=p_per_node_kn, Moment=Vector(0, 0, 0))
load_pattern = LoadPatternAlpaca4d(TimeSeries=null, Loads=point_load, Factor=1, mode="PlainPattern (Alpaca4d)")
assemble_model = AssembleModelAlpaca4d(Elements=flatten(ssp_brick), Supports=flatten(support), LoadPatterns=flatten(load_pattern), Tolerance=0.01)  # -> AlpacaModel, Mass
analysis_settings = AnalysisSettingsAlpaca4d(Constraint="Transformation", Numberer="RCM", System="BandSPD", Algorithm="Newton", AnalysisType="Static")
run_analysis = RunAnalysisAlpaca4d(AlpacaModel=assemble_model.AlpacaModel, Settings=analysis_settings, settings=True)  # -> Log, AlpacaModel
nodal_displacements = NodalDisplacementsAlpaca4d(AlpacaModel=run_analysis.AlpacaModel, History=False, Step=0)  # -> Position, Displacement, Rotation, port, Velocity, AngularVelocity, Acceleration, AngularAcceleration
devec = DeconstructVector(Vector=nodal_displacements.Displacement)  # -> XComponent, YComponent, ZComponent
bnd = Bounds(Numbers=devec.ZComponent)
uz_range_m = Panel(bnd)
