# Grasshopper definition Alpaca4d_Benchmark_CantileverVibration.gh (Grasshopper 1.0.8)
# plug-ins: Alpaca4d

l_m = Number(5)
elements = Integer(20)
# Alpaca4d benchmark - cantilever beam, natural vibration
# L = 5 m, 100 x 100 mm steel bar, E = 2.1e5 N/mm2, rho = 7850 kg/m3, 20 elements
line = LineSDL(Start=Point(0, 0, 0), Direction=Vector(1, 0, 0), Length=l_m)
divide = DivideCurve(Curve=line, Count=elements, Kinks=False)  # -> Points, Tangents, Parameters
shatter = Shatter(Curve=line, Parameters=divide.Parameters)
end = EndPoints(Curve=line)  # -> Start, End
uniaxial = Uniaxial(
    MaterialName="S275",
    E=210000000,
    Eneg=210000000,
    Eta=0,
    G=80769230.77,
    Ν=0.3,
    Rho=7850,
    mode="UniaxialElastic (Alpaca4d)")
rectanglecs = RectangleCSAlpaca4d(SectionName="100 x 100", Width=0.1, Height=0.1, Material=uniaxial)
forcebeamcolumn = ForceBeamColumnAlpaca4d(Line=shatter, Section=rectanglecs, Colour=RGB(1, 30, 254), mode="ForceBeamColumn (Alpaca4d)")
support = SupportAlpaca4d(Position=end.Start, Tx=True, Ty=True, Tz=True, Rx=True, Ry=True, Rz=True)
assemble_model = AssembleModelAlpaca4d(Elements=flatten(forcebeamcolumn), Supports=flatten(support), Tolerance=0.01)  # -> AlpacaModel, Mass
natural_vibration = NaturalVibrationAnalysisAlpaca4d(AlpacaModel=assemble_model.AlpacaModel, VibrationModes=6, Solver="-genBandArpack")  # -> Log, AlpacaModel, Eigenvalues, Period, Frequencies
frequencies_hz = Panel(natural_vibration.Frequencies)
