# Grasshopper definition Alpaca4d_Benchmark_PlatePressure.gh (Grasshopper 1.0.8)
# plug-ins: Alpaca4d

plate = Rectangle({Plane=PlaneXY(0, 0, 0), Size=Domain2(u=0..0.8, v=0..0.8)})
p_kn_m2 = Vector(Vector(0, 0, -1))
# Alpaca4d benchmark - simply supported square plate under uniform pressure
# 0.8 x 0.8 m, t = 8 mm, E = 2.1e5 N/mm2, nu = 0.3, p = 1 kN/m2, 16 x 16 ASDShellQ4
mplane = MeshPlane(Boundary=plate, WidthCount=16, HeightCount=16)  # -> Mesh, Area
nd = ND(MaterialName="steel", E=210000000, G=80769230.77, Ν=0.3, Rho=7850, mode="ElasticIsotropic (Alpaca4d)")
pfs = PlateFiberSectionAlpaca4d(SectionName="t 8 mm", Thickness=0.008, Material=nd)
asdq4_asdt3 = ASDShellAlpaca4d(Mesh=mplane.Mesh, Section=pfs, IsCorotational=False)
divide = DivideCurve(Curve=plate, Count=64, Kinks=False)  # -> Points, Tangents, Parameters
edges_along_x = ListItem(
    List=divide.Points,
    Index=[1, 2, 3, 4, 5, 6, 7, 8, 9, 10, 11, 12, 13, 14, 15, 33, 34, 35, 36, 37, 38, 39, 40, 41, 42, 43, 44, 45, 46, 47],
    Wrap=True)
support = SupportAlpaca4d(Position=edges_along_x, Tx=True, Ty=True, Tz=True, Rx=False, Ry=True, Rz=False)
edges_along_y = ListItem(
    List=divide.Points,
    Index=[17, 18, 19, 20, 21, 22, 23, 24, 25, 26, 27, 28, 29, 30, 31, 49, 50, 51, 52, 53, 54, 55, 56, 57, 58, 59, 60, 61, 62, 63],
    Wrap=True)
support_2 = SupportAlpaca4d(Position=edges_along_y, Tx=True, Ty=True, Tz=True, Rx=True, Ry=False, Rz=False)
corners = ListItem(List=divide.Points, Index=[0, 16, 32, 48], Wrap=True)
support_3 = SupportAlpaca4d(Position=corners, Tx=True, Ty=True, Tz=True, Rx=True, Ry=True, Rz=False)
meshload = MeshLoadAlpaca4d(ShellElement=asdq4_asdt3, Force=p_kn_m2)
load_pattern = LoadPatternAlpaca4d(TimeSeries=null, Loads=meshload, Factor=1, mode="PlainPattern (Alpaca4d)")
assemble_model = AssembleModelAlpaca4d(
    Elements=flatten(asdq4_asdt3),
    Supports=flatten([support, support_2, support_3]),
    LoadPatterns=flatten(load_pattern),
    Tolerance=0.01)  # -> AlpacaModel, Mass
analysis_settings = AnalysisSettingsAlpaca4d(Constraint="Transformation", Numberer="RCM", System="BandSPD", Algorithm="Newton", AnalysisType="Static")
run_analysis = RunAnalysisAlpaca4d(AlpacaModel=assemble_model.AlpacaModel, Settings=analysis_settings, settings=True)  # -> Log, AlpacaModel
nodal_displacements = NodalDisplacementsAlpaca4d(AlpacaModel=run_analysis.AlpacaModel, History=False, Step=0)  # -> Position, Displacement, Rotation, port, Velocity, AngularVelocity, Acceleration, AngularAcceleration
devec = DeconstructVector(Vector=nodal_displacements.Displacement)  # -> XComponent, YComponent, ZComponent
bnd = Bounds(Numbers=devec.ZComponent)
uz_range_m = Panel(bnd)
