# Grasshopper definition Alpaca4d_Benchmark_PlateVibration_FV16.gh (Grasshopper 1.0.8)
# plug-ins: Alpaca4d

plate = Rectangle({Plane=PlaneXY(0, 0, 0), Size=Domain2(u=0..10, v=0..10)})
# Alpaca4d benchmark - NAFEMS FV16, cantilevered thin square plate
# 10 x 10 m, t = 0.05 m, E = 2.0e5 N/mm2, nu = 0.3, rho = 8000 kg/m3, clamped along x = 0, 16 x 16 ASDShellQ4
mplane = MeshPlane(Boundary=plate, WidthCount=16, HeightCount=16)  # -> Mesh, Area
nd = ND(MaterialName="steel", E=200000000, G=76923076.92, Ν=0.3, Rho=8000, mode="ElasticIsotropic (Alpaca4d)")
pfs = PlateFiberSectionAlpaca4d(SectionName="t 50 mm", Thickness=0.05, Material=nd)
asdq4_asdt3 = ASDShellAlpaca4d(Mesh=mplane.Mesh, Section=pfs, IsCorotational=False)
ln = Line(StartPoint=Point(0, 0, 0), EndPoint=Point(0, 10, 0))
divide = DivideCurve(Curve=ln, Count=16, Kinks=False)  # -> Points, Tangents, Parameters
support = SupportAlpaca4d(Position=divide.Points, Tx=True, Ty=True, Tz=True, Rx=True, Ry=True, Rz=True)
assemble_model = AssembleModelAlpaca4d(Elements=flatten(asdq4_asdt3), Supports=flatten(support), Tolerance=0.01)  # -> AlpacaModel, Mass
natural_vibration = NaturalVibrationAnalysisAlpaca4d(AlpacaModel=assemble_model.AlpacaModel, VibrationModes=6, Solver="-genBandArpack")  # -> Log, AlpacaModel, Eigenvalues, Period, Frequencies
frequencies_hz = Panel(natural_vibration.Frequencies)
