# Grasshopper definition Alpaca4d_Benchmark_SimplySupported.gh (Grasshopper 1.0.8)
# plug-ins: Alpaca4d

l_m = Number(5)
elements = Integer(10)
q_kn_m = Vector(Vector(0, 0, -6))
# Alpaca4d benchmark - simply supported beam
# q = 6 kN/m, L = 5 m, E = 2.07e5 N/mm2, 300 x 300 section (I = 6.75e8 mm4), 10 elements
line = LineSDL(Start=Point(0, 0, 0), Direction=Vector(1, 0, 0), Length=l_m)
divide = DivideCurve(Curve=line, Count=elements, Kinks=False)  # -> Points, Tangents, Parameters
shatter = Shatter(Curve=line, Parameters=divide.Parameters)
end = EndPoints(Curve=line)  # -> Start, End
uniaxial = Uniaxial(
    MaterialName="E 2.07e5",
    E=207000000,
    Eneg=207000000,
    Eta=0,
    G=79615384.62,
    Ν=0.3,
    Rho=7850,
    mode="UniaxialElastic (Alpaca4d)")
rectanglecs = RectangleCSAlpaca4d(SectionName="300 x 300", Width=0.3, Height=0.3, Material=uniaxial)
forcebeamcolumn = ForceBeamColumnAlpaca4d(Line=shatter, Section=rectanglecs, Colour=RGB(1, 30, 254), mode="ForceBeamColumn (Alpaca4d)")
support = SupportAlpaca4d(Position=end.Start, Tx=True, Ty=True, Tz=True, Rx=True, Ry=False, Rz=False)
support_2 = SupportAlpaca4d(Position=end.End, Tx=False, Ty=True, Tz=True, Rx=False, Ry=False, Rz=False)
linearload = LinearLoadAlpaca4d(BeamElement=forcebeamcolumn, Force=q_kn_m)
load_pattern = LoadPatternAlpaca4d(TimeSeries=null, Loads=linearload, Factor=1, mode="PlainPattern (Alpaca4d)")
assemble_model = AssembleModelAlpaca4d(
    Elements=flatten(forcebeamcolumn),
    Supports=flatten([support, support_2]),
    LoadPatterns=flatten(load_pattern),
    Tolerance=0.01)  # -> AlpacaModel, Mass
analysis_settings = AnalysisSettingsAlpaca4d(Constraint="Transformation", Numberer="RCM", System="BandSPD", Algorithm="Newton", AnalysisType="Static")
run_analysis = RunAnalysisAlpaca4d(AlpacaModel=assemble_model.AlpacaModel, Settings=analysis_settings, settings=True)  # -> Log, AlpacaModel
beam_forces = BeamForcesAlpaca4d(AlpacaModel=run_analysis.AlpacaModel, History=False, Step=0)  # -> N, Vy, Vz, Mx, My, Mz, Element
bnd = Bounds(Numbers=flatten(beam_forces.Vz))
bnd_2 = Bounds(Numbers=flatten(beam_forces.My))
nodal_displacements = NodalDisplacementsAlpaca4d(AlpacaModel=run_analysis.AlpacaModel, History=False, Step=0)  # -> Position, Displacement, Rotation, port, Velocity, AngularVelocity, Acceleration, AngularAcceleration
devec = DeconstructVector(Vector=nodal_displacements.Displacement)  # -> XComponent, YComponent, ZComponent
bnd_3 = Bounds(Numbers=devec.ZComponent)
vz_range_kn = Panel(bnd)
my_range_knm = Panel(bnd_2)
uz_range_m = Panel(bnd_3)
