# Grasshopper definition Alpaca4d_Benchmark_SolidPlateVibration_FV52.gh (Grasshopper 1.0.8)
# plug-ins: Alpaca4d

section = Rectangle({Plane=PlaneXY(0, 0, -0.5), Size=Domain2(u=0..10, v=0..10)})
# Alpaca4d benchmark - NAFEMS FV52, simply supported solid square plate
# 10 x 10 x 1 m, E = 2.0e5 N/mm2, nu = 0.3, rho = 8000 kg/m3, uz = 0 along the edges of the bottom face, 8 x 8 x 3 SSP bricks
mplane = MeshPlane(Boundary=section, WidthCount=8, HeightCount=8)  # -> Mesh, Area
series = Series(Start=0, Step=0.3333333333, Count=4)
Z = UnitZ(Factor=series)
move = Move(Geometry=mplane.Mesh, Motion=Z)  # -> Geometry, Transform
mesh_series_to_brick = MeshSeriesToBrickAlpaca4d(Meshes=move.Geometry, Closed=False)
nd = ND(MaterialName="steel", E=200000000, G=76923076.92, Ν=0.3, Rho=8000, mode="ElasticIsotropic (Alpaca4d)")
ssp_brick = SSPBrickAlpaca4d(Mesh=mesh_series_to_brick, Material=nd)
divide = DivideCurve(Curve=section, Count=32, Kinks=False)  # -> Points, Tangents, Parameters
support = SupportAlpaca4d(Position=divide.Points, Tx=False, Ty=False, Tz=True, Rx=False, Ry=False, Rz=False)
assemble_model = AssembleModelAlpaca4d(Elements=flatten(ssp_brick), Supports=flatten(support), Tolerance=0.01)  # -> AlpacaModel, Mass
natural_vibration = NaturalVibrationAnalysisAlpaca4d(AlpacaModel=assemble_model.AlpacaModel, VibrationModes=10, Solver="-genBandArpack")  # -> Log, AlpacaModel, Eigenvalues, Period, Frequencies
frequencies_hz = Panel(natural_vibration.Frequencies)
