# Grasshopper definition Alpaca4d_brick_example.gh (Grasshopper 1.0.7)
# plug-ins: Alpaca4d

# ----
# Alpaca4d example file
# Brick elements
# Input
width_m = Slider(2, range=0..10)
length_m = Slider(4, range=0..10)
bricks_hor = Slider(4, range=0..10)
bricks_ver = Slider(8, range=0..10)
layers_of_bricks = Slider(30, range=0..100)
int = Integer(width_m)
int_2 = Integer(length_m)
int_3 = Integer(bricks_hor)
int_4 = Integer(bricks_ver)
int_5 = Integer(layers_of_bricks)

brick_height_m = Slider(0.5, range=0..10)
multiplication = Multiplication(A=int_3, B=int_4, C=int_5)
bricks = Panel(multiplication)
num = Number(brick_height_m)
multiplication_2 = Multiplication(A=num, B=int_5)
total_height_m = Panel(multiplication_2)
num_2 = Number(num)

# ----
# Geometry
int_6 = Integer(int)
int_7 = Integer(int_2)
int_8 = Integer(int_3)
int_9 = Integer(int_4)
int_10 = Integer(int_5)
series = Series(Start=0, Step=num_2, Count=expr("x+1", int_10))
rectangle = Rectangle(Plane=PlaneXY(0, 0, 0), XSize=int_6, YSize=int_7, Radius=0)  # -> Rectangle, Length
mplane = MeshPlane(Boundary=rectangle.Rectangle, WidthCount=int_8, HeightCount=int_9)  # -> Mesh, Area
Z = UnitZ(Factor=series)
move = Move(Geometry=mplane.Mesh, Motion=Z)  # -> Geometry, Transform
mesh = Mesh(move.Geometry)
mesh_2 = Mesh(mplane.Mesh)

base = Rectangle(rectangle.Rectangle)
# Dimensions
item = ListItem(Height=series, Index=-1, Wrap=True)
explode = Explode(Curve=base, Recursive=True)  # -> Segments, Vertices
Z_2 = UnitZ(Factor=item)
item_2 = ListItem(List=explode.Vertices, Index=0, Wrap=True)  # -> Item, Item1, Item2
move_2 = Move(Geometry=item_2.Item, Motion=Z_2)  # -> Geometry, Transform
aligndim = AlignedDimension(
    Plane=[PlaneXY(0, 0, 0), PlaneXY(0, 0, 0), PlaneYZ(0, 0, 0)],
    PointA=[item_2.Item, item_2.Item1, move_2.Geometry],
    PointB=[item_2.Item1, item_2.Item2, item_2.Item],
    Offset=expr("-x", Slider(1, range=0..10)),
    Text="{0:0.0}",
    Size=Slider(0.4, range=0..10))

# ----
# Brick elements
modulus_of_elasticity_n_m² = Panel("2.1e11")
close_mesh = BooleanToggle(False)
mesh_3 = Mesh(mesh)
shear_modulus_n_m² = Panel("8.076e10")
poissons_ratio = Panel("0.3")
density_n_m³ = Panel("78500")
name = Panel("Steel")
mstb = MeshSeriesToBrickAlpaca4d(Meshes=mesh_3, Closed=close_mesh)
eim = ElasticIsotropicMaterialAlpaca4d(MaterialName=name, E=modulus_of_elasticity_n_m², G=shear_modulus_n_m², V=poissons_ratio, Rho=density_n_m³)
ssp = SSPBrickAlpaca4d(Mesh=mstb, Material=eim)

# ----
# Load
mesh_4 = Mesh(mesh)
force_kn = Slider(10, range=0..10000)
demesh = DeconstructMesh(Mesh=mesh_4)  # -> flatten(Vertices), Faces, Colours, Normals
pdecon = Deconstruct(Point=demesh.Vertices)  # -> XComponent, YComponent, ZComponent
X = UnitX(Factor=expr("x*1e3", force_kn))
equals = Equality(FirstNumber=pdecon.XComponent, SecondNumber=0)  # -> Equality, Inequality
dispatch = Dispatch(List=demesh.Vertices, DispatchPattern=equals.Equality)  # -> ListA, ListB
point_load = PointLoadAlpaca4d(Point=dispatch.ListA, Force=X, Moment=Vector(0, 0, 0))

# ----
# Support
mesh_5 = Mesh(mesh_2)
demesh_2 = DeconstructMesh(Mesh=mesh_5)  # -> Vertices, Faces, Colours, Normals
cullpt = CullDuplicates(Points=demesh_2.Vertices, Tolerance=0.01, CullMode=3)  # -> Points, Indices, Valence
tx = BooleanToggle(True)
ty = BooleanToggle(True)
tz = BooleanToggle(True)
rx = BooleanToggle(True)
ry = BooleanToggle(True)
rz = BooleanToggle(True)
support = SupportAlpaca4d(Point=cullpt.Points, Tx=tx, Ty=ty, Tz=tz, Rx=rx, Ry=ry, RZ=rz)

# ----
# Assemble
assemble_model = AssembleModelAlpaca4d(Element=ssp, Support=support, Load=point_load, Tolerance=0.01)  # -> AlpacaModel, Mass
# Settings
analysissettings = AnalysisSettingsAlpaca4d()
pt = Point(dispatch.ListA)
num_3 = Number(force_kn)
multiplication_3 = Multiplication(A=num, B=int_5)
# Equivalent surface load
lng = ListLength(List=pt)
multiplication_4 = Multiplication(A=int_2, B=multiplication_3)
multiplication_5 = Multiplication(A=lng, B=num_3)
division = Division(A=multiplication_5, B=multiplication_4)
# Analysis
ra = RunAnalysisAlpaca4d(AlpacaModel=assemble_model.AlpacaModel, Settings=analysissettings)  # -> Log, AlpacaModel
kn_m² = Panel(division)
# Brick stresses
bs = BrickStressesAlpaca4d(AlpacaModel=ra.AlpacaModel, History=False, Step=0)  # -> Sigma11, Sigma22, Sigma33, Sigma12, Sigma23, Sigma13, VonMises
# Deformed model
deformed_model_view = DeformedModelViewAlpaca4d(AlpacaModel=ra.AlpacaModel, Step=0, Scale=Slider(300, range=0..1000))  # -> Line, Mesh, Brick
nd = NodalDisplacementsAlpaca4d(AlpacaModel=ra.AlpacaModel, History=False, Step=0)  # -> Displacement, Rotation, port, Velocity, Acceleration
expression = Expression(b=int_2, h=int, Expression="(1/12)*b*h^3")
division_2 = Division(A=[bs.Sigma11, bs.Sigma22, bs.Sigma33, bs.Sigma12, bs.Sigma23, bs.Sigma13], B=1000000)
division_3 = Division(A=bs.VonMises, B=1000000)
num_4 = Number(expr("round(x,2)", division_2))
multiplication_6 = Multiplication(A=division, B=int_2)
division_4 = Division(A=modulus_of_elasticity_n_m², B=1000)
num_5 = Number(expr("round(x,2)", division_3))
item_3 = ListItem(List=nd.Displacement, Index=-1, Wrap=True)
# Standard beam equation
panel = Panel(multiplication_6)
panel_2 = Panel(expression)
panel_3 = Panel(total_height_m)
panel_4 = Panel(division_4)
sort = SortList(Keys=num_5)  # -> reverse(Keys), ValuesA
# Alpaca delta max hor
pdecon_2 = Deconstruct(Point=item_3)  # -> XComponent, YComponent, ZComponent
multiplication_7 = Multiplication(A=pdecon_2.XComponent, B=100)
expression_2 = Expression(q=panel, l=panel_3, E=panel_4, I=panel_2, Expression="(q*l^4)/(8*E*I)")
item_4 = ListItem(List=sort.Keys, Index=Slider(0, range=0..100), Wrap=True)
num_6 = Number(expr("Round(x,3)", flatten(multiplication_7)))
# Find bricks with
# highest stresses
mindex = MemberIndex(Set=num_5, Member=item_4)  # -> Index, Count
num_7 = Number(expr("(Round(x*100,3))", flatten(expression_2)))
item_5 = ListItem(List=deformed_model_view.Brick, Index=mindex.Index, Wrap=True)
hor_displacement = Panel(num_6)
hor_displacement_2 = Panel(num_7)
mesh_6 = Mesh(item_5)
division_5 = Division(A=hor_displacement, B=hor_displacement_2)
subtraction = Subtraction(A=division_5, B=1)
abs = Absolute(Value=subtraction)
multiplication_8 = Multiplication(A=abs, B=100)
num_8 = Number(expr("(Round(x,3))", multiplication_8))
devation = Panel(num_8)
