# Grasshopper definition Multi_Storey_Building.gh (Grasshopper 1.0.7)
# plug-ins: Kangaroo2 Components, Weaverbird, MeshEdit Components, Alpaca4d

number_floor = Slider(5, range=2..15)
series = Series(Start=0, Step="5", Count=number_floor)
rectangle = Rectangle(Plane=PlaneXY(0, 0, 0), XSize="40", YSize="20", Radius=0)  # -> Rectangle, Length
Z = UnitZ(Factor=series)
srf = Surface(simplify(rectangle.Rectangle))
span_v = Slider(5, range=1..6)
span_u = Slider(5, range=1..6)
# Example Name
# Units
# N, mm
panel = Panel("Small Description")

# ---- group: Element
data = Data(0)
data_2 = Data(0)

# ---- group: Load
data_3 = Data(0)
data_4 = Data(0)

# ----
num = Number("40")
num_2 = Number("20")

# ---- group: Cross_Section
data_5 = Data(0)
data_6 = Data(0)

# ---- group: Support
data_7 = Data(0)
data_8 = Data(0)

# ----
division = Division(A=num, B=span_u)
division_2 = Division(A=num_2, B=span_v)

# ---- group: Material
data_9 = Data(0)
data_10 = Data(0)

# ---- group: Constraint
data_11 = Data(0)
data_12 = Data(0)

# ----
mplane = MeshPlane(Boundary=rectangle.Rectangle, WidthCount=division, HeightCount=division_2)  # -> Mesh, Area

# ---- group: Visualization
data_13 = Data(0)
data_14 = Data(0)

# ---- group: Output
data_15 = Data(0)
data_16 = Data(0)

# ----
medges = MeshEdges(Mesh=mplane.Mesh)  # -> NakedEdges, InteriorEdges, NonManifoldEdges
nv = NakedVertices(Mesh=mplane.Mesh)  # -> ClothedIndex, NakedIndex, ClothedPts, NakedPts
join = JoinCurves(Curves=medges.NakedEdges, Preserve=False)
explode = Explode(Curve=join, Recursive=True)  # -> Segments, Vertices
graft = GraftTree(Tree=nv.ClothedPts, IncludeEmptyLists=True, IncludeNullItems=True)
graft_2 = GraftTree(Tree=nv.NakedPts, IncludeEmptyLists=True, IncludeNullItems=True)
graft_3 = GraftTree(Tree=explode.Segments, IncludeEmptyLists=True, IncludeNullItems=True)
graft_4 = GraftTree(Tree=medges.InteriorEdges, IncludeEmptyLists=True, IncludeNullItems=True)
vec = Vector(Z)
vec_2 = Vector(Z)
vec_3 = Vector(Z)
vec_4 = Vector(Z)

panel_2 = Panel("""10
22""")
faceb = FaceBoundaries(Mesh=mplane.Mesh)
item = ListItem(List=faceb, Index=panel_2, Wrap=True)
graft_5 = GraftTree(Tree=item, IncludeEmptyLists=True, IncludeNullItems=True)
vec_5 = Vector(Z)
move = Move(Geometry=graft_5, Motion=vec_5)  # -> Geometry, Transform
shift = ShiftList(List=move.Geometry, Shift=1, Wrap=invert(True))
merge = Merge(Data1=simplify(graft(move.Geometry)), Data2=simplify(graft(shift)))
loft = Loft(Curves=merge, Options={Adjust=False, Closed=False, LoftEnds=0, LoftSimp=0, LoftType=0, Rebuild=10, Refit=0.01})
clean = CleanTree(RemoveNulls=True, RemoveInvalid=True, RemoveEmpty=invert(False), Tree=loft)
debrep = DeconstructBrep(Brep=clean)  # -> simplify(Faces), Edges, Vertices

move_2 = Move(Geometry=graft, Motion=vec_2)  # -> Geometry, Transform
move_3 = Move(Geometry=graft_2, Motion=vec_3)  # -> Geometry, Transform
move_4 = Move(Geometry=graft_3, Motion=vec_4)  # -> Geometry, Transform
move_5 = Move(Geometry=graft_4, Motion=vec)  # -> Geometry, Transform
crv = Curve(simplify(move_4.Geometry))
pline = PolyLine(Vertices=move_2.Geometry, Closed=False)
pline_2 = PolyLine(Vertices=move_3.Geometry, Closed=False)
crv_2 = Curve(simplify(move_5.Geometry))
flip = FlipMatrix(Data=crv)
flip_2 = FlipMatrix(Data=crv_2)
join_2 = JoinCurves(Curves=flip_2, Preserve=invert(False))
join_3 = JoinCurves(Curves=flip, Preserve=False)
split = SplitTree(Data=simplify(join_3), Masks=flatten("{>0}"))  # -> Positive, Negative
split_2 = SplitTree(Data=simplify(join_2), Masks=flatten("{>0}"))  # -> Positive, Negative
external_colum = Curve(pline_2)
internal_colum = Curve(pline)
internal_beam = Curve(split_2.Positive)
outer_beam = Curve(split.Positive)

branch = TreeBranch(Tree=crv, Path=[Slider(0, range=0..17), Slider(17, range=0..17)], MaintainPaths=True)
crv_3 = Curve(branch)
shift_2 = ShiftList(List=crv_3, Shift=1, Wrap=invert(True))
merge_2 = Merge(Data1=simplify(graft(crv_3)), Data2=simplify(graft(shift_2)))
loft_2 = Loft(Curves=merge_2, Options={Adjust=False, Closed=False, LoftEnds=0, LoftSimp=0, LoftType=0, Rebuild=10, Refit=0.01})
clean_2 = CleanTree(RemoveNulls=True, RemoveInvalid=True, RemoveEmpty=invert(False), Tree=loft_2)
debrep_2 = DeconstructBrep(Brep=clean_2)  # -> simplify(Faces), Edges, Vertices
item_2 = ListItem(List=debrep_2.Vertices, Index=0, Wrap=True)  # -> Item, Item1, Item2, Item3
ln = Line(StartPoint=item_2.Item, EndPoint=item_2.Item2)
ln_2 = Line(StartPoint=item_2.Item1, EndPoint=item_2.Item3)

graft_6 = GraftTree(Tree=debrep.Faces, IncludeEmptyLists=True, IncludeNullItems=True)
dim = Dimensions(Surface=graft_6)  # -> UDimension, VDimension
num_3 = Number(dim.UDimension)
num_4 = Number(dim.VDimension)
division_3 = Division(A=num_3, B=Slider(1, range=0.1..1))
division_4 = Division(A=num_4, B=Slider(1, range=0.1..1))
divide = DivideDomain²(Domain=graft_6, UCount=division_3, VCount=division_4)
subsrf = Isotrim(Surface=graft_6, Domain=divide)  # -> simplify(Surface)
smesh = SimpleMesh(Brep=subsrf)  # -> simplify(Mesh)

mjoin = MeshJoin(Meshes=flatten(smesh))
weldvertices = MeshWeldVertices(Mesh=mjoin, Tolerance=0.01)  # -> RuntimeMessage, Mesh

# ----
# Connect if you want to use the mesh element
wbnaked = WeaverbirdsNakedBoundary(MeshClosedPolylines=weldvertices.Mesh)
item_3 = ListItem(List=wbnaked, Index=0, Wrap=True)
explode_2 = Explode(Curve=item_3, Recursive=True)  # -> Segments, Vertices
geo = Geometry([nv.ClothedPts, nv.NakedPts])
merge_3 = Merge(Data1=geo)  # -> flatten(Result)
cullpt = CullDuplicates(Points=merge_3, Tolerance=0.1, CullMode=3)  # -> Points, Indices, Valence

mesh = Mesh(weldvertices.Mesh)
elastic_isotropic_material_alpaca4d = ElasticIsotropicMaterialAlpaca4d(E=210000000, G=80760000, V=0.3, Rho=7850)

crv_4 = Curve([internal_beam, outer_beam])
explode_3 = Explode(Curve=crv_4, Recursive=True)  # -> Segments, Vertices
i_section_alpaca4d = ISectionAlpaca4d(Height="1", TopFlangeWidth="1", TopFlangeThickness="0.2", BottomFlangeWidth="1", BottomFlangeThickness="0.2", Web="0.2")
force_beam_column = ForceBeamColumnAlpaca4d(Line=explode_3.Segments, Section=i_section_alpaca4d)

uniaxial_material_elastic = UniaxialMaterialElasticAlpaca4d(G="0.20", Rho="2500")

crv_5 = Curve([internal_colum, external_colum])
explode_4 = Explode(Curve=crv_5, Recursive=True)  # -> Segments, Vertices
rectanglecs = RectangleCSAlpaca4d(Width="0.3", Height="0.3", Material=uniaxial_material_elastic)
force_beam_column_2 = ForceBeamColumnAlpaca4d(Line=explode_4.Segments, Section=rectanglecs)

pt = Point(flatten(explode_3.Vertices))
list = ValueList({"Static": 0, "Transient": 1}, selected="Static")
cullpt_2 = CullDuplicates(Points=pt, Tolerance=0.1, CullMode=3)  # -> Points, Indices, Valence

pt_2 = Point(cullpt_2.Points)
num_5 = Number([0, 0.002166377816, 0.004332755633, 0.006499133449, 0.008665511265, 0.01083188908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])
num_6 = Number([0, 0.039111, 0.020721, 0.006817, 0.002312, 0.001892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])
pts = PathTimeSeriesAlpaca4d(Times=num_5, Values=num_6, LoadFactor="1000")  # -> TimeSeries, Graph

pfs = PlateFiberSectionAlpaca4d(Thickness="0.15", Material=elastic_isotropic_material_alpaca4d)

pt_3 = Point(cullpt_2.Points)
constant_time_series = ConstantTimeSeriesAlpaca4d(LoadFactor=1)  # -> TimeSeries, Graph
vec_6 = VectorXYZ(XComponent="-0.001", YComponent=0, ZComponent=0)  # -> Vector, Length

pt_4 = Point(cullpt.Points)
toggle = BooleanToggle(True)
support = SupportAlpaca4d(Point=pt_4, Tx=True, Ty=True, Tz=True, Rx=True, Ry=True, RZ=True)

asdq4 = ASDShellQ4Alpaca4d(Mesh=mesh, Section=pfs, Colour=ColourSwatch(SwatchColor=RGB(60, 0, 255)))

panel_3 = Panel(rectanglecs)
point_load_alpaca4d = PointLoadAlpaca4d(Point=pt_3, Force=vec_6.Vector, Moment=Vector(0, 0, 0))
point_load_alpaca4d_2 = PointLoadAlpaca4d(Point=pt_2, Force=vec_6.Vector, Moment=Vector(0, 0, 0))
load_pattern_alpaca4d = LoadPatternAlpaca4d(TimeSeries=pts.TimeSeries, Loads=point_load_alpaca4d_2, Factor=1)
load_pattern_alpaca4d_2 = LoadPatternAlpaca4d(TimeSeries=constant_time_series.TimeSeries, Loads=point_load_alpaca4d, Factor=1)
filter = StreamFilter(Gate=list, Stream0=load_pattern_alpaca4d_2, Stream1=load_pattern_alpaca4d)
assemblemodel_alpaca4d = AssembleModelAlpaca4d(
    Elements=flatten([asdq4, force_beam_column_2, force_beam_column]),
    Supports=flatten(support),
    LoadPatterns=flatten(filter),
    Tolerance=0.01)  # -> AlpacaModel, Mass
analysisstep = AnalysisStepAlpaca4d(NumIncr="5000", Dt="0.001")
integrator_newmark_alpaca4d = IntegratorNewmarkAlpaca4d(Gamma=0.5, Beta=0.25)
analysisstep_2 = AnalysisStepAlpaca4d(NumIncr=1)
analysissettings = AnalysisSettingsAlpaca4d(AnalysisType="Transient", AnalysisSteps=analysisstep)
analysissettings_2 = AnalysisSettingsAlpaca4d(AnalysisSteps=analysisstep_2)
data_17 = Data(list)
filter_2 = StreamFilter(Gate=data_17, Stream0=analysissettings_2, Stream1=analysissettings)

# ---- group: Run Analysis (Alpaca4d)
ra = RunAnalysisAlpaca4d(AlpacaModel=assemblemodel_alpaca4d.AlpacaModel, Settings=filter_2)  # -> Log, AlpacaModel

# ----
clr = ColorsAlpaca4d(GradientIndex=Slider(11, range=0..12))  # -> reverse(Colors)
modelview = ModelViewAlpaca4d(
    AlpacaModel=ra.AlpacaModel,
    Extruded=Toggle(True),
    Load=False,
    LoadFactor=1,
    Support=Toggle(True),
    SupportFactor=Slider(2.15, range=1..10),
    Constraint=False)  # -> AlpacaModel, Info
deformed_model_view_alpaca4d = DeformedModelViewAlpaca4d(AlpacaModel=ra.AlpacaModel, Step=Slider(0, range=0..10), Scale="3", Colors=clr)  # -> Line, Mesh, Brick
rf = ReactionForcesAlpaca4d(AlpacaModel=ra.AlpacaModel, History=False, Step=0)  # -> SupportPosition, ReactionForce, ReactionMoment
nd = NodalDisplacementsAlpaca4d(AlpacaModel=ra.AlpacaModel, History=False, Step=0)  # -> Displacement, Rotation, port, Velocity, Acceleration
devec = DeconstructVector(Vector=nd.Displacement)  # -> XComponent, YComponent, ZComponent
graph = QuickGraph(devec.XComponent, SortOrder=0)
