# Grasshopper definition Alpaca4d_cantilever_example.gh (Grasshopper 1.0.7)
# plug-ins: Alpaca4d

# ----
# Material
number_slider = Slider(7830, range=0..100000)
num = Number("2.07e11")
num_2 = Number("8.076e10")
uniaxial_material_elastic = UniaxialMaterialElasticAlpaca4d(MaterialName="Steel", E=num, Eneg=num, Eta=Slider(0, range=0..1), G=num_2, V=Slider(0.3, range=0..1), Rho=number_slider)

# ----
# Alpaca4d example file
# Cantilever beam
# Input
beam_length_m = Slider(8, range=0..100)
point_load_kn = Slider(80, range=0..1000)
segments = Slider(30, range=0..100)

# ----
# Section
# Example: HEB600
flange_thickness_m = Slider(0.03, range=0..0.1)
web_thickness_m = Slider(0.0155, range=0..0.1)
flange_width_m = Slider(0.3, range=0..1)
height_m = Slider(0.6, range=0..1)
bottomflange_m = Slider(0.02, range=0..0.1)
topflange_m = Slider(0.02, range=0..0.1)
height_m_2 = Slider(0.5, range=0..1)
width_m = Slider(0.3, range=0..1)
diameter_m = Slider(0.3, range=0..1)
thickness_m = Slider(0.01, range=0..1)
web_m = Slider(0.02, range=0..0.1)
height_m_3 = Slider(0.3, range=0..1)
width_m_2 = Slider(0.3, range=0..1)
section = ValueList({"Rectangular": 0, "Circular": 1, "Hollow Rectangle": 2, "I profile": 3}, selected="Rectangular")
i_section = ISectionAlpaca4d(
    SectionName="I profile",
    Height=height_m,
    TopFlangeWidth=flange_width_m,
    TopFlangeThickness=flange_thickness_m,
    BottomFlangeWidth=flange_width_m,
    BottomFlangeThickness=flange_thickness_m,
    Web=web_thickness_m,
    Material=uniaxial_material_elastic)
rectanglehollowcs = RectangleHollowAlpaca4d(
    SectionName="Hollow Rectangle",
    Width=width_m,
    Height=height_m_2,
    Web=web_m,
    TopFlange=topflange_m,
    BottomFlange=bottomflange_m,
    Material=uniaxial_material_elastic)
circlecs = CircleCSAlpaca4d(SectionName="Circular section", Diameter=diameter_m, Thickness=thickness_m, Material=uniaxial_material_elastic)
rectanglecs = RectangleCSAlpaca4d(SectionName="Rectangular section", Width=width_m_2, Height=height_m_3, Material=uniaxial_material_elastic)

# ----
# Create beam
panel = Panel("{0,0,0}")
X = UnitX(Factor=beam_length_m)
pt = Point(panel)
move = Move(Geometry=pt, Motion=X)  # -> Geometry, Transform
ln = Line(StartPoint=pt, EndPoint=move.Geometry)

filter = StreamFilter(Gate=section, Stream0=rectanglecs, Stream1=circlecs, Stream2=rectanglehollowcs, Stream3=i_section)
end = EndPoints(Curve=ln)  # -> Start, End

# ----
# Mesh line
line = Line(ln)
int = Integer(segments)
data = Data(filter)
divide = DivideCurve(Curve=line, Count=int, Kinks=False)  # -> Points, Tangents, Parameters
shatter = Shatter(Curve=line, Parameters=divide.Parameters)
Y = UnitY(Factor="1")
force_beam_column = ForceBeamColumnAlpaca4d(Line=shatter, Section=data, ZAxis=Y)

# ----
# Load
pt_2 = Point(end.End)
num_3 = Number(point_load_kn)
multiplication = Multiplication(A=num_3, _1e3=1000)
Z = UnitZ(Factor=expr("-x", multiplication))
point_load_alpaca4d = PointLoadAlpaca4d(Point=pt_2, Force=Z, Moment=Vector(0, 0, 0))

# ----
# Supports
pt_3 = Point(end.Start)
tx = BooleanToggle(True)
ty = BooleanToggle(True)
tz = BooleanToggle(True)
rx = BooleanToggle(True)
ry = BooleanToggle(True)
rz = BooleanToggle(True)
support = SupportAlpaca4d(Point=pt_3, Tx=tx, Ty=ty, Tz=tz, Rx=rx, Ry=ry, RZ=rz)

# ----
# Assemble
assemble_model = AssembleModelAlpaca4d(Element=force_beam_column, Support=support, Load=point_load_alpaca4d, Tolerance=0.01)  # -> AlpacaModel, Mass
# Settings
analysissettings = AnalysisSettingsAlpaca4d()
# Analysis
ra = RunAnalysisAlpaca4d(AlpacaModel=assemble_model.AlpacaModel, Settings=analysissettings)  # -> Log, AlpacaModel

# ----
# Validation vertical displacement
# Open Sees
# Standard beam equation
expression = Expression(b=width_m_2, h=height_m_3, Expression="(1/12)*b*h^3")
panel_2 = Panel(num)
panel_3 = Panel(expression)
panel_4 = Panel(point_load_kn)
panel_5 = Panel(beam_length_m)
num_4 = Number(panel_4)
num_5 = Number(panel_5)
num_6 = Number(panel_2)
# For now only rectangular section validation
num_7 = Number(panel_3)
nd = NodalDisplacementsAlpaca4d(AlpacaModel=ra.AlpacaModel, History=False, Step=0)  # -> Displacement, Rotation, port, Velocity, Acceleration
multiplication_2 = Multiplication(A=num_4, B=1000)
expression_2 = Expression(F=multiplication_2, L=num_5, E=num_6, I=num_7, Expression="(F*L^3)/(3*E*I)")
item = ListItem(List=nd.Displacement, Index=-1, Wrap=True)
pdecon = Deconstruct(Point=item)  # -> XComponent, YComponent, ZComponent
multiplication_3 = Multiplication(A=pdecon.ZComponent, _100=-100)
multiplication_4 = Multiplication(A=expression_2, _100=100)
num_8 = Number(expr("Round(x,2)", flatten(multiplication_3)))
num_9 = Number(expr("round(x,2)", multiplication_4))
delta_vertical_cm = Panel(num_8)
delta_vertical_cm_2 = Panel(num_9)
expression_3 = Expression(x=delta_vertical_cm, y=delta_vertical_cm_2, Expression="round((abs((x/y)-1))*100,3)")
devation = Panel(expression_3)

# ----
# Deformed model
deformed_model_view = DeformedModelViewAlpaca4d(AlpacaModel=ra.AlpacaModel, Step=0, Scale=Slider(20, range=0..1000))  # -> Line, Mesh, Brick
