# Grasshopper definition EarthQuake_city.gh (Grasshopper 1.0.7)
# plug-ins: Alpaca4d

# Example Name
# Units
# N, mm
panel = Panel("Small Description")

# ---- group: Element
data = Data(0)
data_2 = Data(0)

# ---- group: Load
data_3 = Data(0)
data_4 = Data(0)

# ---- group: Cross_Section
data_5 = Data(0)
data_6 = Data(0)

# ---- group: Support
data_7 = Data(0)
data_8 = Data(0)

# ---- group: Material
data_9 = Data(0)
data_10 = Data(0)

# ---- group: Constraint
data_11 = Data(0)
data_12 = Data(0)

# ---- group: Visualization
data_13 = Data(0)
data_14 = Data(0)

# ---- group: Output
data_15 = Data(0)
data_16 = Data(0)

# ----
pop2d = Populate2D(Region={Plane=PlaneXY(0, 0, 0), Size=Domain2(u=0..20, v=0..10)}, Count="50", Seed=1)
panel_2 = Panel("""0
0.01
0.02
5""")
panel_3 = Panel("""0
1
0
0""")
random = Random(Range="4 to 12", Number=1, Seed=pop2d)  # -> flatten(Random)
path_time_series_alpaca4d = PathTimeSeriesAlpaca4d(Times=panel_2, Values=panel_3, LoadFactor=1)  # -> TimeSeries, Graph
line = LineSDL(Start=pop2d, Direction=Vector(0, 0, 1), Length=random)
uniaxial_material_elastic_alpaca4d = UniaxialMaterialElasticAlpaca4d(E=210000000, Eneg=210000000, Eta=0, G=80760000, V=0.3, Rho="2500")
end = EndPoints(Curve=line)  # -> Start, End
panel_4 = Panel("""-.4524259E-02  -.5453609E-02  -.3879534E-02  -.5966478E-04   .1453968E-03
   .3141729E-03   .4242131E-03   .5230633E-03   .6191808E-03   .7135598E-03
   .8102202E-03   .9037519E-03   .9789034E-03   .1022652E-02   .1030402E-02
   .1008570E-02   .9681240E-03   .9171226E-03   .8604907E-03   .7983539E-03
   .7297761E-03   .6620882E-03   .6072410E-03   .5730847E-03   .5632766E-03
   .5751092E-03   .5944994E-03   .6041827E-03   .5949643E-03   .5639703E-03
   .5158626E-03   .4628568E-03   .4094630E-03   .3564320E-03   .3189031E-03
   .3207575E-03   .3747367E-03   .4634662E-03   .5513970E-03   .6230334E-03
   .6835686E-03   .7298884E-03   .7527032E-03   .7525612E-03   .7358731E-03
   .7119356E-03   .6901599E-03   .6724041E-03   .6500149E-03   .6118034E-03
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""")
crv = Curve(line)
pt = Point(end.End)
Y = UnitY(Factor="1000000")
pt_2 = Point(end.Start)
rectanglecs_alpaca4d = RectangleCSAlpaca4d(Width="1", Height="0.50", Material=uniaxial_material_elastic_alpaca4d)
toggle = BooleanToggle(True)
divide = DivideCurve(Curve=crv, Count="5", Kinks=False)  # -> Points, Tangents, Parameters
point_load_alpaca4d = PointLoadAlpaca4d(Point=pt, Force=Y, Moment=Vector(0, 0, 0))
pline = PolyLine(Vertices=divide.Points, Closed=False)
support = SupportAlpaca4d(Point=pt_2, Tx=toggle, Ty=toggle, Tz=toggle, Rx=toggle, Ry=toggle, RZ=toggle)
explode = Explode(Curve=pline, Recursive=True)  # -> flatten(Segments), Vertices
load_pattern_alpaca4d = LoadPatternAlpaca4d(TimeSeries=path_time_series_alpaca4d.TimeSeries, Loads=point_load_alpaca4d, Factor=1)
force_beam_column = ForceBeamColumnAlpaca4d(Line=explode.Segments, Section=rectanglecs_alpaca4d)
assemblemodel_alpaca4d = AssembleModelAlpaca4d(Elements=force_beam_column, Supports=support, LoadPatterns=load_pattern_alpaca4d, Tolerance=0.01)  # -> AlpacaModel, Mass
analysisstep = AnalysisStepAlpaca4d(NumIncr="1000", Dt="0.005")
nm = IntegratorNewmarkAlpaca4d(Gamma=0.5, Beta=0.25)
damping = DampingAlpaca4d(AlphaM=0, BetaKCurr=0, BetaKInit=0, BetaKComm="0.001")
analysissettings = AnalysisSettingsAlpaca4d(Damping=damping, Integrator=nm, AnalysisType="Transient", AnalysisSteps=analysisstep)

# ---- group: Run Analysis (Alpaca4d)
ra = RunAnalysisAlpaca4d(AlpacaModel=assemblemodel_alpaca4d.AlpacaModel, Settings=analysissettings)  # -> Log, AlpacaModel

# ----
nd = NodalDisplacementsAlpaca4d(AlpacaModel=ra.AlpacaModel, History=Toggle(True), Step=Slider(0, range=0..100))  # -> Displacement, Rotation, port, Velocity, Acceleration
flip = FlipMatrix(Data=nd.Rotation)
counter = CounterAlpaca4d(Run=Toggle(False), Reset=Button())  # -> Counter; inputs Run: Boolean, Reset: Boolean
# ---------- counter: Python ----------
"""Counter
    Inputs:
        Run:
        Reset:
        Interval: how fast it will update (milliseconds)
    Output:
        Counter:"""

__author__ = "Marco Pellegrino"
__contact__ = "pellegrino.marco@icloud.com"
__linkedIn__ = "https://www.linkedin.com/in/mp0110/"

ghenv.Component.Name = "Counter (Alpaca4d)"
ghenv.Component.NickName = 'Counter'
ghenv.Component.Message = "Counter (Alpaca4d)"


import Grasshopper as gh
import math


def updateComponent(interval):
    
    """ Updates this component, similar to using a grasshopper timer """
    
    # Define callback action
    def callBack(e):
        ghenv.Component.ExpireSolution(False)
        
    # Get grasshopper document
    ghDoc = ghenv.Component.OnPingDocument()
    
    # Schedule this component to expire
    ghDoc.ScheduleSolution(interval,gh.Kernel.GH_Document.GH_ScheduleDelegate(callBack)) # Note that the first input here is how often to update the component (in milliseconds)


Interval = 1 if Interval is None else Interval


# Instantiate/reset persisent starting counter variable
if "myCounter" not in globals() or Reset:
    myCounter = 0

# Update the variable and component
if Run and not Reset:
    myCounter +=1
    updateComponent(Interval)

# Output counter
Counter = myCounter
# ---------- end counter ----------
clr = ColorsAlpaca4d(GradientIndex=11)  # -> reverse(Colors)
devec = DeconstructVector(Vector=flip)  # -> XComponent, YComponent, ZComponent
graph = QuickGraph(devec.XComponent, SortOrder=0)
panel_5 = Panel(counter)
deformed_model_view = DeformedModelViewAlpaca4d(AlpacaModel=ra.AlpacaModel, Step=counter, Scale="4", Colors=clr)  # -> Line, Mesh, Brick
