# Grasshopper definition shell.gh (Grasshopper 1.0.7)
# plug-ins: Kangaroo2 Components, Alpaca4d

mplane = MeshPlane(Boundary={Plane=PlaneXY(0, 0, 0), Size=Domain2(u=-10..10, v=-10..10)}, WidthCount=10, HeightCount=10)  # -> Mesh, Area
mc = MeshCorners(Mesh=mplane.Mesh, Angle=2.35619449)
pfs = PlateFiberSectionAlpaca4d(Thickness=0.15)
gravity_load = GravityLoadAlpaca4d(TimeSeriesType="Constant", GFactor=9.81)
support = SupportAlpaca4d(Point=mc, Tx=True, Ty=True, Tz=True, Rx=True, Ry=True, RZ=True)
asdq4_dkgt = ASDShellQ4Alpaca4d(Mesh=mplane.Mesh, Section=pfs)
assemble_model = AssembleModelAlpaca4d(Element=flatten(asdq4_dkgt), Support=support, Load=gravity_load, Tollerance=0.01)  # -> AlpacaModel, Mass
analysissettings = AnalysisSettingsAlpaca4d()
ra = RunAnalysisAlpaca4d(AlpacaModel=assemble_model.AlpacaModel, Settings=analysissettings)  # -> Log, AlpacaModel
deformed_model_view = DeformedModelViewAlpaca4d(AlpacaModel=ra.AlpacaModel, Step=0, Scale=1)  # -> Line, Mesh, Brick
