# Grasshopper definition Alpaca4d_Karamba3d.gh (Grasshopper 1.0.7)
# plug-ins: Alpaca4d, Karamba3D

matselect = MaterialSelectionKaramba3D(menu=[dropdown(1), dropdown(1)])
uniaxial_material_elastic = UniaxialMaterialElasticAlpaca4d(E=210000000, Eneg=210000000, Eta=0, G=80760000, V=0.3, Rho="7850")
division = Division(A="1", B="100")
division_2 = Division(A="15", B="100")
division_3 = Division(A="50", B="100")
division_4 = Division(A="30", B="100")
rectanglecs = RectangleCSAlpaca4d(Width=division_4, Height=division_3, Material=uniaxial_material_elastic)
circlecs = CircleCSAlpaca4d(Diameter=division_2, Thickness=division, Material=uniaxial_material_elastic)
X = UnitX(Factor=1)
pt = Point(Point(0, 0, 0))
line = LineSDL(Start=pt, Direction=X, Length="12")
crosec = CrossSectionKaramba3D(
    FamilyNameOfCrossSection="DefaultCroSec",
    Material=matselect,
    Height_cm="50",
    UpperFlangeWidth_cm="30",
    LowerFlangeWidth_cm="30",
    mode="Trapezoid")
crosec_2 = CrossSectionKaramba3D(
    FamilyNameOfCrossSection="DefaultCroSec",
    Material=matselect,
    Diameter_cm="15",
    WallThickness_cm="1",
    mode="Circular Hollow")
end = EndPoints(Curve=line)  # -> Start, End
Z = UnitZ(Factor="20")
divide = DivideCurve(Curve=line, Count="20", Kinks=False)  # -> Points, Tangents, Parameters
shatter = Shatter(Curve=line, Parameters=divide.Parameters)
lineelem = CreateLinearElementKaramba3D(
    Line=shatter,
    CrossSection=crosec_2,
    LimitDistance_m=0.005,
    BucklingLengthY_m=-1,
    BucklingLengthZ_m=-1,
    BucklingLengthLT_m=-1,
    Bending=True,
    ToPolylineMaxAngle=0.25,
    ToPolylineTolerance=0.1,
    ToPolylineMaxEdgeLength=0.25,
    New=True,
    Remove=True,
    mode="LineToBeam")  # -> Element, Points, Info
point_load = PointLoadAlpaca4d(Point=end.End, Force=Z, Moment=Vector(0, 0, 0))
supp = SupportKaramba3D(PosInd=pt, Ct_kN_m=Vector(0, 0, 0), Cr_kNm_rad=Vector(0, 0, 0), menu=[buttons(on, on, on, on, on, on)])
Y = UnitY(Factor=1)
force_beam_column = ForceBeamColumnAlpaca4d(Line=shatter, Section=circlecs, ZAxis=Y)
gravity_load = GravityLoadAlpaca4d(GFactor=9.81)
support = SupportAlpaca4d(Point=pt, Tx=True, Ty=True, Tz=True, Rx=True, Ry=True, Rz=True)
loads = LoadsKaramba3D(ForceVector=Z, Local=False, PosInd=end.End, LCase="LC0", mode="Point")
load_pattern = LoadPatternAlpaca4d(Loads=point_load, Factor=1)
load_pattern_2 = LoadPatternAlpaca4d(Loads=gravity_load, Factor=1)
assemble_model = AssembleModelAlpaca4d(Elements=force_beam_column, Supports=support, LoadPatterns=load_pattern_2, Tolerance=0.01)  # -> AlpacaModel, Mass
assemble = AssembleModelKaramba3D(Elem=lineelem.Element, Support=supp, Load=loads, LimitDistance_m=0.005)  # -> Model, Info, Mass_kg, CentreOfGravity, LoadCaseNames
int = Integer()
list = ValueList({"-genBandArpack", "-symmBandLapack", "-fullGenLapack"}, selected="-genBandArpack")
analysissettings = AnalysisSettingsAlpaca4d()
analyse = AnalyseKaramba3D(Model=assemble.Model)  # -> AnalysedModel, MaximumDisplacement_cm, ResultingForce_kN, ChangeOfElasticEnergy_kNm
ra = RunAnalysisAlpaca4d(AlpacaModel=assemble_model.AlpacaModel, Settings=analysissettings)  # -> Log, AlpacaModel
nv = NaturalVibrationAnalysisAlpaca4d(AlpacaModel=assemble_model.AlpacaModel, VibrationModes="10", Solver=list)  # -> Log, AlpacaModel, Eigenvalues, Period, Frequencies
nvibes = NaturalVibrationsKaramba3D(Model=assemble.Model, FromIndex=1, NumberOfModes="10", WithThIIEffects=True, MaximumNumberOfIterations=30, Epsilon=1e-05)  # -> ModelWithVibrationModes, NaturalFrequencies_Hz, ModalMass_kg, ParticipationFactorInGlobalXYAndZDirection
slrz = SerializeAlpaca4d(AlpacaModel=assemble_model.AlpacaModel, Save=Toggle(False))
nodedisp = NodalDisplacementsKaramba3D(AnalysedModel=analyse.AnalysedModel)  # -> Model, flatten(NodalTranslations_m), NodalRotations_rad, DisplacementPosition, LoadCaseIndex
panel = Panel(nvibes.NaturalFrequencies_Hz)
panel_2 = Panel(nv.Frequencies)
nd = NodalDisplacementsAlpaca4d(AlpacaModel=ra.AlpacaModel, History=False, Step=0)  # -> Displacement, Rotation, port, Velocity, Acceleration
panel_3 = Panel(nodedisp.NodalTranslations_m)
panel_4 = Panel(slrz)
panel_5 = Panel(nd.Displacement)
