# Grasshopper definition Cantiliver.gh (Grasshopper 1.0.8)
# plug-ins: Alpaca4d

Z = UnitZ(Factor=1)
pt = Point(Point(0, 0, 0))
line = LineSDL(Start=pt, Direction=Z, Length="6.00")
end = EndPoints(Curve=line)  # -> Start, End
X = UnitX(Factor="10")
panel = Panel("100")  # disabled
X_2 = UnitX(Factor=panel)  # disabled
number_slider = Slider(1000, range=100..1000)
point_load = PointLoadAlpaca4d(Point=end.End, Force=X_2, Moment=Vector(0, 0, 0))  # disabled
linear_time_series = LinearTimeSeriesAlpaca4d(LinearFactor="2")  # -> TimeSeries, Graph
divide = DivideCurve(Curve=line, Count=10, Kinks=False)  # -> Points, Tangents, Parameters
uniaxial_material_elastic = UniaxialMaterialElasticAlpaca4d(E=210000000, Eneg=210000000, Eta=0, G=80760000, V=0.3, Rho=7850)
pline = PolyLine(Vertices=divide.Points, Closed=False)
vec = VectorXYZ(XComponent=number_slider, YComponent=number_slider, ZComponent=number_slider)  # -> Vector, Length
explode = Explode(Curve=pline, Recursive=True)  # -> Segments, Vertices
mp = MassPointAlpaca4d(Point=end.End, TransMass=vec.Vector, RotationalMass=Vector(0, 0, 0))
circlecs = CircleCSAlpaca4d(Diameter=0.15, Thickness=0.01, Material=uniaxial_material_elastic)
support = SupportAlpaca4d(Point=end.Start, Tx=True, Ty=True, Tz=True, Rx=True, Ry=True, Rz=True)
force_beam_column = ForceBeamColumnAlpaca4d(Line=explode.Segments, Section=circlecs)
linearload = LinearLoadAlpaca4d(BeamElement=force_beam_column, Force=X)
load_pattern = LoadPatternAlpaca4d(TimeSeries=linear_time_series.TimeSeries, Loads=flatten([point_load, linearload]), Factor=1)  # -> flatten(LoadPattern)
assemble_model = AssembleModelAlpaca4d(Elements=force_beam_column, Supports=support, LoadPatterns=[mp, load_pattern], Tolerance=0.01)  # -> AlpacaModel, Mass
analysissettings = AnalysisSettingsAlpaca4d(AnalysisSteps="10")
list = ValueList({"-genBandArpack", "-symmBandLapack", "-fullGenLapack"}, selected="-genBandArpack")
ra = RunAnalysisAlpaca4d(AlpacaModel=assemble_model.AlpacaModel, Settings=analysissettings)  # -> Log, AlpacaModel
nv = NaturalVibrationAnalysisAlpaca4d(AlpacaModel=assemble_model.AlpacaModel, VibrationModes="1", Solver=list)  # -> Log, AlpacaModel, Eigenvalues, Period, Frequencies
panel_2 = Panel(nv.Period)
nd = NodalDisplacementsAlpaca4d(AlpacaModel=ra.AlpacaModel, History=False, Step=Slider(9, range=0..9))  # -> Displacement, Rotation, port, Velocity, Acceleration
panel_3 = Panel(nd.Displacement)
