# Grasshopper definition FreeFormRoof.gh (Grasshopper 1.0.8)
# plug-ins: Alpaca4d, LunchBox

crv = Curve([<curve referenced from the Rhino model> x4])
item = ListItem(List=crv, Index=0, Wrap=True)  # -> Item, Item1, Item2, Item3
edgesrf = EdgeSurface(CurveA=item.Item, CurveB=item.Item1, CurveC=item.Item2, CurveD=item.Item3)
neg = Negative(Value=Slider(1.07, range=0.5..2))
offset = OffsetSurface(Surface=edgesrf, Distance=neg, Retrim=True)
merge = Merge(Data1=edgesrf, Data2=offset)
spacetruss_2 = SpaceTrussStructure2(SurfaceA=edgesrf, SurfaceB=offset, UDivisions=10, VDivisions=10)  # -> LinesA, LinesB, Web, Nodes
debrep = DeconstructBrep(Brep=merge)  # -> Faces, Edges, Vertices
cp = ClosestPoint(Point=debrep.Vertices, Cloud=spacetruss_2.Nodes)  # -> ClosestPoint, CPIndex, Distance
entwine = Entwine(Branch00=spacetruss_2.LinesA, Branch01=spacetruss_2.LinesB, Branch02=spacetruss_2.Web, FlattenInputs=True)
linear_time_series = LinearTimeSeriesAlpaca4d(LinearFactor="2")  # -> TimeSeries, Graph
Z = UnitZ(Factor="100")
point_load = PointLoadAlpaca4d(Point=spacetruss_2.Nodes, Force=Z, Moment=Vector(0, 0, 0))
divide = DivideCurve(Curve=entwine, Count="2", Kinks=False)  # -> Points, Tangents, Parameters
uniaxial_material_elastic = UniaxialMaterialElasticAlpaca4d(E=210000000, Eneg=210000000, Eta=0, G=80760000, V=0.3, Rho=7850)
pline = PolyLine(Vertices=divide.Points, Closed=False)
explode = Explode(Curve=pline, Recursive=True)  # -> Segments, Vertices
load_pattern = LoadPatternAlpaca4d(TimeSeries=linear_time_series.TimeSeries, Loads=point_load, Factor=1)
support = SupportAlpaca4d(Point=cp.ClosestPoint, Tx=True, Ty=True, Tz=True, Rx=True, Ry=True, Rz=True)
circlecs = CircleCSAlpaca4d(Diameter=0.15, Thickness=0.01, Material=uniaxial_material_elastic)
panel = Panel(load_pattern)
force_beam_column = ForceBeamColumnAlpaca4d(Line=explode.Segments, Section=circlecs)
assemble_model = AssembleModelAlpaca4d(Elements=flatten(force_beam_column), Supports=flatten(support), LoadPatterns=load_pattern, Tolerance=0.01)  # -> AlpacaModel, Mass
analysissettings = AnalysisSettingsAlpaca4d(AnalysisSteps="1")
list = ValueList({"-genBandArpack", "-symmBandLapack", "-fullGenLapack"}, selected="-genBandArpack")
deconstruct = DeconstructAlpaca4d(Object=analysissettings)  # -> Object_Class, Constraint, Numberer, SystemEquation, Test, Algorithm, Integrator, Analysis, AnalysisStep, Damping
nv = NaturalVibrationAnalysisAlpaca4d(AlpacaModel=assemble_model.AlpacaModel, VibrationModes="24", Solver=list)  # -> Log, AlpacaModel, Eigenvalues, Period, Frequencies
ra = RunAnalysisAlpaca4d(AlpacaModel=assemble_model.AlpacaModel, Settings=analysissettings)  # -> Log, AlpacaModel
clr = ColorsAlpaca4d(GradientIndex=2)
deconstruct_2 = DeconstructAlpaca4d(Object=deconstruct.SystemEquation)  # -> Object_Class, Type
nd = NodalDisplacementsAlpaca4d(AlpacaModel=ra.AlpacaModel, History=False, Step=Slider(0, range=0..9))  # -> Displacement, Rotation, port, Velocity, Acceleration
deformed_model_view = DeformedModelViewAlpaca4d(AlpacaModel=nv.AlpacaModel, Step=Slider(0, range=0..23), Scale="10", Colors=clr)  # -> Line, Mesh, Brick
panel_2 = Panel(nd.Displacement)
mjoin = MeshJoin(Meshes=deformed_model_view.Line)
