# Grasshopper definition connection-design.gh (Grasshopper 1.0.7)
# plug-ins: ONLMapGraph, Kangaroo2 Components, Weaverbird, EleFront, treesloth01, Alpaca4d, MeshEdit Components

box = DomainBox(Base=PlaneXY(0, 0, 0), X=Slider(11, range=1..20), Y=Slider(3, range=1..20), Z=Slider(3, range=1..20))
pop3d = Populate3D(Region=box, Count=100, Seed=5)
voronoi³ = Voronoi3D(Points=pop3d, Box=box)  # -> Cells, Boundary
edges = BrepEdges(Brep=voronoi³.Cells)  # -> Naked, flatten(Interior), NonManifold
dupln = RemoveDuplicateLines(Lines=edges.Interior, Tolerance=0.01)
debrep = DeconstructBrep(Brep=box)  # -> Faces, Edges, Vertices
explode = Explode(Curve=dupln, Recursive=True)  # -> Segments, flatten(Vertices)
duppt = RemoveDuplicatePts(Points=explode.Vertices, Tolerance=0.01)
item = ListItem(List=debrep.Faces, Index=Slider(1, range=0..5), Wrap=True)
midpt = CurveMiddle(Curve=dupln)
pull = PullPoint(Point=duppt, Geometry=item, ClosestOnly=True)  # -> ClosestPoint, Distance
pull_2 = PullPoint(Point=midpt, Geometry=item, ClosestOnly=True)  # -> ClosestPoint, Distance
smaller = SmallerThan(FirstNumber=pull.Distance, SecondNumber="0.01")  # -> SmallerThan, OrEqualTo
smaller_2 = SmallerThan(FirstNumber=pull_2.Distance, SecondNumber="0.01")  # -> SmallerThan, OrEqualTo
cull = CullPattern(List=duppt, CullPattern=smaller.SmallerThan)
cull_2 = CullPattern(List=dupln, CullPattern=invert(smaller_2.SmallerThan))

uniaxial_material_elastic = UniaxialMaterialElasticAlpaca4d(E="3.3e+10", G="0.20", Rho="2500")

crv = Curve(cull_2)
len = Length(Curve=crv)
support_points = Point(cull)
larger = LargerThan(FirstNumber=len, SecondNumber=0.01)  # -> LargerThan, OrEqualTo
toggle = BooleanToggle(True)
circlecs = CircleCSAlpaca4d(Diameter="0.1", Thickness="0.01", Material=uniaxial_material_elastic)
cull_3 = CullPattern(List=crv, CullPattern=larger.LargerThan)
force_beam_column = ForceBeamColumnAlpaca4d(Line=cull_3, Section=circlecs)
support = SupportAlpaca4d(Point=support_points, Tx=toggle, Ty=toggle, Tz=toggle, Rx=toggle, Ry=toggle, RZ=toggle)
gravity_load = GravityLoadAlpaca4d(TimeSeriesType="Constant", GFactor=1)
analysisstep = AnalysisStepAlpaca4d(NumIncr="1")
list = ValueList({"BandGen", "BandSPD", "ProfileSPD", "SuperLU", "UmfPack", "FullGeneral", "SparseSYM"}, selected="BandSPD")
assemble_model = AssembleModelAlpaca4d(Element=force_beam_column, Support=support, Load=gravity_load, Tollerance=0.01)  # -> AlpacaModel, MassForce
analysissettings = AnalysisSettingsAlpaca4d(System=list, AnalysisSteps=analysisstep)

# ---- group: Run Analysis (Alpaca4d)
ra = RunAnalysisAlpaca4d(AlpacaModel=assemble_model.AlpacaModel, Settings=analysissettings)  # -> Log, AlpacaModel

# ----
modelview = ModelViewAlpaca4d(
    AlpacaModel=ra.AlpacaModel,
    Extruded=False,
    Load=Toggle(False),
    LoadFactor=1,
    Support=Toggle(True),
    SupportFactor=1,
    Constraint=False)  # -> AlpacaModel, Info
deformed_model_view = DeformedModelViewAlpaca4d(AlpacaModel=ra.AlpacaModel, Step=0, Scale=Slider(0.17, range=0..1))  # -> Line, Mesh, Brick

# ----
# a = x.Id - 1
# Point where to extract
# the forces
ds = DisassembleModelAlpaca4d(AlpacaModel=ra.AlpacaModel)  # -> out, Points, Beam
# ---------- ds: Python ----------
"""
Disassemble a Model
-
    Args:
        AlpacaModel:
    Returns:
        Points:
        threeNdfPoints:
        sixNdfPoints:
        
        Beam:
        Shell:
        Brick:
        Support:
        Constraint:
        TimeSeries:
        Load:
        Material:
"""

ghenv.Component.Name = "Disassemble Model (Alpaca4d)"
ghenv.Component.NickName = 'DS'
ghenv.Component.Message = "Disassemble Model (Alpaca4d)"


import sys
import Rhino.Geometry as rg
import Grasshopper as gh


## add alpaca install directory to system path
checkData = True


if not AlpacaModel:
    checkData = False
    msg = "Input parameter AlpacaModel failed to collect data"
    ghenv.Component.AddRuntimeMessage(gh.Kernel.GH_RuntimeMessageLevel.Warning, msg)

if checkData:
    Points = AlpacaModel.UniquePoints

    
    Beam = AlpacaModel.Beams
# ---------- end ds ----------
db = DisassembleBeamElementAlpaca4d(BeamElement=ds.Beam)  # -> CurveAxis
# ---------- db: Python ----------
"""
Disassemble a Beam Element
-
    Args:
        BeamElement:
    Returns:
        CurveAxis:
        CrossSection:
        Z_Axis:
        iNode:
        jNode:
        eleTag:
        ndf:
        GeomTransfType:
        ElementClass:
"""

ghenv.Component.Name = "Disassemble Beam Element (Alpaca4d)"
ghenv.Component.NickName = 'DB'
ghenv.Component.Message = "Disassemble Beam(Alpaca4d)"


import sys
import Rhino.Geometry as rg
import Grasshopper as gh


## add alpaca install directory to system path



checkData = True




if checkData:
    CurveAxis = BeamElement.Curve
# ---------- end db ----------
lng = ListLength(List=ds.Points)
series = Series(Start=0, Step=1, Count=lng)
textdot = DefineTextDot(Text=series, Location=ds.Points, Font="Arial", Size=14)
item_2 = ListItem(List=ds.Points, Index="44", Wrap=True)
custgraph = CustomGraph(Cs=db)  # -> G, As, Ns
pt = Point(item_2)
findnode = FindNode(MarshallingSignalParameter=custgraph.G, Ps=pt)
adjac = NodeAdjacent(G=custgraph.G, N=findnode)  # -> As, Ns, Dir, Deg
python = GhPythonScript(x=adjac.As)  # -> out, a
# ---------- python: Python ----------
a = x.Id - 1
# ---------- end python ----------
panel_2 = Panel(python.a)
item_3 = ListItem(List=db, Index=panel_2, Wrap=True)

crv_2 = Curve(item_3)
explode_2 = Explode(Curve=crv_2, Recursive=True)  # -> Segments, Vertices
shift = ShiftPaths(Data=explode_2.Vertices, Offset=-1)
cullpt = CullDuplicates(Points=shift, Tolerance="0.01", CullMode=1)  # -> Points, Indices, Valence
item_4 = ListItem(List=cullpt.Indices, Index=0, Wrap=True)
item_5 = ListItem(List=shift, Index=item_4, Wrap=True)
python_2 = GhPythonScript(iCurve=simplify(crv_2), iPoint=simplify(item_5))  # -> out, a
# ---------- python_2: Python ----------
import Rhino.Geometry as rg


start_point = iCurve.PointAtStart

distance = start_point.DistanceTo(iPoint)

if not(distance <= 0.01):
    iCurve.Reverse()
else:
    iCurve = iCurve

a = iCurve
# ---------- end python_2 ----------
line = LineSDL(Start=item_5, Direction=python_2.a, Length="0.25")
mp = MultiPipe(Curves=line, NodeSize="0.05", EndOffset=1, StrutSize=1, Segment=0, KinkAngle=0.6, CubeFit=0, Caps=0)
data = Data(mp)

meshsubd = MeshFromSubD(SubD=data, Density="3")
wbnaked = WeaverbirdsNakedBoundary(MeshClosedPolylines=meshsubd)
split = SplitList(List=wbnaked, Index="1")  # -> ListA, ListB
explode_3 = Explode(Curve=split.ListB, Recursive=True)  # -> Segments, flatten(Vertices)
explode_4 = Explode(Curve=split.ListA, Recursive=True)  # -> Segments, Vertices
cullpt_2 = CullDuplicates(Points=explode_3.Vertices, Tolerance="0.001", CullMode=3)  # -> Points, Indices, Valence
cullpt_3 = CullDuplicates(Points=explode_4.Vertices, Tolerance="0.001", CullMode=3)  # -> Points, Indices, Valence
fcircle = CircleFit(Points=cullpt_2.Points)  # -> Circle, Radius, Deviation
darc = DeconstructArc(Arc=fcircle.Circle)  # -> BasePlane, Radius, Angle
deplane = DeconstructPlane(Plane=darc.BasePlane)  # -> Origin, XAxis, YAxis, ZAxis
eim = ElasticIsotropicMaterialAlpaca4d(E="2.1e9", V="0.3", Rho="7850")
vdisex = VectorDisplayEx(Point=deplane.Origin, Vector=deplane.YAxis, Colour=RGB(0, 0, 0), Width=2)
toggle_2 = BooleanToggle(True)
toggle_3 = BooleanToggle(False)
pfs = PlateFiberSectionAlpaca4d(Thickness="0.004", Material=eim)
pt_2 = Point(cullpt_3.Points)
explode_5 = MeshExplode(Mesh=meshsubd, Interpolate=False)
multiplication = Multiplication(A=deplane.YAxis, B="2000")
constant_time_series = ConstantTimeSeriesAlpaca4d(LoadFactor=1)  # -> TimeSeries, Graph
support_2 = SupportAlpaca4d(Point=pt_2, Tx=toggle_2, Ty=toggle_2, Tz=toggle_2, Rx=toggle_3, Ry=toggle_3, RZ=toggle_3)
asdq4 = ASDShellQ4Alpaca4d(Mesh=explode_5, Section=pfs)  # -> flatten(Element)
point_load = PointLoadAlpaca4d(Point=cullpt_2.Points, Force=multiplication, Moment=Vector(0, 0, 0), TimeSeries=constant_time_series.TimeSeries)
assemble_model_2 = AssembleModelAlpaca4d(Element=flatten(asdq4), Support=flatten(support_2), Load=flatten(point_load), Tollerance="0.001")  # -> AlpacaModel, MassForce
analysisstep_2 = AnalysisStepAlpaca4d(NumIncr="1")
analysissettings_2 = AnalysisSettingsAlpaca4d(AnalysisSteps=analysisstep_2)

# ---- group: Run Analysis (Alpaca4d)
ra_2 = RunAnalysisAlpaca4d(AlpacaModel=assemble_model_2.AlpacaModel, Settings=analysissettings_2)  # -> Log, AlpacaModel

# ----
clr = ColorsAlpaca4d(gradIndex=Slider(11, range=0..12))  # -> reverse(colors); inputs gradIndex: Int32
#   port colors: A series of colors to be plugged into the "Ladybug_Legend Parameters" component.
# ---------- clr: Python ----------
"""
Preset of gradient colors perfect for Data Visualisation
    Inputs:
        gradIndex: An index refering to one of the following possible gradients:
            0 - Orignal Ladybug
            1 - Nuanced Ladybug
            2 - Multi-colored Ladybug
            3 - Ecotect
            4 - Thermal Comfort Percentage
            5 - Thermal Comfort Colors
            6 - Shade Benefit/Harm
            7 - Shade Harm
            8 - Shade Benefit
            9 - CFD Colors 1
            10 - Radiation Benefit
            11 - Gsa10 Colour
            12 - Gsa9 Colour
    Returns:
        customColors: A series of colors.
"""

ghenv.Component.Name = "Colors (Alpaca4d)"
ghenv.Component.NickName = 'CLR'
ghenv.Component.Message = 'Colors (Alpaca4d)'

import scriptcontext as sc
import Grasshopper.Kernel as gh
import System

gradientLibrary = {
        0: [System.Drawing.Color.FromArgb(75, 107, 169), System.Drawing.Color.FromArgb(115, 147, 202), System.Drawing.Color.FromArgb(170, 200, 247), System.Drawing.Color.FromArgb(193, 213, 208), System.Drawing.Color.FromArgb(245, 239, 103), System.Drawing.Color.FromArgb(252, 230, 74), System.Drawing.Color.FromArgb(239, 156, 21), System.Drawing.Color.FromArgb(234, 123, 0), System.Drawing.Color.FromArgb(234, 74, 0), System.Drawing.Color.FromArgb(234, 38, 0)],
        1: [System.Drawing.Color.FromArgb(49,54,149), System.Drawing.Color.FromArgb(69,117,180), System.Drawing.Color.FromArgb(116,173,209), System.Drawing.Color.FromArgb(171,217,233), System.Drawing.Color.FromArgb(224,243,248), System.Drawing.Color.FromArgb(255,255,191), System.Drawing.Color.FromArgb(254,224,144), System.Drawing.Color.FromArgb(253,174,97), System.Drawing.Color.FromArgb(244,109,67), System.Drawing.Color.FromArgb(215,48,39), System.Drawing.Color.FromArgb(165,0,38)],
        2: [System.Drawing.Color.FromArgb(4,25,145), System.Drawing.Color.FromArgb(7,48,224), System.Drawing.Color.FromArgb(7,88,255), System.Drawing.Color.FromArgb(1,232,255), System.Drawing.Color.FromArgb(97,246,156), System.Drawing.Color.FromArgb(166,249,86), System.Drawing.Color.FromArgb(254,244,1), System.Drawing.Color.FromArgb(255,121,0), System.Drawing.Color.FromArgb(239,39,0), System.Drawing.Color.FromArgb(138,17,0)],
        3: [System.Drawing.Color.FromArgb(0,0,255), System.Drawing.Color.FromArgb(53,0,202), System.Drawing.Color.FromArgb(107,0,148), System.Drawing.Color.FromArgb(160,0,95), System.Drawing.Color.FromArgb(214,0,41), System.Drawing.Color.FromArgb(255,12,0), System.Drawing.Color.FromArgb(255,66,0), System.Drawing.Color.FromArgb(255,119,0), System.Drawing.Color.FromArgb(255,173,0), System.Drawing.Color.FromArgb(255,226,0), System.Drawing.Color.FromArgb(255,255,0)],
        4: [System.Drawing.Color.FromArgb(0,0,0), System.Drawing.Color.FromArgb(110,0,153), System.Drawing.Color.FromArgb(255,0,0), System.Drawing.Color.FromArgb(255,255,102), System.Drawing.Color.FromArgb(255,255,255)],
        5: [System.Drawing.Color.FromArgb(0,136,255), System.Drawing.Color.FromArgb(200,225,255), System.Drawing.Color.FromArgb(255,255,255), System.Drawing.Color.FromArgb(255,230,230), System.Drawing.Color.FromArgb(255,0,0)],
        6: [System.Drawing.Color.FromArgb(5,48,97), System.Drawing.Color.FromArgb(33,102,172), System.Drawing.Color.FromArgb(67,147,195), System.Drawing.Color.FromArgb(146,197,222), System.Drawing.Color.FromArgb(209,229,240), System.Drawing.Color.FromArgb(255,255,255), System.Drawing.Color.FromArgb(253,219,199), System.Drawing.Color.FromArgb(244,165,130), System.Drawing.Color.FromArgb(214,96,77), System.Drawing.Color.FromArgb(178,24,43), System.Drawing.Color.FromArgb(103,0,31)],
        7: [System.Drawing.Color.FromArgb(255,255,255), System.Drawing.Color.FromArgb(253,219,199), System.Drawing.Color.FromArgb(244,165,130), System.Drawing.Color.FromArgb(214,96,77), System.Drawing.Color.FromArgb(178,24,43), System.Drawing.Color.FromArgb(103,0,31)],
        8: [System.Drawing.Color.FromArgb(255,255,255), System.Drawing.Color.FromArgb(209,229,240), System.Drawing.Color.FromArgb(146,197,222), System.Drawing.Color.FromArgb(67,147,195), System.Drawing.Color.FromArgb(33,102,172), System.Drawing.Color.FromArgb(5,48,97)],
        9: [System.Drawing.Color.FromArgb(0,16,120), System.Drawing.Color.FromArgb(38,70,160), System.Drawing.Color.FromArgb(5,180,222), System.Drawing.Color.FromArgb(16,180,109), System.Drawing.Color.FromArgb(59,183,35), System.Drawing.Color.FromArgb(143,209,19), System.Drawing.Color.FromArgb(228,215,29), System.Drawing.Color.FromArgb(246,147,17), System.Drawing.Color.FromArgb(243,74,0), System.Drawing.Color.FromArgb(255,0,0)],
        10: [System.Drawing.Color.FromArgb(0,191,48), System.Drawing.Color.FromArgb(255,238,184), System.Drawing.Color.FromArgb(255,0,0)],
        11: [System.Drawing.Color.FromArgb(204,0,71), System.Drawing.Color.FromArgb(255,182,71), System.Drawing.Color.FromArgb(206,255,115), System.Drawing.Color.FromArgb(26,180, 214),System.Drawing.Color.FromArgb(0,0,207)],
        12: [System.Drawing.Color.FromArgb(255, 51, 51), System.Drawing.Color.FromArgb(255, 170, 51), System.Drawing.Color.FromArgb(255, 255, 51), System.Drawing.Color.FromArgb(170, 255, 125), System.Drawing.Color.FromArgb(51, 255, 231), System.Drawing.Color.FromArgb(51, 170, 255), System.Drawing.Color.FromArgb(51,51, 255)]}
colors = gradientLibrary[gradIndex]
# ---------- end clr ----------
deformed_model_view_2 = DeformedModelViewAlpaca4d(AlpacaModel=ra_2.AlpacaModel, Step=0, Scale=Slider(0, range=0..1), Colors=clr)  # -> Line, Mesh, Brick
