# Grasshopper definition deconstruct-anything.gh (Grasshopper 1.0.8)
# plug-ins: Alpaca4d

n_mm2 = Panel("210000")
uniaxial_material_elastic = UniaxialMaterialElasticAlpaca4d(E=n_mm2, V="0.30", Rho="0.00000785")
mm = Panel("300")
mm_2 = Panel("4")
pt = Point(Point(0, 0, 0))
circlecs = CircleCSAlpaca4d(Diameter=mm, Thickness=mm_2, Material=uniaxial_material_elastic)
unit_z = UnitZ(Factor=1)
line = LineSDL(Start=pt, Direction=Vector(0, 0, 1), Length=1)
point = Point(Point(0, 0, 0))
constant_time_series_alpaca4d = ConstantTimeSeriesAlpaca4d(LoadFactor=1)  # -> TimeSeries, Graph
point_load_alpaca4d = PointLoadAlpaca4d(Point=point, Force=unit_z, Moment=Vector(0, 0, 0))
force_beam_column = ForceBeamColumnAlpaca4d(Line=line, Section=circlecs)
load_pattern_alpaca4d = LoadPatternAlpaca4d(TimeSeries=constant_time_series_alpaca4d.TimeSeries, Loads=point_load_alpaca4d, Factor=1, mode="PlainPattern")
deconstruct_alpaca4d = DeconstructAlpaca4d(Object=load_pattern_alpaca4d)  # -> Object_Class, Load, TimeSeries, PatternType, Factor, Id, Dof, Velocity
deconstruct = DeconstructAlpaca4d(Object=force_beam_column)  # -> Object_Class, Curve, Section, GeomTransf, BeamIntegration, LocalZAxis, Type, Id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
deconstruct_alpaca4d_2 = DeconstructAlpaca4d(Object=deconstruct_alpaca4d.TimeSeries)  # -> Object_Class, Type, CFactor, Id
deconstruct_alpaca4d_3 = DeconstructAlpaca4d(Object=deconstruct_alpaca4d.Load)  # -> Object_Class, Pos, Force, Moment, Ndf, Type, Id, PatternTag, TimeSeries
deconstruct_2 = DeconstructAlpaca4d(Object=deconstruct.Section)  # -> Object_Class, Id, Material, SectionName, Diameter, Thickness, Area, AlphaY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
deconstruct_3 = DeconstructAlpaca4d(Object=deconstruct_2.Material)  # -> Object_Class, Id, MatName, E, Eneg, Eta, G, Nu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
