# Grasshopper definition earthquake.gh (Grasshopper 1.0.8)
# plug-ins: Alpaca4d

pop2d = Populate2D(Region={Plane=PlaneXY(0, 0, 0), Size=Domain2(u=0..20, v=0..10)}, Count="50", Seed=1)
random = Random(Range="4 to 12", Number=1, Seed=pop2d)  # -> flatten(Random)
line = LineSDL(Start=pop2d, Direction=Vector(0, 0, 1), Length=random)
panel = Panel("""0
0.01
0.02
5""")
panel_2 = Panel("""0
1
0
0""")
end = EndPoints(Curve=line)  # -> Start, End
panel_3 = Panel("""-.4524259E-02  -.5453609E-02  -.3879534E-02  -.5966478E-04   .1453968E-03
   .3141729E-03   .4242131E-03   .5230633E-03   .6191808E-03   .7135598E-03
   .8102202E-03   .9037519E-03   .9789034E-03   .1022652E-02   .1030402E-02
   .1008570E-02   .9681240E-03   .9171226E-03   .8604907E-03   .7983539E-03
   .7297761E-03   .6620882E-03   .6072410E-03   .5730847E-03   .5632766E-03
   .5751092E-03   .5944994E-03   .6041827E-03   .5949643E-03   .5639703E-03
   .5158626E-03   .4628568E-03   .4094630E-03   .3564320E-03   .3189031E-03
   .3207575E-03   .3747367E-03   .4634662E-03   .5513970E-03   .6230334E-03
   .6835686E-03   .7298884E-03   .7527032E-03   .7525612E-03   .7358731E-03
   .7119356E-03   .6901599E-03   .6724041E-03   .6500149E-03   .6118034E-03
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""")
path_time_series_alpaca4d = PathTimeSeriesAlpaca4d(Times=panel, Values=panel_2, LoadFactor=1)  # -> TimeSeries, Graph
quick_graph = QuickGraph(path_time_series_alpaca4d.Graph, SortOrder=0)
uniaxial = Uniaxial(E=210000000, Eneg=210000000, Eta=0, G=90760000, V=0.3, Rho="2500", mode="UniaxialElastic")
crv = Curve(line)
pt = Point(end.End)
pt_2 = Point(end.Start)
Y = UnitY(Factor="20")
toggle = BooleanToggle(True)
divide = DivideCurve(Curve=crv, Count="10", Kinks=False)  # -> Points, Tangents, Parameters
pline = PolyLine(Vertices=divide.Points, Closed=False)
rectanglecs_alpaca4d = RectangleCSAlpaca4d(Width="1", Height="0.50", Material=uniaxial)
point_load_alpaca4d = PointLoadAlpaca4d(Point=pt, Force=Y, Moment=Vector(0, 0, 0))
support = SupportAlpaca4d(Point=pt_2, Tx=toggle, Ty=toggle, Tz=toggle, Rx=toggle, Ry=toggle, RZ=toggle)
explode = Explode(Curve=pline, Recursive=True)  # -> flatten(Segments), Vertices
load_pattern_alpaca4d = LoadPatternAlpaca4d(TimeSeries=path_time_series_alpaca4d.TimeSeries, Loads=point_load_alpaca4d, Factor=1, mode="PlainPattern")
force_beam_column = ForceBeamColumnAlpaca4d(Line=explode.Segments, Section=rectanglecs_alpaca4d)
assemblemodel_alpaca4d = AssembleModelAlpaca4d(Elements=force_beam_column, Supports=support, LoadPatterns=load_pattern_alpaca4d, Tolerance=0.01)  # -> AlpacaModel, Mass
value_list = ValueList({"Static", "Transient"}, selected="Transient")
analysisstep = AnalysisStepAlpaca4d(NumIncr="1000", Dt="0.005")
damping = DampingAlpaca4d(AlphaM=0, BetaKCurr=0, BetaKInit=0, BetaKComm="0.001")
integrator_alpaca4d = IntegratorAlpaca4d(Gamma=0.5, Beta=0.25, mode="Newmark")
analysissettings = AnalysisSettingsAlpaca4d(Damping=damping, Integrator=integrator_alpaca4d, AnalysisType=value_list, AnalysisSteps=analysisstep)
run_analysis_alpaca4d = RunAnalysisAlpaca4d(AlpacaModel=assemblemodel_alpaca4d.AlpacaModel, Settings=analysissettings, settings=True)  # -> Log, AlpacaModel
nd = NodalDisplacementsAlpaca4d(AlpacaModel=run_analysis_alpaca4d.AlpacaModel, History=Toggle(True), Step=Slider(0, range=0..100))  # -> Displacement, Rotation, port, Velocity, Acceleration
flip = FlipMatrix(Data=nd.Rotation)
devec = DeconstructVector(Vector=flip)  # -> XComponent, YComponent, ZComponent
graph = QuickGraph(devec.XComponent, SortOrder=0)
colors_alpaca4d = ColorsAlpaca4d(GradientIndex=0)
counter = CounterAlpaca4d(Run=Toggle(False), Reset=Button(), Interval="1")  # -> Counter; inputs Run: Boolean, Reset: Boolean
# ---------- counter: Python ----------
"""Counter
    Inputs:
        Run:
        Reset:
        Interval: how fast it will update (milliseconds)
    Output:
        Counter:"""

__author__ = "Marco Pellegrino"
__contact__ = "pellegrino.marco@icloud.com"
__linkedIn__ = "https://www.linkedin.com/in/mp0110/"

ghenv.Component.Name = "Counter (Alpaca4d)"
ghenv.Component.NickName = 'Counter'
ghenv.Component.Message = "Counter (Alpaca4d)"


import Grasshopper as gh
import math


def updateComponent(interval):
    
    """ Updates this component, similar to using a grasshopper timer """
    
    # Define callback action
    def callBack(e):
        ghenv.Component.ExpireSolution(False)
        
    # Get grasshopper document
    ghDoc = ghenv.Component.OnPingDocument()
    
    # Schedule this component to expire
    ghDoc.ScheduleSolution(interval,gh.Kernel.GH_Document.GH_ScheduleDelegate(callBack)) # Note that the first input here is how often to update the component (in milliseconds)


Interval = 1 if Interval is None else Interval


# Instantiate/reset persisent starting counter variable
if "myCounter" not in globals() or Reset:
    myCounter = 0

# Update the variable and component
if Run and not Reset:
    myCounter +=1
    updateComponent(Interval)

# Output counter
Counter = myCounter
# ---------- end counter ----------
panel_4 = Panel(counter)
deformed_model_view = DeformedModelViewAlpaca4d(AlpacaModel=run_analysis_alpaca4d.AlpacaModel, Step=counter, Scale="4000", Colors=colors_alpaca4d)  # -> Line, Mesh, Brick
