# Grasshopper definition meshloft-meshbrick.gh (Grasshopper 1.0.8)
# plug-ins: treesloth01, Alpaca4d, Human

number_slider = Slider(12, range=5..20)
nurbscrv = Curve(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)
nurbscrv_2 = Curve(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)
divide_curve = DivideCurve(Curve=nurbscrv, Count=number_slider, Kinks=False)  # -> Points, Tangents, Parameters
divide_curve_2 = DivideCurve(Curve=nurbscrv_2, Count=number_slider, Kinks=False)  # -> Points, Tangents, Parameters
entwine = Entwine(Branch00=divide_curve.Points, Branch01=divide_curve_2.Points, FlattenInputs=True)
polyline = PolyLine(Vertices=entwine, Closed=False)
shift_paths = ShiftPaths(Data=polyline, Offset=-1)
list_item = ListItem(List=shift_paths, Index=0, Wrap=True)  # -> Item, Item1
number = Number(Slider(7, range=2..20))
endcrv = Curve(list_item.Item1)
startcrv = Curve(list_item.Item)
range = Range(Domain=Domain(0, 1), Steps=number)
tween_curve = TweenCurve(CurveA=startcrv, CurveB=endcrv, Factor=range, BlendType=0)
curve = Curve(tween_curve)
meshloft_alpaca4d = MeshLoftAlpaca4d(Polylines=curve)
mesh = Mesh(meshloft_alpaca4d)
mesh_edges = MeshEdges(Mesh=mesh)  # -> NakedEdges, InteriorEdges, NonManifoldEdges
colour_swatch = ColourSwatch(SwatchColor=RGB(125, 0, 209))
custom_preview_lineweights = CustomPreviewLineweights(Geometry=[mesh_edges.NakedEdges, mesh_edges.InteriorEdges], Shader=colour_swatch, Absolute=False)
custom_preview = CustomPreview(Geometry=mesh, Material=colour_swatch)

# ----
# MeshLoft
polyline_2 = Curve(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)
unit_y = UnitY(Factor=Slider(21.2, range=10..50))
move = Move(Geometry=polyline_2, Motion=unit_y)  # -> Geometry, Transform
number_2 = Number(Slider(20, range=2..20))
endcrv_2 = Curve(move.Geometry)
startcrv_2 = Curve(polyline_2)
range_2 = Range(Domain=Domain(0, 1), Steps=number_2)
# The polylines must have the same number of vertices
# in order to have MeshLoft to properly compute a mesh
tween_curve_2 = TweenCurve(CurveA=startcrv_2, CurveB=endcrv_2, Factor=range_2, BlendType=0)
curve_2 = Curve(tween_curve_2)
meshloft_alpaca4d_2 = MeshLoftAlpaca4d(Polylines=curve_2)
mesh_2 = Mesh(meshloft_alpaca4d_2)
colour_swatch_2 = ColourSwatch(SwatchColor=RGB(255, 0, 0))
mesh_edges_2 = MeshEdges(Mesh=mesh_2)  # -> NakedEdges, InteriorEdges, NonManifoldEdges
custom_preview_2 = CustomPreview(Geometry=mesh_2, Material=colour_swatch_2)
custom_preview_lineweights_2 = CustomPreviewLineweights(Geometry=[mesh_edges_2.NakedEdges, mesh_edges_2.InteriorEdges], Shader=colour_swatch_2, Absolute=False)

cull_duplicates = CullDuplicates(Tolerance=0.1, CullMode=3)  # -> Points, Indices, Valence

quad_remesh_settings = QuadRemeshSettings(TargetCount="50", AdaptiveSize=0, AdaptiveCount=False, HardEdges=False, SeamEdges=0, Symmetry=0, GuideCurves=0)
# MeshSeriesToBrick
closedcurve = Curve(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)
surface = Surface(closedcurve)
quad_remesh = QuadRemesh(Geometry=surface, Settings=quad_remesh_settings)
series = Series(Start=0, Step=1, Count=10)
unit_z = UnitZ(Factor=series)
# The meshes must have the same topology
move_2 = Move(Geometry=quad_remesh, Motion=unit_z)  # -> Geometry, Transform
colour_swatch_3 = ColourSwatch(SwatchColor=RGB(31, 67, 145))

mesh_3 = Mesh(move_2.Geometry)

meshseriestobrick_alpaca4d = MeshSeriesToBrickAlpaca4d(Meshes=mesh_3, Closed=False)
mesh_4 = Mesh(meshseriestobrick_alpaca4d)
mesh_edges_3 = MeshEdges(Mesh=mesh_4)  # -> NakedEdges, InteriorEdges, NonManifoldEdges
custom_preview_3 = CustomPreview(Geometry=mesh_4, Material=colour_swatch_3)
custom_preview_lineweights_3 = CustomPreviewLineweights(Geometry=[mesh_edges_3.NakedEdges, mesh_edges_3.InteriorEdges], Shader=colour_swatch_3, Absolute=False)

curve_3 = Curve(reparameterize(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))
curve_4 = Curve(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)
range_3 = Range(Domain=Domain(0, 1), Steps=10)
mesh_plane = MeshPlane(Boundary=curve_4, WidthCount="5", HeightCount="5")  # -> Mesh, Area
perp_frame = PerpFrame(Curve=curve_3, Parameter=range_3)
orient = Orient(Geometry=mesh_plane.Mesh, Source=curve_4, Target=perp_frame)  # -> Geometry, Transform
colour_swatch_4 = ColourSwatch(SwatchColor=RGB(145, 48, 0))

mesh_5 = Mesh(orient.Geometry)

meshseriestobrick_alpaca4d_2 = MeshSeriesToBrickAlpaca4d(Meshes=mesh_5, Closed=False)
mesh_6 = Mesh(meshseriestobrick_alpaca4d_2)
mesh_edges_4 = MeshEdges(Mesh=mesh_6)  # -> NakedEdges, InteriorEdges, NonManifoldEdges
custom_preview_lineweights_4 = CustomPreviewLineweights(Geometry=[mesh_edges_4.NakedEdges, mesh_edges_4.InteriorEdges], Shader=colour_swatch_4, Absolute=False)
custom_preview_4 = CustomPreview(Geometry=mesh_6, Material=colour_swatch_4)
