# Grasshopper definition moment-curvature.gh (Grasshopper 1.0.8)
# plug-ins: Alpaca4d, Wombat

number = Number(expr("x/2000", Slider(300, range=100..500)))
number_2 = Number(expr("x/2000", Slider(500, range=100..500)))
construct_domain = ConstructDomain(DomainStart=expr("-x", number), DomainEnd=number)
construct_domain_2 = ConstructDomain(DomainStart=expr("-x", number_2), DomainEnd=number_2)
rectangle = Rectangle(Plane=PlaneXY(0, 0, 0), XSize=construct_domain, YSize=construct_domain_2, Radius=0)  # -> Rectangle, Length
geometry = Geometry(rectangle.Rectangle)
quad_remesh_settings = QuadRemeshSettings(TargetCount="500", AdaptiveSize=0, AdaptiveCount=False, HardEdges=False, SeamEdges=0, Symmetry=0, GuideCurves=0)
number_3 = Number(expr("-x/1000", "30"))
boundary_surfaces = BoundarySurfaces(Edges=geometry)
mm = Panel("24")
offset_curve_loose = OffsetCurveLoose(Curve=rectangle.Rectangle, Distance=number_3)
number_4 = Number(expr("x/2000", mm))
quad_remesh = QuadRemesh(Geometry=boundary_surfaces, Settings=quad_remesh_settings)
concrete01_alpaca4d = Concrete01Alpaca4d(MaterialName="C25/30", Fco=-25000, Fcu=-20000, EpsilonCo=-0.002, EpsilonCu=-0.0035, MinMax=False)
explode = Explode(Curve=offset_curve_loose, Recursive=True)  # -> Segments, Vertices
circle = Circle(Plane=PlaneXY(0, 0, 0), Radius=number_4)
reinforcingsteel_alpaca4d = ReinforcingSteelAlpaca4d(MaterialName="B450C", Fy=450000, Fu=540000, Es=200000000, Esh=2000000, Esh_2=0.008, Eult=0.075, MinMax=False)
area = Area(Geometry=circle)  # -> Area, Centroid
patch_alpaca4d = PatchAlpaca4d(Mesh=quad_remesh, Material=concrete01_alpaca4d)
list_item = ListItem(List=explode.Segments, Index=0, Wrap=True)  # -> Item, Item1, Item2
merge = Merge(Data1=list_item.Item, Data2=list_item.Item2)
panel = Panel("""8
3""")
layer_fiber_alpaca4d = LayerFiberAlpaca4d(Curve=merge, NumberOfFibers=panel, AreaFiber=area.Area, Material=reinforcingsteel_alpaca4d)
fiber_section_alpaca4d = FiberSectionAlpaca4d(Layer=layer_fiber_alpaca4d, Patch=patch_alpaca4d, GJ=100000000)
momentcurvature_alpaca4d = MomentCurvatureAlpaca4d(FiberSection=fiber_section_alpaca4d, Axial="-400", Direction="0", NumIncr="1000", MaxPhi="0.04")  # -> Log, N, My, Mz, Ε, Κy, Κz, FiberStressStrain
fiber_stress_strain_alpaca4d = FiberStressStrainAlpaca4d(FiberStressStrain=momentcurvature_alpaca4d.FiberStressStrain)  # -> flatten(FiberPoint), Stress, Strain
bounds = Bounds(Numbers=flatten(fiber_stress_strain_alpaca4d.Stress))
deconstruct_domain = DeconstructDomain(Domain=bounds)  # -> Start, End
absolute = Absolute(Value=deconstruct_domain.End)
absolute_2 = Absolute(Value=deconstruct_domain.Start)
maximum = Maximum(A=absolute_2, B=absolute)
multiplication = Multiplication(A=maximum, B=2)
list_item_2 = ListItem(List=fiber_stress_strain_alpaca4d.Stress, Index=Slider(999, range=0..999), Wrap=True)
deconstruct_alpaca4d = DeconstructAlpaca4d(Object=fiber_stress_strain_alpaca4d.FiberPoint)  # -> Object_Class, Index, Pos, Area, Material, Stress, Strain
centered_domain = CenteredDomain(DomainSize=multiplication)
deconstruct_domain_2 = DeconstructDomain(Domain=bounds)  # -> Start, End
gradient = Gradient(
    LowerLimit=deconstruct_domain_2.Start,
    UpperLimit=deconstruct_domain_2.End,
    Parameter=list_item_2,
    stops=[0: RGB(48, 18, 59), 0.0294: RGB(56, 40, 112), 0.0588: RGB(63, 62, 156), 0.0882: RGB(68, 82, 193), 0.118: RGB(70, 102, 221), 0.147: RGB(71, 122, 241)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])
custom_preview = CustomPreview(Geometry=deconstruct_alpaca4d.Pos, Material=flatten(gradient))
