# Grasshopper definition brick.gh (Grasshopper 1.0.7)
# plug-ins: Alpaca4d, Kangaroo2 Components

rectangle = Rectangle(Plane=PlaneXY(0, 0, 0), XSize="2", YSize="6", Radius=0)  # -> Rectangle, Length
mplane = MeshPlane(Boundary=rectangle.Rectangle, WidthCount=10, HeightCount=10)  # -> Mesh, Area
series = Series(Start=0, Step=1, Count="20")
Z = UnitZ(Factor=series)
move = Move(Geometry=mplane.Mesh, Motion=Z)  # -> Geometry, Transform
eim = ElasticIsotropicMaterialAlpaca4d()
mstb = MeshSeriesToBrickAlpaca4d(Meshes=move.Geometry, Closed=False)
demesh = DeconstructMesh(Mesh=mplane.Mesh)  # -> Vertices, Faces, Colours, Normals
demesh_2 = DeconstructMesh(Mesh=move.Geometry)  # -> Vertices, Faces, Colours, Normals
X = UnitX(Factor="10000")
duppt = RemoveDuplicatePts(Points=demesh.Vertices, Tolerance=0.01)
support = SupportAlpaca4d(Point=duppt, Tx=True, Ty=True, Tz=True, Rx=True, Ry=True, RZ=True)
ssp = SSPBrickAlpaca4d(Mesh=mstb, Material=eim)
point_load = PointLoadAlpaca4d(Point=demesh_2.Vertices, Force=X, Moment=Vector(0, 0, 0))  # -> flatten(Load)
assemble_model = AssembleModelAlpaca4d(Element=ssp, Support=support, Load=point_load, Tollerance=0.01)  # -> AlpacaModel, Mass
analysissettings = AnalysisSettingsAlpaca4d()
ra = RunAnalysisAlpaca4d(AlpacaModel=assemble_model.AlpacaModel, Settings=analysissettings)  # -> Log, AlpacaModel
deformed_model_view = DeformedModelViewAlpaca4d(AlpacaModel=ra.AlpacaModel, Step=0, Scale="300")  # -> Line, Mesh, Brick
mjoin = MeshJoin(Meshes=deformed_model_view.Brick)
