# Grasshopper definition 3dPrintedStructure.gh (Grasshopper 1.0.7)
# plug-ins: VoxelPrint, NGon, Karamba3D, MeshEdit Components, treesloth01, Pufferfish, Alpaca4d

brep = Brep(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)

# ---- group: Element
data = Data(0)
data_2 = Data(0)

# ---- group: Load
# Bricks Elements
# Units
# N, mm
data_3 = Data(0)
data_4 = Data(0)

# ---- group: increase me
steps = Slider(242, range=0..487)

# ----
voxelizer = BrepToVoxel(Brep=brep, VoxelSize="10", BeadWidth="30", LayerHeight="10")  # -> PointList, VoxelSettings

# ---- group: Cross_Section
data_5 = Data(0)
data_6 = Data(0)

# ---- group: Support
data_7 = Data(0)
data_8 = Data(0)

# ---- group: Material
data_9 = Data(0)
data_10 = Data(0)

# ---- group: Constraint
data_11 = Data(0)
data_12 = Data(0)

# ----
division = Division(A="1", B="10")
cullpt = CullDuplicates(Points=voxelizer.PointList, Tolerance=0.1, CullMode=1)  # -> Points, Indices, Valence

# ---- group: Visualization
data_13 = Data(0)
data_14 = Data(0)

# ---- group: Output
data_15 = Data(0)
data_16 = Data(0)

# ----
voxels = Voxels(Points=graft(cullpt.Points), Scale=division)  # -> Mesh, Points
weldvertices = MeshWeldVertices(Mesh=voxels.Mesh, Tolerance=0.01)  # -> RuntimeMessage, Mesh
data_17 = Data(simplify(weldvertices.Mesh))
shift = ShiftPaths(Data=data_17, Offset=-1)  # -> flatten(Data)
partition = PartitionList(List=shift, Size="24")  # -> simplify(Chunks)
concat = Concatenate(FragmentA="{<", FragmentB=steps, FragmentC="}")
split = SplitTree(Data=simplify(partition), Masks=flatten(concat))  # -> Positive, Negative
demesh = DeconstructMesh(Mesh=flatten(split.Positive))  # -> Vertices, Faces, Colours, Normals
rdpoints = RemoveDuplicatePointsKaramba3D(Point=flatten(demesh.Vertices), LimitDistance=0.005)  # -> graft(OutPoint), Info, Indexes

pt = Point(flatten(rdpoints.OutPoint))
pdecon = Deconstruct(Point=pt)  # -> XComponent, YComponent, ZComponent
bnd = Bounds(Numbers=pdecon.ZComponent)
dedomain = DeconstructDomain(Domain=bnd)  # -> Start, End
addition = Addition(A="0.01", B=dedomain.Start)
smaller = SmallerThan(FirstNumber=pdecon.ZComponent, SecondNumber=addition)  # -> SmallerThan, OrEqualTo
dispatch = Dispatch(List=pt, DispatchPattern=smaller.SmallerThan)  # -> ListA, ListB

weldvertices_2 = MeshWeldVertices(Mesh=split.Positive, Tolerance=0.01)  # -> RuntimeMessage, Mesh
eim = ElasticIsotropicMaterialAlpaca4d(E="210000", V="0.3", Rho="2400")
constant_time_series = ConstantTimeSeriesAlpaca4d(LoadFactor=1)  # -> TimeSeries, Graph
Z = UnitZ(Factor="-10")
pt_2 = Point(dispatch.ListB)
toggle = BooleanToggle(True)
pt_3 = Point(dispatch.ListA)
ssp = SSPBrickAlpaca4d(Mesh=weldvertices_2.Mesh, Material=eim, Colour=ColourSwatch(SwatchColor=RGB(255, 255, 255)))
support = SupportAlpaca4d(Point=pt_3, Tx=toggle, Ty=toggle, Tz=toggle, Rx=True, Ry=True, RZ=True)
point_load = PointLoadAlpaca4d(Point=pt_2, Force=Z, Moment=Vector(0, 0, 0), TimeSeries=constant_time_series.TimeSeries)
assemble_model = AssembleModelAlpaca4d(Element=flatten(ssp), Support=support, Load=point_load, Tollerance=0.01)  # -> AlpacaModel, MassForce
analysissettings = AnalysisSettingsAlpaca4d(AnalysisSteps="1")

# ---- group: Run Analysis (Alpaca4d)
ra = RunAnalysisAlpaca4d(AlpacaModel=assemble_model.AlpacaModel, Settings=analysissettings)  # -> Log, AlpacaModel

# ----
panel = Panel(ra.Log)
ds = DisassembleModelAlpaca4d(AlpacaModel=ra.AlpacaModel)  # -> out, Points, threeNdfPoints, sixNdfPoints, Beam, Shell, Brick, Support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
# ---------- ds: Python ----------
"""
Disassemble a Model
-
    Args:
        AlpacaModel:
    Returns:
        Points:
        threeNdfPoints:
        sixNdfPoints:
        
        Beam:
        Shell:
        Brick:
        Support:
        Constraint:
        TimeSeries:
        Load:
        Material:
"""

ghenv.Component.Name = "Disassemble Model (Alpaca4d)"
ghenv.Component.NickName = 'DS'
ghenv.Component.Message = "Disassemble Model (Alpaca4d)"


import sys
import Rhino.Geometry as rg
import Grasshopper as gh


checkData = True


if not AlpacaModel:
    checkData = False
    msg = "Input parameter AlpacaModel failed to collect data"
    ghenv.Component.AddRuntimeMessage(gh.Kernel.GH_RuntimeMessageLevel.Warning, msg)

if checkData:
    Points = AlpacaModel.UniquePoints
    threeNdfPoints = AlpacaModel.UniquePointsThreeNDF
    sixNdfPoints = AlpacaModel.UniquePointsSixNDF
    
    Beam = AlpacaModel.Beams
    Shell  = AlpacaModel.Shells
    Brick = AlpacaModel.Bricks
    Support = AlpacaModel.Supports
    Constraint = AlpacaModel.Constraint
    Load = AlpacaModel.Loads
    Material = AlpacaModel.Materials
# ---------- end ds ----------
nd = NodalDisplacementsAlpaca4d(AlpacaModel=ra.AlpacaModel, History=False, Step=0)  # -> Displacement, Rotation, port, Velocity, Acceleration
db = DisassembleBrickElementAlpaca4d(BrickElement=ds.Brick)  # -> Mesh, Material, port, indexNodes, eleTag, port_2, ndf, ElementClass
# ---------- db: Python ----------
"""
Disassemble a Brick Element
-
    Args:
        BrickElement:
    Returns:
        Mesh:
        Material:
        indexNodes:
        eleTag:
        ndf:
        ElementClass:
"""

ghenv.Component.Name = "Disassemble Brick Element (Alpaca4d)"
ghenv.Component.NickName = 'DB'
ghenv.Component.Message = "Disassemble Brick (Alpaca4d)"


import sys
import Rhino.Geometry as rg
import Grasshopper as gh


## add alpaca install directory to system path



Mesh = BrickElement.Mesh
Material = BrickElement.Material
indexNodes = BrickElement.IndexNodes
eleTag = BrickElement.Id
ndf = BrickElement.Ndf

ElementClass = BrickElement.ElementClass
# ---------- end db ----------
vlen = VectorLength(Vector=nd.Displacement)
remap = RemapNumbers(Value=vlen, Source="0.0053", Target=Domain(0, 1))  # -> Mapped, Clipped
demesh_2 = DeconstructMesh(Mesh=db.Mesh)  # -> Vertices, Faces, Colours, Normals
subtraction = Subtraction(A=db.indexNodes, B=1)
clr = ColorsAlpaca4d(gradIndex=11)  # -> reverse(colors); inputs gradIndex: Int32
#   port colors: A series of colors to be plugged into the "Ladybug_Legend Parameters" component.
# ---------- clr: Python ----------
"""
Preset of gradient colors perfect for Data Visualisation
    Inputs:
        gradIndex: An index refering to one of the following possible gradients:
            0 - Orignal Ladybug
            1 - Nuanced Ladybug
            2 - Multi-colored Ladybug
            3 - Ecotect
            4 - Thermal Comfort Percentage
            5 - Thermal Comfort Colors
            6 - Shade Benefit/Harm
            7 - Shade Harm
            8 - Shade Benefit
            9 - CFD Colors 1
            10 - Radiation Benefit
            11 - Gsa10 Colour
            12 - Gsa9 Colour
    Returns:
        customColors: A series of colors.
"""

ghenv.Component.Name = "Colors (Alpaca4d)"
ghenv.Component.NickName = 'CLR'
ghenv.Component.Message = 'Colors (Alpaca4d)'

import scriptcontext as sc
import Grasshopper.Kernel as gh
import System

gradientLibrary = {
        0: [System.Drawing.Color.FromArgb(75, 107, 169), System.Drawing.Color.FromArgb(115, 147, 202), System.Drawing.Color.FromArgb(170, 200, 247), System.Drawing.Color.FromArgb(193, 213, 208), System.Drawing.Color.FromArgb(245, 239, 103), System.Drawing.Color.FromArgb(252, 230, 74), System.Drawing.Color.FromArgb(239, 156, 21), System.Drawing.Color.FromArgb(234, 123, 0), System.Drawing.Color.FromArgb(234, 74, 0), System.Drawing.Color.FromArgb(234, 38, 0)],
        1: [System.Drawing.Color.FromArgb(49,54,149), System.Drawing.Color.FromArgb(69,117,180), System.Drawing.Color.FromArgb(116,173,209), System.Drawing.Color.FromArgb(171,217,233), System.Drawing.Color.FromArgb(224,243,248), System.Drawing.Color.FromArgb(255,255,191), System.Drawing.Color.FromArgb(254,224,144), System.Drawing.Color.FromArgb(253,174,97), System.Drawing.Color.FromArgb(244,109,67), System.Drawing.Color.FromArgb(215,48,39), System.Drawing.Color.FromArgb(165,0,38)],
        2: [System.Drawing.Color.FromArgb(4,25,145), System.Drawing.Color.FromArgb(7,48,224), System.Drawing.Color.FromArgb(7,88,255), System.Drawing.Color.FromArgb(1,232,255), System.Drawing.Color.FromArgb(97,246,156), System.Drawing.Color.FromArgb(166,249,86), System.Drawing.Color.FromArgb(254,244,1), System.Drawing.Color.FromArgb(255,121,0), System.Drawing.Color.FromArgb(239,39,0), System.Drawing.Color.FromArgb(138,17,0)],
        3: [System.Drawing.Color.FromArgb(0,0,255), System.Drawing.Color.FromArgb(53,0,202), System.Drawing.Color.FromArgb(107,0,148), System.Drawing.Color.FromArgb(160,0,95), System.Drawing.Color.FromArgb(214,0,41), System.Drawing.Color.FromArgb(255,12,0), System.Drawing.Color.FromArgb(255,66,0), System.Drawing.Color.FromArgb(255,119,0), System.Drawing.Color.FromArgb(255,173,0), System.Drawing.Color.FromArgb(255,226,0), System.Drawing.Color.FromArgb(255,255,0)],
        4: [System.Drawing.Color.FromArgb(0,0,0), System.Drawing.Color.FromArgb(110,0,153), System.Drawing.Color.FromArgb(255,0,0), System.Drawing.Color.FromArgb(255,255,102), System.Drawing.Color.FromArgb(255,255,255)],
        5: [System.Drawing.Color.FromArgb(0,136,255), System.Drawing.Color.FromArgb(200,225,255), System.Drawing.Color.FromArgb(255,255,255), System.Drawing.Color.FromArgb(255,230,230), System.Drawing.Color.FromArgb(255,0,0)],
        6: [System.Drawing.Color.FromArgb(5,48,97), System.Drawing.Color.FromArgb(33,102,172), System.Drawing.Color.FromArgb(67,147,195), System.Drawing.Color.FromArgb(146,197,222), System.Drawing.Color.FromArgb(209,229,240), System.Drawing.Color.FromArgb(255,255,255), System.Drawing.Color.FromArgb(253,219,199), System.Drawing.Color.FromArgb(244,165,130), System.Drawing.Color.FromArgb(214,96,77), System.Drawing.Color.FromArgb(178,24,43), System.Drawing.Color.FromArgb(103,0,31)],
        7: [System.Drawing.Color.FromArgb(255,255,255), System.Drawing.Color.FromArgb(253,219,199), System.Drawing.Color.FromArgb(244,165,130), System.Drawing.Color.FromArgb(214,96,77), System.Drawing.Color.FromArgb(178,24,43), System.Drawing.Color.FromArgb(103,0,31)],
        8: [System.Drawing.Color.FromArgb(255,255,255), System.Drawing.Color.FromArgb(209,229,240), System.Drawing.Color.FromArgb(146,197,222), System.Drawing.Color.FromArgb(67,147,195), System.Drawing.Color.FromArgb(33,102,172), System.Drawing.Color.FromArgb(5,48,97)],
        9: [System.Drawing.Color.FromArgb(0,16,120), System.Drawing.Color.FromArgb(38,70,160), System.Drawing.Color.FromArgb(5,180,222), System.Drawing.Color.FromArgb(16,180,109), System.Drawing.Color.FromArgb(59,183,35), System.Drawing.Color.FromArgb(143,209,19), System.Drawing.Color.FromArgb(228,215,29), System.Drawing.Color.FromArgb(246,147,17), System.Drawing.Color.FromArgb(243,74,0), System.Drawing.Color.FromArgb(255,0,0)],
        10: [System.Drawing.Color.FromArgb(0,191,48), System.Drawing.Color.FromArgb(255,238,184), System.Drawing.Color.FromArgb(255,0,0)],
        11: [System.Drawing.Color.FromArgb(204,0,71), System.Drawing.Color.FromArgb(255,182,71), System.Drawing.Color.FromArgb(206,255,115), System.Drawing.Color.FromArgb(26,180, 214),System.Drawing.Color.FromArgb(0,0,207)],
        12: [System.Drawing.Color.FromArgb(255, 51, 51), System.Drawing.Color.FromArgb(255, 170, 51), System.Drawing.Color.FromArgb(255, 255, 51), System.Drawing.Color.FromArgb(170, 255, 125), System.Drawing.Color.FromArgb(51, 255, 231), System.Drawing.Color.FromArgb(51, 170, 255), System.Drawing.Color.FromArgb(51,51, 255)]}
colors = gradientLibrary[gradIndex]
# ---------- end clr ----------
item = ListItem(List=remap.Mapped, Index=subtraction, Wrap=True)
twnthrucols = TweenThroughColors(
    Colors=clr,
    Factor=item,
    Normalized=True,
    Equalized=False,
    Weighted=False,
    Loopback=False,
    Degree=3,
    InterpolationType=0,
    Alpha=True)
conmesh = ConstructMesh(Vertices=demesh_2.Vertices, Faces=demesh_2.Faces, Colours=twnthrucols)
mjoin = MeshJoin(Meshes=flatten(conmesh))
medges = MeshEdges(Mesh=mjoin)  # -> NakedEdges, InteriorEdges, NonManifoldEdges
crv = Curve([medges.InteriorEdges, medges.NonManifoldEdges])
