# Grasshopper definition High Tension Tower.gh (Grasshopper 1.0.7)
# plug-ins: Human, Alpaca4d

crv = Curve(graft([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]))
mcx = MultipleCurves(Curves=flatten(crv))  # -> Points, IndexA, IndexB, ParamA, ParamB
crv_cp = CurveClosestPoint(Point=mcx.Points, Curve=crv)  # -> Point, Parameter, Distance

# ---- group: Element
data = Data(0)
data_2 = Data(0)

# ---- group: Load
# High Tension Tower
# Units
# N, mm
data_3 = Data(0)
data_4 = Data(0)

# ---- group: Cross_Section
data_5 = Data(0)
data_6 = Data(0)

# ---- group: Support
data_7 = Data(0)
data_8 = Data(0)

# ----
smaller = SmallerThan(FirstNumber=crv_cp.Distance, SecondNumber="0.01")  # -> SmallerThan, OrEqualTo

# ---- group: Material
data_9 = Data(0)
data_10 = Data(0)

# ---- group: Constraint
data_11 = Data(0)
data_12 = Data(0)

# ----
cull = CullPattern(List=crv_cp.Parameter, CullPattern=smaller.SmallerThan)

# ---- group: Visualization
data_13 = Data(0)
data_14 = Data(0)

# ---- group: Output
data_15 = Data(0)
data_16 = Data(0)

# ----
shatter = Shatter(Curve=crv, Parameters=cull)
kn = Panel("500")
pt = Point([Point(21.02621553, 4.52571924, 0), Point(15.04621553, 4.52571924, 0), Point(15.04621553, -1.45428076, 0), Point(21.02621553, -1.45428076, 0)])
n_to_kn = Number(expr("x*1000", kn))
toggle = BooleanToggle(True)
uniaxial_material_elastic = UniaxialMaterialElasticAlpaca4d(E="2.1e9", V="0.3", Rho="7850")
crv_2 = Curve(shatter)
explode = Explode(Curve=crv_2, Recursive=True)  # -> Segments, flatten(Vertices)
cullpt = CullDuplicates(Points=flatten(explode.Vertices), Tolerance=0.1, CullMode=1)  # -> Points, Indices, Valence
lng = ListLength(List=cullpt.Points)
constant_time_series = ConstantTimeSeriesAlpaca4d(LoadFactor=1)  # -> TimeSeries, Graph
division = Division(A=n_to_kn, B=lng)
Y = UnitY(Factor=division)
support = SupportAlpaca4d(Point=pt, Tx=toggle, Ty=toggle, Tz=toggle, Rx=True, Ry=True, RZ=True)
gravity_load = GravityLoadAlpaca4d(TimeSeriesType="Constant", GFactor=1)
point_load = PointLoadAlpaca4d(Point=cullpt.Points, Force=Y, Moment=Vector(0, 0, 0), TimeSeries=constant_time_series.TimeSeries)
circlecs = CircleCSAlpaca4d(Diameter="0.15", Thickness="0.005", Material=uniaxial_material_elastic)
data_17 = Data(flatten([gravity_load, point_load]))
force_beam_column = ForceBeamColumnAlpaca4d(Line=crv_2, Section=circlecs)
data_18 = Data(flatten(force_beam_column))
assemble_model = AssembleModelAlpaca4d(Element=data_18, Support=support, Load=data_17, Tollerance=0.01)  # -> AlpacaModel, MassForce
panel = Panel(assemble_model.MassForce)
analysisstep = AnalysisStepAlpaca4d(NumIncr="4")
analysissettings = AnalysisSettingsAlpaca4d(AnalysisSteps=analysisstep)

# ---- group: Run Analysis (Alpaca4d)
ra = RunAnalysisAlpaca4d(AlpacaModel=assemble_model.AlpacaModel, Settings=analysissettings)  # -> Log, AlpacaModel

# ---- group: Tension and Compression Visualisation
data_19 = Data(ra.AlpacaModel)
ds = DisassembleModelAlpaca4d(AlpacaModel=data_19)  # -> out, Beam
# ---------- ds: Python ----------
"""
Disassemble a Model
-
    Args:
        AlpacaModel:
    Returns:
        Points:
        threeNdfPoints:
        sixNdfPoints:
        
        Beam:
        Shell:
        Brick:
        Support:
        Constraint:
        TimeSeries:
        Load:
        Material:
"""

ghenv.Component.Name = "Disassemble Model (Alpaca4d)"
ghenv.Component.NickName = 'DS'
ghenv.Component.Message = "Disassemble Model (Alpaca4d)"


import sys
import Rhino.Geometry as rg
import Grasshopper as gh



checkData = True



if checkData:
    
    Beam = AlpacaModel.Beams
# ---------- end ds ----------
db = DisassembleBeamElementAlpaca4d(BeamElement=ds.Beam)  # -> CurveAxis
# ---------- db: Python ----------
"""
Disassemble a Beam Element
-
    Args:
        BeamElement:
    Returns:
        CurveAxis:
        CrossSection:
        Z_Axis:
        iNode:
        jNode:
        eleTag:
        ndf:
        GeomTransfType:
        ElementClass:
"""

ghenv.Component.Name = "Disassemble Beam Element (Alpaca4d)"
ghenv.Component.NickName = 'DB'
ghenv.Component.Message = "Disassemble Beam(Alpaca4d)"


import sys
import Rhino.Geometry as rg
import Grasshopper as gh


checkData = True


if checkData:
    CurveAxis = BeamElement.Curve
# ---------- end db ----------
dom = ConstructDomain(DomainStart=Slider(1, range=0..1), DomainEnd=Slider(3, range=3..7))

# ----
bf = BeamForcesAlpaca4d(AlpacaModel=data_19, History=False, Step=0)  # -> N, Vy, Vz, Mx, My, Mz
midpt = CurveMiddle(Curve=db)

# ---- group: Tension and Compression Visualisation (continued)
avr = Average(Input=bf.N)
item = ListItem(List=avr, Index=0, Wrap=True)  # -> flatten(Item)
bnd = Bounds(Numbers=item)
abs = Absolute(Value=bnd)
dedomain = DeconstructDomain(Domain=abs)  # -> Start, End
max = Maximum(A=dedomain.Start, B=dedomain.End)
neg = Negative(Value=max)
merge = Merge(Data1=max, Data2=neg)
bnd_2 = Bounds(Numbers=merge)
remap = RemapNumbers(Value=item, Source=bnd_2, Target=dom)  # -> Mapped, Clipped
python = GhPythonScript(x=remap.Mapped)  # -> out, a
# ---------- python: Python ----------
if x ==0:
    a = 1
else:
    a = x
# ---------- end python ----------
python_2 = GhPythonScript(x=flatten(item))  # -> out, a
# ---------- python_2: Python ----------
import System.Drawing

if x > 0.01:
    a = System.Drawing.Color.Red
elif x < 0.01:
    a = System.Drawing.Color.Blue
# ---------- end python_2 ----------
num = Number(expr("Round(x,2)", item))
round = Round(Number=python.a)  # -> Nearest, Floor, Ceiling
tag = TextTag(Location=midpt, Text=num)
previewlw = CustomPreviewLineweights(Geometry=db, Shader=python_2.a, Thickness=round.Ceiling, Absolute=False)
