# Grasshopper definition moment_curvature.gh (Grasshopper 1.0.7)
# plug-ins: Alpaca4d

rectangle = Rectangle(Plane=PlaneXY(0, 0, 0), XSize="300", YSize="300", Radius=0)  # -> Rectangle, Length
neg = Negative(Value="35")
offset = OffsetCurve(Curve=rectangle.Rectangle, Distance=neg, Corners=1)
explode = Explode(Curve=offset, Recursive=True)  # -> Segments, Vertices
qrsettings = QuadRemeshSettings(TargetCount="200", AdaptiveSize=0, AdaptiveCount=False, HardEdges=False, SeamEdges=0, Symmetry=0, GuideCurves=0)
concrete01 = Concrete01Alpaca4d(MinMax=False)
qrmesh = QuadRemesh(Mesh=rectangle.Rectangle, Settings=qrsettings)
divide = DivideCurve(Curve=explode.Segments, Count="5", Kinks=False)  # -> Points, Tangents, Parameters
cullpt = CullDuplicates(Points=flatten(divide.Points), Tolerance=0.1, CullMode=3)  # -> Points, Indices, Valence
steel01 = Steel01Alpaca4d()
python = GhPythonScript(x=concrete01)  # -> out, a
# ---------- python: Python ----------
__author__ = "mp"

import rhinoscriptsyntax as rs

x.Id = 1

a = x
# ---------- end python ----------
cir = Circle(Plane=cullpt.Points, Radius="10")
python_2 = GhPythonScript(x=steel01)  # -> out, a
# ---------- python_2: Python ----------
__author__ = "mp"

import rhinoscriptsyntax as rs

x.Id = 2

a = x
# ---------- end python_2 ----------
area = Area(Geometry=cir)  # -> Area, Centroid
fiber_point = FiberPointAlpaca4d(Point=cullpt.Points, AreaFiber=area.Area, Material=python_2.a)
patch = PatchAlpaca4d(Mesh=qrmesh, Material=python.a)
fibersection = FiberSectionAlpaca4d(PointFiber=fiber_point, Patch=patch, GJ=100000000)
mc = MomentCurvatureAlpaca4d(FiberSection=fibersection, Axial="0.01", Direction="y", NumIncr="1000", MaxPhi="0.001")  # -> Log, N, My, Mz, Ε, Κy, Κz, FiberStressStrain
panel = Panel(mc.N)
fiber_stress_strain = FiberStressStrainAlpaca4d(FiberStressStrain=mc.FiberStressStrain)  # -> FiberPoint, Stress, Strain
