# Grasshopper definition utility.gh (Grasshopper 1.0.7)

crv = Curve([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])
divide = DivideCurve(Curve=crv, Count=10, Kinks=False)  # -> Points, Tangents, Parameters
pline = PolyLine(Vertices=divide.Points, Closed=False)  # -> simplify(flatten(Polyline))
ml = MeshLoftAlpaca4d(Polylines=pline)  # -> Mesh; inputs Polylines: list of Curve, Closed: Boolean
# ---------- ml: Python ----------
"""
Create a Mesh Loft. The code has been borrowed from Chromodoris and translated in python.
-
    Args:
        Polylines:
        Closed:
    Returns:
        Mesh:
"""

import Rhino.Geometry as rg
import Grasshopper as gh


ghenv.Component.Name = "Mesh Loft (Alpaca4d)"
ghenv.Component.NickName = 'ML'
ghenv.Component.Message = "Mesh Loft (Alpaca4d)"


checkData = True

if not Polylines:
    checkData = False
    msg = "Input parameter Polylines failed to collect data"
    ghenv.Component.AddRuntimeMessage(gh.Kernel.GH_RuntimeMessageLevel.Warning, msg)


if checkData:
    
    isClosed = Polylines[0].IsClosed
    Mesh = rg.Mesh()
    
    number_points = Polylines[0].PointCount
    
    
    if Closed == True:
        Polylines.append(Polylines[0])
    
    if number_points > 0:
        array = []
        for i in range(number_points):
            Mesh.Vertices.Add(Polylines[0].Point(i))
            array.append(i)
        
        for j in range(1, len(Polylines)):
            array2 = []
            for k in range(number_points):
                
                Mesh.Vertices.Add(Polylines[j].Point(k))
                array2.append(Mesh.Vertices.Count-1)
            
            
            
            for l in range(1, number_points):
                if l == number_points:
                    if isClosed:
                        Mesh.Faces.AddFace(array[l - 1], array[0], array2[0], array2[l - 1])
                Mesh.Faces.AddFace(array[l - 1], array[l], array2[l], array2[l - 1])
            
            array = array2
# ---------- end ml ----------

crv_2 = Curve([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])
boundary = BoundarySurfaces(Edges=crv_2)
series = Series(Start=0, Step="2", Count=10)
qrmesh = QuadRemesh(Mesh=boundary, Settings={aqc=True, as=50, dhe=True, gci=0, null=False, pme=0, sa=0, tqc=2000})
Z = UnitZ(Factor=series)
move = Move(Geometry=qrmesh, Motion=Z)  # -> Geometry, Transform
mstb = MeshSeriesToBrickAlpaca4d(MeshSeries=move.Geometry)  # -> Brick; inputs MeshSeries: list of Mesh, Closed: Boolean
# ---------- mstb: Python ----------
"""Generate a Brick element from a list of mesh .
    the faces of the mesh '0' will be connected with the faces of the meshes '1' generating a brick element ( cube ).
    Attention : Each mesh in the list must have the same number of faces.
    Inputs:
        MeshSeries: quadMesh list with the same number of subdivisions .
    Output:
        Brick: Brick element --> Mesh with 6 faces and 8 nodes.
       """




ghenv.Component.Name = "Mesh Series to Brick (Alpaca4d)"
ghenv.Component.NickName = 'MSTB'
ghenv.Component.Message = "Mesh Series to Brick (Alpaca4d)"


import Rhino.Geometry as rg
import Grasshopper as gh

def MeshToShell(Mesh):
    
    Mesh.Unweld(0, True)
    mesh = Mesh.ExplodeAtUnweldedEdges()
    #print( len(mesh) )
    newMesh = []
    elementType = []
    for explodedMesh in mesh:
        newMesh.append(explodedMesh)
    return newMesh 

def brick( MeshList ):
    meshExpl = []
    Vertix = []
    elementType = []
    solid = []
    a = rg.Mesh.DuplicateMesh( MeshList[0] ) #.Unweld(0, True)
    a.Unweld(0, True)
    b = a.ExplodeAtUnweldedEdges()
    if len( b ) > 0 :
        for Mesh in MeshList:
            shellWrapper = MeshToShell(Mesh)
            meshExpl.append( shellWrapper )
        for index1 in range(0, len(MeshList)-1):
            for index2 in range(0, len(meshExpl[0])):
                if meshExpl[ index1 ][ index2 ].Vertices.Count == 4:
                    
                    elementType.append("stdBrick")
                    vertix1 = meshExpl[ index1 ][ index2 ].Vertices[0]
                    vertix2 = meshExpl[ index1 ][ index2 ].Vertices[1]
                    vertix3 = meshExpl[ index1 ][ index2 ].Vertices[2]
                    vertix4 = meshExpl[ index1 ][ index2 ].Vertices[3]
                    vertix5 = meshExpl[index1 + 1 ][ index2].Vertices[0]
                    vertix6 = meshExpl[index1 + 1 ][ index2].Vertices[1]
                    vertix7 = meshExpl[index1 + 1 ][ index2].Vertices[2]
                    vertix8 = meshExpl[index1 + 1 ][ index2].Vertices[3]
                    
                    vertix = [ vertix1, vertix2, vertix3, vertix4,
                    vertix5, vertix6, vertix7, vertix8 ]
                    
                    ele = rg.Mesh()
                    
                    ele.Vertices.Add( vertix1 ) # 0 
                    ele.Vertices.Add( vertix2 ) # 1
                    ele.Vertices.Add( vertix3 ) # 2
                    ele.Vertices.Add( vertix4 ) # 3
                    ele.Vertices.Add( vertix5 ) # 4
                    ele.Vertices.Add( vertix6 ) # 5
                    ele.Vertices.Add( vertix7 ) # 6
                    ele.Vertices.Add( vertix8 ) # 7
                    
                    ele.Faces.AddFace(0, 1, 2, 3) # 0
                    ele.Faces.AddFace(4, 5, 6, 7) # 1
                    ele.Faces.AddFace(0, 1, 5, 4) # 2
                    ele.Faces.AddFace(3, 2, 6, 7) # 3
                    ele.Faces.AddFace(1, 5, 6, 2) # 4
                    ele.Faces.AddFace(0, 4, 7, 3) # 5
                solid.append(ele)
                #ele.IsClosed()
                    
    else:
        for index1 in range(0, len(MeshList)-1):
            elementType.append("stdBrick")
            vertix1 = MeshList[ index1 ].Vertices[0]
            vertix2 = MeshList[ index1 ].Vertices[1]
            vertix3 = MeshList[ index1 ].Vertices[2]
            vertix4 = MeshList[ index1 ].Vertices[3]
            vertix5 = MeshList[index1 + 1 ].Vertices[0]
            vertix6 = MeshList[index1 + 1 ].Vertices[1]
            vertix7 = MeshList[index1 + 1 ].Vertices[2]
            vertix8 = MeshList[index1 + 1 ].Vertices[3]
            
            vertix = [ vertix1, vertix2, vertix3, vertix4,
            vertix5, vertix6, vertix7, vertix8 ]
            
            ele = rg.Mesh()
            
            ele.Vertices.Add( vertix1 ) # 0 
            ele.Vertices.Add( vertix2 ) # 1
            ele.Vertices.Add( vertix3 ) # 2
            ele.Vertices.Add( vertix4 ) # 3
            ele.Vertices.Add( vertix5 ) # 4
            ele.Vertices.Add( vertix6 ) # 5
            ele.Vertices.Add( vertix7 ) # 6
            ele.Vertices.Add( vertix8 ) # 7
            
            ele.Faces.AddFace(0, 1, 2, 3) # 0
            ele.Faces.AddFace(4, 5, 6, 7) # 1
            ele.Faces.AddFace(0, 1, 5, 4) # 2
            ele.Faces.AddFace(3, 2, 6, 7) # 3
            ele.Faces.AddFace(1, 5, 6, 2) # 4
            ele.Faces.AddFace(0, 4, 7, 3) # 5
            
            solid.append(ele)

    return solid

checkData = True

if not MeshSeries or len(MeshSeries) == 1 :  #is not None:
    checkData = False
    msg = "input MeshSeries failed to collect data"
    ghenv.Component.AddRuntimeMessage( gh.Kernel.GH_RuntimeMessageLevel.Warning, msg )

Closed = False if Closed is None else Closed

if checkData:
    if Closed == True:
        MeshSeries.append(MeshSeries[0])
    Brick= brick( MeshSeries )
# ---------- end mstb ----------

clr = ColorsAlpaca4d(gradIndex=Slider(11, range=0..12))  # -> colors; inputs gradIndex: Int32
#   port colors: A series of colors to be plugged into the "Ladybug_Legend Parameters" component.
# ---------- clr: Python ----------
"""
Preset of gradient colors perfect for Data Visualisation
    Inputs:
        gradIndex: An index refering to one of the following possible gradients:
            0 - Orignal Ladybug
            1 - Nuanced Ladybug
            2 - Multi-colored Ladybug
            3 - Ecotect
            4 - Thermal Comfort Percentage
            5 - Thermal Comfort Colors
            6 - Shade Benefit/Harm
            7 - Shade Harm
            8 - Shade Benefit
            9 - CFD Colors 1
            10 - Radiation Benefit
            11 - Gsa10 Colour
            12 - Gsa9 Colour
    Returns:
        customColors: A series of colors.
"""

ghenv.Component.Name = "Colors (Alpaca4d)"
ghenv.Component.NickName = 'CLR'
ghenv.Component.Message = 'Colors (Alpaca4d)'

import scriptcontext as sc
import Grasshopper.Kernel as gh
import System

gradientLibrary = {
        0: [System.Drawing.Color.FromArgb(75, 107, 169), System.Drawing.Color.FromArgb(115, 147, 202), System.Drawing.Color.FromArgb(170, 200, 247), System.Drawing.Color.FromArgb(193, 213, 208), System.Drawing.Color.FromArgb(245, 239, 103), System.Drawing.Color.FromArgb(252, 230, 74), System.Drawing.Color.FromArgb(239, 156, 21), System.Drawing.Color.FromArgb(234, 123, 0), System.Drawing.Color.FromArgb(234, 74, 0), System.Drawing.Color.FromArgb(234, 38, 0)],
        1: [System.Drawing.Color.FromArgb(49,54,149), System.Drawing.Color.FromArgb(69,117,180), System.Drawing.Color.FromArgb(116,173,209), System.Drawing.Color.FromArgb(171,217,233), System.Drawing.Color.FromArgb(224,243,248), System.Drawing.Color.FromArgb(255,255,191), System.Drawing.Color.FromArgb(254,224,144), System.Drawing.Color.FromArgb(253,174,97), System.Drawing.Color.FromArgb(244,109,67), System.Drawing.Color.FromArgb(215,48,39), System.Drawing.Color.FromArgb(165,0,38)],
        2: [System.Drawing.Color.FromArgb(4,25,145), System.Drawing.Color.FromArgb(7,48,224), System.Drawing.Color.FromArgb(7,88,255), System.Drawing.Color.FromArgb(1,232,255), System.Drawing.Color.FromArgb(97,246,156), System.Drawing.Color.FromArgb(166,249,86), System.Drawing.Color.FromArgb(254,244,1), System.Drawing.Color.FromArgb(255,121,0), System.Drawing.Color.FromArgb(239,39,0), System.Drawing.Color.FromArgb(138,17,0)],
        3: [System.Drawing.Color.FromArgb(0,0,255), System.Drawing.Color.FromArgb(53,0,202), System.Drawing.Color.FromArgb(107,0,148), System.Drawing.Color.FromArgb(160,0,95), System.Drawing.Color.FromArgb(214,0,41), System.Drawing.Color.FromArgb(255,12,0), System.Drawing.Color.FromArgb(255,66,0), System.Drawing.Color.FromArgb(255,119,0), System.Drawing.Color.FromArgb(255,173,0), System.Drawing.Color.FromArgb(255,226,0), System.Drawing.Color.FromArgb(255,255,0)],
        4: [System.Drawing.Color.FromArgb(0,0,0), System.Drawing.Color.FromArgb(110,0,153), System.Drawing.Color.FromArgb(255,0,0), System.Drawing.Color.FromArgb(255,255,102), System.Drawing.Color.FromArgb(255,255,255)],
        5: [System.Drawing.Color.FromArgb(0,136,255), System.Drawing.Color.FromArgb(200,225,255), System.Drawing.Color.FromArgb(255,255,255), System.Drawing.Color.FromArgb(255,230,230), System.Drawing.Color.FromArgb(255,0,0)],
        6: [System.Drawing.Color.FromArgb(5,48,97), System.Drawing.Color.FromArgb(33,102,172), System.Drawing.Color.FromArgb(67,147,195), System.Drawing.Color.FromArgb(146,197,222), System.Drawing.Color.FromArgb(209,229,240), System.Drawing.Color.FromArgb(255,255,255), System.Drawing.Color.FromArgb(253,219,199), System.Drawing.Color.FromArgb(244,165,130), System.Drawing.Color.FromArgb(214,96,77), System.Drawing.Color.FromArgb(178,24,43), System.Drawing.Color.FromArgb(103,0,31)],
        7: [System.Drawing.Color.FromArgb(255,255,255), System.Drawing.Color.FromArgb(253,219,199), System.Drawing.Color.FromArgb(244,165,130), System.Drawing.Color.FromArgb(214,96,77), System.Drawing.Color.FromArgb(178,24,43), System.Drawing.Color.FromArgb(103,0,31)],
        8: [System.Drawing.Color.FromArgb(255,255,255), System.Drawing.Color.FromArgb(209,229,240), System.Drawing.Color.FromArgb(146,197,222), System.Drawing.Color.FromArgb(67,147,195), System.Drawing.Color.FromArgb(33,102,172), System.Drawing.Color.FromArgb(5,48,97)],
        9: [System.Drawing.Color.FromArgb(0,16,120), System.Drawing.Color.FromArgb(38,70,160), System.Drawing.Color.FromArgb(5,180,222), System.Drawing.Color.FromArgb(16,180,109), System.Drawing.Color.FromArgb(59,183,35), System.Drawing.Color.FromArgb(143,209,19), System.Drawing.Color.FromArgb(228,215,29), System.Drawing.Color.FromArgb(246,147,17), System.Drawing.Color.FromArgb(243,74,0), System.Drawing.Color.FromArgb(255,0,0)],
        10: [System.Drawing.Color.FromArgb(0,191,48), System.Drawing.Color.FromArgb(255,238,184), System.Drawing.Color.FromArgb(255,0,0)],
        11: [System.Drawing.Color.FromArgb(204,0,71), System.Drawing.Color.FromArgb(255,182,71), System.Drawing.Color.FromArgb(206,255,115), System.Drawing.Color.FromArgb(26,180, 214),System.Drawing.Color.FromArgb(0,0,207)],
        12: [System.Drawing.Color.FromArgb(255, 51, 51), System.Drawing.Color.FromArgb(255, 170, 51), System.Drawing.Color.FromArgb(255, 255, 51), System.Drawing.Color.FromArgb(170, 255, 125), System.Drawing.Color.FromArgb(51, 255, 231), System.Drawing.Color.FromArgb(51, 170, 255), System.Drawing.Color.FromArgb(51,51, 255)]}
colors = gradientLibrary[gradIndex]
# ---------- end clr ----------
legend = Legend(Colour=clr, Tags=["One Fish", "Two Fish", "Red Fish", "Blue Fish"], LegendType=1)

ms = Panel("1")
counter = CounterAlpaca4d(Run=Toggle(False), Reset=Button(), Interval=ms)  # -> Counter; inputs Run: Boolean, Reset: Boolean
# ---------- counter: Python ----------
"""Counter
    Inputs:
        Run:
        Reset:
        Interval: how fast it will update (milliseconds)
    Output:
        Counter:"""

__author__ = "Marco Pellegrino"
__contact__ = "pellegrino.marco@icloud.com"
__linkedIn__ = "https://www.linkedin.com/in/mp0110/"

ghenv.Component.Name = "Counter (Alpaca4d)"
ghenv.Component.NickName = 'Counter'
ghenv.Component.Message = "Counter (Alpaca4d)"


import Grasshopper as gh
import math


def updateComponent(interval):
    
    """ Updates this component, similar to using a grasshopper timer """
    
    # Define callback action
    def callBack(e):
        ghenv.Component.ExpireSolution(False)
        
    # Get grasshopper document
    ghDoc = ghenv.Component.OnPingDocument()
    
    # Schedule this component to expire
    ghDoc.ScheduleSolution(interval,gh.Kernel.GH_Document.GH_ScheduleDelegate(callBack)) # Note that the first input here is how often to update the component (in milliseconds)


Interval = 1 if Interval is None else Interval


# Instantiate/reset persisent starting counter variable
if "myCounter" not in globals() or Reset:
    myCounter = 0

# Update the variable and component
if Run and not Reset:
    myCounter +=1
    updateComponent(Interval)

# Output counter
Counter = myCounter
# ---------- end counter ----------
panel = Panel(counter)

# ---- group: Element
data = Data(0)
data_2 = Data(0)

# ---- group: Load
# Utility
data_3 = Data(0)
data_4 = Data(0)

# ----
random = Random(Range=Domain(0, 1), Number="100", Seed=2)
clr_2 = ColorsAlpaca4d(gradIndex=Slider(3, range=0..12))  # -> colors; inputs gradIndex: Int32; same code as clr
list = ValueList({"top left": 0, "top right": 1, "bottom center": 2}, selected="top left")
num = Number(random)
lgnd = LegendAlpaca4d(Title="Title", Data=num, Colors=clr_2, Pos=list)  # inputs Data: list, Colors: list, Pos: Int32
# ---------- lgnd: Python ----------
"""Visualise a legend on screen
    Inputs:
        Title:
        Data:
        Colors:
        Pos:
        Scale:
    Output:
        """





from ghpythonlib.componentbase import executingcomponent as component
import Rhino as rc
import System


ghenv.Component.Name = "Legend (Alpaca4d)"
ghenv.Component.NickName = 'LGND'
ghenv.Component.Message = 'Legend (Alpaca4d)'

class MyComponent(component):

    def RunScript(self,Title,Data,Colors,Pos,Scale):
        # Assign input variables
        
        self.title = Title
        self.col = Colors
        self.scale = Scale
        self.data = Data
        
        
        self.pos = 2 if Pos is None else Pos
        
        RhinoDocument = rc.RhinoDoc.ActiveDoc
        self.active_view = RhinoDocument.Views.ActiveView

        self.black = System.Drawing.Color.Black
        
        if not self.scale:
            self.scale = 1.5
        
        if self.data:
            self.min_number = float(min(self.data))
            self.max_number = float(max(self.data))
        else:
            self.min_number = -1.0
            self.max_number = 1.0
        
        if not self.col:
            self.col = [System.Drawing.Color.FromArgb(255, 51, 51), System.Drawing.Color.FromArgb(255, 170, 51), System.Drawing.Color.FromArgb(255, 255, 51), System.Drawing.Color.FromArgb(170, 255, 125), System.Drawing.Color.FromArgb(51, 255, 231), System.Drawing.Color.FromArgb(51, 170, 255), System.Drawing.Color.FromArgb(51,51, 255)]
        
        
        self.diff = self.max_number - self.min_number
        
        self.range = len(self.col) + 1



    def DrawViewportWires(self,arg):
        
        
        width = self.active_view.Size.Width
        height = self.active_view.Size.Height
        
        anchor_y = height * 0.075
        
        
        if self.pos == 0:
            anchor_x = width * 0.025
        elif self.pos == 1:
            anchor_x = width * (1- 0.125)
        elif self.pos == 2:
            anchor_x = width * 0.5
            anchor_y = height * (1 - 0.125)
        
        
        
        
        
        rect_x = 20 * self.scale
        rect_y = 20 * self.scale
        
        txt_height = rect_y * 0.6
        title_height = rect_y * 0.9
        
        
        
        # Vertical Gradient
        if self.pos == 0 or self.pos == 1:
        
        # Title
            pt = rc.Geometry.Point2d(anchor_x, anchor_y - 3/(1.6) * txt_height)
            arg.Display.Draw2dText(self.title ,self.black,pt,False,title_height,"Arial")
        
            for i,col in enumerate(self.col):
                
                
                # Rectangle is drawn in front of mesh
                rec2d = System.Drawing.Rectangle(anchor_x,anchor_y + i * rect_y, rect_x,rect_y)
                arg.Display.Draw2dRectangle(rec2d,self.black,3,col)


                value = self.diff * i/self.range + self.min_number
                value = "{:.1f}".format(value)
                
                # Text is drawn in front of mesh
                pt = rc.Geometry.Point2d(anchor_x + 1.5 * rect_x, anchor_y - 1/(1.6*2) * txt_height + i * rect_y)
                
                arg.Display.Draw2dText(value,self.black,pt,False,txt_height,"Arial")
            
            i += 1
            pt = rc.Geometry.Point2d(anchor_x + 1.5 * rect_x, anchor_y - 1/(1.6*2) * txt_height + i * rect_y)
            value = "{:.1f}".format(self.max_number)
            arg.Display.Draw2dText(value,self.black,pt,False,txt_height,"Arial")

        # Horizontal Gradient
        if self.pos == 2:
        
        # Title
            pt = rc.Geometry.Point2d(anchor_x, anchor_y - 3/(1.6) * txt_height)
            arg.Display.Draw2dText(self.title,self.black,pt,False,title_height,"Arial")
            
            
            for i,col in enumerate(self.col):
                
                # Rectangle is drawn in front of mesh
                rec2d = System.Drawing.Rectangle(anchor_x + i * rect_x, anchor_y, rect_x,rect_y)
                arg.Display.Draw2dRectangle(rec2d,self.black,3,col)


                value = self.diff * i/self.range + self.min_number
                value = "{:.1f}".format(value)
                
                # Text is drawn in front of mesh
                #pt = rc.Geometry.Point2d(anchor_x + 1.5 * rect_x, anchor_y - 1/(1.6*2) * txt_height + i * rect_y)
                pt = rc.Geometry.Point2d(anchor_x - 1/(1.6) * txt_height + i * rect_x, anchor_y + 3/(1.2) * txt_height)
                arg.Display.Draw2dText(value,self.black,pt,False,txt_height/1.4,"Arial")
            
            i += 1
            pt = rc.Geometry.Point2d(anchor_x - 1/(1.2) * txt_height + i * rect_x, anchor_y + 3/(1.2) * txt_height)
            value = "{:.1f}".format(self.max_number)
            arg.Display.Draw2dText(value,self.black,pt,False,txt_height/1.4,"Arial")
# ---------- end lgnd ----------

openfile = BooleanToggle(False)
capture = BooleanToggle(False)
vcf = CaptureToFileAlpaca4d(
    Capture=capture,
    BackgroundColor=ColourSwatch(SwatchColor=RGB(255, 255, 255)),
    Grid=Toggle(False),
    WorldAxes=Toggle(False),
    CPlaneAxes=Toggle(False),
    OpenFile=openfile,
    FileName="Foo")  # -> out, Path; inputs Capture: Boolean, BackgroundColor: Color, Grid: Boolean, WorldAxes: Boolean, CPlaneAxes: Boolean, OpenFile: Boolean
# ---------- vcf: Python ----------
"""
Captures the Rhino viewport to an image file. Places the image in a folder called
Captures in the same directory as the GH definition. Names the image the same as 
the GH defintion followed by _hourMinuteSecond. Edit the script directly to set more options.
Note: Do not use this script with the GH button, freezes up the canvas for some reason.

    Inputs:
        Capture: Activate the component using a boolean toggle. Do NOT use a Button {item,bool}
        BackgroundColor: Set the color of the Rhino viewport background {item,color,optional}
        Grid: Turn on the grid {item,bool,optional}
        WorldAxes:Turn on the world axes {item,bool,optional}
        CPlaneAxes: Turn on the cplane axes {item,bool,optional}
        OpenFile: If true the image will open in the default application {item,bool,optional}
    Outputs:
        Path: The path of the captured image {item,str}
    Remarks:
        Author: Anders Holden Deleuran
        License: Apache License 2.0
"""

ghenv.Component.Name = "Capture To File (Alpaca4d)"
ghenv.Component.NickName ="VCF"
ghenv.Component.Message = "View Capture To File (Alpaca4d)"


import os
import datetime
import System
import scriptcontext as sc
import Rhino as rc

def checkOrMakeFolder():
    
    """ Check/makes a "Captures" folder in the GH def folder """
    
    if ghdoc.Path:
        folder = os.path.dirname(ghdoc.Path)
        captureFolder = folder + "\\Captures"
        if not os.path.isdir(captureFolder):
            os.makedirs(captureFolder)
        return captureFolder

def makeFileName():
    
    """ Make a string with the gh def name + current hourMinuteSecond """
    
    # Make hour minute seconds string
    n = datetime.datetime.now()
    ho,mt,sc = str(n.hour),str(n.minute),str(n.second)
    if len(ho) == 1:
        ho = "0"+ ho
    if len(mt) == 1:
        mt = "0"+mt
    if len(sc) == 1:
        sc = "0"+ sc
    hms = ho+mt+sc
    
    # Get name of GH def
    ghDef = ghenv.LocalScope.ghdoc.Name.strip("*")
    
    # Concatenate and return
    fileName = ghDef + "_" + hms
    
    return fileName

def captureActiveViewToFile(width,height,path,grid,worldAxes,cplaneAxes):
    
    """
    Captures the active view to an image file at the path. Path looks like this:
    "C:\\Users\\adel\\Desktop\\Captures\\foooo_112747.png"
    """
    
    # Set the script context to the current Rhino doc
    sc.doc = rc.RhinoDoc.ActiveDoc
    
    # Get the active view and set image dimensions
    activeView = sc.doc.Views.ActiveView
    imageDim = System.Drawing.Size(width,height)
    
    # Perform the capture
    try:
        imageCap = rc.Display.RhinoView.CaptureToBitmap(activeView,imageDim,grid,worldAxes,cplaneAxes)
        System.Drawing.Bitmap.Save(imageCap,path)
        rc.RhinoApp.WriteLine(path)
        return path
    except:
        raise Exception(" Capture failed, check the path")

# Set background color
if BackgroundColor:
    rc.ApplicationSettings.AppearanceSettings.ViewportBackgroundColor = BackgroundColor

sc.doc = rc.RhinoDoc.ActiveDoc
viewtoCapture = sc.doc.Views.ActiveView

# Capture
if Capture:
    if not Width:
        Width = viewtoCapture.ActiveViewport.Size.Width
    if not Height:
        Height = height = viewtoCapture.ActiveViewport.Size.Height
    capFolder = checkOrMakeFolder()
    if FileName:
        fileName = FileName
    else:
        fileName = makeFileName()
    try:
        path = os.path.join(capFolder,fileName + ".png")
        Path = captureActiveViewToFile(Width,Height,path,Grid,WorldAxes,CPlaneAxes)
        if OpenFile:
            os.startfile(path)
    except:
        raise Exception(" Capture failed, save the GH definition")
# ---------- end vcf ----------

# ---- group: Cross_Section
data_5 = Data(0)
data_6 = Data(0)

# ---- group: Support
data_7 = Data(0)
data_8 = Data(0)

# ---- group: Material
data_9 = Data(0)
data_10 = Data(0)

# ---- group: Constraint
data_11 = Data(0)
data_12 = Data(0)

# ---- group: Visualization
data_13 = Data(0)
data_14 = Data(0)

# ---- group: Output
data_15 = Data(0)
data_16 = Data(0)
