# Grasshopper definition compressed-shell.gh (Grasshopper 1.0.8)
# plug-ins: MeshEdit Components, Alpaca4d, Weaverbird

constraint_curve = Curve([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])
coarse_mesh = Mesh([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])
mjoin = MeshJoin(Meshes=coarse_mesh)
weldvertices = MeshWeldVertices(Mesh=mjoin, Tolerance=0.01)  # -> RuntimeMessage, Mesh
refine = Refine(Mesh=weldvertices.Mesh, Level="2")
demesh = DeconstructMesh(Mesh=refine)  # -> Vertices, Faces, Colours, Normals
pull = PullPoint(Point=demesh.Vertices, Geometry=constraint_curve, ClosestOnly=True)  # -> ClosestPoint, Distance, Index
smaller = SmallerThan(FirstNumber=pull.Distance, SecondNumber=0.01)  # -> SmallerThan, OrEqualTo
cull = CullPattern(List=demesh.Vertices, CullPattern=smaller.SmallerThan)

pt = Point(cull)
mesh = Mesh(refine)
medges = MeshEdges(Mesh=mesh)  # -> NakedEdges, InteriorEdges, NonManifoldEdges
crv = Curve([medges.NakedEdges, medges.InteriorEdges])
demesh_2 = DeconstructMesh(Mesh=mesh)  # -> Vertices, Faces, Colours, Normals
length_line = LengthLine(Line=crv, Length="0", Strength=Slider(16.884, range=0..20))
anchor = Anchor(Point=pt, Strength=10000)
load = Load(Point=demesh_2.Vertices, ForceVector=Vector(0, 0, 1), Weighting=Slider(3, range=1..5))
show = Show(G=crv)
show_2 = Show(G=pt)
entwine = Entwine(Branch00=show, Branch01=show_2, Branch02=length_line, Branch03=anchor, Branch04=load, FlattenInputs=True)
zombiesolver = ZombieSolver(GoalObjects=entwine, Threshold=1e-10, Tolerance=0.01, MaxIterations=50000)  # -> I, V, O
unflatten = UnflattenTree(Tree=zombiesolver.O, Guide=entwine)
data = Data(unflatten)

bang = ExplodeTree(Data=data)  # -> Branch0, Branch1, Branch2, Branch3, Branch4
clean = CleanTree(RemoveNulls=True, RemoveInvalid=True, RemoveEmpty=False, Tree=flatten(bang.Branch0))  # -> flatten(Tree)
wbweave = WeaverbirdsMeshFromLinesWeaveBack(Lines=clean, MaximumValence=4)
clean_2 = CombineClean(Meshes=wbweave)
mesh_structure = Mesh(clean_2)
supports = Point(bang.Branch1)
material_library_elastic_alpaca4d = MaterialLibraryElasticAlpaca4d(
    MaterialPresetElastic_Grade="C25_30",
    MaterialPresetElastic_Model="nD",
    MaterialPresetElastic_Type="Concrete",
    menu=[dropdown(1), dropdown(1), dropdown(1)])
m = Panel("0.15")
boolean_toggle = BooleanToggle(True)
plate_fiber_section_alpaca4d = PlateFiberSectionAlpaca4d(Thickness=m, Material=material_library_elastic_alpaca4d)
constant_time_series_alpaca4d = ConstantTimeSeriesAlpaca4d(LoadFactor=1)  # -> TimeSeries, Graph
gravity_load_alpaca4d = GravityLoadAlpaca4d(Factor=1)
support_alpaca4d = SupportAlpaca4d(
    Point=supports,
    Tx=boolean_toggle,
    Ty=boolean_toggle,
    Tz=boolean_toggle,
    Rx=boolean_toggle,
    Ry=boolean_toggle,
    Rz=boolean_toggle)
asd_shell_alpaca4d = ASDShellAlpaca4d(Mesh=mesh_structure, Section=plate_fiber_section_alpaca4d, IsCorotational=False)
load_pattern_alpaca4d = LoadPatternAlpaca4d(
    TimeSeries=constant_time_series_alpaca4d.TimeSeries,
    Loads=gravity_load_alpaca4d,
    Factor=1,
    mode="PlainPattern (Alpaca4d)")
assemblemodel_alpaca4d = AssembleModelAlpaca4d(Elements=asd_shell_alpaca4d, Supports=support_alpaca4d, LoadPatterns=load_pattern_alpaca4d, Tolerance=0.01)  # -> AlpacaModel, Mass
analysis_settings_alpaca4d = AnalysisSettingsAlpaca4d()
run_analysis_alpaca4d = RunAnalysisAlpaca4d(AlpacaModel=assemblemodel_alpaca4d.AlpacaModel, Settings=analysis_settings_alpaca4d, settings=True)  # -> AlpacaModel, Log
view_results_wip_alpaca4d = ViewResults_WIPAlpaca4d(AlpacaModel=run_analysis_alpaca4d.AlpacaModel, Step=0, ResultMenuOrder=1, ResultUnits=1)  # -> Info, Values, Colors
nodal_displacements_alpaca4d = NodalDisplacementsAlpaca4d(AlpacaModel=run_analysis_alpaca4d.AlpacaModel, History=False, Step=0)  # -> Displacement, Rotation, port, Velocity, Acceleration, AngularVelocity, Acceleration_2, AngularAcceleration
devec = DeconstructVector(Vector=nodal_displacements_alpaca4d.Displacement)  # -> XComponent, YComponent, ZComponent
m_to_mm = Number(expr("x*1000", devec.ZComponent))
sort = SortList(Keys=m_to_mm)  # -> reverse(Keys), ValuesA
item = ListItem(List=sort.Keys, Index=0, Wrap=True)
mm = Panel(item)
