# Grasshopper definition connection-design.gh (Grasshopper 1.0.8)
# plug-ins: MeshEdit Components, Alpaca4d, Weaverbird, Kangaroo2 Components, eleFront

box = DomainBox(Base=PlaneXY(0, 0, 0), X=Slider(11, range=1..20), Y=Slider(3, range=1..20), Z=Slider(3, range=1..20))
pop3d = Populate3D(Region=box, Count=100, Seed=5)
voronoi³ = Voronoi3D(Points=pop3d, Box=box)  # -> Cells, Boundary
edges = BrepEdges(Brep=voronoi³.Cells)  # -> Naked, flatten(Interior), NonManifold
dupln = RemoveDuplicateLines(Lines=edges.Interior, Tolerance=0.01)
debrep = DeconstructBrep(Brep=box)  # -> Faces, Edges, Vertices
explode = Explode(Curve=dupln, Recursive=True)  # -> Segments, flatten(Vertices)
duppt = RemoveDuplicatePts(Points=explode.Vertices, Tolerance=0.01)
item = ListItem(List=debrep.Faces, Index=Slider(1, range=0..5), Wrap=True)
midpt = CurveMiddle(Curve=dupln)
pull = PullPoint(Point=duppt, Geometry=item, ClosestOnly=True)  # -> ClosestPoint, Distance
pull_2 = PullPoint(Point=midpt, Geometry=item, ClosestOnly=True)  # -> ClosestPoint, Distance
smaller = SmallerThan(FirstNumber=pull.Distance, SecondNumber="0.01")  # -> SmallerThan, OrEqualTo
smaller_2 = SmallerThan(FirstNumber=pull_2.Distance, SecondNumber="0.01")  # -> SmallerThan, OrEqualTo
cull = CullPattern(List=duppt, CullPattern=smaller.SmallerThan)
cull_2 = CullPattern(List=dupln, CullPattern=invert(smaller_2.SmallerThan))

uniaxial_material_elastic = UniaxialMaterialElasticAlpaca4d(E="3.3e+10", G="0.20", Rho="2500")

uniaxial = Uniaxial(E=210000000, Eneg=210000000, Eta=0, G=90760000, V=0.3, Rho=7850, mode="UniaxialElastic")
crv = Curve(cull_2)
len = Length(Curve=crv)
support_points = Point(cull)
larger = LargerThan(FirstNumber=len, SecondNumber=0.01)  # -> LargerThan, OrEqualTo
toggle = BooleanToggle(True)
circlecs_alpaca4d = CircleCSAlpaca4d(Diameter="0.1", Thickness="0.01", Material=uniaxial)
cull_3 = CullPattern(List=crv, CullPattern=larger.LargerThan)
support_alpaca4d = SupportAlpaca4d(Point=support_points, Tx=True, Ty=True, Tz=True, Rx=True, Ry=True, Rz=True)
constant_time_series_alpaca4d = ConstantTimeSeriesAlpaca4d(LoadFactor=1)  # -> TimeSeries, Graph
force_beam_column = ForceBeamColumnAlpaca4d(Line=cull_3, Section=circlecs_alpaca4d)
gravity_load_alpaca4d = GravityLoadAlpaca4d(Factor=1)
load_pattern_alpaca4d = LoadPatternAlpaca4d(TimeSeries=constant_time_series_alpaca4d.TimeSeries, Loads=gravity_load_alpaca4d, Factor=1, mode="PlainPattern")
analysisstep = AnalysisStepAlpaca4d(NumIncr="1")
value_list = ValueList({"BandGen", "BandSPD", "ProfileSPD", "SuperLU", "UmfPack", "FullGeneral", "SparseSYM"}, selected="BandGen")
assemblemodel_alpaca4d = AssembleModelAlpaca4d(Elements=force_beam_column, Supports=support_alpaca4d, LoadPatterns=load_pattern_alpaca4d, Tolerance=0.01)  # -> AlpacaModel, Mass
analysissettings = AnalysisSettingsAlpaca4d(System=value_list, AnalysisSteps=analysisstep)
run_analysis_alpaca4d = RunAnalysisAlpaca4d(AlpacaModel=assemblemodel_alpaca4d.AlpacaModel, Settings=analysissettings, settings=True)  # -> Log, AlpacaModel
modelview = ModelViewAlpaca4d(
    AlpacaModel=run_analysis_alpaca4d.AlpacaModel,
    Extruded=False,
    Load=Toggle(False),
    LoadFactor=1,
    Support=Toggle(True),
    SupportFactor=1,
    Constraint=False)  # -> AlpacaModel, Info
deformed_model_view = DeformedModelViewAlpaca4d(AlpacaModel=run_analysis_alpaca4d.AlpacaModel, Step=0, Scale=Slider(0, range=0..1))  # -> Line, Mesh, Brick
deconstruct_alpaca4d = DeconstructAlpaca4d(Object=run_analysis_alpaca4d.AlpacaModel)  # -> Object_Class, Ndm, Ndf, UniquePoints, UniquePointsThreeNDF, UniquePointsSixNDF, PointCloud, CloudPointThreeNDF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
deconstruct_alpaca4d_2 = DeconstructAlpaca4d(Object=deconstruct_alpaca4d.Elements)  # -> Object_Class, Curve, Section, GeomTransf, BeamIntegration, LocalZAxis, Type, Id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
lng = ListLength(List=deconstruct_alpaca4d.UniquePoints)
series = Series(Start=0, Step=1, Count=lng)
# Point where to extract
# the forces
define_text_dot = DefineTextDot(Text=series, Location=deconstruct_alpaca4d.UniquePoints, Font="Arial", Size=14)
item_2 = ListItem(List=deconstruct_alpaca4d.UniquePoints, Index="39", Wrap=True)
pt = Point(item_2)
curve = Curve(deconstruct_alpaca4d_2.Curve)
dot_display = DotDisplay(Point=pt, Colour=RGB(0, 0, 0), Size="0.20")
curve_closest_point = CurveClosestPoint(Point=pt, Curve=curve)  # -> Point, Parameter, Distance
smaller_than = SmallerThan(FirstNumber=curve_closest_point.Distance, SecondNumber="0.01")  # -> SmallerThan, OrEqualTo
cull_pattern = CullPattern(List=curve, CullPattern=smaller_than.SmallerThan)
point = Point(pt)

crv_2 = Curve(cull_pattern)
python = GhPythonScript(iCurve=simplify(crv_2), iPoint=simplify(point))  # -> out, a
# ---------- python: Python ----------
import Rhino.Geometry as rg


start_point = iCurve.PointAtStart

distance = start_point.DistanceTo(iPoint)

if not(distance <= 0.01):
    iCurve.Reverse()
else:
    iCurve = iCurve

a = iCurve
# ---------- end python ----------
line = LineSDL(Start=point, Direction=python.a, Length="0.25")
mp = MultiPipe(Curves=line, NodeSize="0.05", EndOffset=1, StrutSize=1, Segment=0, KinkAngle=0.6, CubeFit=0, Caps=0)
data = Data(mp)

meshsubd = MeshFromSubD(SubD=data, Density="2")
meshsubd_2 = MeshFromSubD(SubD=data, Density="3")
tolerance = Panel("0.001")
wbnaked = WeaverbirdsNakedBoundary(MeshClosedPolylines=meshsubd_2)
split = SplitList(List=wbnaked, Index="1")  # -> ListA, ListB
explode_2 = Explode(Curve=split.ListB, Recursive=True)  # -> Segments, flatten(Vertices)
explode_3 = Explode(Curve=split.ListA, Recursive=True)  # -> Segments, Vertices
panel_2 = Panel(tolerance)
cullpt = CullDuplicates(Points=explode_3.Vertices, Tolerance=panel_2, CullMode=3)  # -> Points, Indices, Valence
cullpt_2 = CullDuplicates(Points=explode_2.Vertices, Tolerance=tolerance, CullMode=3)  # -> Points, Indices, Valence
fcircle = CircleFit(Points=cullpt_2.Points)  # -> Circle, Radius, Deviation
darc = DeconstructArc(Arc=fcircle.Circle)  # -> BasePlane, Radius, Angle
deplane = DeconstructPlane(Plane=darc.BasePlane)  # -> Origin, XAxis, YAxis, ZAxis
nd = ND(E=210000000, G=80760000, Nu=0.3, Rho=7850, mode="ElasticIsotropic")
vdisex = VectorDisplayEx(Point=deplane.Origin, Vector=deplane.YAxis, Colour=RGB(0, 0, 0), Width=2)
plate_fiber_section_alpaca4d = PlateFiberSectionAlpaca4d(Thickness="0.004", Material=nd)
pt_2 = Point(cullpt.Points)
explode_4 = MeshExplode(Mesh=meshsubd_2, Interpolate=False)
multiplication = Multiplication(A=deplane.YAxis, B="2")
support_alpaca4d_2 = SupportAlpaca4d(Point=pt_2, Tx=True, Ty=True, Tz=True, Rx=True, Ry=True, Rz=True)
constant_time_series_alpaca4d_2 = ConstantTimeSeriesAlpaca4d(LoadFactor=1)  # -> TimeSeries, Graph
point_load_alpaca4d = PointLoadAlpaca4d(Point=cullpt_2.Points, Force=multiplication, Moment=Vector(0, 0, 0))
asd_shellq4_alpaca4d = ASDShellQ4Alpaca4d(Mesh=explode_4, Section=plate_fiber_section_alpaca4d)  # -> flatten(Element)
load_pattern_alpaca4d_2 = LoadPatternAlpaca4d(TimeSeries=constant_time_series_alpaca4d_2.TimeSeries, Loads=point_load_alpaca4d, Factor=1, mode="PlainPattern")
panel_3 = Panel(tolerance)
assemblemodel_alpaca4d_2 = AssembleModelAlpaca4d(Elements=asd_shellq4_alpaca4d, Supports=support_alpaca4d_2, LoadPatterns=load_pattern_alpaca4d_2, Tolerance=panel_3)  # -> AlpacaModel, Mass
analysis_settings_alpaca4d = AnalysisSettingsAlpaca4d()
run_analysis_alpaca4d_2 = RunAnalysisAlpaca4d(AlpacaModel=assemblemodel_alpaca4d_2.AlpacaModel, Settings=analysis_settings_alpaca4d, settings=True)  # -> Log, AlpacaModel
clr = ColorsAlpaca4d(gradIndex=Slider(11, range=0..12))  # -> reverse(colors); inputs gradIndex: Int32
#   port colors: A series of colors to be plugged into the "Ladybug_Legend Parameters" component.
# ---------- clr: Python ----------
"""
Preset of gradient colors perfect for Data Visualisation
    Inputs:
        gradIndex: An index refering to one of the following possible gradients:
            0 - Orignal Ladybug
            1 - Nuanced Ladybug
            2 - Multi-colored Ladybug
            3 - Ecotect
            4 - Thermal Comfort Percentage
            5 - Thermal Comfort Colors
            6 - Shade Benefit/Harm
            7 - Shade Harm
            8 - Shade Benefit
            9 - CFD Colors 1
            10 - Radiation Benefit
            11 - Gsa10 Colour
            12 - Gsa9 Colour
    Returns:
        customColors: A series of colors.
"""

ghenv.Component.Name = "Colors (Alpaca4d)"
ghenv.Component.NickName = 'CLR'
ghenv.Component.Message = 'Colors (Alpaca4d)'

import scriptcontext as sc
import Grasshopper.Kernel as gh
import System

gradientLibrary = {
        0: [System.Drawing.Color.FromArgb(75, 107, 169), System.Drawing.Color.FromArgb(115, 147, 202), System.Drawing.Color.FromArgb(170, 200, 247), System.Drawing.Color.FromArgb(193, 213, 208), System.Drawing.Color.FromArgb(245, 239, 103), System.Drawing.Color.FromArgb(252, 230, 74), System.Drawing.Color.FromArgb(239, 156, 21), System.Drawing.Color.FromArgb(234, 123, 0), System.Drawing.Color.FromArgb(234, 74, 0), System.Drawing.Color.FromArgb(234, 38, 0)],
        1: [System.Drawing.Color.FromArgb(49,54,149), System.Drawing.Color.FromArgb(69,117,180), System.Drawing.Color.FromArgb(116,173,209), System.Drawing.Color.FromArgb(171,217,233), System.Drawing.Color.FromArgb(224,243,248), System.Drawing.Color.FromArgb(255,255,191), System.Drawing.Color.FromArgb(254,224,144), System.Drawing.Color.FromArgb(253,174,97), System.Drawing.Color.FromArgb(244,109,67), System.Drawing.Color.FromArgb(215,48,39), System.Drawing.Color.FromArgb(165,0,38)],
        2: [System.Drawing.Color.FromArgb(4,25,145), System.Drawing.Color.FromArgb(7,48,224), System.Drawing.Color.FromArgb(7,88,255), System.Drawing.Color.FromArgb(1,232,255), System.Drawing.Color.FromArgb(97,246,156), System.Drawing.Color.FromArgb(166,249,86), System.Drawing.Color.FromArgb(254,244,1), System.Drawing.Color.FromArgb(255,121,0), System.Drawing.Color.FromArgb(239,39,0), System.Drawing.Color.FromArgb(138,17,0)],
        3: [System.Drawing.Color.FromArgb(0,0,255), System.Drawing.Color.FromArgb(53,0,202), System.Drawing.Color.FromArgb(107,0,148), System.Drawing.Color.FromArgb(160,0,95), System.Drawing.Color.FromArgb(214,0,41), System.Drawing.Color.FromArgb(255,12,0), System.Drawing.Color.FromArgb(255,66,0), System.Drawing.Color.FromArgb(255,119,0), System.Drawing.Color.FromArgb(255,173,0), System.Drawing.Color.FromArgb(255,226,0), System.Drawing.Color.FromArgb(255,255,0)],
        4: [System.Drawing.Color.FromArgb(0,0,0), System.Drawing.Color.FromArgb(110,0,153), System.Drawing.Color.FromArgb(255,0,0), System.Drawing.Color.FromArgb(255,255,102), System.Drawing.Color.FromArgb(255,255,255)],
        5: [System.Drawing.Color.FromArgb(0,136,255), System.Drawing.Color.FromArgb(200,225,255), System.Drawing.Color.FromArgb(255,255,255), System.Drawing.Color.FromArgb(255,230,230), System.Drawing.Color.FromArgb(255,0,0)],
        6: [System.Drawing.Color.FromArgb(5,48,97), System.Drawing.Color.FromArgb(33,102,172), System.Drawing.Color.FromArgb(67,147,195), System.Drawing.Color.FromArgb(146,197,222), System.Drawing.Color.FromArgb(209,229,240), System.Drawing.Color.FromArgb(255,255,255), System.Drawing.Color.FromArgb(253,219,199), System.Drawing.Color.FromArgb(244,165,130), System.Drawing.Color.FromArgb(214,96,77), System.Drawing.Color.FromArgb(178,24,43), System.Drawing.Color.FromArgb(103,0,31)],
        7: [System.Drawing.Color.FromArgb(255,255,255), System.Drawing.Color.FromArgb(253,219,199), System.Drawing.Color.FromArgb(244,165,130), System.Drawing.Color.FromArgb(214,96,77), System.Drawing.Color.FromArgb(178,24,43), System.Drawing.Color.FromArgb(103,0,31)],
        8: [System.Drawing.Color.FromArgb(255,255,255), System.Drawing.Color.FromArgb(209,229,240), System.Drawing.Color.FromArgb(146,197,222), System.Drawing.Color.FromArgb(67,147,195), System.Drawing.Color.FromArgb(33,102,172), System.Drawing.Color.FromArgb(5,48,97)],
        9: [System.Drawing.Color.FromArgb(0,16,120), System.Drawing.Color.FromArgb(38,70,160), System.Drawing.Color.FromArgb(5,180,222), System.Drawing.Color.FromArgb(16,180,109), System.Drawing.Color.FromArgb(59,183,35), System.Drawing.Color.FromArgb(143,209,19), System.Drawing.Color.FromArgb(228,215,29), System.Drawing.Color.FromArgb(246,147,17), System.Drawing.Color.FromArgb(243,74,0), System.Drawing.Color.FromArgb(255,0,0)],
        10: [System.Drawing.Color.FromArgb(0,191,48), System.Drawing.Color.FromArgb(255,238,184), System.Drawing.Color.FromArgb(255,0,0)],
        11: [System.Drawing.Color.FromArgb(204,0,71), System.Drawing.Color.FromArgb(255,182,71), System.Drawing.Color.FromArgb(206,255,115), System.Drawing.Color.FromArgb(26,180, 214),System.Drawing.Color.FromArgb(0,0,207)],
        12: [System.Drawing.Color.FromArgb(255, 51, 51), System.Drawing.Color.FromArgb(255, 170, 51), System.Drawing.Color.FromArgb(255, 255, 51), System.Drawing.Color.FromArgb(170, 255, 125), System.Drawing.Color.FromArgb(51, 255, 231), System.Drawing.Color.FromArgb(51, 170, 255), System.Drawing.Color.FromArgb(51,51, 255)]}
colors = gradientLibrary[gradIndex]
# ---------- end clr ----------
deformed_model_view_2 = DeformedModelViewAlpaca4d(AlpacaModel=run_analysis_alpaca4d_2.AlpacaModel, Step=0, Scale=Slider(0, range=0..1), Colors=clr)  # -> Line, Mesh, Brick
