# Grasshopper definition high-tension-tower.gh (Grasshopper 1.0.8)
# plug-ins: Alpaca4d

crv = Curve(graft([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]))
mcx = MultipleCurves(Curves=flatten(crv))  # -> Points, IndexA, IndexB, ParamA, ParamB
crv_cp = CurveClosestPoint(Point=mcx.Points, Curve=crv)  # -> Point, Parameter, Distance
smaller = SmallerThan(FirstNumber=crv_cp.Distance, SecondNumber="0.01")  # -> SmallerThan, OrEqualTo
cull = CullPattern(List=crv_cp.Parameter, CullPattern=smaller.SmallerThan)
shatter = Shatter(Curve=crv, Parameters=cull)
pt = Point([Point(21.02621553, 4.52571924, 0), Point(15.04621553, 4.52571924, 0), Point(15.04621553, -1.45428076, 0), Point(21.02621553, -1.45428076, 0)])
kn = Panel("500")
toggle = BooleanToggle(True)
crv_2 = Curve(shatter)
explode = Explode(Curve=crv_2, Recursive=True)  # -> Segments, flatten(Vertices)
cullpt = CullDuplicates(Points=flatten(explode.Vertices), Tolerance=0.1, CullMode=1)  # -> Points, Indices, Valence
lng = ListLength(List=cullpt.Points)
constant_time_series = ConstantTimeSeriesAlpaca4d(LoadFactor=1)  # -> TimeSeries, Graph
division = Division(A=kn, B=lng)
uniaxial = Uniaxial(E=210000000, Eneg=210000000, Eta=0, G=90760000, V=0.3, Rho=7850, mode="UniaxialElastic")
Y = UnitY(Factor=division)
support = SupportAlpaca4d(Point=pt, Tx=toggle, Ty=toggle, Tz=toggle, Rx=True, Ry=True, RZ=True)
point_load_alpaca4d = PointLoadAlpaca4d(Point=cullpt.Points, Force=Y, Moment=Vector(0, 0, 0))
gravity_load_alpaca4d = GravityLoadAlpaca4d(Factor=1)
circlecs_alpaca4d = CircleCSAlpaca4d(Diameter="0.15", Thickness="0.005", Material=uniaxial)
load_pattern_alpaca4d = LoadPatternAlpaca4d(TimeSeries=constant_time_series.TimeSeries, Loads=point_load_alpaca4d, Factor=1, mode="PlainPattern")
load_pattern_alpaca4d_2 = LoadPatternAlpaca4d(TimeSeries=constant_time_series.TimeSeries, Loads=gravity_load_alpaca4d, Factor=1, mode="PlainPattern")
force_beam_column = ForceBeamColumnAlpaca4d(Line=crv_2, Section=circlecs_alpaca4d)
data = Data(flatten([load_pattern_alpaca4d, load_pattern_alpaca4d_2]))
data_2 = Data(flatten(force_beam_column))
assemble_model = AssembleModelAlpaca4d(Element=data_2, Support=support, Load=data, Tolerance=0.01)  # -> AlpacaModel, Mass
panel = Panel(assemble_model.Mass)
analysisstep = AnalysisStepAlpaca4d(NumIncr="4")
analysissettings = AnalysisSettingsAlpaca4d(AnalysisSteps=analysisstep)
ra = RunAnalysisAlpaca4d(AlpacaModel=assemble_model.AlpacaModel, Settings=analysissettings, settings=True)  # -> Log, AlpacaModel
colors_alpaca4d = ColorsAlpaca4d(GradientIndex=0)
beam_forces_view_alpaca4d = BeamForcesViewAlpaca4d(alpacamodel=ra.AlpacaModel, internalforce=0, scale=0.1, label=0)
deformed_model_view_alpaca4d = DeformedModelViewAlpaca4d(AlpacaModel=ra.AlpacaModel, Step=0, Scale=1, Colors=colors_alpaca4d)  # -> Line, Mesh, Brick

# ==== cluster BeamForcesViewAlpaca4d
label_size = ClusterInput()
scale = ClusterInput()  # Scale diagram
internalforce = ClusterInput()  # N = 0 Vy = 1 Vz = 2 Mx = 3 My = 4 Mz = 5
label = ClusterInput()
alpacamodel = ClusterInput()
number = Number(scale)
number_2 = Number(internalforce)
alpacamodel_2 = ClusterOutput(alpacamodel)

# ----
# Visualise force
panel = Panel("0")
stream_filter = StreamFilter(Gate=label, Stream0=panel, Stream1=label_size)
beam_forces_alpaca4d = BeamForcesAlpaca4d(AlpacaModel=alpacamodel, History=False, Step=0)  # -> N, Vy, Vz, Mx, My, Mz
ghpython_script = GhPythonScript(x=alpacamodel)  # -> out, crv, frame, points
# ---------- ghpython_script: Python ----------
__author__ = "Marco"
__version__ = "2024.06.07"

import rhinoscriptsyntax as rs

a = x.Beams

crv = []
frame = []
for item in a:
    crv.append(item.Curve)
    frame.append(item.LocalZAxis)

points = x.UniquePoints
# ---------- end ghpython_script ----------
concatenate = Concatenate(Fragment_A="{", Fragment_B=number_2, A=";", B="*}")
entwine = Entwine(
    Branch0X=beam_forces_alpaca4d.N,
    Branch1X=beam_forces_alpaca4d.Vy,
    Branch2X=beam_forces_alpaca4d.Vz,
    Branch3X=beam_forces_alpaca4d.Mx,
    Branch4X=beam_forces_alpaca4d.My,
    Branch5X=beam_forces_alpaca4d.Mz,
    FlattenInputs=False)  # -> simplify(Result)
bounding_box = BoundingBox(Content=ghpython_script.points, Plane=PlaneXY(0, 0, 0), UnionBox=True)  # -> Box, Box_2
curve_middle = CurveMiddle(Curve=ghpython_script.crv)
graft_tree = GraftTree(Tree=ghpython_script.crv, IncludeEmptyLists=True, IncludeNullItems=True)
box_properties = BoxProperties(Box=bounding_box.Box)  # -> Center, Diagonal, Area, Volume, Degeneracy
split_tree = SplitTree(Data=entwine, Masks=flatten(concatenate))  # -> Positive, Negative
bounds = Bounds(Numbers=flatten(split_tree.Positive))
plane_normal = PlaneNormal(Origin=curve_middle, ZAxis=ghpython_script.frame)
merge = Merge(Data1=ColourSwatch(SwatchColor=RGB(252, 0, 0)), Data2=ColourSwatch(SwatchColor=RGB(51, 136, 255)))
deconstruct_plane = DeconstructPlane(Plane=plane_normal)  # -> Origin, XAxis, YAxis, ZAxis
stream_filter_2 = StreamFilter(
    Gate=number_2,
    Stream0=deconstruct_plane.ZAxis,
    Stream1=deconstruct_plane.YAxis,
    Stream2=deconstruct_plane.ZAxis,
    Stream3=deconstruct_plane.YAxis,
    Stream4=deconstruct_plane.ZAxis,
    Stream5=deconstruct_plane.YAxis)
graft_tree_2 = GraftTree(Tree=stream_filter_2, IncludeEmptyLists=True, IncludeNullItems=True)

deconstruct_domain = DeconstructDomain(Domain=bounds)  # -> Start, End
absolute = Absolute(Value=deconstruct_domain.Start)
absolute_2 = Absolute(Value=deconstruct_domain.End)
number_3 = Number(box_properties.Diagonal)
maximum = Maximum(A=absolute, B=absolute_2)
multiplication = Multiplication(A=number_3, B=number)
negative = Negative(Value=multiplication)
negative_2 = Negative(Value=maximum)
construct_domain = ConstructDomain(DomainStart=negative_2, DomainEnd=maximum)

construct_domain_2 = ConstructDomain(DomainStart=negative, DomainEnd=multiplication)
remap_numbers = RemapNumbers(Value=split_tree.Positive, Source=construct_domain, Target=construct_domain_2)  # -> Mapped, Clipped
list_length = ListLength(List=remap_numbers.Mapped)
range = Range(Domain=Domain(0, 1), Steps=list_length)  # -> simplify(Range)
shatter = Shatter(Curve=reparameterize(graft_tree), Parameters=simplify(range))  # -> simplify(Segments)
ironpython_2_script = IronPython2Script(x=remap_numbers.Mapped, y=merge)  # -> out, a; inputs x: Double, y: list
# ---------- ironpython_2_script: IronPython ----------
if x > 0:
    a = y[0]
else:
    a = y[1]
# ---------- end ironpython_2_script ----------
curve_middle_2 = CurveMiddle(Curve=shatter)
line_sdl = LineSDL(Start=simplify(curve_middle_2), Direction=simplify(graft_tree_2), Length=remap_numbers.Mapped)
end_points = EndPoints(Curve=line_sdl)  # -> Start, End
screen_oriented_text = ScreenOrientedText(
    Text=split_tree.Positive,
    Justification=7,
    Location=end_points.End,
    SizeFactor=stream_filter,
    Depth=0,
    Absolute=Toggle(False))
custom_preview_lineweights = CustomPreviewLineweights(Geometry=line_sdl, Shader=ironpython_2_script.a, Absolute=False)

custom_preview_lineweights_2 = CustomPreviewLineweights(Geometry=ghpython_script.crv, Shader=ColourSwatch(SwatchColor=RGB(0, 0, 0)), Thickness="2", Absolute=False)
