# Grasshopper definition natural-vibration.gh (Grasshopper 1.0.8)
# plug-ins: Alpaca4d, Weaverbird

mesh = Mesh(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)
wbnaked = WeaverbirdsNakedBoundary(MeshClosedPolylines=mesh)
explode = Explode(Curve=wbnaked, Recursive=True)  # -> Segments, Vertices
panel = Panel("210e6")
panel_2 = Panel("7850")  # "kg/m3"
cullpt = CullDuplicates(Points=explode.Vertices, Tolerance="0.01", CullMode=3)  # -> Points, Indices, Valence
nd = ND(E=panel, G=80760000, Nu="0.3", Rho=panel_2, mode="ElasticIsotropic")
meter = Panel("0.01")
plate_fiber_section_alpaca4d = PlateFiberSectionAlpaca4d(Thickness=meter, Material=nd)
toggle = BooleanToggle(True)
asd_shellq4_alpaca4d = ASDShellQ4Alpaca4d(Mesh=mesh, Section=plate_fiber_section_alpaca4d)  # -> flatten(Element)
support = SupportAlpaca4d(Point=cullpt.Points, Tx=toggle, Ty=toggle, Tz=toggle, Rx=toggle, Ry=toggle, RZ=toggle)
assemblemodel_alpaca4d = AssembleModelAlpaca4d(Elements=asd_shellq4_alpaca4d, Supports=support, Tolerance=0.01)  # -> AlpacaModel, Mass
list = ValueList({"-genBandArpack", "-symmBandLapack", "-fullGenLapack"}, selected="-genBandArpack")
nv = NaturalVibrationAnalysisAlpaca4d(AlpacaModel=assemblemodel_alpaca4d.AlpacaModel, VibrationModes="12", Solver=list)  # -> Log, AlpacaModel, Eigenvalues, Period, Frequencies
colors_alpaca4d = ColorsAlpaca4d(GradientIndex=0)
modal_analysis_report_alpaca4d = ModalAnalysisReportAlpaca4d(AlpacaModel=nv.AlpacaModel)  # -> EigenValueAnalysis, TotalMassOfStructure, TotalFreeMass, CenterOfMass, ModalParticipationFactors, ModalParticipationMasses, ModalParticipationMasses_Cumulative, ModalParticipationMassesRatio, ModalParticipationMassesRatio_Cumulative
deformed_model_view_alpaca4d = DeformedModelViewAlpaca4d(AlpacaModel=nv.AlpacaModel, Step=Slider(3, range=0..23), Scale=Slider(3, range=0..3), Colors=colors_alpaca4d)  # -> Line, Mesh, Brick
panel_3 = Panel(modal_analysis_report_alpaca4d.ModalParticipationMassesRatio)
